# Dynamo graph 1.0 Center Rooms And Tags.dyn "1.0 Cente rRooms And Tags" (Dynamo 2.0.3.8810)

categories = Categories(index=424)  # graph input
placedRooms = Custom[Collector.PlacedRooms]()  # This will collect placed rooms in current file.
room_or_space_reset_center = Custom[Room or Space reset center location](Rooms_Spaces=placedRooms)  # This node will attempt to reset the location of the room or space to its default center location
passthrough = Custom[Passthrough](passThrough=categories, waitFor=room_or_space_reset_center.Rooms_Spaces)  # Forces a sequential order of execution. The node wired into the output of the Passthrough node will be executed *after* the node wired into the waitFor input (e.g. important for some Revit operations). The value of the passThrough input will be passed on to the node wired into the output port of the Passthrough node.
all_elements_of_category = ElementsOfCategory(Category=passthrough)
ʳʰʸᵗʰᵐ_roomtag = Rhythm.Revit.Elements.RoomTag.CenterOnRoomLocation(roomTag=all_elements_of_category)
