# Dynamo graph 10. Enable or disable joints.dyn "9. Enable or disable joints" (Dynamo 2.0.3.8810)

element_types = ElementTypes(index=341)
all_elements_of_type = ElementsOfType(element_type=element_types)
boolean = BoolSelector(false)
allowDisallowJoins = WombatDynamo.Wall.AllowDisallowJoins(wall=all_elements_of_type, allow=boolean)
watch = Watch(allowDisallowJoins)
