# Dynamo graph 2.1 Create floor  and ceiling plans for rooms and trim annotation crop and place floor plans on sheets V3.dyn "2.1 Create floor and ceiling plans for rooms and trim annotation crop and place floor plans on sheets V3" (Dynamo 2.0.3.8810)

# group: Podešavanja
title_block_name = FamilyTypes(index=295)
sheet_name_prefix = StringInput("R0")
plan_name_prefix = StringInput("R0")
pokreni = BoolSelector(true)  # graph input
view_templates = ViewTemplatesUi(index=5)
string = StringInput("A2 - EN")
pokreni_2 = BoolSelector(true)  # graph input
view_templates_2 = ViewTemplatesUi(index=6)

placedRooms = Python()  # "Collector.PlacedRooms"; unwired: IN[0]
# ---------- placedRooms.python (36 lines) ----------
#Copyright(c) 2017, john pierson
# @60secondrevit, http://sixtysecondrevit.com

import clr
clr.AddReference('ProtoGeometry')
from Autodesk.DesignScript.Geometry import *

# Import DocumentManager and TransactionManager
clr.AddReference("RevitServices")
import RevitServices
from RevitServices.Persistence import DocumentManager
from RevitServices.Transactions import TransactionManager

# Import RevitAPI
clr.AddReference("RevitAPI")
import Autodesk
from Autodesk.Revit.DB import *

doc = DocumentManager.Instance.CurrentDBDocument
uiapp = DocumentManager.Instance.CurrentUIApplication
app = uiapp.Application

from System.Collections.Generic import *


#The inputs to this node will be stored as a list in the IN variable.
dataEnteringNode = IN
collector = FilteredElementCollector(doc)
rooms = collector.OfCategory(BuiltInCategory.OST_Rooms).ToElements()

roomInstances = []
for i in rooms:
	if i.Area != 0:
		roomInstances.append(i)

OUT = roomInstances
# ----------------------------------------
number = Room.Number(room=placedRooms)
code_block = CodeBlock { " - "; }
add = number + code_block
name = Room.Name(room=placedRooms)
add_2 = add + name
watch = Watch(number)
watch_2 = Watch(sheet_name_prefix)
code_block_2 = CodeBlock { 0.5; }
# note: rooms = [UnwrapElement(IN[0])]
# namePrefix = IN[1]
# bboxOffset = IN[2]
# runMe = IN[3]
byRoom = Python(IN[0]=placedRooms, IN[1]=plan_name_prefix, IN[2]=code_block_2, IN[3]=pokreni)  # "FloorPlan.ByRoom"
# ---------- byRoom.python (115 lines) ----------
# Copyright(c) 2015, Konrad K Sobon
# @arch_laboratory, http://archi-lab.net

import clr
clr.AddReference('ProtoGeometry')
from Autodesk.DesignScript.Geometry import *

# Import Element wrapper extension methods
clr.AddReference("RevitNodes")
import Revit
clr.ImportExtensions(Revit.Elements)

# Import geometry conversion extension methods
clr.ImportExtensions(Revit.GeometryConversion)

# Import DocumentManager and TransactionManager
clr.AddReference("RevitServices")
import RevitServices
from RevitServices.Persistence import DocumentManager
from RevitServices.Transactions import TransactionManager
doc = DocumentManager.Instance.CurrentDBDocument

# Import RevitAPI
clr.AddReference("RevitAPI")
import Autodesk
from Autodesk.Revit.DB import *

import System
from System import Array
from System.Collections.Generic import *

import sys
pyt_path = r'C:\Program Files (x86)\IronPython 2.7\Lib'
sys.path.append(pyt_path)

#The inputs to this node will be stored as a list in the IN variable.
dataEnteringNode = IN

if isinstance(IN[0], list):
	rooms = UnwrapElement(IN[0])
else:
	rooms = [UnwrapElement(IN[0])]
namePrefix = IN[1]
bboxOffset = IN[2]
runMe = IN[3]

def OffsetBBox(bbox, offset):
	bboxMinX = bbox.Min.X - offset
	bboxMinY = bbox.Min.Y - offset
	bboxMinZ = bbox.Min.Z - offset
	bboxMaxX = bbox.Max.X + offset
	bboxMaxY = bbox.Max.Y + offset
	bboxMaxZ = bbox.Max.Z + offset
	newBbox = BoundingBoxXYZ()
	newBbox.Min = XYZ(bboxMinX, bboxMinY, bboxMinZ)
	newBbox.Max = XYZ(bboxMaxX, bboxMaxY, bboxMaxZ)
	return newBbox

try:
	errorReport = None
	if runMe:
		viewTypes = FilteredElementCollector(doc).OfClass(ViewFamilyType)
		for i in viewTypes:
			if i.ViewFamily == ViewFamily.FloorPlan:
				viewTypeId = i.Id
				break
			else:
				continue
		
		existingPlans = FilteredElementCollector(doc).OfClass(View).ToElements()
		
		existingPlanNames, existingPlanElements = [], []
		for i in existingPlans:
			if not i.IsTemplate:
				if i.ViewType == ViewType.FloorPlan:
					existingPlanNames.append(i.ToDSType(True).Name)
					existingPlanElements.append(i)
					
		# Start Transaction
		TransactionManager.Instance.EnsureInTransaction(doc)
		
		floorPlans = []
		for i in rooms:
			levelId = i.LevelId
			bbox = i.BoundingBox[doc.ActiveView]
			newBbox = OffsetBBox(bbox, bboxOffset)
			viewName = namePrefix + "-" + i.get_Parameter(BuiltInParameter.ROOM_NUMBER).AsString() + "-" + i.get_Parameter(BuiltInParameter.ROOM_NAME).AsString()
			if viewName in existingPlanNames:
				view = existingPlanElements[existingPlanNames.index(viewName)]
				view.CropBox = newBbox
				view.CropBoxActive = True
				view.CropBoxVisible = False
				floorPlans.append(view)
			else:
				newView = ViewPlan.Create(doc, viewTypeId, levelId)
				newView.ViewName = viewName
				newView.CropBox = newBbox
				newView.CropBoxActive = True
				newView.CropBoxVisible = False
				floorPlans.append(newView)
	
		# End Transaction
		TransactionManager.Instance.TransactionTaskDone()
	else:
		errorReport = "Run Me set to False"
except:
	# if error accurs anywhere in the process catch it
	import traceback
	errorReport = traceback.format_exc()

#Assign your output to the OUT variable
if errorReport == None:
	OUT = floorPlans
else:
	OUT = errorReport
# ----------------------------------------
string_2 = StringInput("Annotation Crop")
boolean = BoolSelector(true)
setParameterByName = Element.SetParameterByName(element=byRoom, parameterName=string_2, value=boolean)
setViewTemplate = archilab.Revit.Views.Views.SetViewTemplate(view=setParameterByName, viewTemplate=view_templates)
flatten = List.Flatten(list=setViewTemplate)
count = List.Count(list=flatten)
code_block_3 = CodeBlock(COUNT=count) { 1..#COUNT..1; }
string_from_object = FromObject(obj=code_block_3)
add_3 = watch_2 + string_from_object
byName = FamilyType.ByName(name=string)
watch_3 = Watch(byName)
createSheets = ViewTools.Sheets.CreateSheets(sheetNames=watch, sheetNumbers=add_3, titleBlock=watch_3)
string_3 = StringInput("KATEGORIJA CRTEZA")
string_4 = StringInput("04 POGLEDI")
setParameterByName_2 = Element.SetParameterByName(element=createSheets@L1, parameterName=string_3, value=string_4)
boolean_2 = BoolSelector(true)
byViewsName = archilab.Revit.Views.ViewSets.ByViewsName(views=setParameterByName_2, name=string_4, replace=boolean_2)
byRoom_2 = Python(IN[0]=placedRooms, IN[1]=plan_name_prefix, IN[2]=code_block_2, IN[3]=pokreni_2)  # "CeilingPlan.ByRoom"; graph output
# ---------- byRoom_2.python (118 lines) ----------
# Copyright(c) 2015, Konrad K Sobon
# @arch_laboratory, http://archi-lab.net
# http://tinypic.com/m/kbrvxh/1

import clr
clr.AddReference('ProtoGeometry')
from Autodesk.DesignScript.Geometry import *

# Import Element wrapper extension methods
clr.AddReference("RevitNodes")
import Revit
clr.ImportExtensions(Revit.Elements)

# Import geometry conversion extension methods
clr.ImportExtensions(Revit.GeometryConversion)

# Import DocumentManager and TransactionManager
clr.AddReference("RevitServices")
import RevitServices
from RevitServices.Persistence import DocumentManager
from RevitServices.Transactions import TransactionManager
doc = DocumentManager.Instance.CurrentDBDocument

# Import RevitAPI
clr.AddReference("RevitAPI")
import Autodesk
from Autodesk.Revit.DB import *

import System
from System import Array
from System.Collections.Generic import *

import sys
pyt_path = r'C:\Program Files (x86)\IronPython 2.7\Lib'
sys.path.append(pyt_path)

#The inputs to this node will be stored as a list in the IN variable.
dataEnteringNode = IN

if isinstance(IN[0], list):
	rooms = UnwrapElement(IN[0])
else:
	rooms = [UnwrapElement(IN[0])]
namePrefix = IN[1]
bboxOffset = IN[2]
runMe = IN[3]

def OffsetBBox(bbox, offset):
	bboxMinX = bbox.Min.X - offset
	bboxMinY = bbox.Min.Y - offset
	bboxMinZ = bbox.Min.Z - offset
	bboxMaxX = bbox.Max.X + offset
	bboxMaxY = bbox.Max.Y + offset
	bboxMaxZ = bbox.Max.Z + offset
	newBbox = BoundingBoxXYZ()
	newBbox.Min = XYZ(bboxMinX, bboxMinY, bboxMinZ)
	newBbox.Max = XYZ(bboxMaxX, bboxMaxY, bboxMaxZ)
	return newBbox

try:
	errorReport = None
	if runMe:
		viewTypes = FilteredElementCollector(doc).OfClass(ViewFamilyType)
		for i in viewTypes:
			if i.ViewFamily == ViewFamily.CeilingPlan:
				viewTypeId = i.Id
				break
			else:
				continue
		
		existingPlans = FilteredElementCollector(doc).OfClass(View).ToElements()
		
		existingPlanNames, existingPlanElements = [], []
		for i in existingPlans:
			if not i.IsTemplate:
				if i.ViewType == ViewType.CeilingPlan:
					existingPlanNames.append(i.ToDSType(True).Name)
					existingPlanElements.append(i)
					
		# Start Transaction
		# viewName = namePrefix + i.get_Parameter(BuiltInParameter.ROOM_NUMBER).AsString()

		TransactionManager.Instance.EnsureInTransaction(doc)
		
		ceilingPlans = []
		for i in rooms:
			levelId = i.LevelId
			bbox = i.BoundingBox[doc.ActiveView]
			newBbox = OffsetBBox(bbox, bboxOffset)
			viewName = namePrefix + i.get_Parameter(BuiltInParameter.ROOM_NUMBER).AsString()
			if viewName in existingPlanNames:
				view = existingPlanElements[existingPlanNames.index(viewName)]
				view.CropBox = newBbox
				view.CropBoxActive = True
				view.CropBoxVisible = True
				ceilingPlans.append(view)
			else:
				newView = ViewPlan.Create(doc, viewTypeId, levelId)
				newView.ViewName = viewName
				newView.CropBox = newBbox
				newView.CropBoxActive = True
				newView.CropBoxVisible = False
				ceilingPlans.append(newView)
	
		# End Transaction
		TransactionManager.Instance.TransactionTaskDone()
	else:
		errorReport = "Run Me set to False"
except:
	# if error accurs anywhere in the process catch it
	import traceback
	errorReport = traceback.format_exc()

#Assign your output to the OUT variable
if errorReport == None:
	OUT = ceilingPlans
else:
	OUT = errorReport
# ----------------------------------------
string_5 = StringInput("Annotation Crop")
boolean_3 = BoolSelector(true)
setParameterByName_3 = Element.SetParameterByName(element=byRoom_2, parameterName=string_5, value=boolean_3)
setViewTemplate_2 = archilab.Revit.Views.Views.SetViewTemplate(view=setParameterByName_3, viewTemplate=view_templates_2)
join = List.Join(list0=flatten, list1=setViewTemplate_2)
conversion_factor = CodeBlock { 304.8; }
trim_size = DoubleSlider(1, range=1..10 step 1)
# note: 0 - Plan
# 1- Conversion Factor
# 2 - Trim Size
TRIM = Python(IN[0]=join, IN[1]=conversion_factor, IN[2]=trim_size)
# ---------- TRIM.python (52 lines) ----------
import clr
clr.AddReference('ProtoGeometry')
from Autodesk.DesignScript.Geometry import *

import clr
clr.AddReference('RevitAPI')
import Autodesk.Revit.DB

import clr
clr.AddReference("RevitNodes")
import Revit

clr.AddReference('DSCoreNodes')
import DSCore
from DSCore import *

clr.AddReference("RevitServices")
import RevitServices
from RevitServices.Persistence import DocumentManager
from RevitServices.Transactions import TransactionManager
doc = DocumentManager.Instance.CurrentDBDocument

# Import ToProtoType, ToRevitType geometry conversion extension methods
clr.ImportExtensions(Revit.GeometryConversion)

#The inputs to this node will be stored as a list in the IN variables.
if isinstance(IN[0], list):
	views = UnwrapElement(IN[0])
	cf = IN[1]
	Tsize = IN[2]/cf

else:
	views = [UnwrapElement(IN[0])]
	    	
listout = []
for view in views:
	regionMan = view.GetCropRegionShapeManager()
	TransactionManager.Instance.EnsureInTransaction(doc)
	try:
		regionMan.BottomAnnotationCropOffset = Tsize
		regionMan.LeftAnnotationCropOffset = Tsize
		regionMan.RightAnnotationCropOffset = Tsize
		regionMan.TopAnnotationCropOffset = Tsize
		listout.append(view)
	except:
		listout.append("failed")
	
	TransactionManager.Instance.TransactionTaskDone()


#Assign your output to the OUT variable.
OUT = listout
# ----------------------------------------
name_2 = Element.Name()  # unwired: element
sortByFunction = List.SortByFunction(list=flatten, func=name_2)
flatten_2 = List.Flatten(list=sortByFunction)
name_3 = Element.Name()  # unwired: element
sortByFunction_2 = List.SortByFunction(list=setViewTemplate_2, func=name_3)
flatten_3 = List.Flatten(list=sortByFunction_2)
list_create = List.Create(item0=flatten_2, item1=flatten_3)
transpose = List.Transpose(lists=list_create)
ʳʰʸᵗʰᵐ_sheet_packviews = Rhythm.Revit.Views.Sheet.PackViews(sheet=createSheets, views=transpose)
