# Dynamo graph 3.0 Place and name elevations v3.dyn (Dynamo 2.0.3.8810)

placedRooms = Custom[Collector.PlacedRooms]()  # This will collect placed rooms in current file.
ʳʰʸᵗʰᵐ_rooms_centerroom = Rhythm.Revit.Elements.Rooms.CenterRoom(room=placedRooms)
watch = Watch(ʳʰʸᵗʰᵐ_rooms_centerroom)
watch_2 = Watch(watch)

# group: Get Room Location & Create Elevation Marker
location = Room.Location(room=watch_2)
code_block = CodeBlock { 96; }
python_script = Python()  # unwired: IN[0]
# ---------- python_script.python (43 lines) ----------
#Copyright(c) 2016 www.Learndynamo.com 
#Please contact at jeremy@learndynamo.com

import clr
clr.AddReference('RevitAPI')
clr.AddReference("RevitServices")
clr.AddReference("RevitNodes")
import RevitServices
import Revit
import Autodesk
from Autodesk.Revit.DB import *
from math import *

clr.ImportExtensions(Revit.GeometryConversion)

from RevitServices.Persistence import DocumentManager
from RevitServices.Transactions import TransactionManager

doc = DocumentManager.Instance.CurrentDBDocument

toggle = IN[0]

elements = []
names = []
lst = []

#Get Family View Type
vft = 0
collector = FilteredElementCollector(doc).OfClass(ViewFamilyType).ToElements()

#eleViews = []
for i in collector:
	if i.ViewFamily == ViewFamily.Elevation:
		elements.append(i)
		#elements.append(i.Name)
		for j in i.Parameters:
			if j.Definition.Name == "Type Name":
				names.append(j.AsString())
		
lst.append(elements)
lst.append(names)
	
OUT = lst
# ----------------------------------------
code_block_2 = CodeBlock(item=python_script) { item[0][0]; }
ʳʰʸᵗʰᵐ_elevationmarker = Rhythm.Revit.Elements.ElevationMarker.CreateElevationMarker(location=location, scaleFactor=code_block, viewFamilyType=code_block_2)

# group: Get Room Levels & Find Corresponding Plan
code_block_3 = CodeBlock { "Level"; }
getParameterValueByName = Element.GetParameterValueByName(element=watch, parameterName=code_block_3)
getLevelByName = archilab.Revit.Selection.Select.GetLevelByName(name=getParameterValueByName)
boolean = BoolSelector(true)
views = Custom[Level.Views](level=getLevelByName, toggleToRefresh=boolean)  # Returns all views associated with a given level
code_block_4 = CodeBlock { "View Name"; }
getParameterValueByName_2 = Element.GetParameterValueByName(element=views.allViews, parameterName=code_block_4)
code_block_5 = CodeBlock { "Dynamo"; true; }
contains = String.Contains(str=getParameterValueByName_2, searchFor=code_block_5.out0, ignoreCase=code_block_5.out1)
filterByBoolMask = List.FilterByBoolMask(list=views.allViews, mask=contains)

# group: Create Elevations at Rooms in Plans
code_block_6 = CodeBlock { 0..3; }
ʳʰʸᵗʰᵐ_elevationmarker_2 = Rhythm.Revit.Elements.ElevationMarker.CreateElevationByMarkerIndex(elevationMarker=ʳʰʸᵗʰᵐ_elevationmarker, planView=filterByBoolMask.in, index=code_block_6)
code_block_7 = CodeBlock { 1; }
flatten = List.Flatten(list=ʳʰʸᵗʰᵐ_elevationmarker_2, amt=code_block_7)

# group: Create View Names based on Room Name & Number, Assign to Elevations
name = Room.Name(room=watch_2)
toUpper = String.ToUpper(str=name)
code_block_8 = CodeBlock { "View Name"; }
number = Room.Number(room=watch_2)
code_block_9 = CodeBlock(RNum=number) { RNum+" - "+["D","A","B","C"]<1>; }
transpose = List.Transpose(lists=code_block_9)
setParameterByName = Element.SetParameterByName(element=flatten, parameterName=code_block_8, value=transpose, lacing=Longest)

# group: Get Room Boundaries and Crop Elevations
start = Revit.Transaction.Transaction.Start(input=setParameterByName)
geometry = Element.Geometry(element=watch_2)  # frozen
boundingBox = Geometry.BoundingBox(geometry=geometry)
code_block_10 = CodeBlock { 4; }
ofRepeatedItem = List.OfRepeatedItem(item=boundingBox, amount=code_block_10, lacing=Longest)
code_block_11 = CodeBlock { 1; }
flatten_2 = List.Flatten(list=ofRepeatedItem, amt=code_block_11, lacing=Longest)
setCropRegion = Rhythm.Revit.Views.View.SetCropRegion(view=start, bBox=flatten_2, lacing=Longest)
end = Revit.Transaction.Transaction.End(input=setCropRegion.success)

groupByKey = List.GroupByKey()  # frozen; unwired: list, keys

# group: Renumber Views
code_block_12 = CodeBlock { "VIEWPORT_DETAIL_NUMBER"; }
flatten_3 = List.Flatten(list=groupByKey.groups)
code_block_13 = CodeBlock { [1..4]; [11..14]; [21..24]; [31..34]; }
list_create = List.Create(item0=code_block_13.out0, item1=code_block_13.out1, item2=code_block_13.out2, item3=code_block_13.out3)
code_block_14 = CodeBlock { 1; }
flatten_4 = List.Flatten(list=list_create, amt=code_block_14)
count = List.Count(list=groupByKey.groups)
takeItems = List.TakeItems(list=flatten_4, amount=count)
flatten_5 = List.Flatten(list=takeItems)
code_block_15 = CodeBlock(x=flatten_5) { x+40; }
string_from_object = FromObject(obj=code_block_15)
set_builtin_parameter = Custom[Set BuiltIn Parameter](ParameterName=code_block_12, Elements=flatten_3, ParameterValues=string_from_object)  # This node will take an input of a built in parameter name and set that parameter to given value for given elements.
string_from_object_2 = FromObject(obj=flatten_5)
set_builtin_parameter_2 = Custom[Set BuiltIn Parameter](ParameterName=code_block_12, Elements=set_builtin_parameter, ParameterValues=string_from_object_2)

code_block_16 = CodeBlock { RName+" "+RNum+" - "+["WEST","NORTH","EAST","SOUTH"]<1>+" ELEVATION"; }  # frozen; unwired: RName, RNum
code_block_17 = CodeBlock { 3; }
flatten_6 = List.Flatten(list=ʳʰʸᵗʰᵐ_elevationmarker_2, amt=code_block_17)

# group: Set View Template
templejt_za_poglede = ViewTemplatesUi(index=8)
setViewTemplate = archilab.Revit.Views.Views.SetViewTemplate(view=flatten_6, viewTemplate=templejt_za_poglede)
