# Dynamo graph 4.0 Place all elevation views on sheets v1.dyn "4.1. Place all elevation views on sheets" (Dynamo 2.0.3.8810)

categories = Categories(index=425)
all_elements_of_category = ElementsOfCategory(Category=categories)
boundaries = Custom[Room.Boundaries](room=all_elements_of_category)  # Gets a list of all boundaries of a given room or area and a corresponding list of the elements that are generating those boundaries.
boundingBox = Geometry.BoundingBox(geometry=boundaries.curves)
contains = BoundingBox.Contains(boundingBox=boundingBox)  # unwired: point
boolean = BoolSelector(true)
elements_in_room = Custom[Elements in Room](Rooms=all_elements_of_category)  # This node will check if any of the elements are inside any of the supplied rooms.; unwired: Elements
isInsideRoom = Room.IsInsideRoom()  # unwired: room, point
getElementsInside = Revit.BoundingBox.GetElementsInside()  # unwired: boundingBox, elements
getViewsByType = Custom[GetViewsByType]()  # Get all views in the project classified by type
watch = Watch(getViewsByType.elevations)
code_block = CodeBlock { 4; }
takeItems = List.TakeItems(list=watch, amount=code_block)
compareIfNotExist = Custom[List.Checks.CompareIfNotExist](List1=watch, List2=takeItems)  # Compares values in list1 against values in list 2. If these exist in list2 they will be replaced with False in list 1
string = StringInput("SectionView")
removeIfNot = List.RemoveIfNot(list=compareIfNotExist, type=string)
name = Element.Name()  # unwired: element
sortByFunction = List.SortByFunction(list=removeIfNot, func=name)
getElementsInside_2 = Revit.BoundingBox.GetElementsInside(boundingBox=boundingBox, elements=sortByFunction)
getElementsIntersect = Revit.BoundingBox.GetElementsIntersect(boundingBox=boundingBox, elements=sortByFunction)
