# Dynamo graph 5.0 Floor and roof by room v2.dyn "5. Floor and roof by room v2" (Dynamo 2.0.3.8810)

# group: PODEŠAVANJA ROOF
roof_types = RoofTypes(index=2)
offset_od_sredine_zida = CodeBlock { -40; }
string = StringInput("Roof")
na_koj_nivo_da_se_iscrta_roof = Levels(index=1)

boolean = BoolSelector(true)
placedRooms = Custom[Collector.PlacedRooms](toggle=boolean)  # This will collect placed rooms in current file.
finishBoundary = Room.FinishBoundary(room=placedRooms)
code_block = CodeBlock { 1..10; }
removeItemAtIndex = List.RemoveItemAtIndex(list=finishBoundary@L3, indices=code_block)
code_block_2 = CodeBlock { 1; }
flatten = List.Flatten(list=removeItemAtIndex, amt=code_block_2)
startPoint = Curve.StartPoint(curve=flatten)
code_block_3 = CodeBlock { 1; }
tangentAtParameter = Curve.TangentAtParameter(curve=flatten, param=code_block_3)
code_block_4 = CodeBlock { 1; }
shiftIndices = List.ShiftIndices(list=flatten@L2, amount=code_block_4)
code_block_5 = CodeBlock { 1; }
tangentAtParameter_2 = Curve.TangentAtParameter(curve=shiftIndices, param=code_block_5)
isAlmostEqualTo = Vector.IsAlmostEqualTo(vector=tangentAtParameter, other=tangentAtParameter_2)
filterByBoolMask = List.FilterByBoolMask(list=startPoint, mask=isAlmostEqualTo)
reverse = List.Reverse(list=filterByBoolMask.out@L2)
X = Point.X(point=reverse)
Y = Point.Y(point=reverse)
add = X + Y
maximumItem = List.MaximumItem(list=add)
indexOf = List.IndexOf(list=add, element=maximumItem, lacing=Longest)
code_block_6 = CodeBlock(x=indexOf) { x*-1; }
shiftIndices_2 = List.ShiftIndices(list=reverse@L2, amount=code_block_6, lacing=Longest)
boolean_2 = BoolSelector(true)
byPoints = PolyCurve.ByPoints(points=shiftIndices_2, connectLastToFirst=boolean_2)
closeWithLine = PolyCurve.CloseWithLine(polyCurve=byPoints)
ꟿ_polycurve_points = Custom[ꟿ PolyCurve.Points](polyCurve=closeWithLine)  # Gets all the unique start and end points of the underlying curves in a sorted list.
byPoints_2 = PolyCurve.ByPoints(points=ꟿ_polycurve_points@@L2, connectLastToFirst=boolean_2)
offset = Curve.Offset(curve=byPoints_2, distance=offset_od_sredine_zida)
byName = RoofType.ByName(name=string)
byOutlineTypeAndLevel = Roof.ByOutlineTypeAndLevel(outline=offset@L1, roofType=byName, level=na_koj_nivo_da_se_iscrta_roof)

# group: PODEŠAVANJA FLOOR
floor_types = FloorTypes(index=2)
levels = Levels(index=0)

byOutlineTypeAndLevel_2 = Floor.ByOutlineTypeAndLevel(outlineCurves=byPoints_2, floorType=floor_types, level=levels)
