# Dynamo graph 5.2. Roof by room v2.dyn (Dynamo 2.0.3.8810)

roof_types = RoofTypes(index=8)
boolean = BoolSelector(true)
placedRooms = Custom[Collector.PlacedRooms](toggle=boolean)  # This will collect placed rooms in current file.
finishBoundary = Room.FinishBoundary(room=placedRooms)
code_block = CodeBlock { 1; }
flatten = List.Flatten(list=finishBoundary, amt=code_block)
startPoint = Curve.StartPoint(curve=flatten)
code_block_2 = CodeBlock { 1; }
tangentAtParameter = Curve.TangentAtParameter(curve=flatten, param=code_block_2)
code_block_3 = CodeBlock { 1; }
shiftIndices = List.ShiftIndices(list=flatten@L2, amount=code_block_3)
code_block_4 = CodeBlock { 1; }
tangentAtParameter_2 = Curve.TangentAtParameter(curve=shiftIndices, param=code_block_4)
isAlmostEqualTo = Vector.IsAlmostEqualTo(vector=tangentAtParameter, other=tangentAtParameter_2)
filterByBoolMask = List.FilterByBoolMask(list=startPoint, mask=isAlmostEqualTo)
points_to_polycurve_with = Custom[Points to PolyCurve with PruneDuplicates](points=filterByBoolMask.out)
code_block_5 = CodeBlock { -40; }
offset = Custom[Offset](curve=points_to_polycurve_with.PolyCurve, OffsetDistance=code_block_5)  # Safe offset curve, minus distance will return a smaller curve or a closer curve to [0,0,0]
byPatch = Surface.ByPatch(closedCurve=offset)
perimeterCurves = Surface.PerimeterCurves(surface=byPatch)
curve_superjoin_archilab = Custom[Curve.SuperJoin-ArchiLab](curves=perimeterCurves)  # Group and join all end-to-end joinable curves into polycurves, then sort them by their length (from big to small). This is ugraded from ArchiLab node. Closed input curves will be passed directly without being converted into PolyCurves.
levels = Levels(index=2)
string = StringInput("Roof")
byName = RoofType.ByName(name=string)
byFootprint = Roof.FootPrintRoof.ByFootprint(footprint=curve_superjoin_archilab, level=levels, roofType=byName)
categories = Categories(index=425)
all_elements_of_category = ElementsOfCategory(Category=categories)
code_block_6 = CodeBlock { -200; }
boolean_2 = BoolSelector(false)  # frozen
offset_2 = PolyCurve.Offset(signedDistance=code_block_6, extendCircular=boolean_2)  # unwired: polyCurve
code_block_7 = CodeBlock { 50; }  # frozen
filletOffset = Custom[Geometry.Curve.FilletOffset](curve=points_to_polycurve_with.PolyCurve, Fillets=code_block_7, Offset_Size_double_var=code_block_7)
