# Dynamo graph 9.0 Place legend views v3.dyn (Dynamo 2.0.3.8810)

file_path = Filename("Z:\Čiste Sobe\logo.png")
file_from_path = FileObject(path=file_path)
readFromFile = Image.ReadFromFile(file=file_from_path)
string = StringInput("Done")  # graph input
string_2 = StringInput("Izaberi uzornu legendu")
string_3 = StringInput("Choose")
boolean = BoolSelector(true)
ui_selectmodelelements_data = Custom[UI.SelectModelElements Data](InputName=string_2, ButtonText=string_3, SelectSingleElement=boolean)  # Creates a Revit element selection input for UI.MultipleInputForm++ . Check out www.data-shapes.net for more infos!
create = List.Create(item0=ui_selectmodelelements_data)
boolean_2 = BoolSelector(true)
string_4 = StringInput("Cancel")  # graph input
code_block = CodeBlock { 800; }
ui_multipleinputform = Custom[UI.MultipleInputForm ++](Logo_optional=readFromFile, ButtonText_optional=string, Inputs=create, Toggle=boolean_2, CancelButtonText_optional=string_4, Width_optional=code_block)  # Create a form with multiple inputs. see www.data-shapes.net for tutorials and infos!
code_block_2 = CodeBlock { 0; }
getItemAtIndex = List.GetItemAtIndex(list=ui_multipleinputform.User_Inputs, index=code_block_2)
getView = Rhythm.Revit.Elements.Viewport.GetView(viewport=getItemAtIndex)
get_all_sheets_in_project_py = Python()
# ---------- get_all_sheets_in_project_py.python (33 lines) ----------
import clr
# import Document Manager
clr.AddReference("RevitServices")
import RevitServices 
from RevitServices.Persistence import DocumentManager
from RevitServices.Transactions import TransactionManager
doc = DocumentManager.Instance.CurrentDBDocument
uidoc = DocumentManager.Instance.CurrentUIDocument
clr.AddReference("RevitNodes")
import Revit
clr.ImportExtensions(Revit.Elements)
clr.ImportExtensions(Revit.GeometryConversion)
clr.AddReference("RevitAPI")
from Autodesk.Revit.DB import *

dataEnteringNode = IN

sheets = []
sheetNum = []
sheetName = []

coll = FilteredElementCollector(doc)
vSheets = coll.OfClass(ViewSheet)

for vs in vSheets:
	sht = UnwrapElement(vs)
	sheetNum.Add(sht.SheetNumber)
	sheetName.Add(sht.Name)
	sheets.Add(sht)

OUT = [sheets,sheetNum,sheetName]
	
#For more information refer to RBG Wiki or email me (ctrl + click link): daniel.woodcock@robertbird.com
# ----------------------------------------
code_block_3 = CodeBlock(a=get_all_sheets_in_project_py) { a[0]; }
string_5 = StringInput("KATEGORIJA CRTEZA")
getParameterValueByName = Element.GetParameterValueByName(element=code_block_3, parameterName=string_5)

# group: Koji crteži?
string_6 = StringInput("04 POGLEDI")
watch = Watch(string_6)
string_7 = StringInput("03 OSNOVE")

eq = getParameterValueByName == watch
filterByBoolMask = List.FilterByBoolMask(list=code_block_3, mask=eq)
locationData = Rhythm.Revit.Elements.Viewport.LocationData(viewport=getItemAtIndex)
watch_2 = Watch(locationData.boxCenter)
X = Point.X(point=watch_2)
convert_between_units = DynamoConvert(X, MeasurementType="Length", FromConversion="Millimeters", ToConversion="Feet")
Y = Point.Y(point=watch_2)
convert_between_units_2 = DynamoConvert(Y, MeasurementType="Length", FromConversion="Millimeters", ToConversion="Feet")
Z = Point.Z(point=watch_2)
convert_between_units_3 = DynamoConvert(Z, MeasurementType="Length", FromConversion="Millimeters", ToConversion="Feet")
byCoordinates = Point.ByCoordinates(x=convert_between_units, y=convert_between_units_2, z=convert_between_units_3)
place_legend_on_sheets_py = Python(IN[0]=getView, IN[1]=filterByBoolMask.in, IN[2]=byCoordinates)
# ---------- place_legend_on_sheets_py.python (40 lines) ----------
import clr
# import Document Manager
clr.AddReference("RevitServices")
import RevitServices 
from RevitServices.Persistence import DocumentManager
from RevitServices.Transactions import TransactionManager
doc = DocumentManager.Instance.CurrentDBDocument
uidoc = DocumentManager.Instance.CurrentUIDocument
clr.AddReference("RevitNodes")
import Revit
clr.ImportExtensions(Revit.Elements)
clr.ImportExtensions(Revit.GeometryConversion)
clr.AddReference("RevitAPI")
from Autodesk.Revit.DB import *

dataEnteringNode = IN

legend = UnwrapElement(IN[0])
sheets = IN[1]
loc = XYZ(IN[2].X, IN[2].Y, IN[2].Z)
viewports = []
failed = []

for vs in sheets:
	sheet = UnwrapElement(vs)
	canAddToSht = Viewport.CanAddViewToSheet(doc, sheet.Id, legend.Id)
	if canAddToSht:
		try:		
			TransactionManager.Instance.EnsureInTransaction(doc)	
			viewport = Viewport.Create(doc, sheet.Id, legend.Id, loc)	
			TransactionManager.Instance.TransactionTaskDone()
			viewports.Add([viewport,sheet])
		except:
			failed.Add(["Failed",sheet])
	else:
		failed.Add(["Failed",sheet])
		
OUT = [viewports, failed]
	
#For more information refer to RBG Wiki or email me (ctrl + click link): daniel.woodcock@robertbird.com
# ----------------------------------------
succeded = CodeBlock(a=place_legend_on_sheets_py) { a[0]; }
failed = CodeBlock(a=place_legend_on_sheets_py) { a[1]; }
code_block_4 = CodeBlock(a=get_all_sheets_in_project_py) { a[1]; }
ui_listview_data = Custom[UI.Listview Data](Keys=code_block_4, Values=code_block_3)  # Create data for ListView input in UI.MultiInputForm ++ . Check out www.data-shapes.net for more infos.
code_block_5 = CodeBlock(a=get_all_sheets_in_project_py) { a[2]; }
all_elements_of_type = ElementsOfType()  # unwired: element_type
filterByParameterValue = WombatDynamo.Element.FilterByParameterValue()  # unwired: elements, parameterName, parameterValue
