# Dynamo graph A03.5 Šema Vrata.dyn (Dynamo 2.12.1.8246)
# Za svaki od markova prave se pogledi
# packages: Orchid 212.1.0.8171, BattleBIM 2018.12.17, Rhythm 2022.4.3, Data-Shapes 2022.2.103

# group: Filtriranje Termovent vrata
code_block = CodeBlock { cat = Revit.Category.ByName("Doors"); }
all_elements_of_category = ElementsOfCategory(Category=code_block)
string_from_object = FromObject(object=all_elements_of_category)
code_block_2 = CodeBlock { ["WDB","WDS","WDD","WDDB"]; }
contains = String.Contains(string=string_from_object, searchFor=code_block_2, lacing=CrossProduct)
countTrue = List.CountTrue(list=contains@L2)
code_block_3 = CodeBlock(n=countTrue) { n > 0; }
filterByBoolMask = List.FilterByBoolMask(list=all_elements_of_category, mask=code_block_3)
code_block_4 = CodeBlock(elementz=filterByBoolMask.in)
# ---------- code_block_4.designscript (7 lines) ----------
MarkZ = Element.GetParameterValueByName(elementz, "Mark");

//Lists.DuplicateItemIndicies - archilab
mark = Lists.DuplicateItemIndicies(MarkZ);
duplikati = Dictionary.ValueAtKey(mark, "duplicate");
ostavisamoUnikate  = List.RemoveItemAtIndex(elementz, duplikati);
//
# ----------------------------------------
code_block_5 = CodeBlock(razbiMarkUlistu=code_block_4.MarkZ, ostavisamoUnikate=code_block_4.ostavisamoUnikate)
# ---------- code_block_5.designscript (7 lines) ----------
jelImaMark = List.IsEmpty(razbiMarkUlistu@L1<1>);

unikatesamarkom = List.FilterByBoolMask(ostavisamoUnikate, jelImaMark);
vrata = Dictionary.ValueAtKey(unikatesamarkom, "out");

brojPraznihListi = List.CountTrue(jelImaMark);
provera = brojPraznihListi >= 1;
# ----------------------------------------
vrata = Watch(code_block_5.vrata)
vrata_bez_marka = Python(IN[0]=code_block_5.brojPraznihListi, IN[1]=code_block_5.provera)  # IronPython2
# ---------- vrata_bez_marka.python (38 lines) ----------
import clr
clr.AddReference("RevitAPI")
clr.AddReference("ProtoGeometry")
clr.AddReference("RevitNodes")
clr.AddReference("RevitServices")
clr.AddReference("RevitAPIUI")
clr.AddReference("DSCoreNodes")
import DSCore
from DSCore import *
import Autodesk
import Revit
clr.ImportExtensions(Revit.GeometryConversion)
import RevitServices
from Autodesk.Revit.UI import TaskDialog
from Autodesk.Revit.DB import *
from Autodesk.DesignScript.Geometry import *

clr.AddReference("System.Windows.Forms")
from System.Windows.Forms import Form,Label,FormStartPosition

#input
brojVrataBezMarka = IN[0]
tf = IN[1]
text = "Broj Vrata koja nisu markirana: ";



msgBox=TaskDialog
result = []

if tf:
	
	msgBox.Show("Error: ", text + str(brojVrataBezMarka))
else:
	"0"
	pass
	
OUT = "Done"
# ----------------------------------------
# note: ZID VRATA
getHost = FamilyInstance.GetHost(familyInstance=code_block_5.vrata)
string_from_object_2 = FromObject(object=code_block_4.MarkZ)

# group: Define vectors
facingOrientation = Python(IN[0]=vrata)  # "Element.FacingOrientation"; IronPython2
# ---------- facingOrientation.python (28 lines) ----------
#This script looks for the hand orientation of selected elements in Revit.
#It returns the X-vector of the element facing.
#Authored by Dieter Vermeulen, Autodesk, 2016
#http://revitbeyondbim.wordpress.com

import clr

clr.AddReference('RevitAPI')
from Autodesk.Revit.DB import *
from Autodesk.Revit.DB.Structure import *

X=[]
Y=[]
Z=[]
vec=[]
Invalid=[]

for i in IN[0]:
	StraFra=UnwrapElement(i)
	try:
		XYZ=StraFra.HandOrientation
		X.append(XYZ.X)
		Y.append(XYZ.Y)
		Z.append(XYZ.Z)
		
	except:
		Invalid.append(i)
OUT = X,Y,Z,Invalid
# ----------------------------------------
code_block_6 = CodeBlock(a=facingOrientation) { a[0]; a[1]; a[2]; a[3]; }
byCoordinates = Vector.ByCoordinates(x=code_block_6.out0, y=code_block_6.out1, z=code_block_6.out2)
# note: X-vector
flatten = List.Flatten(list=byCoordinates)
number = DoubleInput(1)
byCoordinates_2 = Vector.ByCoordinates(y=number)
# note: Y-vector
cross = Vector.Cross(vector=flatten, cross=byCoordinates_2)
string_from_object_3 = FromObject(object=cross)
# note: Z-vector
byCoordinates_3 = Vector.ByCoordinates()
string_from_object_4 = FromObject(object=byCoordinates_3)
eq = string_from_object_3 == string_from_object_4
byCoordinates_4 = Vector.ByCoordinates(z=number)
if_ = If(test=eq, true=byCoordinates_4, false=cross)  # frozen
cross_2 = Vector.Cross(vector=flatten, cross=byCoordinates_4)
if_2 = RefactoredIf(test=eq, true=byCoordinates_4, false=cross)

# group: Door to Solid
vrata_2 = Watch(vrata)
boundingBox = Element.BoundingBox(element=vrata_2)
toCuboid = BoundingBox.ToCuboid(boundingBox=boundingBox)
centroid = Solid.Centroid(solid=toCuboid)

# group: Verzija
# note: designtech
# BIM4Struc
# archilab
# Orchid
# BattleBIM
# Data-Shapes
codeBlock = CodeBlock()
# ---------- codeBlock.designscript (14 lines) ----------
//V1
"Inicijalna verzija
- pravljenje pogleda vrata napred i pozadi po marku 1 komad";
//V2
"Osnove
- pravljenje osnova vrata napred i pozadi po marku 1 komad";
//V3
"Crtež
- postavljanje pogleda na crtež";
//V4
"Izbor lista
- opcije za izbor lista";
//V5
"Dorada za revit 2022";
# ----------------------------------------

code_block_7 = CodeBlock(elementz=filterByBoolMask.in)  # frozen
# ---------- code_block_7.designscript (15 lines) ----------
MarkZ = Element.GetParameterValueByName(elementz, "Mark");

//Lists.DuplicateItemIndicies - archilab
mark = Lists.DuplicateItemIndicies(MarkZ);
duplikati = Dictionary.ValueAtKey(mark, "duplicate");
ostavisamoUnikate  = List.RemoveItemAtIndex(elementz, duplikati);
//
razbiMarkUlistu = dtCore.String.ToList(MarkZ);
jelImaMark = List.IsEmpty(razbiMarkUlistu@L2<1>);

unikatesamarkom = List.FilterByBoolMask(ostavisamoUnikate, jelImaMark);
vrata = Dictionary.ValueAtKey(unikatesamarkom, "out");

brojPraznihListi = List.CountTrue(jelImaMark);
provera = brojPraznihListi >= 1;
# ----------------------------------------
zatvoriti_vrata = CodeBlock(elementZ=vrata)
# ---------- zatvoriti_vrata.designscript (7 lines) ----------
//aktivno krilo
ZatvoriAktiv = Element.SetParameterByName(elementZ, "Ugao rotacije aktiv", 0);
//pasivno krilo
pasivProvera = RevitProject.Parameter.Exists("Ugao rotacije pasiv", elementZ);
filtrirajDvokrilnaVrata = List.FilterByBoolMask(elementZ, pasivProvera);
dvokrilnaVr = Dictionary.ValueAtKey(filtrirajDvokrilnaVrata, "in");
ZatvoriPasiv = Element.SetParameterByName(dvokrilnaVr, "Ugao rotacije pasiv", 0);
# ----------------------------------------

# group: Get insertion point
wall = Watch(getHost)
code_block_8 = CodeBlock(elem=wall)
# ---------- code_block_8.designscript (8 lines) ----------
geo = Element.GetLocation(elem);

tipIn = DSCore.Object.Type(geo);
tipTest = "Autodesk.DesignScript.Geometry.Line";

test = tipIn == tipTest;

true;
# ----------------------------------------
filterByBoolMask_2 = List.FilterByBoolMask(list=code_block_8.geo, mask=code_block_8.test)
startPoint = Curve.StartPoint(curve=filterByBoolMask_2.in)
replace_items_at_condition = Python(IN[0]=code_block_8.test, IN[1]=code_block_8.out4, IN[2]=startPoint, IN[3]=code_block_8.geo)  # IronPython2
# ---------- replace_items_at_condition.python (23 lines) ----------
import clr
clr.AddReference('ProtoGeometry')
from Autodesk.DesignScript.Geometry import *
#The inputs to this node will be stored as a list in the IN variables.
Test=IN[0]
Condition=IN[1]
ValCondition=IN[2]
OriginalValue=IN[3]
Results=[]
i=0
j=0

for t in Test:
	if t == Condition:
		Results.append(ValCondition[i])
		i=i+1
	else:
		Results.append(OriginalValue[j])
	j=j+1


#Assign your output to the OUT variable.
OUT = Results
# ----------------------------------------

# group: XYZ door/wall vector
invalid_elements = Watch(code_block_6.out3)
code_block_9 = CodeBlock(InsertionPoint=replace_items_at_condition) { InsertionPoint; }
code_block_10 = CodeBlock(Xvector=flatten) { Xvector; }
code_block_11 = CodeBlock(Yvector=cross_2) { Yvector; }
code_block_12 = CodeBlock(Zvector=if_2) { Zvector; }

string_from_object_5 = FromObject(object=code_block_12)
code_block_13 = CodeBlock { nullVector = "Vector(X = 0.000, Y = 0.000, Z = 0.000, Length = 0.000)"; }
ne = string_from_object_5 != code_block_13
filterByBoolMask_3 = List.FilterByBoolMask(list=code_block_12, mask=ne)

# group: Vector Visualizer (BIM4Struc)
in_ = CodeBlock(origin=code_block_9, Xvector=code_block_10, Yvector=code_block_11, Zvector=filterByBoolMask_3.in) { origin; Xvector; Yvector; Zvector; LineLength = 1000; RGB = 255; }
byStartPointDirectionLength = Line.ByStartPointDirectionLength(startPoint=in_.origin, direction=in_.Zvector, length=in_.LineLength)
firstItem = List.FirstItem(list=byStartPointDirectionLength@L2)
byARGB = Color.ByARGB(blue=in_.RGB)
byGeometryColor = Modifiers.GeometryColor.ByGeometryColor(geometry=firstItem, color=byARGB)
# note: Xvector = Red
# Yvector = Green
# Zvector = Blue
byStartPointDirectionLength_2 = Line.ByStartPointDirectionLength(startPoint=in_.origin, direction=in_.Yvector, length=in_.LineLength)
byARGB_2 = Color.ByARGB(green=in_.RGB)
byGeometryColor_2 = Modifiers.GeometryColor.ByGeometryColor(geometry=byStartPointDirectionLength_2, color=byARGB_2)
byStartPointDirectionLength_3 = Line.ByStartPointDirectionLength(startPoint=in_.origin, direction=in_.Xvector, length=in_.LineLength)
byARGB_3 = Color.ByARGB(red=in_.RGB)
byGeometryColor_3 = Modifiers.GeometryColor.ByGeometryColor(geometry=byStartPointDirectionLength_3, color=byARGB_3)

# group: Podešavanja
code_block_14 = CodeBlock { "CropRegion Offset_Top"; 0; 2000; 100; }
# note: Custom Package: Data-Shapes
# note: Custom Node: Data-Shapes
slider = Custom[UI.Slider](InputName=code_block_14.out0, Minimum=code_block_14.out1, Maximum=code_block_14.out2, Default_Value=code_block_14.out1, Step=code_block_14.out3)  # package Data-Shapes; Creates slider input for UI.MultipleInputForm ++ . Set the step to decimal value if you want a double slider, or to a integer value if you want an integer slider.
code_block_15 = CodeBlock { "CropRegion Offset_Bottom"; 0; 2000; 100; }
slider_2 = Custom[UI.Slider](InputName=code_block_15.out0, Minimum=code_block_15.out1, Maximum=code_block_15.out2, Default_Value=code_block_15.out1, Step=code_block_15.out3)
code_block_16 = CodeBlock { "CropRegion Offset_LeftRight"; 0; 2000; 100; }
slider_3 = Custom[UI.Slider](InputName=code_block_16.out0, Minimum=code_block_16.out1, Maximum=code_block_16.out2, Default_Value=code_block_16.out1, Step=code_block_16.out3)
code_block_17 = CodeBlock(ddi1=slider, ddi2=slider_2, ddi3=slider_3) { title = "Crop Offset"; input= List.Join([ddi1, ddi2, ddi3]); }
ui_inputgroup_data = Custom[UI.InputGroup Data](GroupTitle=code_block_17.title, Inputs=code_block_17.input)  # package Data-Shapes; Creates a group of inputs for UI.MultipleInputForm ++ . Check out www.data-shapes.net for more infos !
code_block_18 = CodeBlock { "View Center Offset"; 100; 1000; 500; }
slider_4 = Custom[UI.Slider](InputName=code_block_18.out0, Minimum=code_block_18.out1, Maximum=code_block_18.out2, Default_Value=code_block_18.out3, Step=code_block_18.out1)
code_block_19 = CodeBlock { "View Depth"; 100; 2000; 700; }
slider_5 = Custom[UI.Slider](InputName=code_block_19.out0, Minimum=code_block_19.out1, Maximum=code_block_19.out2, Default_Value=code_block_19.out3, Step=code_block_19.out1)
code_block_20 = CodeBlock(ddi1=slider_4, ddi2=slider_5) { title = "View Depth Offset"; input= List.Join([ddi1, ddi2]); }
ui_inputgroup_data_2 = Custom[UI.InputGroup Data](GroupTitle=code_block_20.title, Inputs=code_block_20.input)
code_block_21 = CodeBlock { "Presek"; "Osnova"; }
get_all_view_templates = Python()  # IronPython2; unwired: IN[0]
# ---------- get_all_view_templates.python (22 lines) ----------
import clr
clr.AddReference('ProtoGeometry')
from Autodesk.DesignScript.Geometry import *
clr.AddReference('RevitAPI')
from Autodesk.Revit.DB import *
import Autodesk
clr.AddReference('RevitServices')
from RevitServices.Persistence import *
import RevitServices
#The inputs to this node will be stored as a list in the IN variables.
dataEnteringNode = IN

doc = DocumentManager.Instance.CurrentDBDocument
views = FilteredElementCollector(doc).OfClass(View)
viewlist = list()

for view in views:
	if view.IsTemplate == True:
		viewlist.append(view)

#Assign your output to the OUT variable.
OUT = viewlist
# ----------------------------------------
clear_list = Python(IN[0]=get_all_view_templates)  # CPython3
# ---------- clear_list.python (23 lines) ----------
#Copyright(c) 2015, Konrad K Sobon
# @arch_laboratory, http://archi-lab.net

import clr
clr.AddReference('ProtoGeometry')
from Autodesk.DesignScript.Geometry import *
#The inputs to this node will be stored as a list in the IN variable.
dataEnteringNode = IN

def ClearList(_list):
    out = []
    for _list1 in _list:
        if _list1 is None:
            continue
        if isinstance(_list1, list):
             _list1 = ClearList(_list1)
             if not _list1:
                 continue
        out.append(_list1)
    return out

#Assign your output to the OUT variable
OUT = ClearList(IN[0])
# ----------------------------------------
name = Element.Name(element=clear_list)
code_block_22 = CodeBlock { str1 = "Šema Vrata Pogledi 1.50"; str2 = "Šema Vrata Osnova 1.50"; }
indexOf = List.IndexOf(list=name, element=code_block_22.str1)
ui_dropdown_data = Custom[UI.DropDown Data](InputName=code_block_21.out0, Keys=name, Values=clear_list, DefaultValueIndex=indexOf)  # package Data-Shapes; Create data for DropDown input in UI.MultiInputForm ++ . Check out www.data-shapes.net for more infos.
indexOf_2 = List.IndexOf(list=name, element=code_block_22.str2)
ui_dropdown_data_2 = Custom[UI.DropDown Data](InputName=code_block_21.out1, Keys=name, Values=clear_list, DefaultValueIndex=indexOf_2)
code_block_23 = CodeBlock(ddi1=ui_dropdown_data, ddi2=ui_dropdown_data_2) { title = "Vitew Template"; input= List.Join([ddi1, ddi2]); }
ui_inputgroup_data_3 = Custom[UI.InputGroup Data](GroupTitle=code_block_23.title, Inputs=code_block_23.input)
sheets = Python()  # "Collector.Sheets"; IronPython2
# ---------- sheets.python (31 lines) ----------
#Copyright(c) 2017, john pierson
# @60secondrevit, http://sixtysecondrevit.com

import clr
clr.AddReference('ProtoGeometry')
from Autodesk.DesignScript.Geometry import *

# Import DocumentManager and TransactionManager
clr.AddReference("RevitServices")
import RevitServices
from RevitServices.Persistence import DocumentManager
from RevitServices.Transactions import TransactionManager

# Import RevitAPI
clr.AddReference("RevitAPI")
import Autodesk
from Autodesk.Revit.DB import *

doc = DocumentManager.Instance.CurrentDBDocument
uiapp = DocumentManager.Instance.CurrentUIApplication
app = uiapp.Application

from System.Collections.Generic import *


#The inputs to this node will be stored as a list in the IN variable.
collector = FilteredElementCollector(doc)
sheets = collector.OfCategory(BuiltInCategory.OST_Sheets).ToElements()


OUT = sheets;
# ----------------------------------------
name_2 = Element.Name(element=sheets)
code_block_24 = CodeBlock()
# ---------- code_block_24.designscript (2 lines) ----------
//t1 = dtCore.String.FromObject(a);
str1 = "Specifikacija vrata";
# ----------------------------------------
indexOf_3 = List.IndexOf(list=name_2, element=code_block_24)
ui_dropdown_data_3 = Custom[UI.DropDown Data](Keys=name_2, Values=sheets, DefaultValueIndex=indexOf_3)
code_block_25 = CodeBlock(ddi1=ui_dropdown_data_3) { title = "Izbor lista "; input= ddi1; }
ui_inputgroup_data_4 = Custom[UI.InputGroup Data](GroupTitle=code_block_25.title, Inputs=code_block_25.input)
code_block_26 = CodeBlock(t1=ui_inputgroup_data, t2=ui_inputgroup_data_2, t3=ui_inputgroup_data_3, t4=ui_inputgroup_data_4) { title = "Podešavanja"; done = "Done"; inputs = List.Join([t1, t2, t3, t4]); toggle = true; cancel = "Cancel"; }
code_block_27 = CodeBlock { "Z:\\Čiste Sobe\\T1.png"; }
file_from_path = FileObject(path=code_block_27)
readFromFile = Image.ReadFromFile(file=file_from_path)
ui_multipleinputform = Custom[UI.MultipleInputForm ++](Description_optional=code_block_26.title, Logo_optional=readFromFile, ButtonText_optional=code_block_26.done, Inputs=code_block_26.inputs, Toggle=code_block_26.toggle, CancelButtonText_optional=code_block_26.cancel)  # package Data-Shapes; Create a form with multiple inputs. see www.data-shapes.net for tutorials and infos!
code_block_28 = CodeBlock(UI=ui_multipleinputform.User_Inputs)
# ---------- code_block_28.designscript (10 lines) ----------
//Crops Region Offset
CROTop= UI[0];
CROBot= UI[1];
CROSide= UI[2];
//View
ViewCenterOffset= UI[3];
ViewDepth= UI[4];
VitewTemplatePogledi=UI[5];
VitewTemplateOsnove=UI[6];
SheetZaCrteže=UI[7];
# ----------------------------------------

watch = Watch(code_block_28.SheetZaCrteže)

# group: INPUT
zid = Watch(getHost)
boundingBox_2 = Element.BoundingBox(element=zid)
toCuboid_2 = BoundingBox.ToCuboid(boundingBox=boundingBox_2)
centroid_2 = Solid.Centroid(solid=toCuboid_2)
view_center_offset_front = CodeBlock(x=code_block_28.ViewCenterOffset) { [x]; }
translate = Geometry.Translate(geometry=centroid_2, direction=code_block_11, distance=view_center_offset_front, lacing=Longest)
CSPoint = Watch(translate)
y_vector_tj_z_vector = Watch(filterByBoolMask_3.in)
view_center_offset_back = CodeBlock(x=code_block_28.ViewCenterOffset) { -[x]; }
translate_2 = Geometry.Translate(geometry=centroid_2, direction=code_block_11, distance=view_center_offset_back, lacing=Longest)
CSPoint_2 = Watch(translate_2)

# group: ELEMENT GEOMETRY SIMPLIFICATION
ZAxis = Vector.ZAxis()
code_block_29 = CodeBlock { 90; }
count = List.Count(list=toCuboid_2)
ofRepeatedItem = List.OfRepeatedItem(item=code_block_29, amount=count)
code_block_30 = CodeBlock(num=ofRepeatedItem) { Math.Round(num,3); }
uglovi = Python(IN[0]=code_block_30)  # IronPython2
# ---------- uglovi.python (10 lines) ----------
inAngles = IN[0]
outAngles = []

for n in inAngles:
	if n%90 == 0:
		outAngles.append(0)
	else:
		outAngles.append(n)

OUT = outAngles
# ----------------------------------------
rotate = Geometry.Rotate(geometry=toCuboid_2, origin=centroid_2, axis=ZAxis, degrees=uglovi)
centroid_3 = Solid.Centroid(solid=rotate)
width = Cuboid.Width(cuboid=rotate)
code_block_31 = CodeBlock(num=width) { Math.Round(num,3); }
UI = CodeBlock(UI=ui_multipleinputform.User_Inputs)
# ---------- UI.designscript (4 lines) ----------
//Crops Region Offset
CROTop= UI[0];
CROBot= UI[1];
CROSide= UI[2];
# ----------------------------------------
length = Cuboid.Length(cuboid=rotate)
code_block_32 = CodeBlock(num=length) { Math.Round(num,3); }
height = Cuboid.Height(cuboid=toCuboid)
code_block_33 = CodeBlock(num=height) { Math.Round(num,3); }
height_2 = Cuboid.Height(cuboid=rotate)
code_block_34 = CodeBlock(num=height_2) { Math.Round(num,3); }
sub = code_block_34 - code_block_33

code_block_35 = CodeBlock(Cuboid_Width=code_block_31, CRO_Side=UI.CROSide) { Cuboid_Width + CRO_Side + CRO_Side; }
code_block_36 = CodeBlock(Cuboid_Length=code_block_32, CRO_Side=UI.CROSide) { Cuboid_Length + CRO_Side + CRO_Side; }
code_block_37 = CodeBlock(Cuboid_Height=code_block_33, CRO_Top=UI.CROTop, CRO_Bottom=UI.CROBot) { Cuboid_Height + CRO_Top + CRO_Bottom; }

# group (continued): ELEMENT GEOMETRY SIMPLIFICATION
byLengths = Cuboid.ByLengths(origin=centroid_3, width=code_block_35, length=code_block_36, height=code_block_37)
rotate_2 = Geometry.Rotate(geometry=byLengths, origin=centroid_3, axis=ZAxis, degrees=uglovi)

code_block_38 = CodeBlock(CRO_Top=UI.CROTop, CRO_Bottom=UI.CROBot, CRO_Bottom2=sub) { CRO_Top - ((CRO_Top + CRO_Bottom + CRO_Bottom2) / 2); }

# group (continued): ELEMENT GEOMETRY SIMPLIFICATION
translate_3 = Geometry.Translate(geometry=rotate_2, direction=ZAxis, distance=code_block_38)

# group: SECTION BOUNDARY CURVES AND WORKPOINTS
section_napred_xvector = CodeBlock(vec=code_block_10) { true; vec; vecReverse = Vector.Reverse(vec); }
if_3 = RefactoredIf(test=section_napred_xvector.out0, true=section_napred_xvector.vecReverse, false=section_napred_xvector.vec)
centroid_4 = Solid.Centroid(solid=rotate_2)
byOriginXAxisYAxis = Plane.ByOriginXAxisYAxis(origin=centroid_4, xAxis=if_3, yAxis=y_vector_tj_z_vector, lacing=Longest)
firstItem_2 = List.FirstItem(list=byOriginXAxisYAxis@@L2)
intersect = Geometry.Intersect(geometry=translate_3, other=firstItem_2, lacing=Longest)
flatten_2 = List.Flatten(list=intersect)
perimeterCurves = Surface.PerimeterCurves(surface=flatten_2)
startPoint_2 = Curve.StartPoint(curve=perimeterCurves)

# group: APPLY CS AND WORKPLANE
# note: Top view:
# X=length axis element
# Y=normal at length axis
# Front view:
# X=length axis element
# Y=Global Z axis
# Cross section view:
# X=normal axis element
# Y=Global Z axis
byOriginVectors = CoordinateSystem.ByOriginVectors(origin=CSPoint, xAxis=if_3, yAxis=y_vector_tj_z_vector, lacing=Longest)

# group: UI
UI_2 = CodeBlock(UI=ui_multipleinputform.User_Inputs)
# ---------- UI_2.designscript (4 lines) ----------
//View
ViewDepth= UI[4];
VitewTemplatePogledi=UI[5];
VitewTemplateOsnove=UI[6];
# ----------------------------------------

# group: TRANSLATE TO WCS FOR minPoint / maxPoint Calc
firstItem_3 = List.FirstItem(list=byOriginVectors@@L2)
identity = CoordinateSystem.Identity()
transform = Geometry.Transform(contextCoordinateSystem=identity)  # unwired: geometry, fromCoordinateSystem
# note: As Point.X and Point.Y only work according to global WCS, the curves are transformed from the solid.centroid to the WCS in order to define the MinPoint and MaxPoint of the cut surface (offset values already included)
combine = List.Combine(comb=transform, list1=startPoint_2, list2=firstItem_3)
code_block_39 = CodeBlock(LC=combine, ViewDepth=UI_2.ViewDepth)
# ---------- code_block_39.designscript (16 lines) ----------
XXX = Point.X(LC);
minX = List.MinimumItem(XXX);
maxX = List.MaximumItem(XXX);
YYY = Point.Y(LC);
minY = List.MinimumItem(YYY);
maxY = List.MaximumItem(YYY);


CropRegionOffset = 0;
//Z value calculation
//in accordance with the
//Centroid point
//Startingpoint of sectionview
ZZZ = -CropRegionOffset;
//Relative depth of sectionview
ViewDepth-ZZZ;
# ----------------------------------------

# group: CREATE SECTION VIEW ACCORDING BOUNDING BOX
byCoordinates_5 = Point.ByCoordinates(x=code_block_39.minX, y=code_block_39.minY, z=code_block_39.ZZZ)
byCoordinates_6 = Point.ByCoordinates(x=code_block_39.maxX, y=code_block_39.maxY, z=code_block_39.out8)
byCoordinateSystemMinPointMaxPoint = SectionView.ByCoordinateSystemMinPointMaxPoint(cs=firstItem_3, minPoint=byCoordinates_5, maxPoint=byCoordinates_6)

# group: SECTION BOUNDARY CURVES AND WORKPOINTS
section_napred_xvector_2 = CodeBlock(vec=code_block_10) { false; vec; vecReverse = Vector.Reverse(vec); }
if_4 = RefactoredIf(test=section_napred_xvector_2.out0, true=section_napred_xvector_2.vecReverse, false=section_napred_xvector_2.vec)
centroid_5 = Solid.Centroid(solid=rotate_2)
byOriginXAxisYAxis_2 = Plane.ByOriginXAxisYAxis(origin=centroid_5, xAxis=if_4, yAxis=y_vector_tj_z_vector, lacing=Longest)
firstItem_4 = List.FirstItem(list=byOriginXAxisYAxis_2@@L2)
intersect_2 = Geometry.Intersect(geometry=translate_3, other=firstItem_4, lacing=Longest)
flatten_3 = List.Flatten(list=intersect_2)
perimeterCurves_2 = Surface.PerimeterCurves(surface=flatten_3)
startPoint_3 = Curve.StartPoint(curve=perimeterCurves_2)

# group: APPLY CS AND WORKPLANE
byOriginVectors_2 = CoordinateSystem.ByOriginVectors(origin=CSPoint_2, xAxis=if_4, yAxis=y_vector_tj_z_vector, lacing=Longest)

# group: TRANSLATE TO WCS FOR minPoint / maxPoint Calc
firstItem_5 = List.FirstItem(list=byOriginVectors_2@@L2)
identity_2 = CoordinateSystem.Identity()
transform_2 = Geometry.Transform(contextCoordinateSystem=identity_2)  # unwired: geometry, fromCoordinateSystem
combine_2 = List.Combine(comb=transform_2, list1=startPoint_3, list2=firstItem_5)
code_block_40 = CodeBlock(LC=combine_2, ViewDepth=UI_2.ViewDepth)  # same code as code_block_39

# group: CREATE SECTION VIEW ACCORDING BOUNDING BOX
byCoordinates_7 = Point.ByCoordinates(x=code_block_40.minX, y=code_block_40.minY, z=code_block_40.ZZZ)
byCoordinates_8 = Point.ByCoordinates(x=code_block_40.maxX, y=code_block_40.maxY, z=code_block_40.out8)
byCoordinateSystemMinPointMaxPoint_2 = SectionView.ByCoordinateSystemMinPointMaxPoint(cs=firstItem_5, minPoint=byCoordinates_7, maxPoint=byCoordinates_8)

# group: Front/Back ReName
vrata_3 = Watch(vrata)
code_block_41 = CodeBlock(elem=vrata_3)
# ---------- code_block_41.designscript (7 lines) ----------
Mark = Element.GetParameterValueByName(elem, "Mark");

FR = Mark + " - Napred";
BA = Mark +" - Pozadi";
OS = Mark +" - Osnova";

vRn = [FR, BA];
# ----------------------------------------

# group: Postavke za familiju preseka, podešavanje pogleda
familija_za_presek = List.Create(item0=byCoordinateSystemMinPointMaxPoint, item1=byCoordinateSystemMinPointMaxPoint_2)
view_depth_override = CodeBlock(sectionview1=familija_za_presek, vrednost=code_block_39.out8) { element1 = Element.SetParameterByName(sectionview1, "Far Clip Offset", vrednost); }
view_families_section = Python()  # IronPython2; unwired: IN[0]
# ---------- view_families_section.python (43 lines) ----------
#Copyright(c) 2016 www.Learndynamo.com 
#Please contact at jeremy@learndynamo.com

import clr
clr.AddReference('RevitAPI')
clr.AddReference("RevitServices")
clr.AddReference("RevitNodes")
import RevitServices
import Revit
import Autodesk
from Autodesk.Revit.DB import *
from math import *

clr.ImportExtensions(Revit.GeometryConversion)

from RevitServices.Persistence import DocumentManager
from RevitServices.Transactions import TransactionManager

doc = DocumentManager.Instance.CurrentDBDocument

toggle = IN[0]

elements = []
names = []
lst = []

#Get Family View Type
vft = 0
collector = FilteredElementCollector(doc).OfClass(ViewFamilyType).ToElements()

#eleViews = []
for i in collector:
	if i.ViewFamily == ViewFamily.Section:
		elements.append(i)
		#elements.append(i.Name)
		for j in i.Parameters:
			if j.Definition.Name == "Type Name":
				names.append(j.AsString())
		
lst.append(elements)
lst.append(names)
	
OUT = lst
# ----------------------------------------
code_block_42 = CodeBlock(item=view_families_section) { familijaPreseka=item[0][1]; elementId = Element.Id(familijaPreseka); }
change_family_type = Python(IN[0]=view_depth_override, IN[1]=code_block_42.elementId)  # IronPython2
# ---------- change_family_type.python (73 lines) ----------
# Copyright(c) 2016, Konrad Sobon
# @arch_laboratory, http://archi-lab.net

# Import ToDSType(bool) extension method
import clr
clr.AddReference("RevitNodes")
import Revit
clr.ImportExtensions(Revit.Elements)

# Import DocumentManager and TransactionManager
clr.AddReference("RevitServices")
import RevitServices
from RevitServices.Persistence import DocumentManager
from RevitServices.Transactions import TransactionManager
doc = DocumentManager.Instance.CurrentDBDocument

# Import RevitAPI
clr.AddReference("RevitAPI")
import Autodesk
from Autodesk.Revit.DB import *

import sys
pyt_path = r'C:\Program Files (x86)\IronPython 2.7\Lib'
sys.path.append(pyt_path)

#The inputs to this node will be stored as a list in the IN variable.
dataEnteringNode = IN

def ProcessList(_func, _list):
    return map( lambda x: ProcessList(_func, x) if type(x)==list else _func(x), _list )

def ProcessParallelLists(_func, *lists):
	return map( lambda *xs: ProcessParallelLists(_func, *xs) if all(type(x) is list for x in xs) else _func(*xs), *lists )

def ProcessListArg(_func, _list, _arg):
    return map( lambda x: ProcessListArg(_func, x, _arg) if type(x)==list else _func(x, _arg), _list )

def Unwrap(item):
	return UnwrapElement(item)

def ChangeType(element, typeId):
	element.ChangeTypeId(ElementId(typeId))
	return element

if isinstance(IN[0], list):
	elements = ProcessList(Unwrap, IN[0])
else:
	elements = [Unwrap(IN[0])]

typeIds = IN[1]

try:
	errorReport = None
	TransactionManager.Instance.EnsureInTransaction(doc)
	if isinstance(typeIds, list):
		output = ProcessParallelLists(ChangeType, elements, typeIds)
	else:
		output = ProcessListArg(ChangeType, elements, typeIds)
	TransactionManager.Instance.TransactionTaskDone()
except:
	# if error accurs anywhere in the process catch it
	import traceback
	errorReport = traceback.format_exc()

# End Transaction
TransactionManager.Instance.TransactionTaskDone()


#Assign your output to the OUT variable
if errorReport == None:
	OUT = output
else:
	OUT = errorReport
# ----------------------------------------
id = Element.Id(element=change_family_type)
# note: Custom Node: Orchid
o_element_byid = Orchid.RevitProject.Elements.Element.ById(id=id)
o_viewtemplate_set = Orchid.RevitProject.Views.ViewTemplate.Set(view=o_element_byid, viewTemplate=UI_2.VitewTemplatePogledi)
code_block_43 = CodeBlock(name=code_block_41.vRn, element=o_viewtemplate_set)
# ---------- code_block_43.designscript (9 lines) ----------
DSCore.List.Flatten([name]);
DSCore.List.Flatten([element]);

num = DSCore.List.Count(name);
cond = DSCore.List.Count(element) < 2 && num > 1;
repseq = DSCore.List.OfRepeatedItem(element[0],num);
nameover = cond ? repseq : element;

true;
# ----------------------------------------
# note: Custom Node: BattleBIM
setName = Custom[Element.SetName](element=code_block_43.out1, name=code_block_43.out0, reset=code_block_43.out6)  # package BattleBIM; Gets the name of a given Revit element **Forks
o_datastream_await = Orchid.Common.DataStream.Await(pass=o_viewtemplate_set, waitFor=setName.Fail)
transpose = List.Transpose(lists=o_datastream_await)

# group: podešavanje osnova
byBoundingBox = SectionView.ByBoundingBox(box=boundingBox)
view_families_section_2 = Python()  # IronPython2; unwired: IN[0]; same code as view_families_section
code_block_44 = CodeBlock(item=view_families_section_2) { familijaPreseka=item[0][1]; elementId = Element.Id(familijaPreseka); }
change_family_type_2 = Python(IN[0]=byBoundingBox, IN[1]=code_block_44.elementId)  # IronPython2; same code as change_family_type
# note: Custom Node: Orchid
o_viewtemplate_set_2 = Orchid.RevitProject.Views.ViewTemplate.Set(view=change_family_type_2, viewTemplate=UI_2.VitewTemplateOsnove)
code_block_45 = CodeBlock(name=code_block_41.OS, element=o_viewtemplate_set_2)
# ---------- code_block_45.designscript (9 lines) ----------
namez = DSCore.List.Flatten([name]);
elementz = DSCore.List.Flatten([element]);

num = List.Count(elementz);
cond = List.Count(namez) < 2 && num > 1;
repseq = List.OfRepeatedItem(namez[0],num);
cond ? repseq : namez;

true;
# ----------------------------------------

setName_2 = Python(IN[0]=code_block_45.elementz, IN[1]=code_block_45.out5, IN[2]=code_block_45.out6)  # "Element.SetName"; CPython3
# ---------- setName_2.python (31 lines) ----------
import clr
clr.AddReference('RevitAPI')
from Autodesk.Revit.DB import *

clr.AddReference("RevitNodes")
import Revit
clr.ImportExtensions(Revit.Elements)

clr.AddReference("RevitServices")
import RevitServices
from RevitServices.Persistence import DocumentManager
from RevitServices.Transactions import TransactionManager

doc = DocumentManager.Instance.CurrentDBDocument
items = UnwrapElement(IN[0])
names = IN[1]
goodlist = list()
badlist = list()
counter = 0

TransactionManager.Instance.EnsureInTransaction(doc)
while counter < len(items):
	try:
		items[counter].Name = names[counter]
		goodlist.append(items[counter].ToDSType(True))
	except:
		badlist.append(items[counter].ToDSType(True))
	counter += 1
TransactionManager.Instance.TransactionTaskDone()

OUT = (goodlist,badlist)
# ----------------------------------------
code_block_46 = CodeBlock(seq=setName_2) { seq[0]; seq[1]; }

# group (continued): podešavanje osnova
code_block_47 = CodeBlock(viewTemp=o_viewtemplate_set_2, namez=code_block_46.out0) { cekcek = DataStream.Await(viewTemp, namez); t3 = List.Transpose([cekcek]); }

# group: Postavi na list
# note: Custom Node: Orchid
o_sheet_views = SheetView()  # nothing selected
list_create = List.Create(item0=transpose, item1=code_block_47.t3)
transpose_2 = List.Transpose(lists=list_create)
code_block_48 = CodeBlock { -1; }
flatten_4 = List.Flatten(list=transpose_2@L3, amount=code_block_48)
count_2 = List.Count(list=flatten_4)
code_block_49 = CodeBlock(n=count_2) { koef = 70; x = 0..n*koef..koef; secsec = List.Chop(x, 1); y = List.Cycle([[100, 100+koef, 100+koef*2]], n); }
byCoordinates_9 = Point.ByCoordinates(x=code_block_49.x, y=code_block_49.y)
# note: Custom Node: Rhythm
ʳʰʸᵗʰᵐ_viewport_create = Rhythm.Revit.Elements.Viewport.Create(sheet=watch, view=flatten_4, location=byCoordinates_9)

# group: Detail numbering
code_block_50 = CodeBlock(viewPortz=ʳʰʸᵗʰᵐ_viewport_create)
# ---------- code_block_50.designscript (7 lines) ----------
ListaNaziva = ["3", "2", "1"];
ListaOznaka = "A".."Z";

vrednostSet = ListaOznaka<1> + ListaNaziva<2>;


elem = Element.SetParameterByName(viewPortz, "Detail Number", vrednostSet);
# ----------------------------------------

watch_2 = Watch(code_block_50.ListaOznaka)
watch_3 = Watch(code_block_50.ListaNaziva)
watch_4 = Watch(code_block_50.vrednostSet)
watch_5 = Watch(code_block_50.elem)
code_block_51 = CodeBlock(a=code_block_5.brojPraznihListi) { a; }
code_block_52 = CodeBlock(a=code_block_5.provera) { a; }
code_block_53 = CodeBlock(a=code_block_4.MarkZ) { a; }
facingOrientation_2 = FamilyInstance.FacingOrientation(familyInstance=vrata)  # frozen
string_from_object_6 = FromObject(object=clear_list)
