# Dynamo graph A05.4 Pod i plafon od soba.dyn (Dynamo 2.3.1.11775)
# packages: Data-Shapes 2019.2.44

# group: Linije sobe
placedRooms = Python()  # "Collector.PlacedRooms"; unwired: IN[0]
# ---------- placedRooms.python (36 lines) ----------
#Copyright(c) 2017, john pierson
# @60secondrevit, http://sixtysecondrevit.com

import clr
clr.AddReference('ProtoGeometry')
from Autodesk.DesignScript.Geometry import *

# Import DocumentManager and TransactionManager
clr.AddReference("RevitServices")
import RevitServices
from RevitServices.Persistence import DocumentManager
from RevitServices.Transactions import TransactionManager

# Import RevitAPI
clr.AddReference("RevitAPI")
import Autodesk
from Autodesk.Revit.DB import *

doc = DocumentManager.Instance.CurrentDBDocument
uiapp = DocumentManager.Instance.CurrentUIApplication
app = uiapp.Application

from System.Collections.Generic import *


#The inputs to this node will be stored as a list in the IN variable.
dataEnteringNode = IN
collector = FilteredElementCollector(doc)
rooms = collector.OfCategory(BuiltInCategory.OST_Rooms).ToElements()

roomInstances = []
for i in rooms:
	if i.Area != 0:
		roomInstances.append(i)

OUT = roomInstances
# ----------------------------------------
code_block = CodeBlock { 1..10; }
code_block_2 = CodeBlock { 1; }
code_block_3 = CodeBlock { 1; }
code_block_4 = CodeBlock { 1; }
code_block_5 = CodeBlock { 1; }
boolean = BoolSelector(true)

finishBoundary = Room.FinishBoundary(room=placedRooms)

# group (continued): Linije sobe
removeItemAtIndex = List.RemoveItemAtIndex(list=finishBoundary@L3, indices=code_block)
flatten = List.Flatten(list=removeItemAtIndex, amt=code_block_2)
startPoint = Curve.StartPoint(curve=flatten)
tangentAtParameter = Curve.TangentAtParameter(curve=flatten, param=code_block_3)
shiftIndices = List.ShiftIndices(list=flatten@L2, amount=code_block_4)
tangentAtParameter_2 = Curve.TangentAtParameter(curve=shiftIndices, param=code_block_5)
isAlmostEqualTo = Vector.IsAlmostEqualTo(vector=tangentAtParameter, other=tangentAtParameter_2)
filterByBoolMask = List.FilterByBoolMask(list=startPoint, mask=isAlmostEqualTo)
reverse = List.Reverse(list=filterByBoolMask.out@L2)
X = Point.X(point=reverse)
Y = Point.Y(point=reverse)
add = X + Y
maximumItem = List.MaximumItem(list=add)
indexOf = List.IndexOf(list=add, element=maximumItem, lacing=Longest)
code_block_6 = CodeBlock(x=indexOf) { x*-1; }
shiftIndices_2 = List.ShiftIndices(list=reverse@L2, amount=code_block_6, lacing=Longest)
byPoints = PolyCurve.ByPoints(points=shiftIndices_2, connectLastToFirst=boolean)
closeWithLine = PolyCurve.CloseWithLine(polyCurve=byPoints)
ꟿ_polycurve_points = CodeBlock(pc=closeWithLine)
# ---------- ꟿ_polycurve_points.designscript (11 lines) ----------
pc;
c = pc.Curves();
sp = c.StartPoint;
pts = [Imperative]{
if (!pc.IsClosed)
{
return = List.AddItemToEnd(
  c[-1].EndPoint, sp);
}
return = sp;
};
# ----------------------------------------

# group: Verzije
code_block_7 = CodeBlock()
# ---------- code_block_7.designscript (4 lines) ----------
"V3";
//"korigovani package-i
"V4";
//"data shapes opcije, spojeni roof i floor po izboru
# ----------------------------------------

code_block_8 = CodeBlock(verzija=code_block_7.out1) { tekst= "Floor and roof by room "; opis = tekst + verzija; }

# group: Izbor podova
code_block_9 = CodeBlock { "Podovi (Floors)"; }
code_block_10 = CodeBlock { "Postavi pod?"; true; " "; }
ui_boolean_input = Custom[UI.Boolean input](InputName=code_block_10.out0, DefaultValue=code_block_10.out1, SideText=code_block_10.out2)  # package Data-Shapes; Creates a boolean input for UI.MultipleInputForm ++ . Check out www.data-shapes.net for more infos!
collector_element_type_class = Python()  # "Collector.Element type (Class) - FloorType"; unwired: IN[0]
# ---------- collector_element_type_class.python (35 lines) ----------
#Copyright(c) 2017, john pierson
# @60secondrevit, http://sixtysecondrevit.com

import clr
clr.AddReference('ProtoGeometry')
from Autodesk.DesignScript.Geometry import *

# Import DocumentManager and TransactionManager
clr.AddReference("RevitServices")
import RevitServices
from RevitServices.Persistence import DocumentManager
from RevitServices.Transactions import TransactionManager

# Import RevitAPI
clr.AddReference("RevitAPI")
import Autodesk
from Autodesk.Revit.DB import *

doc = DocumentManager.Instance.CurrentDBDocument
uiapp = DocumentManager.Instance.CurrentUIApplication
app = uiapp.Application

from System.Collections.Generic import *


#The inputs to this node will be stored as a list in the IN variable.
dataEnteringNode = IN
collector = FilteredElementCollector(doc)
roofs = collector.OfClass(FloorType).ToElements()


#OfType(BuiltInCategory.OST_RoofType).ToElements()


OUT = roofs;
# ----------------------------------------
code_block_11 = CodeBlock(lvlv=collector_element_type_class) { "Izbor tipa koji će biti postavljen"; imeKrova = Revit.Elements.Element.Name(lvlv); value=lvlv; 1; }
ui_dropdown_data = Custom[UI.DropDown Data](InputName=code_block_11.out0, Keys=code_block_11.imeKrova, Values=code_block_11.value, DefaultValueIndex=code_block_11.out3)  # package Data-Shapes; Create data for DropDown input in UI.MultiInputForm ++ . Check out www.data-shapes.net for more infos.
collector_element_type_class_2 = Python()  # "Collector.Element type (Class) - Level"; unwired: IN[0]
# ---------- collector_element_type_class_2.python (35 lines) ----------
#Copyright(c) 2017, john pierson
# @60secondrevit, http://sixtysecondrevit.com

import clr
clr.AddReference('ProtoGeometry')
from Autodesk.DesignScript.Geometry import *

# Import DocumentManager and TransactionManager
clr.AddReference("RevitServices")
import RevitServices
from RevitServices.Persistence import DocumentManager
from RevitServices.Transactions import TransactionManager

# Import RevitAPI
clr.AddReference("RevitAPI")
import Autodesk
from Autodesk.Revit.DB import *

doc = DocumentManager.Instance.CurrentDBDocument
uiapp = DocumentManager.Instance.CurrentUIApplication
app = uiapp.Application

from System.Collections.Generic import *


#The inputs to this node will be stored as a list in the IN variable.
dataEnteringNode = IN
collector = FilteredElementCollector(doc)
lvlv = collector.OfClass(Level).ToElements()


#OfType(BuiltInCategory.OST_RoofType).ToElements()


OUT = lvlv;
# ----------------------------------------
code_block_12 = CodeBlock(lvlv=collector_element_type_class_2) { "Izbor nivoa na kome se postavlja krov"; imeLevela = Revit.Elements.Element.Name(lvlv); value=lvlv; 0; }
ui_dropdown_data_2 = Custom[UI.DropDown Data](InputName=code_block_12.out0, Keys=code_block_12.imeLevela, Values=code_block_12.value, DefaultValueIndex=code_block_12.out3)
list_create = List.Create(item0=ui_boolean_input, item1=ui_dropdown_data, item2=ui_dropdown_data_2)
# note: Custom Node: Data-Shapes v.2019.2.44
ui_inputgroup_data = Custom[UI.InputGroup Data](GroupTitle=code_block_9, Inputs=list_create)  # package Data-Shapes; Creates a group of inputs for UI.MultipleInputForm ++ . Check out www.data-shapes.net for more infos !

# group: Izbor Plafona
code_block_13 = CodeBlock { "Krovovi (Roofs)"; }
code_block_14 = CodeBlock { "Postavi krov?"; true; " "; }
ui_boolean_input_2 = Custom[UI.Boolean input](InputName=code_block_14.out0, DefaultValue=code_block_14.out1, SideText=code_block_14.out2)
collector_element_type_class_3 = Python()  # "Collector.Element type (Class) - RoofType"; unwired: IN[0]
# ---------- collector_element_type_class_3.python (35 lines) ----------
#Copyright(c) 2017, john pierson
# @60secondrevit, http://sixtysecondrevit.com

import clr
clr.AddReference('ProtoGeometry')
from Autodesk.DesignScript.Geometry import *

# Import DocumentManager and TransactionManager
clr.AddReference("RevitServices")
import RevitServices
from RevitServices.Persistence import DocumentManager
from RevitServices.Transactions import TransactionManager

# Import RevitAPI
clr.AddReference("RevitAPI")
import Autodesk
from Autodesk.Revit.DB import *

doc = DocumentManager.Instance.CurrentDBDocument
uiapp = DocumentManager.Instance.CurrentUIApplication
app = uiapp.Application

from System.Collections.Generic import *


#The inputs to this node will be stored as a list in the IN variable.
dataEnteringNode = IN
collector = FilteredElementCollector(doc)
roofs = collector.OfClass(RoofType).ToElements()


#OfType(BuiltInCategory.OST_RoofType).ToElements()


OUT = roofs;
# ----------------------------------------
code_block_15 = CodeBlock(lvlv=collector_element_type_class_3) { "Izbor tipa koji će biti postavljen"; imeKrova = Revit.Elements.Element.Name(lvlv); value=lvlv; 5; }
ui_dropdown_data_3 = Custom[UI.DropDown Data](InputName=code_block_15.out0, Keys=code_block_15.imeKrova, Values=code_block_15.value, DefaultValueIndex=code_block_15.out3)
collector_element_type_class_4 = Python()  # "Collector.Element type (Class) - Level"; unwired: IN[0]; same code as collector_element_type_class_2
code_block_16 = CodeBlock(lvlv=collector_element_type_class_4) { "Izbor nivoa na kome se postavlja krov"; imeLevela = Revit.Elements.Element.Name(lvlv); value=lvlv; 1; }
ui_dropdown_data_4 = Custom[UI.DropDown Data](InputName=code_block_16.out0, Keys=code_block_16.imeLevela, Values=code_block_16.value, DefaultValueIndex=code_block_16.out3)
code_block_17 = CodeBlock { "Offset od zida"; -40; 0; -40; 40; }
slider = Custom[UI.Slider](InputName=code_block_17.out0, Minimum=code_block_17.out1, Maximum=code_block_17.out2, Default_Value=code_block_17.out3, Step=code_block_17.out4)  # package Data-Shapes; Creates slider input for UI.MultipleInputForm ++ . Set the step to decimal value if you want a double slider, or to a integer value if you want an integer slider.
code_block_18 = CodeBlock { "Napomena:"; "Kod klasičnih zidova, je potrebno staviti na 0, dok se kod CurtainPanela stavlja na -40"; }
ui_textnote_data = Custom[UI.TextNote Data](Title=code_block_18.out0, TextNote=code_block_18.out1)  # package Data-Shapes; Create Data for TextNote input in UI.MultipleInputForm ++ . Check out www.data-shapes.net for more informations
list_create_2 = List.Create(item0=ui_boolean_input_2, item1=ui_dropdown_data_3, item2=ui_dropdown_data_4, item3=slider, item4=ui_textnote_data)
# note: Custom Node: Data-Shapes v.2019.2.44
ui_inputgroup_data_2 = Custom[UI.InputGroup Data](GroupTitle=code_block_13, Inputs=list_create_2)

# group: Interfejs
code_block_19 = CodeBlock { "Done"; true; "Cancel"; 400; }
byPoints_2 = PolyCurve.ByPoints(points=ꟿ_polycurve_points.out3@@L2, connectLastToFirst=code_block_19.out1)
file_path = Filename("Z:\Čiste Sobe\T1.png")
file_from_path = FileObject(path=file_path)
readFromFile = Image.ReadFromFile(file=file_from_path)
create = List.Create(item0=ui_inputgroup_data, item1=ui_inputgroup_data_2)
# note: Custom Node: Data-Shapes v.2019.2.44
ui_multipleinputform = Custom[UI.MultipleInputForm ++](Description_optional=code_block_8.opis, Logo_optional=readFromFile, ButtonText_optional=code_block_19.out0, Inputs=create, Toggle=code_block_19.out1, CancelButtonText_optional=code_block_19.out2, Width_optional=code_block_19.out3)  # package Data-Shapes; Create a form with multiple inputs. see www.data-shapes.net for tutorials and infos!
code_block_20 = CodeBlock(a=ui_multipleinputform.User_Inputs)
# ---------- code_block_20.designscript (14 lines) ----------
// YesNo Podovi
a[0];
// Tip Poda
a[1];
// Nivo Poda
a[2];
// Offset Plafona
a[6];
// Tip Plafona
a[4];
// Nivo Plafona
a[5];
// YesNo Plafona
a[3];
# ----------------------------------------

# group: Set Plafoni
watch = Watch(code_block_20.out3)
offset = Curve.Offset(curve=byPoints_2, distance=watch)
watch_2 = Watch(code_block_20.out6)
watch_3 = Watch(code_block_20.out4)
code_block_21 = CodeBlock(roofElement=watch_3) { roofName = Revit.Elements.Element.Name(roofElement); roofType = RoofType.ByName(roofName); }
code_block_22 = CodeBlock { null; }
if_ = If(test=watch_2, true=code_block_21.roofType, false=code_block_22)
watch_4 = Watch(code_block_20.out5)
byOutlineTypeAndLevel = Roof.ByOutlineTypeAndLevel(outline=offset@L1, roofType=if_, level=watch_4)  # graph output

# group: Set Podovi
watch_5 = Watch(code_block_20.out0)
watch_6 = Watch(code_block_20.out1)
codeBlock = CodeBlock { null; }
if_2 = If(test=watch_5, true=watch_6, false=codeBlock)
watch_7 = Watch(code_block_20.out2)
byOutlineTypeAndLevel_2 = Floor.ByOutlineTypeAndLevel(outlineCurves=byPoints_2, floorType=if_2, level=watch_7)
