# Dynamo graph A06.3 Place legend views.dyn (Dynamo 2.3.1.11775)
# packages: Data-Shapes 2019.2.44

# group: Napomena
opis = StringInput("""1. Klikni na dugme za izbor legende čija pozicija treba da bude kopirana na druge listove

2. Izaberi legendu sa crteža koja treba da se postavi na kategoriju crteža""")
# note: Custom Node: Data-Shapes v.2019.2.44
ui_textnote_data = Custom[UI.TextNote Data](TextNote=opis)  # package Data-Shapes; Create Data for TextNote input in UI.MultipleInputForm ++ . Check out www.data-shapes.net for more informations

# group: Izaberi uzornu legendu
code_block = CodeBlock { "1. Izbor uzorne legende za kopiranje na druge listove"; }
string = StringInput("Izabrati sa crteža (sheet)")
string_2 = StringInput("Izaberi legendu po svojoj meri i dobro pazi, ne dozvoli da te gazi")
boolean = BoolSelector(true)
# note: Custom Node: Data-Shapes v.2019.2.44
ui_selectmodelelements_data = Custom[UI.SelectModelElements Data](InputName=string, ButtonText=string_2, SelectSingleElement=boolean)  # package Data-Shapes; Creates a Revit element selection input for UI.MultipleInputForm++ . Check out www.data-shapes.net for more infos!
ui_inputgroup_data = Custom[UI.InputGroup Data](GroupTitle=code_block, Inputs=ui_selectmodelelements_data)  # package Data-Shapes; Creates a group of inputs for UI.MultipleInputForm ++ . Check out www.data-shapes.net for more infos !
opis_2 = StringInput("""1. Klikni na dugme za izbor legende
2. Izaberi legendu sa crteža koja treba da se postavi na kategoriju crteža""")

# group: Izbor kategorije crteža
code_block_2 = CodeBlock { "2. Izbor kategorije crteža"; }
codeBlock = CodeBlock { "03 Osnove"; "04 Pogledi"; 1; }
list_create = List.Create(item0=codeBlock.out0, item1=codeBlock.out1)
# note: Custom Node: Data-Shapes v.2019.2.44
ui_dropdown_data = Custom[UI.DropDown Data](Keys=list_create, Values=list_create, DefaultValueIndex=codeBlock.out2)  # package Data-Shapes; Create data for DropDown input in UI.MultiInputForm ++ . Check out www.data-shapes.net for more infos.
ui_inputgroup_data_2 = Custom[UI.InputGroup Data](GroupTitle=code_block_2, Inputs=ui_dropdown_data)

# group: Interfejs
file_path = Filename("Z:\Čiste Sobe\T1.png")
file_from_path = FileObject(path=file_path)
readFromFile = Image.ReadFromFile(file=file_from_path)
codeBlock_2 = CodeBlock { "Done"; true; "Cancel"; 600; }
create = List.Create(item0=ui_textnote_data, item1=ui_inputgroup_data, item2=ui_inputgroup_data_2)
ui_multipleinputform = Custom[UI.MultipleInputForm ++](Logo_optional=readFromFile, ButtonText_optional=codeBlock_2.out0, Inputs=create, Toggle=codeBlock_2.out1, CancelButtonText_optional=codeBlock_2.out2, Width_optional=codeBlock_2.out3)  # package Data-Shapes; Create a form with multiple inputs. see www.data-shapes.net for tutorials and infos!
code_block_3 = CodeBlock(a=ui_multipleinputform.User_Inputs)
# ---------- code_block_3.designscript (4 lines) ----------
// Legenda
a[0];
// Kategorija Crteža
a[1];
# ----------------------------------------

code_block_4 = CodeBlock(t1=code_block_3.out0) { element1 = Rhythm.Viewport.GetView(t1); }
get_all_sheets_in_project_py = Python()
# ---------- get_all_sheets_in_project_py.python (33 lines) ----------
import clr
# import Document Manager
clr.AddReference("RevitServices")
import RevitServices 
from RevitServices.Persistence import DocumentManager
from RevitServices.Transactions import TransactionManager
doc = DocumentManager.Instance.CurrentDBDocument
uidoc = DocumentManager.Instance.CurrentUIDocument
clr.AddReference("RevitNodes")
import Revit
clr.ImportExtensions(Revit.Elements)
clr.ImportExtensions(Revit.GeometryConversion)
clr.AddReference("RevitAPI")
from Autodesk.Revit.DB import *

dataEnteringNode = IN

sheets = []
sheetNum = []
sheetName = []

coll = FilteredElementCollector(doc)
vSheets = coll.OfClass(ViewSheet)

for vs in vSheets:
	sht = UnwrapElement(vs)
	sheetNum.Add(sht.SheetNumber)
	sheetName.Add(sht.Name)
	sheets.Add(sht)

OUT = [sheets,sheetNum,sheetName]
	
#For more information refer to RBG Wiki or email me (ctrl + click link): daniel.woodcock@robertbird.com
# ----------------------------------------
code_block_5 = CodeBlock(a=get_all_sheets_in_project_py) { a[0]; }
string_3 = StringInput("KATEGORIJA CRTEZA")
getParameterValueByName = Element.GetParameterValueByName(element=code_block_5, parameterName=string_3)
eq = getParameterValueByName == code_block_3.out1
filterByBoolMask = List.FilterByBoolMask(list=code_block_5, mask=eq)
code_block_6 = CodeBlock(t1=code_block_3.out0)
# ---------- code_block_6.designscript (4 lines) ----------
t2 = Rhythm.Viewport.LocationData(t1);
t3 = Dictionary.ValueAtKey(t2, "bBox");
t4 = Dictionary.ValueAtKey(t2, "boxCenter");
t5 = Dictionary.ValueAtKey(t2, "boxOutline");
# ----------------------------------------
watch = Watch(code_block_6.t4)
X = Point.X(point=watch)
convert_between_units = DynamoConvert(X, MeasurementType="Length", FromConversion="Millimeters", ToConversion="Feet")
Y = Point.Y(point=watch)
convert_between_units_2 = DynamoConvert(Y, MeasurementType="Length", FromConversion="Millimeters", ToConversion="Feet")
Z = Point.Z(point=watch)
convert_between_units_3 = DynamoConvert(Z, MeasurementType="Length", FromConversion="Millimeters", ToConversion="Feet")
byCoordinates = Point.ByCoordinates(x=convert_between_units, y=convert_between_units_2, z=convert_between_units_3)
place_legend_on_sheets_py = Python(IN[0]=code_block_4, IN[1]=filterByBoolMask.in, IN[2]=byCoordinates)
# ---------- place_legend_on_sheets_py.python (40 lines) ----------
import clr
# import Document Manager
clr.AddReference("RevitServices")
import RevitServices 
from RevitServices.Persistence import DocumentManager
from RevitServices.Transactions import TransactionManager
doc = DocumentManager.Instance.CurrentDBDocument
uidoc = DocumentManager.Instance.CurrentUIDocument
clr.AddReference("RevitNodes")
import Revit
clr.ImportExtensions(Revit.Elements)
clr.ImportExtensions(Revit.GeometryConversion)
clr.AddReference("RevitAPI")
from Autodesk.Revit.DB import *

dataEnteringNode = IN

legend = UnwrapElement(IN[0])
sheets = IN[1]
loc = XYZ(IN[2].X, IN[2].Y, IN[2].Z)
viewports = []
failed = []

for vs in sheets:
	sheet = UnwrapElement(vs)
	canAddToSht = Viewport.CanAddViewToSheet(doc, sheet.Id, legend.Id)
	if canAddToSht:
		try:		
			TransactionManager.Instance.EnsureInTransaction(doc)	
			viewport = Viewport.Create(doc, sheet.Id, legend.Id, loc)	
			TransactionManager.Instance.TransactionTaskDone()
			viewports.Add([viewport,sheet])
		except:
			failed.Add(["Failed",sheet])
	else:
		failed.Add(["Failed",sheet])
		
OUT = [viewports, failed]
	
#For more information refer to RBG Wiki or email me (ctrl + click link): daniel.woodcock@robertbird.com
# ----------------------------------------
succeded = CodeBlock(a=place_legend_on_sheets_py) { a[0]; }
failed = CodeBlock(a=place_legend_on_sheets_py) { a[1]; }

# group: Verzije
code_block_7 = CodeBlock()
# ---------- code_block_7.designscript (2 lines) ----------
//V3
"Korigovani data shapes, da ima sve opcije, i korigovani package-i";
# ----------------------------------------
