# Dynamo graph A07.1 Center Rooms And Tags.dyn (Dynamo 2.3.1.11775)

placedRooms = Python()  # "Collector.PlacedRooms"; unwired: IN[0]
# ---------- placedRooms.python (36 lines) ----------
#Copyright(c) 2017, john pierson
# @60secondrevit, http://sixtysecondrevit.com

import clr
clr.AddReference('ProtoGeometry')
from Autodesk.DesignScript.Geometry import *

# Import DocumentManager and TransactionManager
clr.AddReference("RevitServices")
import RevitServices
from RevitServices.Persistence import DocumentManager
from RevitServices.Transactions import TransactionManager

# Import RevitAPI
clr.AddReference("RevitAPI")
import Autodesk
from Autodesk.Revit.DB import *

doc = DocumentManager.Instance.CurrentDBDocument
uiapp = DocumentManager.Instance.CurrentUIApplication
app = uiapp.Application

from System.Collections.Generic import *


#The inputs to this node will be stored as a list in the IN variable.
dataEnteringNode = IN
collector = FilteredElementCollector(doc)
rooms = collector.OfCategory(BuiltInCategory.OST_Rooms).ToElements()

roomInstances = []
for i in rooms:
	if i.Area != 0:
		roomInstances.append(i)

OUT = roomInstances
# ----------------------------------------
collector_element_category = Python()  # "Collector.Element Category (Category) - Room Tags"; unwired: IN[0]
# ---------- collector_element_category.python (32 lines) ----------
#Copyright(c) 2017, john pierson
# @60secondrevit, http://sixtysecondrevit.com

import clr
clr.AddReference('ProtoGeometry')
from Autodesk.DesignScript.Geometry import *

# Import DocumentManager and TransactionManager
clr.AddReference("RevitServices")
import RevitServices
from RevitServices.Persistence import DocumentManager
from RevitServices.Transactions import TransactionManager

# Import RevitAPI
clr.AddReference("RevitAPI")
import Autodesk
from Autodesk.Revit.DB import *

doc = DocumentManager.Instance.CurrentDBDocument
uiapp = DocumentManager.Instance.CurrentUIApplication
app = uiapp.Application

from System.Collections.Generic import *


#The inputs to this node will be stored as a list in the IN variable.
dataEnteringNode = IN
collector = FilteredElementCollector(doc)
roofs = collector.OfCategory(BuiltInCategory.OST_RoomTags).ToElements()


OUT = roofs;
# ----------------------------------------
code_block = CodeBlock(roomzCollector=placedRooms, tagzCollector=collector_element_category)
# ---------- code_block.designscript (6 lines) ----------
roomz = Rooms.CenterRoom(roomzCollector);
tagz = DataStream.Await(tagzCollector, roomz);

categoryz = Revit.Elements.Element.GetCategory(tagz);

DSCore.List.UniqueItems(categoryz);
# ----------------------------------------
all_elements_of_category = ElementsOfCategory(Category=code_block.out3)
code_block_2 = CodeBlock(elementz=all_elements_of_category) { roomTagz = RoomTag.CenterOnRoomLocation(elementz); comp = roomTagz != null; truez = DSCore.List.Flatten(comp, -1); }
popUp = Python(IN[0]=code_block_2.truez)
# ---------- popUp.python (36 lines) ----------
import clr
clr.AddReference("RevitAPI")
clr.AddReference("ProtoGeometry")
clr.AddReference("RevitNodes")
clr.AddReference("RevitServices")
clr.AddReference("RevitAPIUI")
clr.AddReference("DSCoreNodes")
import DSCore
from DSCore import *
import Autodesk
import Revit
clr.ImportExtensions(Revit.GeometryConversion)
import RevitServices
from Autodesk.Revit.UI import TaskDialog
from Autodesk.Revit.DB import *
from Autodesk.DesignScript.Geometry import *

clr.AddReference("System.Windows.Forms")
from System.Windows.Forms import Form,Label,FormStartPosition

#input
sisenjorita = IN[0]

text = "Centriranje je završeno!"

msgBox=TaskDialog
result = []

if sisenjorita:
	
	msgBox.Show("Error: ",text)
else:
	markr = mark
	pass
	
OUT = text
# ----------------------------------------
