# Dynamo graph B00.0 Python skripte.dyn (Dynamo 2.12.1.8246)

all_categories = Python()  # IronPython2; unwired: IN[0]
# ---------- all_categories.python (16 lines) ----------
import clr

# Import DocumentManager and TransactionManager
clr.AddReference("RevitServices")
import RevitServices
from RevitServices.Persistence import DocumentManager

# Import RevitAPI
clr.AddReference("RevitAPI")
import Autodesk
from Autodesk.Revit.DB import *

doc = DocumentManager.Instance.CurrentDBDocument


OUT = [i.Name for i in doc.Settings.Categories]
# ----------------------------------------
python_disallow_joins = Python()  # IronPython2; unwired: IN[0]
# ---------- python_disallow_joins.python (58 lines) ----------
##### Start of generic stuff imports

import clr

# import Revit API
clr.AddReference("RevitAPI")
import Autodesk
from Autodesk.Revit.DB import *

# import Revit Elements
clr.AddReference("RevitNodes")
import Revit
clr.ImportExtensions(Revit.Elements)

# import DocumentManager and TransactionManager
clr.AddReference("RevitServices")
import RevitServices
from RevitServices.Persistence import DocumentManager
from RevitServices.Transactions import TransactionManager

# get current Revit document
doc = DocumentManager.Instance.CurrentDBDocument

##### End of generic stuff imports



# Unwrap input
inputs = UnwrapElement( IN[0] )
curtainWalls = []
# Initiate counter
n = 0


# Get only curtain walls from input
for e in inputs:
	try:
		elementType = doc.GetElement(e.GetTypeId())
		if elementType.Kind == WallKind.Curtain:
			curtainWalls.append(e)
			n = n + 1
	except:
		print("not curtain wall")


# Start Transaction
TransactionManager.Instance.EnsureInTransaction(doc)

for e in curtainWalls:
    Autodesk.Revit.DB.WallUtils.DisallowWallJoinAtEnd(e, 0)
    Autodesk.Revit.DB.WallUtils.DisallowWallJoinAtEnd(e, 1)

# End Transaction
TransactionManager.Instance.TransactionTaskDone()


# Wrap results
OUT = ["Disallowed joins on walls: " + str(n), curtainWalls]
# ----------------------------------------
placedRooms = Python()  # "Collector.PlacedRooms"; IronPython2; unwired: IN[0]
# ---------- placedRooms.python (36 lines) ----------
#Copyright(c) 2017, john pierson
# @60secondrevit, http://sixtysecondrevit.com

import clr
clr.AddReference('ProtoGeometry')
from Autodesk.DesignScript.Geometry import *

# Import DocumentManager and TransactionManager
clr.AddReference("RevitServices")
import RevitServices
from RevitServices.Persistence import DocumentManager
from RevitServices.Transactions import TransactionManager

# Import RevitAPI
clr.AddReference("RevitAPI")
import Autodesk
from Autodesk.Revit.DB import *

doc = DocumentManager.Instance.CurrentDBDocument
uiapp = DocumentManager.Instance.CurrentUIApplication
app = uiapp.Application

from System.Collections.Generic import *


#The inputs to this node will be stored as a list in the IN variable.
dataEnteringNode = IN
collector = FilteredElementCollector(doc)
rooms = collector.OfCategory(BuiltInCategory.OST_Rooms).ToElements()

roomInstances = []
for i in rooms:
	if i.Area != 0:
		roomInstances.append(i)

OUT = roomInstances
# ----------------------------------------
all_parameter_groups = Python()  # IronPython2; unwired: IN[0]
# ---------- all_parameter_groups.python (16 lines) ----------
import sys
import clr

clr.AddReference('RevitAPI')
import Autodesk
from Autodesk.Revit.DB import *

import System

listBPG = dict(zip(System.Enum.GetNames(BuiltInParameterGroup),System.Enum.GetValues(BuiltInParameterGroup)))
out = []
for name, bpg in listBPG.items():
    labelbpg = LabelUtils.GetLabelFor(bpg)
    out.append([labelbpg, name])

OUT = out
# ----------------------------------------
toString = Python()  # IronPython2; unwired: IN[0]
# ---------- toString.python (20 lines) ----------
# Made by Gavin Crump
# Free for use
# BIM Guru, www.bimguru.com.au

# Get inputs
items = IN[0] if isinstance(IN[0], list) else [IN[0]]

# Convert to strings
strings = []

for i in items:
	tostr = str(i)
	try:
		ind = tostr.index(".")
		strings.append(tostr[:ind])
	except:
		strings.append(tostr)

# Define outputs
OUT = strings
# ----------------------------------------
select_in_revit = Python()  # IronPython2; unwired: IN[0]
# ---------- select_in_revit.python (36 lines) ----------
import clr
clr.AddReference('ProtoGeometry')
from Autodesk.DesignScript.Geometry import *

clr.AddReference("RevitNodes")
import Revit
clr.ImportExtensions(Revit.Elements)

clr.ImportExtensions(Revit.GeometryConversion)

clr.AddReference("RevitServices")
import RevitServices
from RevitServices.Persistence import DocumentManager
from RevitServices.Transactions import TransactionManager
from System.Collections.Generic import *

clr.AddReference("RevitAPI")
import Autodesk
from Autodesk.Revit.DB import *

doc = DocumentManager.Instance.CurrentDBDocument
uiapp = DocumentManager.Instance.CurrentUIApplication
app = uiapp.Application
uidoc=DocumentManager.Instance.CurrentUIApplication.ActiveUIDocument

select = []
elements = UnwrapElement(IN[0])
uisel = uidoc.Selection
result = []

for i in elements:
	select.append(i.Id)
	Icollection = List[ElementId](select)
	uisel.SetElementIds(Icollection)
	result.append("Seccess")
OUT = result
# ----------------------------------------
collector_element_type_class = Python()  # "Collector.Element type (Class) - RoofType"; IronPython2; unwired: IN[0]
# ---------- collector_element_type_class.python (35 lines) ----------
#Copyright(c) 2017, john pierson
# @60secondrevit, http://sixtysecondrevit.com

import clr
clr.AddReference('ProtoGeometry')
from Autodesk.DesignScript.Geometry import *

# Import DocumentManager and TransactionManager
clr.AddReference("RevitServices")
import RevitServices
from RevitServices.Persistence import DocumentManager
from RevitServices.Transactions import TransactionManager

# Import RevitAPI
clr.AddReference("RevitAPI")
import Autodesk
from Autodesk.Revit.DB import *

doc = DocumentManager.Instance.CurrentDBDocument
uiapp = DocumentManager.Instance.CurrentUIApplication
app = uiapp.Application

from System.Collections.Generic import *


#The inputs to this node will be stored as a list in the IN variable.
dataEnteringNode = IN
collector = FilteredElementCollector(doc)
roofs = collector.OfClass(RoofType).ToElements()


#OfType(BuiltInCategory.OST_RoofType).ToElements()


OUT = roofs;
# ----------------------------------------
collector_element_category = Python()  # "Collector.Element Category (Category) - Roof"; IronPython2; unwired: IN[0]
# ---------- collector_element_category.python (32 lines) ----------
#Copyright(c) 2017, john pierson
# @60secondrevit, http://sixtysecondrevit.com

import clr
clr.AddReference('ProtoGeometry')
from Autodesk.DesignScript.Geometry import *

# Import DocumentManager and TransactionManager
clr.AddReference("RevitServices")
import RevitServices
from RevitServices.Persistence import DocumentManager
from RevitServices.Transactions import TransactionManager

# Import RevitAPI
clr.AddReference("RevitAPI")
import Autodesk
from Autodesk.Revit.DB import *

doc = DocumentManager.Instance.CurrentDBDocument
uiapp = DocumentManager.Instance.CurrentUIApplication
app = uiapp.Application

from System.Collections.Generic import *


#The inputs to this node will be stored as a list in the IN variable.
dataEnteringNode = IN
collector = FilteredElementCollector(doc)
roofs = collector.OfCategory(BuiltInCategory.OST_Roofs).ToElements()


OUT = roofs;
# ----------------------------------------
collector_element_category_2 = Python()  # "Collector.Element Category (Category) - Walls in Model"; IronPython2; unwired: IN[0]
# ---------- collector_element_category_2.python (54 lines) ----------
#Copyright(c) 2017, john pierson
# @60secondrevit, http://sixtysecondrevit.com

import clr
clr.AddReference('ProtoGeometry')
from Autodesk.DesignScript.Geometry import *

# Import DocumentManager and TransactionManager
clr.AddReference("RevitServices")
import RevitServices
from RevitServices.Persistence import DocumentManager
from RevitServices.Transactions import TransactionManager

# Import RevitAPI
clr.AddReference("RevitAPI")
import Autodesk
from Autodesk.Revit.DB import *

doc = DocumentManager.Instance.CurrentDBDocument
uiapp = DocumentManager.Instance.CurrentUIApplication
app = uiapp.Application

from System.Collections.Generic import *

spoji = IN[0]

#The inputs to this node will be stored as a list in the IN variable.
dataEnteringNode = IN
collector = FilteredElementCollector(doc)
collector.WhereElementIsNotElementType().WhereElementIsViewIndependent();

kolektor = collector.OfCategory(BuiltInCategory.OST_Walls).ToElements()

# Start Transaction
doc = DocumentManager.Instance.CurrentDBDocument
TransactionManager.Instance.EnsureInTransaction(doc)

zidovi = UnwrapElement(kolektor)

for e in zidovi: 
	if spoji:
		WallUtils.DisallowWallJoinAtEnd(e, 0)
		WallUtils.DisallowWallJoinAtEnd(e, 1)
	else :
		WallUtils.AllowWallJoinAtEnd(e, 0)
		WallUtils.AllowWallJoinAtEnd(e, 1)



	# End Transaction
TransactionManager.Instance.TransactionTaskDone()


OUT = kolektor;
# ----------------------------------------
sheets = Python()  # "Collector.Sheets"; IronPython2
# ---------- sheets.python (31 lines) ----------
#Copyright(c) 2017, john pierson
# @60secondrevit, http://sixtysecondrevit.com

import clr
clr.AddReference('ProtoGeometry')
from Autodesk.DesignScript.Geometry import *

# Import DocumentManager and TransactionManager
clr.AddReference("RevitServices")
import RevitServices
from RevitServices.Persistence import DocumentManager
from RevitServices.Transactions import TransactionManager

# Import RevitAPI
clr.AddReference("RevitAPI")
import Autodesk
from Autodesk.Revit.DB import *

doc = DocumentManager.Instance.CurrentDBDocument
uiapp = DocumentManager.Instance.CurrentUIApplication
app = uiapp.Application

from System.Collections.Generic import *


#The inputs to this node will be stored as a list in the IN variable.
collector = FilteredElementCollector(doc)
sheets = collector.OfCategory(BuiltInCategory.OST_Sheets).ToElements()


OUT = sheets;
# ----------------------------------------
curtainSystem = Python()  # IronPython2
# ---------- curtainSystem.python (35 lines) ----------
#Copyright(c) 2017, john pierson
# @60secondrevit, http://sixtysecondrevit.com

import clr
clr.AddReference('ProtoGeometry')
from Autodesk.DesignScript.Geometry import *

# Import DocumentManager and TransactionManager
clr.AddReference("RevitServices")
import RevitServices
from RevitServices.Persistence import DocumentManager
from RevitServices.Transactions import TransactionManager

# Import RevitAPI
clr.AddReference("RevitAPI")
import Autodesk
from Autodesk.Revit.DB import *

doc = DocumentManager.Instance.CurrentDBDocument
uiapp = DocumentManager.Instance.CurrentUIApplication
app = uiapp.Application

from System.Collections.Generic import *


#The inputs to this node will be stored as a list in the IN variable.
dataEnteringNode = IN
collector = FilteredElementCollector(doc)
roofs = collector.OfClass(CurtainSystem).ToElements()


#OfType(BuiltInCategory.OST_RoofType).ToElements()


OUT = roofs;
# ----------------------------------------
clear_list = Python()  # CPython3; unwired: IN[0]
# ---------- clear_list.python (23 lines) ----------
#Copyright(c) 2015, Konrad K Sobon
# @arch_laboratory, http://archi-lab.net

import clr
clr.AddReference('ProtoGeometry')
from Autodesk.DesignScript.Geometry import *
#The inputs to this node will be stored as a list in the IN variable.
dataEnteringNode = IN

def ClearList(_list):
    out = []
    for _list1 in _list:
        if _list1 is None:
            continue
        if isinstance(_list1, list):
             _list1 = ClearList(_list1)
             if not _list1:
                 continue
        out.append(_list1)
    return out

#Assign your output to the OUT variable
OUT = ClearList(IN[0])
# ----------------------------------------
