# Dynamo graph DY 2.3 - A11. Broj ćoškova u prostorijama - V9.dyn (Dynamo 2.3.1.11775)
# packages: Synthesize toolkit 6.8.0, WombatDynamo 1.3.2, archi-lab.net 2020.23.13, Bakery 2019.5.8, Orchid 230.0.3.7493, Data-Shapes 2019.2.44, designtech 1.0.8, Chynamo 0.8.5

# group: Podešavanja/izbor ISO klase
code_block = CodeBlock { "ISO (klasa po GMPu)"; "KAKO VI KAŽETE ŠEFE"; true; "Prekid"; }
opis_iso_oznake = CodeBlock { "B"; "C"; "D"; "CNC"; "NC"; "PB"; "Ostale prostorije"; }
join = List.Join(list0=opis_iso_oznake.out0, list1=opis_iso_oznake.out1, list2=opis_iso_oznake.out2, list3=opis_iso_oznake.out3, list4=opis_iso_oznake.out4, list5=opis_iso_oznake.out5, list6=opis_iso_oznake.out6)
iso_oznake = CodeBlock { 6; 7; 8; 9; 10; 11; ""; }
join_2 = List.Join(list0=iso_oznake.out0, list1=iso_oznake.out1, list2=iso_oznake.out2, list3=iso_oznake.out3, list4=iso_oznake.out4, list5=iso_oznake.out5, list6=iso_oznake.out6)
ui_listview_data = Custom[UI.Listview Data](Keys=join, Values=join_2)  # package Data-Shapes; Create data for ListView input in UI.MultiInputForm ++ . Check out www.data-shapes.net for more infos.
ui_multipleinputform = Custom[UI.MultipleInputForm ++](Description_optional=code_block.out0, ButtonText_optional=code_block.out1, Inputs=ui_listview_data, Toggle=code_block.out2, CancelButtonText_optional=code_block.out3)  # package Data-Shapes; Create a form with multiple inputs. see www.data-shapes.net for tutorials and infos!
code_block_2 = CodeBlock(lista=ui_multipleinputform.User_Inputs) { DSCore.List.Flatten(lista, -1); }

# group: Filter po parametru
boolean = BoolSelector(true)
placedRooms = Python(IN[0]=boolean)  # "Collector.PlacedRooms"
# ---------- placedRooms.python (36 lines) ----------
#Copyright(c) 2017, john pierson
# @60secondrevit, http://sixtysecondrevit.com

import clr
clr.AddReference('ProtoGeometry')
from Autodesk.DesignScript.Geometry import *

# Import DocumentManager and TransactionManager
clr.AddReference("RevitServices")
import RevitServices
from RevitServices.Persistence import DocumentManager
from RevitServices.Transactions import TransactionManager

# Import RevitAPI
clr.AddReference("RevitAPI")
import Autodesk
from Autodesk.Revit.DB import *

doc = DocumentManager.Instance.CurrentDBDocument
uiapp = DocumentManager.Instance.CurrentUIApplication
app = uiapp.Application

from System.Collections.Generic import *


#The inputs to this node will be stored as a list in the IN variable.
dataEnteringNode = IN
collector = FilteredElementCollector(doc)
rooms = collector.OfCategory(BuiltInCategory.OST_Rooms).ToElements()

roomInstances = []
for i in rooms:
	if i.Area != 0:
		roomInstances.append(i)

OUT = roomInstances
# ----------------------------------------
watch = Watch(placedRooms)
parameter_name = StringInput("ISO")
getParameterValueByName = Element.GetParameterValueByName(element=watch, parameterName=parameter_name)
watch_2 = Watch(getParameterValueByName)
eq = watch_2 == code_block_2  # lacing=CrossProduct
anyTrue = Orchid.Common.List.AnyTrue(list=eq)
filterByBoolMask = List.FilterByBoolMask(list=watch, mask=anyTrue)
id = Element.Id(element=filterByBoolMask.in)
byElementId = archilab.Revit.Selection.Select.ByElementId(id=id)

finishBoundary = Room.FinishBoundary(room=byElementId)

# group: Izbaci stubove
count = List.Count(list=finishBoundary@L3)
code_block_3 = CodeBlock { 1; }
sub = count - code_block_3
maximumItem = List.MaximumItem(list=sub)
code_block_4 = CodeBlock(n=maximumItem) { 1..(n+1); }

removeItemAtIndex = List.RemoveItemAtIndex(list=finishBoundary@L3, indices=code_block_4)
code_block_5 = CodeBlock { 1; }
flatten = List.Flatten(list=removeItemAtIndex, amt=code_block_5)
tangentAtParameter = Curve.TangentAtParameter(curve=flatten, param=code_block_5)
shiftIndices = List.ShiftIndices(list=flatten@L2, amount=code_block_5)
tangentAtParameter_2 = Curve.TangentAtParameter(curve=shiftIndices, param=code_block_5)
isAlmostEqualTo = Vector.IsAlmostEqualTo(vector=tangentAtParameter, other=tangentAtParameter_2)

# group: Remove Non-Corner Points
startPoint = Curve.StartPoint(curve=flatten)
filterByBoolMask_2 = List.FilterByBoolMask(list=startPoint, mask=isAlmostEqualTo)

reverse = List.Reverse(list=filterByBoolMask_2.out@L2)

# group: Find Top-Right Corner (max X+Y)
X = Point.X(point=reverse)
Y = Point.Y(point=reverse)
add = X + Y
maximumItem_2 = List.MaximumItem(list=add)
indexOf = List.IndexOf(list=add, element=maximumItem_2, lacing=Longest)
code_block_6 = CodeBlock(x=indexOf) { x*-1; }
shiftIndices_2 = List.ShiftIndices(list=reverse@L2, amount=code_block_6, lacing=Longest)

# group: Proračun uglova
ukupan_broj_uglova = List.Count(list=shiftIndices_2@L2)
code_block_7 = CodeBlock { 4; }
# note: Petrova jednačina sa dve nepoznate
# S - Spoljašnju ugao (IGM)
# U - unutrašnji ugao (Holker)
# ToT - Ukupan broj uglova koje daje Dynamo
# S= U-4
# ToT= U+S
# ToT = U+U-4
# ToT = 2U-4
add_2 = ukupan_broj_uglova + code_block_7
code_block_8 = CodeBlock { 2; }
div = add_2 / code_block_8
sub_2 = ukupan_broj_uglova - div

# note: Nije potrebno za proračun, samo kontrole radi...
total_bez_stubova = Watch(ukupan_broj_uglova)
watch_3 = Watch(byElementId)
code_block_9 = CodeBlock(Element=watch_3) { Element; }
setParameterByName = Element.SetParameterByName(element=code_block_9)  # unwired: parameterName, value

# group: Parameter name
string = StringInput("1. Spoljašnji (IGM)")
string_2 = StringInput("2. Unutrašnji (Holker)")
string_3 = StringInput("3. Datum očitavanja")
list_create = List.Create(item0=string, item1=string_2, item2=string_3)
watch_4 = Watch(list_create)
string_4 = StringInput("4. Ćoškovi vrata")

# group: Izdvajanje stubova
code_block_10 = CodeBlock { 0; }
nullItem = WombatDynamo.List.NullItem()
replaceItemAtIndex = Custom[CW.List.ReplaceItemAtIndex+](VARseq=finishBoundary@L3, VARindex=code_block_10, VARreplacement=nullItem)  # package Synthesize toolkit; Replaces the item at a given index (or list of indices) of a list by another item
code_block_11 = CodeBlock { 0; }
removeItemAtIndex_2 = List.RemoveItemAtIndex(list=replaceItemAtIndex@L3, indices=code_block_11)
code_block_12 = CodeBlock { 1; }
flatten_2 = List.Flatten(list=removeItemAtIndex_2@@L3, amt=code_block_12)
count_2 = List.Count(list=flatten_2@L2)

watch_5 = Watch(count_2)

# group: Zbirovi
spoljašnji_igm = Watch(sub_2)
total_stubovi = Watch(watch_5)
add_3 = spoljašnji_igm + total_stubovi
zbir_stubova_i_spoljašnjih_u = Watch(add_3)  # "Zbir stubova i spoljašnjih u sobama"
unutrašnji_holker = Watch(div)

# group: Datum očitavanja
now = DateTime.Now()
string_from_object = FromObject(obj=now)
count_3 = List.Count(list=sub_2)
ofRepeatedItem = List.OfRepeatedItem(item=string_from_object, amount=count_3)
string_from_object_2 = FromObject(obj=ofRepeatedItem)

# group: Parameter Value
# note: 0 - Spoljašnji (IGM)
# 1 - Unutrašnji ( Holker)
# 2 - Datum očitavanja
# 3 - Ćoškovi vrata
# note: Popunjavanje parametara
list_create_2 = List.Create(item0=zbir_stubova_i_spoljašnjih_u, item1=unutrašnji_holker, item2=string_from_object_2)

watch_6 = Watch(list_create_2)
combine = List.Combine(comb=setParameterByName, list1=watch_4, list2=watch_6)
watch_7 = Watch(combine)

# group: Proračun špiceva kod vrata (wip)
string_5 = StringInput("Doors")
byName = Category.ByName(name=string_5)
all_elements_of_category = ElementsOfCategory(Category=byName)
current = Document.Current()  # frozen
activeView = Document.ActiveView(document=current)
phase = Python(IN[0]=activeView)  # "View.Phase"
# ---------- phase.python (19 lines) ----------
#gets the phase of the current view 
#copyright 2015 Paul Wintour & Dan Rumery / BVN


import clr
clr.AddReference('RevitAPI')
from Autodesk.Revit.DB import *

clr.AddReference("RevitServices")
import RevitServices
from RevitServices.Persistence import DocumentManager

doc = DocumentManager.Instance.CurrentDBDocument

view = IN[0]

phaseId = view.InternalElement.get_Parameter(BuiltInParameter.VIEW_PHASE).AsElementId()
		
OUT = doc.GetElement(phaseId)
# ----------------------------------------

rooms = Custom[CW.Door.Rooms](VARdoor=all_elements_of_category, VARphase=phase)  # package Synthesize toolkit; Gets the rooms that are connected by a given door
i = CodeBlock { 0; }
eq_2 = rooms.VARroomCount == i
# note: to room
filterByBoolMask_3 = List.FilterByBoolMask(list=rooms.VARtoRoom, mask=eq_2)
# note: from room
filterByBoolMask_4 = List.FilterByBoolMask(list=rooms.VARfromRoom, mask=eq_2)
create = List.Create(item0=filterByBoolMask_3.out, item1=filterByBoolMask_4.out)
flatten_3 = List.Flatten(list=create)
uniqueItems = List.UniqueItems(list=flatten_3)
clean = List.Clean(list=uniqueItems)
transpose = List.Transpose(lists=create)
boolean_2 = BoolSelector(false)  # graph input
clean_2 = List.Clean(list=transpose, preserveIndices=boolean_2)
firstItem = List.FirstItem(list=clean_2@L2)
uniqueItems_2 = List.UniqueItems(list=firstItem)
id_2 = Element.Id(element=firstItem)
# note: doors
# note: Filters any which don't have rooms
filterByBoolMask_5 = List.FilterByBoolMask(list=all_elements_of_category, mask=eq_2)
create_2 = List.Create(item0=uniqueItems_2, item1=id_2, item2=filterByBoolMask_5.out)
code_block_13 = CodeBlock { 1; false; true; }
sortListOfLists = Custom[CW.List.SortListOfLists](VARseq=create_2, VARsortIndex=code_block_13.out0, VARcaseInsensitive=code_block_13.out1, VARorderDescending=code_block_13.out2)  # package Synthesize toolkit; Sorts a list of lists by one of its sublists
code_block_14 = CodeBlock { 1; }
groupListOfListsByKey = Custom[CW.List.GroupListOfListsByKey](VARseq=sortListOfLists, VARkeyIndex=code_block_14)  # package Synthesize toolkit; Groups a list of lists by one of its keys
i_2 = CodeBlock { 2; }
# note: gets doors
getItemAtIndex = List.GetItemAtIndex(list=groupListOfListsByKey@L3, index=i_2)
boolean_3 = BoolSelector(false)  # graph input
clean_3 = List.Clean(list=getItemAtIndex, preserveIndices=boolean_3)
count_4 = List.Count(list=clean_3@L2)
# note: gets rooms
firstItem_2 = List.FirstItem(list=groupListOfListsByKey@@L3)
clean_4 = List.Clean(list=firstItem_2, preserveIndices=boolean_3)
firstItem_3 = List.FirstItem(list=clean_4@L2)
centerBoundary = Room.CenterBoundary(room=firstItem_3)
count_5 = List.Count(list=clean_4@L2)
transpose_2 = List.Transpose(lists=groupListOfListsByKey)
collect_all_elements_in_model = Custom[Collect All Elements in Model]()  # frozen; package Bakery

# group: Verzije
istorija = CodeBlock()
# ---------- istorija.designscript (15 lines) ----------
// V7
"Dodat Datum očitavanja";

// V8
"Krenuto sa proračunom špiceva,
nije završeno";

// V9
"Dodat Filter za obradu soba po KLASI ( ISO )";

//v 10
"Dodat grafički izbor za iso klasu";

//v 11
"Broj panela u sobi";
# ----------------------------------------

parameters = Element.Parameters(element=watch)
value = Parameter.Value(parameter=parameters)

# group: Broj panela u sobi
boolean_4 = BoolSelector(true)
placedRooms_2 = Python(IN[0]=boolean_4)  # "Collector.PlacedRooms"; same code as placedRooms
boundingBox = Element.BoundingBox(element=placedRooms_2)
elementInside = Python(IN[0]=boundingBox)
# ---------- elementInside.python (36 lines) ----------
import clr
clr.AddReference('RevitAPI')
clr.AddReference('System')
clr.AddReference('RevitNodes')
clr.AddReference('RevitServices')
import Revit
import RevitServices
from Autodesk.Revit.DB import *
from System.Collections.Generic import List
from RevitServices.Persistence import DocumentManager
from RevitServices.Transactions import TransactionManager
clr.ImportExtensions(Revit.Elements)
clr.ImportExtensions(Revit.GeometryConversion)
doc = DocumentManager.Instance.CurrentDBDocument

#Functions for list handling
def ProcessList(_func, _list):
   return map( lambda x: ProcessList(_func, x) if type(x)==list else _func(x), _list )

#Preparing input from dynamo to revit

def ToRevit(item):
	return item.ToRevitType(True)

if isinstance(IN[0], list):
	bblist = ProcessList(ToRevit, IN[0])
else:
	bblist = [ToRevit(IN[0])]

def collectElementsInBB(bb):
	outline = Outline(bb.Min, bb.Max)
	filter = BoundingBoxIntersectsFilter(outline)
	collector = FilteredElementCollector(doc, doc.ActiveView.Id).WherePasses(filter)
	return [e.ToDSType(True) for e in collector]

OUT = ProcessList(collectElementsInBB, bblist)
# ----------------------------------------
getCategory = Element.GetCategory(element=elementInside)
# note: Custom Node: designtech
fromObject = dtCore.String.FromObject(obj=getCategory)
kategorija = CodeBlock { dtCore.String.FromObject(Revit.Category.ByName("Curtain Panels")); }
eq_3 = fromObject == kategorija
filterByBoolMask_6 = List.FilterByBoolMask(list=elementInside, mask=eq_3)
# note: Custom Node: Chynamo
hostelement_archilab = Custom[HostElement-ArchiLab](Nested=filterByBoolMask_6.in)  # package Chynamo; Get host elements of given nest elements, imported from ArchiLab
uniqueItems_3 = List.UniqueItems(list=hostelement_archilab)
fromObject_2 = dtCore.String.FromObject(obj=uniqueItems_3)
kategorija_2 = CodeBlock { "Wall"; }
eq_4 = fromObject_2 == kategorija_2
filterByBoolMask_7 = List.FilterByBoolMask(list=filterByBoolMask_6.in, mask=eq_4)
broj_panela_u_prostorijama = CodeBlock(a=filterByBoolMask_7.in, room=placedRooms_2, b=filterByBoolMask_7.out)
# ---------- broj_panela_u_prostorijama.designscript (7 lines) ----------
"Broj Zidnih Panela";
zidni= DSCore.List.Count(a@L2<1>);

soba = room;

"Broj Plafonskih Panela";
plafonski = DSCore.List.Count(b@L2<1>);
# ----------------------------------------
setParameterByName_2 = Element.SetParameterByName(element=broj_panela_u_prostorijama.soba, parameterName=broj_panela_u_prostorijama.out0, value=broj_panela_u_prostorijama.zidni)

setParameterByName_3 = Element.SetParameterByName(element=broj_panela_u_prostorijama.soba, parameterName=broj_panela_u_prostorijama.out3, value=broj_panela_u_prostorijama.plafonski)
watch_8 = Watch()  # unwired: arg0

# group: Profilčići za Vrata
code_block_15 = CodeBlock { "Vrata"; }
string_6 = StringInput("Doors")
byName_2 = Category.ByName(name=string_6)
all_elements_of_category_2 = ElementsOfCategory(Category=byName_2)
name = Element.Name(element=all_elements_of_category_2)
code_block_16 = CodeBlock { ["WDS","WDD","WDB","WDDB"]; }
contains = String.Contains(str=name, searchFor=code_block_16, lacing=CrossProduct)
countTrue = List.CountTrue(list=contains@L2)
code_block_17 = CodeBlock(n=countTrue) { n > 0; }
filterByBoolMask_8 = List.FilterByBoolMask(list=all_elements_of_category_2, mask=code_block_17)
count_6 = List.Count(list=filterByBoolMask_8.in)
setParameterByName_4 = Element.SetParameterByName(element=watch_8, parameterName=code_block_15, value=count_6)

# group: Profilčići za parapet iznad WWG
code_block_18 = CodeBlock { "Stakleni paneli"; }
string_7 = StringInput("Curtain Panels")
byName_3 = Category.ByName(name=string_7)
all_elements_of_category_3 = ElementsOfCategory(Category=byName_3)
name_2 = Element.Name(element=all_elements_of_category_3)
code_block_19 = CodeBlock { ["WWG"]; }
contains_2 = String.Contains(str=name_2, searchFor=code_block_19, lacing=CrossProduct)
countTrue_2 = List.CountTrue(list=contains_2@L2)
code_block_20 = CodeBlock(n=countTrue_2) { n > 0; }
filterByBoolMask_9 = List.FilterByBoolMask(list=all_elements_of_category_3, mask=code_block_20)
count_7 = List.Count(list=filterByBoolMask_9.in)
setParameterByName_5 = Element.SetParameterByName(element=watch_8, parameterName=code_block_18, value=count_7)
