# Dynamo graph DY 2.3 - A2.0 Floor, ceiling, elevation + place on sheets aligned - V6.dyn (Dynamo 2.3.0.5885)
# packages: archi-lab.net 2020.23.13, DynaTools 2018.1.15, Rhythm 2020.2.13, Orchid 230.0.1.7437, Synthesize toolkit 6.8.0, Caribou 2.0.3, designtech 1.0.8, Chynamo 0.8.5, Orchid 230.0.3.7493, Bakery 2019.5.8, SteamNodes 1.2.4

# group: Verzije
# note: V6
# Dodati filteri za izbor rada
# note: V4
# Dodato pozicioniranje na papir
# note: V5
# započeto tagiranje
# note: V3
# Dodati elevation-i

# group: Izbor rada
# note: Sve sobe
placedRooms = Python()  # "Collector.PlacedRooms"; unwired: IN[0]
# ---------- placedRooms.python (36 lines) ----------
#Copyright(c) 2017, john pierson
# @60secondrevit, http://sixtysecondrevit.com

import clr
clr.AddReference('ProtoGeometry')
from Autodesk.DesignScript.Geometry import *

# Import DocumentManager and TransactionManager
clr.AddReference("RevitServices")
import RevitServices
from RevitServices.Persistence import DocumentManager
from RevitServices.Transactions import TransactionManager

# Import RevitAPI
clr.AddReference("RevitAPI")
import Autodesk
from Autodesk.Revit.DB import *

doc = DocumentManager.Instance.CurrentDBDocument
uiapp = DocumentManager.Instance.CurrentUIApplication
app = uiapp.Application

from System.Collections.Generic import *


#The inputs to this node will be stored as a list in the IN variable.
dataEnteringNode = IN
collector = FilteredElementCollector(doc)
rooms = collector.OfCategory(BuiltInCategory.OST_Rooms).ToElements()

roomInstances = []
for i in rooms:
	if i.Area != 0:
		roomInstances.append(i)

OUT = roomInstances
# ----------------------------------------
izbor_rada = Watch(placedRooms)
# note: Izaberi sobe
rh_pick_model_elements = Custom[RH.Pick Model Elements]()  # package Synthesize toolkit; This node offers a pick method for selecting elements in Revit.

number = Room.Number()  # unwired: room
sortByFunction = List.SortByFunction(list=izbor_rada, func=number)
number_2 = Room.Number(room=sortByFunction)

# group: Podešavanja
sheet_name_prefix = StringInput("04 - ")
plan_name_prefix = StringInput("")
PAPIR = CodeBlock { "A1 - RU"; "A1 - ENG"; "A1 - SRB"; "A2 - RU"; "A2 - ENG"; "A2 - SRB"; }

code_block = CodeBlock { "Annotation Crop"; true; false; 2; }
byRoom = Python(IN[0]=izbor_rada, IN[1]=plan_name_prefix, IN[2]=code_block.out3, IN[3]=code_block.out1)  # "FloorPlan.ByRoom"
# ---------- byRoom.python (119 lines) ----------
# Copyright(c) 2015, Konrad K Sobon
# @arch_laboratory, http://archi-lab.net

import clr
clr.AddReference('ProtoGeometry')
from Autodesk.DesignScript.Geometry import *

# Import Element wrapper extension methods
clr.AddReference("RevitNodes")
import Revit
clr.ImportExtensions(Revit.Elements)

# Import geometry conversion extension methods
clr.ImportExtensions(Revit.GeometryConversion)

# Import DocumentManager and TransactionManager
clr.AddReference("RevitServices")
import RevitServices
from RevitServices.Persistence import DocumentManager
from RevitServices.Transactions import TransactionManager
doc = DocumentManager.Instance.CurrentDBDocument

# Import RevitAPI
clr.AddReference("RevitAPI")
import Autodesk
from Autodesk.Revit.DB import *

import System
from System import Array
from System.Collections.Generic import *

import sys
pyt_path = r'C:\Program Files (x86)\IronPython 2.7\Lib'
sys.path.append(pyt_path)

#The inputs to this node will be stored as a list in the IN variable.
dataEnteringNode = IN

if isinstance(IN[0], list):
	rooms = UnwrapElement(IN[0])
else:
	rooms = [UnwrapElement(IN[0])]
namePrefix = IN[1]
bboxOffset = IN[2]
runMe = IN[3]
# nameSufix = IN[4]

def OffsetBBox(bbox, offset):
	bboxMinX = bbox.Min.X - offset
	bboxMinY = bbox.Min.Y - offset
	bboxMinZ = bbox.Min.Z - offset
	bboxMaxX = bbox.Max.X + offset
	bboxMaxY = bbox.Max.Y + offset
	bboxMaxZ = bbox.Max.Z + offset
	newBbox = BoundingBoxXYZ()
	newBbox.Min = XYZ(bboxMinX, bboxMinY, bboxMinZ)
	newBbox.Max = XYZ(bboxMaxX, bboxMaxY, bboxMaxZ)
	return newBbox

try:
	errorReport = None
	if runMe:
		viewTypes = FilteredElementCollector(doc).OfClass(ViewFamilyType)
		for i in viewTypes:
			if i.ViewFamily == ViewFamily.FloorPlan:
				viewTypeId = i.Id
				break
			else:
				continue
		
		existingPlans = FilteredElementCollector(doc).OfClass(View).ToElements()
		
		existingPlanNames, existingPlanElements = [], []
		for i in existingPlans:
			if not i.IsTemplate:
				if i.ViewType == ViewType.FloorPlan:
					existingPlanNames.append(i.ToDSType(True).Name)
					existingPlanElements.append(i)
					
		# Start Transaction
		# i.get_Parameter(BuiltInParameter.ROOM_NAME).AsString()
        # viewName = namePrefix + i.get_Parameter(BuiltInParameter.ROOM_NUMBER).AsString() + nameSufix

		TransactionManager.Instance.EnsureInTransaction(doc)
		
		floorPlans = []
		for i in rooms:
			levelId = i.LevelId
			bbox = i.BoundingBox[doc.ActiveView]
			newBbox = OffsetBBox(bbox, bboxOffset)
			viewName = namePrefix + i.get_Parameter(BuiltInParameter.ROOM_NUMBER).AsString()
			if viewName in existingPlanNames:
				view = existingPlanElements[existingPlanNames.index(viewName)]
				view.CropBox = newBbox
				view.CropBoxActive = True
				view.CropBoxVisible = False
				floorPlans.append(view)
			else:
				newView = ViewPlan.Create(doc, viewTypeId, levelId)
				newView.Name = viewName
				newView.CropBox = newBbox
				newView.CropBoxActive = True
				newView.CropBoxVisible = False
				floorPlans.append(newView)
	
		# End Transaction
		TransactionManager.Instance.TransactionTaskDone()
	else:
		errorReport = "Run Me set to False"
except:
	# if error accurs anywhere in the process catch it
	import traceback
	errorReport = traceback.format_exc()

#Assign your output to the OUT variable
if errorReport == None:
	OUT = floorPlans
else:
	OUT = errorReport
# ----------------------------------------
byRoom_2 = Python(IN[0]=izbor_rada, IN[1]=plan_name_prefix, IN[2]=code_block.out3, IN[3]=code_block.out1)  # "CeilingPlan.ByRoom"; graph output
# ---------- byRoom_2.python (121 lines) ----------
# Copyright(c) 2015, Konrad K Sobon
# @arch_laboratory, http://archi-lab.net
# http://tinypic.com/m/kbrvxh/1

import clr
clr.AddReference('ProtoGeometry')
from Autodesk.DesignScript.Geometry import *

# Import Element wrapper extension methods
clr.AddReference("RevitNodes")
import Revit
clr.ImportExtensions(Revit.Elements)

# Import geometry conversion extension methods
clr.ImportExtensions(Revit.GeometryConversion)

# Import DocumentManager and TransactionManager
clr.AddReference("RevitServices")
import RevitServices
from RevitServices.Persistence import DocumentManager
from RevitServices.Transactions import TransactionManager
doc = DocumentManager.Instance.CurrentDBDocument

# Import RevitAPI
clr.AddReference("RevitAPI")
import Autodesk
from Autodesk.Revit.DB import *

import System
from System import Array
from System.Collections.Generic import *

import sys
pyt_path = r'C:\Program Files (x86)\IronPython 2.7\Lib'
sys.path.append(pyt_path)

#The inputs to this node will be stored as a list in the IN variable.
dataEnteringNode = IN

if isinstance(IN[0], list):
	rooms = UnwrapElement(IN[0])
else:
	rooms = [UnwrapElement(IN[0])]
namePrefix = IN[1]
bboxOffset = IN[2]
runMe = IN[3]
# nameSufix = IN[4]

def OffsetBBox(bbox, offset):
	bboxMinX = bbox.Min.X - offset
	bboxMinY = bbox.Min.Y - offset
	bboxMinZ = bbox.Min.Z - offset
	bboxMaxX = bbox.Max.X + offset
	bboxMaxY = bbox.Max.Y + offset
	bboxMaxZ = bbox.Max.Z + offset
	newBbox = BoundingBoxXYZ()
	newBbox.Min = XYZ(bboxMinX, bboxMinY, bboxMinZ)
	newBbox.Max = XYZ(bboxMaxX, bboxMaxY, bboxMaxZ)
	return newBbox

try:
	errorReport = None
	if runMe:
		viewTypes = FilteredElementCollector(doc).OfClass(ViewFamilyType)
		for i in viewTypes:
			if i.ViewFamily == ViewFamily.CeilingPlan:
				viewTypeId = i.Id
				break
			else:
				continue
		
		existingPlans = FilteredElementCollector(doc).OfClass(View).ToElements()
		
		existingPlanNames, existingPlanElements = [], []
		for i in existingPlans:
			if not i.IsTemplate:
				if i.ViewType == ViewType.CeilingPlan:
					existingPlanNames.append(i.ToDSType(True).Name)
					existingPlanElements.append(i)
					
		# Start Transaction
		# viewName = namePrefix + i.get_Parameter(BuiltInParameter.ROOM_NUMBER).AsString()
        # viewName = namePrefix + i.get_Parameter(BuiltInParameter.ROOM_NUMBER).AsString() + nameSufix


		TransactionManager.Instance.EnsureInTransaction(doc)
		
		ceilingPlans = []
		for i in rooms:
			levelId = i.LevelId
			bbox = i.BoundingBox[doc.ActiveView]
			newBbox = OffsetBBox(bbox, bboxOffset)
			viewName = namePrefix + i.get_Parameter(BuiltInParameter.ROOM_NUMBER).AsString()
			if viewName in existingPlanNames:
				view = existingPlanElements[existingPlanNames.index(viewName)]
				view.CropBox = newBbox
				view.CropBoxActive = True
				view.CropBoxVisible = True
				ceilingPlans.append(view)
			else:
				newView = ViewPlan.Create(doc, viewTypeId, levelId)
				newView.Name = viewName
				newView.CropBox = newBbox
				newView.CropBoxActive = True
				newView.CropBoxVisible = False
				ceilingPlans.append(newView)
	
		# End Transaction
		TransactionManager.Instance.TransactionTaskDone()
	else:
		errorReport = "Run Me set to False"
except:
	# if error accurs anywhere in the process catch it
	import traceback
	errorReport = traceback.format_exc()

#Assign your output to the OUT variable
if errorReport == None:
	OUT = ceilingPlans
else:
	OUT = errorReport
# ----------------------------------------
# note: rooms = [UnwrapElement(IN[0])]
# namePrefix = IN[1]
# bboxOffset = IN[2]
# runMe = IN[3]
# nameSufix = IN[4]
list_create = List.Create(item0=byRoom, item1=byRoom_2)
setParameterByName = Element.SetParameterByName(element=list_create, parameterName=code_block.out0, value=code_block.out1)
i = CodeBlock { 0; 1; }
getItemAtIndex = List.GetItemAtIndex(list=setParameterByName, index=i.out0)
flatten = List.Flatten(list=getItemAtIndex)
all = Orchid.RevitProject.Views.ViewTemplate.All()
name = Element.Name(element=all)

# group: Podešavanja
ime_templejta = StringInput("1.2 OSNOVA 1.50")
ime_templejta_2 = StringInput("2.1 PLAFONI")

boolean = BoolSelector(true)
contains = String.Contains(str=name, searchFor=ime_templejta, ignoreCase=boolean)
filterByBoolMask = List.FilterByBoolMask(list=all, mask=contains)
code_block_2 = CodeBlock { 0; }
getItemAtIndex_2 = List.GetItemAtIndex(list=filterByBoolMask.in, index=code_block_2)
setViewTemplate = archilab.Revit.Views.Views.SetViewTemplate(view=flatten, viewTemplate=getItemAtIndex_2)
name_2 = Element.Name()  # unwired: element
sortByFunction_2 = List.SortByFunction(list=setViewTemplate, func=name_2)
flatten_2 = List.Flatten(list=sortByFunction_2)
count = List.Count(list=flatten_2)
count_1_n = CodeBlock(COUNT=count) { 1..#COUNT..1; }
obj_str = FromObject(obj=count_1_n)
add = CodeBlock(X=sheet_name_prefix, Y=obj_str) { X+Y; }
watch = Watch(PAPIR.out5)
byName = FamilyType.ByName(name=watch)
watch_2 = Watch(byName)
createSheets = ViewTools.Sheets.CreateSheets(sheetNames=number_2, sheetNumbers=add, titleBlock=watch_2)

# group: Podešavanja
# note: Dodeljivanje kategorije Sheet-ovima
string = StringInput("KATEGORIJA CRTEZA")
string_2 = StringInput("04 POGLEDI")
setParameterByName_2 = Element.SetParameterByName(element=createSheets@L1, parameterName=string, value=string_2)
boolean_2 = BoolSelector(true)
byViewsName = archilab.Revit.Views.ViewSets.ByViewsName(views=setParameterByName_2, name=string_2, replace=boolean_2)

getItemAtIndex_3 = List.GetItemAtIndex(list=setParameterByName, index=i.out1)
flatten_3 = List.Flatten(list=getItemAtIndex_3)
all_2 = Orchid.RevitProject.Views.ViewTemplate.All()
name_3 = Element.Name(element=all_2)
boolean_3 = BoolSelector(true)
contains_2 = String.Contains(str=name_3, searchFor=ime_templejta_2, ignoreCase=boolean_3)
filterByBoolMask_2 = List.FilterByBoolMask(list=all_2, mask=contains_2)
code_block_3 = CodeBlock { 0; }
getItemAtIndex_4 = List.GetItemAtIndex(list=filterByBoolMask_2.in, index=code_block_3)
setViewTemplate_2 = archilab.Revit.Views.Views.SetViewTemplate(view=flatten_3, viewTemplate=getItemAtIndex_4)
name_4 = Element.Name()  # unwired: element
sortByFunction_3 = List.SortByFunction(list=setViewTemplate_2, func=name_4)
flatten_4 = List.Flatten(list=sortByFunction_3)
join = List.Join(list0=flatten_2, list1=flatten_4)
conversion_factor = DoubleInput(305)
number_3 = DoubleInput(1)
# note: 0 - Plan
# 1- Conversion Factor
# 2 - Trim Size
# note: TRIM ( SET CROP BOX )
TRIM = Python(IN[0]=join, IN[1]=conversion_factor, IN[2]=number_3)
# ---------- TRIM.python (52 lines) ----------
import clr
clr.AddReference('ProtoGeometry')
from Autodesk.DesignScript.Geometry import *

import clr
clr.AddReference('RevitAPI')
import Autodesk.Revit.DB

import clr
clr.AddReference("RevitNodes")
import Revit

clr.AddReference('DSCoreNodes')
import DSCore
from DSCore import *

clr.AddReference("RevitServices")
import RevitServices
from RevitServices.Persistence import DocumentManager
from RevitServices.Transactions import TransactionManager
doc = DocumentManager.Instance.CurrentDBDocument

# Import ToProtoType, ToRevitType geometry conversion extension methods
clr.ImportExtensions(Revit.GeometryConversion)

#The inputs to this node will be stored as a list in the IN variables.
if isinstance(IN[0], list):
	views = UnwrapElement(IN[0])
	cf = IN[1]
	Tsize = IN[2]/cf

else:
	views = [UnwrapElement(IN[0])]
	    	
listout = []
for view in views:
	regionMan = view.GetCropRegionShapeManager()
	TransactionManager.Instance.EnsureInTransaction(doc)
	try:
		regionMan.BottomAnnotationCropOffset = Tsize
		regionMan.LeftAnnotationCropOffset = Tsize
		regionMan.RightAnnotationCropOffset = Tsize
		regionMan.TopAnnotationCropOffset = Tsize
		listout.append(view)
	except:
		listout.append("failed")
	
	TransactionManager.Instance.TransactionTaskDone()


#Assign your output to the OUT variable.
OUT = listout
# ----------------------------------------
location = Room.Location(room=sortByFunction)
code_block_4 = CodeBlock { 96; }
python_script = Python()  # unwired: IN[0]
# ---------- python_script.python (43 lines) ----------
#Copyright(c) 2016 www.Learndynamo.com 
#Please contact at jeremy@learndynamo.com

import clr
clr.AddReference('RevitAPI')
clr.AddReference("RevitServices")
clr.AddReference("RevitNodes")
import RevitServices
import Revit
import Autodesk
from Autodesk.Revit.DB import *
from math import *

clr.ImportExtensions(Revit.GeometryConversion)

from RevitServices.Persistence import DocumentManager
from RevitServices.Transactions import TransactionManager

doc = DocumentManager.Instance.CurrentDBDocument

toggle = IN[0]

elements = []
names = []
lst = []

#Get Family View Type
vft = 0
collector = FilteredElementCollector(doc).OfClass(ViewFamilyType).ToElements()

#eleViews = []
for i in collector:
	if i.ViewFamily == ViewFamily.Elevation:
		elements.append(i)
		#elements.append(i.Name)
		for j in i.Parameters:
			if j.Definition.Name == "Type Name":
				names.append(j.AsString())
		
lst.append(elements)
lst.append(names)
	
OUT = lst
# ----------------------------------------
code_block_5 = CodeBlock(item=python_script) { item[0][1]; }
# note: Get Room Location & Create Elevation Marker
ʳʰʸᵗʰᵐ_elevationmarker = Rhythm.Revit.Elements.ElevationMarker.CreateElevationMarker(location=location, scaleFactor=code_block_4, viewFamilyType=code_block_5)
get_floor_plans = Python()  # graph input
# ---------- get_floor_plans.python (95 lines) ----------
#Copyright(c) 2014, Konrad Sobon
# @arch_laboratory, http://archi-lab.net
 
import clr
clr.AddReference('ProtoGeometry')
from Autodesk.DesignScript.Geometry import *
 
# Import DocumentManager and TransactionManager
clr.AddReference("RevitServices")
import RevitServices
from RevitServices.Persistence import DocumentManager
from RevitServices.Transactions import TransactionManager
 
# Import RevitAPI
clr.AddReference("RevitAPI")
import Autodesk
from Autodesk.Revit.DB import *
 
doc = DocumentManager.Instance.CurrentDBDocument
uiapp = DocumentManager.Instance.CurrentUIApplication
app = uiapp.Application
 
from System.Collections.Generic import *
 
# Import ToDSType(bool) extension method
clr.AddReference("RevitNodes")
import Revit
clr.ImportExtensions(Revit.Elements)
 
#The inputs to this node will be stored as a list in the IN variable.
dataEnteringNode = IN
 
#collect all views in the model
collector = FilteredElementCollector(doc)
views = collector.OfClass(View).ToElements()
 
#sort views into separate lists based on view type
areaPlans, ceilingPlans, columnSchedules = [], [], []
costReport, details, draftingViews = [], [], []
drawingSheets, elevations, engineetingPlans = [], [], []
floorPlans, internal, legends, loadReports = [], [], [], []
panelSchedules, pressureLossReports, renderings = [], [], []
reports, schedules, sections, threeD = [], [], [], []
undefined, walkthrough = [], []
for i in views:
	if not i.IsTemplate:
		if i.ViewType == ViewType.AreaPlan:
			areaPlans.append(i.ToDSType(True))
		elif i.ViewType == ViewType.CeilingPlan:
			ceilingPlans.append(i.ToDSType(True))
		elif i.ViewType == ViewType.ColumnSchedule:
			columnSchedules.append(i.ToDSType(True))
		elif i.ViewType == ViewType.CostReport:
			costReport.append(i.ToDSType(True))
		elif i.ViewType == ViewType.Detail:
			details.append(i.ToDSType(True))
		elif i.ViewType == ViewType.DraftingView:
			draftingViews.append(i.ToDSType(True))
		elif i.ViewType == ViewType.DrawingSheet:
			drawingSheets.append(i.ToDSType(True))
		elif i.ViewType == ViewType.Elevation:
			elevations.append(i.ToDSType(True))
		elif i.ViewType == ViewType.EngineeringPlan:
			engineetingPlans.append(i.ToDSType(True))
		elif i.ViewType == ViewType.FloorPlan:
			floorPlans.append(i.ToDSType(True))
		elif i.ViewType == ViewType.Internal:
			internal.append(i.ToDSType(True))
		elif i.ViewType == ViewType.Legend:
			legends.append(i.ToDSType(True))
		elif i.ViewType == ViewType.LoadsReport:
			loadReports.append(i.ToDSType(True))
		elif i.ViewType == ViewType.PanelSchedule:
			panelSchedules.append(i.ToDSType(True))
		elif i.ViewType == ViewType.PresureLossReport:
			pressureLossReports.append(i.ToDSType(True))
		elif i.ViewType == ViewType.Rendering:
			renderings.append(i.ToDSType(True))
		elif i.ViewType == ViewType.Report:
			reports.append(i.ToDSType(True))
		elif i.ViewType == ViewType.Schedule:
			schedules.append(i.ToDSType(True))
		elif i.ViewType == ViewType.Section:
			sections.append(i.ToDSType(True))
		elif i.ViewType == ViewType.ThreeD:
			threeD.append(i.ToDSType(True))
		elif i.ViewType == ViewType.Undefined:
			undefined.append(i.ToDSType(True))
		elif i.ViewType == ViewType.Walkthrough:
			walkthrough.append(i.ToDSType(True))
		else:
			continue
 
#Assign your output to the OUT variable
OUT = floorPlans
# ----------------------------------------
code_block_6 = CodeBlock { 0; }
# note: Create Elevations at Rooms in Plans
getItemAtIndex_5 = List.GetItemAtIndex(list=get_floor_plans, index=code_block_6)
code_block_7 = CodeBlock { 0..3; }
ʳʰʸᵗʰᵐ_elevationmarker_2 = Rhythm.Revit.Elements.ElevationMarker.CreateElevationByMarkerIndex(elevationMarker=ʳʰʸᵗʰᵐ_elevationmarker, planView=getItemAtIndex_5, index=code_block_7)
code_block_8 = CodeBlock { "View Name"; }
code_block_9 = CodeBlock(RNum=number_2) { RNum+" - "+["D","A","B","C"]<1>; }
# note: Create View Names based on Room Name & Number, Assign to Elevations
sort = List.Sort(list=code_block_9@L2)
transpose = List.Transpose(lists=sort)
setParameterByName_3 = Element.SetParameterByName(element=ʳʰʸᵗʰᵐ_elevationmarker_2, parameterName=code_block_8, value=transpose@L2, lacing=Longest)
# note: Pakovanje osnova plafona i pogleda na Sheet-ove
list_create_2 = List.Create(item0=flatten_2, item1=flatten_4, item2=setParameterByName_3)
transpose_2 = List.Transpose(lists=list_create_2)
reverseFlatten = Custom[List.Operations.ReverseFlatten](Elements=transpose_2@L3)  # package Caribou; Works the same as flatten, but operatios are made from the end side.

# group: pozicioniranje na listu
number_slider = DoubleSlider(50, range=0..1000 step 0.001)  # graph input
# note: Floor
number_slider_2 = DoubleSlider(50, range=0..1000 step 0.001)  # graph input
byCoordinates = Point.ByCoordinates(x=number_slider, y=number_slider_2)
number_slider_3 = DoubleSlider(200, range=0..1000 step 0.001)  # graph input
# note: Roof
number_slider_4 = DoubleSlider(50, range=0..1000 step 0.001)  # graph input
byCoordinates_2 = Point.ByCoordinates(x=number_slider_3, y=number_slider_4)
number_slider_5 = DoubleSlider(200, range=0..1000 step 0.001)  # graph input
# note: D
number_slider_6 = DoubleSlider(200, range=0..1000 step 0.001)  # graph input
byCoordinates_3 = Point.ByCoordinates(x=number_slider_5, y=number_slider_6)
number_slider_7 = DoubleSlider(50, range=0..1000 step 0.001)  # graph input
# note: A
number_slider_8 = DoubleSlider(400, range=0..1000 step 0.001)  # graph input
byCoordinates_4 = Point.ByCoordinates(x=number_slider_7, y=number_slider_8)
number_slider_9 = DoubleSlider(200, range=0..1000 step 0.001)  # graph input
# note: B
number_slider_10 = DoubleSlider(400, range=0..1000 step 0.001)  # graph input
byCoordinates_5 = Point.ByCoordinates(x=number_slider_9, y=number_slider_10)
number_slider_11 = DoubleSlider(0, range=0..1000 step 0.001)  # graph input
# note: C
number_slider_12 = DoubleSlider(200, range=0..1000 step 0.001)  # graph input

byCoordinates_6 = Point.ByCoordinates(x=number_slider_11, y=number_slider_12)

# group (continued): pozicioniranje na listu
create = List.Create(item0=byCoordinates, item1=byCoordinates_2, item2=byCoordinates_3, item3=byCoordinates_4, item4=byCoordinates_5, item5=byCoordinates_6)

govno = CodeBlock(t1=transpose_2) { t2=DSCore.List.Count(t1); t3=t2-1; }
ofRepeatedItem = List.OfRepeatedItem(item=create, amount=govno.t2)

# group: Place Views on a Sheet
true_to_start = BoolSelector(true)  # graph input
code_block_10 = CodeBlock(Run=true_to_start, Sheet=createSheets, Views=reverseFlatten, Locations=ofRepeatedItem) { Run; Sheet; Views; Locations; }
place_views_on_sheet_py = Python(IN[0]=code_block_10.Run, IN[1]=code_block_10.Sheet, IN[2]=code_block_10.Views, IN[3]=code_block_10.Locations)
# ---------- place_views_on_sheet_py.python (60 lines) ----------
################### Import References ###################
import clr

clr.AddReference("RevitServices")
import RevitServices
from RevitServices.Persistence import DocumentManager
from RevitServices.Transactions import TransactionManager
doc =  DocumentManager.Instance.CurrentDBDocument
app = DocumentManager.Instance.CurrentUIApplication.Application

clr.AddReference("RevitNodes")
import Revit
clr.ImportExtensions(Revit.Elements)
clr.ImportExtensions(Revit.GeometryConversion)

clr.AddReference("RevitAPI")
from Autodesk.Revit.DB import *
################### Definitions ###################
def tolist(obj1):
	if hasattr(obj1,"__iter__"): return obj1
	else: return [obj1]
################### Inputs ###################
#get the bool in port IN[0]...
run = tolist(IN[0])[0]
#get the sheet in port IN[1] and UnwrapElement if not already...
sheetsIN = tolist(UnwrapElement(IN[1]))
#get the views in port IN[1] and UnwrapElement if not already...
viewsIN = tolist(UnwrapElement(IN[2]))
#get the points in port IN[2] (no need to unwrap as these are Dynamo Points)...
locsIN = tolist(IN[3])
################### Outputs ###################
outList = []
################### Script ###################
if run:
	# check if list lengths are the same (the views and locations will be lists of lists here, but the outermost list layer should all be the same length)
	if len(sheetsIN) == len(viewsIN) == len(locsIN):
		TransactionManager.Instance.EnsureInTransaction(doc)
		# loop through all lists (views and locs will be lists of lists)
		for sht,views,locs in zip(sheetsIN,viewsIN,locsIN):
			arr = []
			# test if number of views and number of locations match
			if len(views) == len(locs):
				# loop through all views and locations and try place them on sheet...			
				for v,l in zip(views, locs):					
					try:
						if Viewport.CanAddViewToSheet(doc,sht.Id,v.Id):
							vp = Viewport.Create(doc,sht.Id,v.Id,l.ToXyz())
							arr.append(vp)
						else: arr.append("Can't place view on sheet")
					except Exception, e:
						arr.append(e.message)					
				outList.append(arr)								
			else:
				outList.append("Number of views does not match number of locations")				
		OUT = outList
		TransactionManager.Instance.TransactionTaskDone()			
	else:
		OUT = "Number of sheets does not match either the number of view lists of location lists"
else:
	OUT = "Set Run to True"
# ----------------------------------------

await_ = Orchid.Core.DataStream.Await(pass=setParameterByName_3, waitFor=place_views_on_sheet_py)
code_block_11 = CodeBlock { "Detail Number"; }
code_block_12 = CodeBlock { A = ["D","A","B","C"]<1>; }
# note: Elevation renameing
ofRepeatedItem_2 = List.OfRepeatedItem(item=code_block_12, amount=count)
setParameterByName_4 = Element.SetParameterByName(element=await_, parameterName=code_block_11, value=ofRepeatedItem_2, lacing=Longest)
views = Python(IN[0]=ʳʰʸᵗʰᵐ_elevationmarker_2)
# ---------- views.python (13 lines) ----------
import clr
clr.AddReference('ProtoGeometry')
from Autodesk.DesignScript.Geometry import *
#The inputs to this node will be stored as a list in the IN variables.
input = IN[0]

if isinstance(input,list) == False:
	elements = [input]
else:
	elements = input

#Assign your output to the OUT variable.
OUT = elements
# ----------------------------------------
code_block_13 = CodeBlock { 3; }
flatten_5 = List.Flatten(list=views, amt=code_block_13)
# note: Set View Template
all_3 = Orchid.RevitProject.Views.ViewTemplate.All()
name_5 = Element.Name(element=all_3)
ime_templejta_3 = StringInput("3.1 POGLEDI")
boolean_4 = BoolSelector(true)
contains_3 = String.Contains(str=name_5, searchFor=ime_templejta_3, ignoreCase=boolean_4)
filterByBoolMask_3 = List.FilterByBoolMask(list=all_3, mask=contains_3)
code_block_14 = CodeBlock { 0; }
getItemAtIndex_6 = List.GetItemAtIndex(list=filterByBoolMask_3.in, index=code_block_14)
setViewTemplate_3 = archilab.Revit.Views.Views.SetViewTemplate(view=flatten_5, viewTemplate=getItemAtIndex_6)

# group: ne postoji opcija za pozicioniranje shape-handle
get_all_viewport_types = Python()  # graph input; frozen
# ---------- get_all_viewport_types.python (41 lines) ----------
# Copyright(c) 2015, Konrad K Sobon
# @arch_laboratory, http://archi-lab.net

import clr
# Import Element wrapper extension methods
clr.AddReference("RevitNodes")
import Revit
clr.ImportExtensions(Revit.Elements)

# Import DocumentManager and TransactionManager
clr.AddReference("RevitServices")
import RevitServices
from RevitServices.Persistence import DocumentManager
doc = DocumentManager.Instance.CurrentDBDocument

import sys
pyt_path = r'C:\Program Files (x86)\IronPython 2.7\Lib'
sys.path.append(pyt_path)

# Import RevitAPI
clr.AddReference("RevitAPI")
import Autodesk
from Autodesk.Revit.DB import *

#The inputs to this node will be stored as a list in the IN variable.
dataEnteringNode = IN

try:
	errorReport = None
	viewports = FilteredElementCollector(doc).OfCategory(BuiltInCategory.OST_Viewports).WhereElementIsNotElementType().ToElements()
	types = [doc.GetElement(i) for i in viewports[0].GetValidTypes()]
except:
	# if error accurs anywhere in the process catch it
	import traceback
	errorReport = traceback.format_exc()

#Assign your output to the OUT variable
if errorReport == None:
	OUT = types
else:
	OUT = errorReport
# ----------------------------------------
name_6 = Element.Name(element=get_all_viewport_types)
papirologija = Watch()  # unwired: arg0
i_2 = CodeBlock(i=get_all_viewport_types) { i[3]; }
id = Element.Id(element=i_2)
# note: Setovanje tipa ViewPort-a
change_family_type = Custom[Change Family Type](element=papirologija, typeId=id)  # package archi-lab.net; Changes family type of a family by passing in an Element and type id of the type we want to change it to.

# group: wip
# note: Gets Sheet Outline for visualisation
firstItem = List.FirstItem(list=createSheets)  # frozen
get_view_outlines_py = Python(IN[0]=firstItem)
# ---------- get_view_outlines_py.python (56 lines) ----------
################### Import References ###################
import clr

clr.AddReference("ProtoGeometry")
from Autodesk.DesignScript import Geometry as geom
clr.AddReference("RevitServices")
import RevitServices
from RevitServices.Persistence import DocumentManager
from RevitServices.Transactions import TransactionManager
doc =  DocumentManager.Instance.CurrentDBDocument
app = DocumentManager.Instance.CurrentUIApplication.Application

clr.AddReference("RevitNodes")
import Revit
clr.ImportExtensions(Revit.Elements)
clr.ImportExtensions(Revit.GeometryConversion)

clr.AddReference("RevitAPI")
from Autodesk.Revit.DB import *

import System
from System.Collections.Generic import *
################### Definitions ###################
def tolist(obj1):
	if hasattr(obj1,"__iter__"): return obj1
	else: return [obj1]
################### Input Variables ###################
#get the sheet in port IN[1] and UnwrapElement if not already...
views = tolist(UnwrapElement(IN[0]))
################### Output Variables ###################
outList = []
################### other Variables ###################
#conversion between ft and mm
ft2mm = 304.8
################### Script ###################
for v in views:
	#get outline
	oLine = v.Outline
	minU = oLine.Min.U*304.8
	minV = oLine.Min.V*304.8
	maxU = oLine.Max.U*304.8
	maxV = oLine.Max.V*304.8
	
	#get width and length of Rectangle
	w = maxU-minU
	l = maxV-minV
	
	#create rectangle
	myRec = geom.Rectangle.ByWidthLength(w,l)
	#move rectangle so bottom left corner is at origin
	myRec2 = geom.Geometry.Translate(myRec,w/2,l/2,0)
	#add rectangle to output list
	outList.append(myRec2)

OUT = outList
	
# ----------------------------------------
# note: Gets Views Outline for visualisation
firstItem_2 = List.FirstItem()  # frozen; unwired: list
get_view_outlines_py_2 = Python(IN[0]=firstItem_2)  # same code as get_view_outlines_py
center = Polygon.Center(polygon=get_view_outlines_py_2)
firstItem_3 = List.FirstItem(list=create)
byTwoPoints = Vector.ByTwoPoints(start=center, end=firstItem_3)
translate = Geometry.Translate(geometry=get_view_outlines_py_2, direction=byTwoPoints)

# group: TAG
views_2 = Views("+0.00")
code_block_15 = CodeBlock { "Doors"; }
byName_2 = Category.ByName(name=code_block_15)
all_elements_of_category = ElementsOfCategory(Category=byName_2)
taggable_parameter = StringInput("TAG VRATA")  # graph input
getParameterValueByName = Element.GetParameterValueByName(element=all_elements_of_category, parameterName=taggable_parameter)
code_block_16 = CodeBlock { ""; }
ne = getParameterValueByName != code_block_16
filterByBoolMask_4 = List.FilterByBoolMask(list=all_elements_of_category, mask=ne)
categories = Categories("OST_DoorTags")  # frozen
boolean_5 = BoolSelector(true)
tag_family = FamilyTypes("2.Vrata 1-50:Mark + Dimensions + Tag")  # graph input
string_from_object = FromObject(obj=tag_family)
id_2 = Element.Id(element=filterByBoolMask_4.in)
bySpatialElementAndLocation = Orchid.RevitProject.Annotations.Tag.BySpatialElementAndLocation(view=views_2)  # unwired: spatialElement, tagType, location
all_view_dependent_family = Custom[All View-Dependent Family Instances Of Category]()  # Gets all view-dependent family instances in a given view for a given list of categories - useful for finding annotation elements; unwired: category, view
create_annotation_tag = Custom[Create Annotation Tag]()  # package archi-lab.net; This node will create an annotation tag at a given location, of given type and in a supplied view. If only single view is supplied then all tags will be created in that view.; unwired: tagLocations, tagType, elements, views

python_script_2 = Python(IN[0]=categories, IN[1]=code_block_10.Views, IN[2]=boolean_5)
# ---------- python_script_2.python (24 lines) ----------
import System
import clr
clr.AddReference('RevitAPI')
from Autodesk.Revit.DB import *

clr.AddReference("RevitServices")
import RevitServices
from RevitServices.Persistence import DocumentManager

def CollectByView(bic, view):
	collector = FilteredElementCollector(doc)
	filter = ElementOwnerViewFilter(view.Id)
	return collector.WherePasses(filter).OfCategory(bic).ToElements()

def GetViewDependentElements(cat, views):
	if isinstance(views, list): return [CollectByView(cat, x) for x in UnwrapElement(views)]
	else: return CollectByView(cat, UnwrapElement(views))

doc = DocumentManager.Instance.CurrentDBDocument
cats = IN[0]
views = IN[1]

if isinstance(IN[0], list): OUT = [GetViewDependentElements(x, views) for x in cats]
else: OUT = GetViewDependentElements(cats, views)
# ----------------------------------------

# group (continued): TAG
type = archilab.Revit.Elements.Elements.Type(element=python_script_2)
flatten_6 = List.Flatten(list=type)
string_from_object_2 = FromObject(obj=flatten_6)
eq = string_from_object_2 == string_from_object
filterByBoolMask_5 = List.FilterByBoolMask(list=python_script_2, mask=eq)
taggedElement = Tag.TaggedElement(tag=filterByBoolMask_5.in)
flatten_7 = List.Flatten(list=taggedElement)
id_3 = Element.Id(element=flatten_7)
contains_4 = List.Contains(list=id_3, item=id_2@L1)
filterByBoolMask_6 = List.FilterByBoolMask(list=filterByBoolMask_4.in, mask=contains_4)
flatten_8 = List.Flatten(list=filterByBoolMask_6.out)
hostelement_archilab = Custom[HostElement-ArchiLab](filterByBoolMask_6.out)  # package Chynamo; Get host elements of given nest elements, imported from ArchiLab
getLocation = Element.GetLocation(element=hostelement_archilab)
curve = dtGeometry.Deconstruct.Curve(curve=getLocation)
byElementAndLocation = Orchid.RevitProject.Annotations.Tag.ByElementAndLocation(view=views_2, element=flatten_8, tagType=tag_family, location=curve.midPt)

code_block_17 = CodeBlock { 1; }
get_tagged_element_id = Custom[Get Tagged Element Id](tags=tag_family)  # package archi-lab.net; Retrives an Element Id from input of element tags. For example if wall tags are inputted it will return tagged wall Ids.
taggedElement_2 = Tag.TaggedElement(tag=tag_family)
collect_all_tags_in_project = Custom[Collect All Tags in Project]()  # package Bakery
tag_host_element = Custom[Tag Host Element](tag=collect_all_tags_in_project)  # package archi-lab.net; This node will retrieve an element that is hosting a given tag.

# group: Place Views on a Sheet
run = BoolSelector(true)  # graph input
code_block_18 = CodeBlock(Run=run) { Run; Sheet; Views; Locations; }  # unwired: Sheet, Views, Locations

ʳʰʸᵗʰᵐ_sheet_packviews = Rhythm.Revit.Views.Sheet.PackViews(sheet=code_block_18.Sheet, views=code_block_18.Views)  # frozen
await_2 = Orchid.Core.DataStream.Await(pass=code_block_10.Sheet, waitFor=place_views_on_sheet_py)
getViewport = Custom[View.GetViewport](Sheet=await_2)  # package SteamNodes; Get Vieworts from Views
ʳʰʸᵗʰᵐ_viewport_setboxcenter = Rhythm.Revit.Elements.Viewport.SetBoxCenter(viewport=getViewport, point=code_block_10.Locations)

# group: Filter po parametru
param_1 = StringInput("7")
param_2 = StringInput("8")
id_4 = Element.Id(element=placedRooms)
string_from_object_3 = FromObject(obj=id_4)
placedRooms_2 = Python()  # "Collector.PlacedRooms"; unwired: IN[0]; same code as placedRooms
parameter_name = StringInput("ISO")
getParameterValueByName_2 = Element.GetParameterValueByName(element=placedRooms_2, parameterName=parameter_name)
code_block_19 = CodeBlock { 7; 8; }
list_create_3 = List.Create(item0=code_block_19.out0, item1=code_block_19.out1)
eq_2 = getParameterValueByName_2 == list_create_3  # lacing=CrossProduct
anyTrue = Orchid.Core.List.AnyTrue(list=eq_2)
filterByBoolMask_7 = List.FilterByBoolMask(list=placedRooms_2, mask=anyTrue)
flatten_9 = List.Flatten(list=filterByBoolMask_7.in)
id_5 = Element.Id(element=flatten_9)
string_from_object_4 = FromObject(obj=id_5)
eq_3 = string_from_object_3 == string_from_object_4  # lacing=CrossProduct
anyTrue_2 = Orchid.Core.List.AnyTrue(list=eq_3)
# note: rooms = [UnwrapElement(IN[0])]
# namePrefix = IN[1]
# bboxOffset = IN[2]
# runMe = IN[3]
# nameSufix = IN[4]
filterByBoolMask_8 = List.FilterByBoolMask(list=string_from_object_3, mask=anyTrue_2)
byElementId = archilab.Revit.Selection.Select.ByElementId(id=filterByBoolMask_8.in)

# group (continued): Izbor rada
filter_po_parametru = CodeBlock(F=byElementId) { F; }

# note: https://forum.dynamobim.com/t/placing-multiple-views-on-multiple-sheets/37035
placing_multiple_views_on = Python(IN[0]=code_block_10.Sheet, IN[1]=code_block_10.Views, IN[2]=code_block_10.Locations)  # "Placing Multiple Views on Multiple Sheets"; frozen
# ---------- placing_multiple_views_on.python (53 lines) ----------
#proposed by Julien Benoit @jbenoit44 
#updated by @truevis
import clr
clr.AddReference('ProtoGeometry')
from Autodesk.DesignScript.Geometry import *
# Import ToDSType(bool) extension method
clr.AddReference("RevitNodes")
import Revit
clr.ImportExtensions(Revit.Elements)
# Import geometry conversion extension methods
clr.ImportExtensions(Revit.GeometryConversion)
# Import DocumentManager and TransactionManager
clr.AddReference("RevitServices")
import RevitServices
from RevitServices.Persistence import DocumentManager
from RevitServices.Transactions import TransactionManager
from System.Collections.Generic import *
# Import RevitAPI
clr.AddReference("RevitAPI")
import Autodesk
from Autodesk.Revit.DB import *

doc = DocumentManager.Instance.CurrentDBDocument
uiapp = DocumentManager.Instance.CurrentUIApplication
app = uiapp.Application
uidoc=DocumentManager.Instance.CurrentUIApplication.ActiveUIDocument

sheets = []
for i in IN[0]:
	sheets.append(UnwrapElement(i))
views=[]	
for i in IN[1]:
	views.append(UnwrapElement(i))
points=[]	
for i in IN[2]:
	points.append(UnwrapElement(i).ToXyz())

# Start Transaction
TransactionManager.Instance.EnsureInTransaction(doc)
viewp=[]
#for s in sheets:
#	for v,p in zip(views,points):
#		a=Viewport.Create(doc, s.Id,v.Id, p)
#		viewp.append(a)
cnt = 0		
for cnt in range(len(sheets)):  
    a=Viewport.Create(doc, sheets[cnt].Id,views[cnt].Id, points[cnt])
    viewp.append(a)

# End Transaction
TransactionManager.Instance.TransactionTaskDone()

OUT=viewp
# ----------------------------------------
levels = Custom[Levels](element=placedRooms)  # package Chynamo; Get the residing and above levels of given element, combined functions from Clockwork and ArchiLab
