# Dynamo graph DY 2.3 - A5. Door Renumber - V2.dyn (Dynamo 2.3.0.5885)
# packages: archi-lab.net 2020.23.13, Synthesize toolkit 6.8.0, Write Rooms To doors 0.0.2

# group: Potrebno run-ovati u 3D view

string = StringInput("Doors")
byName = Category.ByName(name=string)
all_elements_of_category = ElementsOfCategory(Category=byName)
current = Document.Current()
activeView = Document.ActiveView(document=current)
phase = Python(IN[0]=activeView)  # "View.Phase"
# ---------- phase.python (19 lines) ----------
#gets the phase of the current view 
#copyright 2015 Paul Wintour & Dan Rumery / BVN


import clr
clr.AddReference('RevitAPI')
from Autodesk.Revit.DB import *

clr.AddReference("RevitServices")
import RevitServices
from RevitServices.Persistence import DocumentManager

doc = DocumentManager.Instance.CurrentDBDocument

view = IN[0]

phaseId = view.InternalElement.get_Parameter(BuiltInParameter.VIEW_PHASE).AsElementId()
		
OUT = doc.GetElement(phaseId)
# ----------------------------------------
rooms = Custom[CW.Door.Rooms](VARdoor=all_elements_of_category, VARphase=phase)  # package Synthesize toolkit; Gets the rooms that are connected by a given door
i = CodeBlock { 0; }
eq = rooms.VARroomCount == i
# note: to room
filterByBoolMask = List.FilterByBoolMask(list=rooms.VARtoRoom, mask=eq)
# note: from room
filterByBoolMask_2 = List.FilterByBoolMask(list=rooms.VARfromRoom, mask=eq)
create = List.Create(item0=filterByBoolMask.out, item1=filterByBoolMask_2.out)
transpose = List.Transpose(lists=create)
boolean = BoolSelector(false)  # graph input
clean = List.Clean(list=transpose, preserveIndices=boolean)
firstItem = List.FirstItem(list=clean@L2)
id = Element.Id(element=firstItem)
# note: Filters any which don't have rooms
# note: doors
filterByBoolMask_3 = List.FilterByBoolMask(list=all_elements_of_category, mask=eq)
create_2 = List.Create(item0=firstItem, item1=id, item2=filterByBoolMask_3.out)
code_block = CodeBlock { 1; false; true; }
sortListOfLists = Custom[CW.List.SortListOfLists](VARseq=create_2, VARsortIndex=code_block.out0, VARcaseInsensitive=code_block.out1, VARorderDescending=code_block.out2)  # package Synthesize toolkit; Sorts a list of lists by one of its sublists
code_block_2 = CodeBlock { 1; }
groupListOfListsByKey = Custom[CW.List.GroupListOfListsByKey](VARseq=sortListOfLists, VARkeyIndex=code_block_2)  # package Synthesize toolkit; Groups a list of lists by one of its keys
# note: gets rooms
firstItem_2 = List.FirstItem(list=groupListOfListsByKey@@L3)
boolean_2 = BoolSelector(false)  # graph input
clean_2 = List.Clean(list=firstItem_2, preserveIndices=boolean_2)
firstItem_3 = List.FirstItem(list=clean_2@L2)
centerBoundary = Room.CenterBoundary(room=firstItem_3)
byJoinedCurves = PolyCurve.ByJoinedCurves(curves=centerBoundary)
firstItem_4 = List.FirstItem(list=byJoinedCurves@L2)
count = List.Count(list=clean_2@L2)
ofRepeatedItem = List.OfRepeatedItem(item=firstItem_4, amount=count, lacing=Longest)
i_2 = CodeBlock { 2; }
# note: gets doors
getItemAtIndex = List.GetItemAtIndex(list=groupListOfListsByKey@L3, index=i_2)
clean_3 = List.Clean(list=getItemAtIndex, preserveIndices=boolean_2)
# note: From Archi-lab. Gets room location. Required as API does not return location of curtain panel doors.
transform_origin = Custom[Transform Origin](element=clean_3@L2)  # package archi-lab.net; This node will query an element for its Transform (Coordinate System) and then return its Origin point.
closestPointTo = Geometry.ClosestPointTo(geometry=ofRepeatedItem, other=transform_origin)
parameterAtPoint = Curve.ParameterAtPoint(curve=ofRepeatedItem, point=closestPointTo)
code_block_3 = CodeBlock { true; }
python_script = Python(IN[0]=parameterAtPoint, IN[1]=clean_2, IN[2]=clean_3, IN[3]=code_block_3)
# ---------- python_script.python (33 lines) ----------
# Copyright(c) 2015, Dan Rumery
# BVN, http://www.bvn.com.au/
# Licence: http://creativecommons.org/licenses/by-sa/4.0/


import clr
clr.AddReference('ProtoGeometry')
from Autodesk.DesignScript.Geometry import *

#The inputs to this node will be stored as a list in the IN variable.
parameters = IN[0]
rooms = IN[1]
doors = IN[2]

sorted_params = []
sorted_rooms = []
sorted_doors = []

for rs, ds, ps in zip(rooms, doors, parameters):
  room = rs[0]
  
  # This calculates a list of pairs (param, door) sorted by param.
  sorted_params_and_doors = sorted(zip(ps, ds), key=lambda param_and_door: param_and_door[0])
  
  # Build the output lists
  sorted_rooms.append(rs) # No need to sort the rooms
  sorted_doors.append(list(door for param, door in sorted_params_and_doors))
  sorted_params.append(list(param for param, door in sorted_params_and_doors))

outList = [sorted_params, sorted_rooms, sorted_doors]

#Assign your output to the OUT variable
OUT = outList
# ----------------------------------------
i_3 = CodeBlock { 2; }
getItemAtIndex_2 = List.GetItemAtIndex(list=python_script, index=i_3)
# note: sorted doors
reverse = List.Reverse(list=getItemAtIndex_2@L2)
# note: reverse list to get clockwise numbering
flatten = List.Flatten(list=reverse)
string_2 = StringInput("TAG VRATA")  # graph input
prefix_i_separator = CodeBlock { "D"; "-"; }
string_from_object = FromObject(obj=prefix_i_separator.out0)
length = String.Length(str=string_from_object)
formula = Formula("LENGTH > 0", length=length)
i_4 = CodeBlock { 1; }
# note: sorted rooms
getItemAtIndex_3 = List.GetItemAtIndex(list=python_script, index=i_4)
string_3 = StringInput("Number")  # graph input
# note: gets room number
getParameterValueByName = Element.GetParameterValueByName(element=getItemAtIndex_3, parameterName=string_3)
string_from_object_2 = FromObject(obj=getParameterValueByName)
flatten_2 = List.Flatten(list=string_from_object_2)
count_2 = List.Count(list=flatten_2)
ofRepeatedItem_2 = List.OfRepeatedItem(item=string_from_object, amount=count_2)
string_from_object_3 = FromObject(obj=prefix_i_separator.out1)
ofRepeatedItem_3 = List.OfRepeatedItem(item=string_from_object_3, amount=count_2)
getKeys = GetKeys(list=getParameterValueByName@L2)
# note: starts numbering at 1
code_block_4 = CodeBlock(a=getKeys) { a+1; }
# note: converts to string
string_from_object_4 = FromObject(obj=code_block_4)
# note: Door number sequence
flatten_3 = List.Flatten(list=string_from_object_4)
# note: with prefix
create_3 = List.Create(item0=ofRepeatedItem_2, item1=ofRepeatedItem_3, item2=flatten_2, item3=ofRepeatedItem_3, item4=flatten_3)
transpose_2 = List.Transpose(lists=create_3)
concat = String.Concat(string0=transpose_2)
# note: new number if true
flatten_4 = List.Flatten(list=concat)
# note: without prefix
create_4 = List.Create(item0=flatten_2, item1=ofRepeatedItem_3, item2=flatten_3)
transpose_3 = List.Transpose(lists=create_4)
concat_2 = String.Concat(string0=transpose_3)
# note: new number if false
flatten_5 = List.Flatten(list=concat_2)
if_ = If(test=formula, true=flatten_4, false=flatten_5)
setParameterByName = Element.SetParameterByName(element=flatten, parameterName=string_2, value=if_)
code_block_5 = CodeBlock(renumberedElements=setParameterByName) { renumberedElements; }
excluded_elements = List.Flatten(list=filterByBoolMask_3.in)
count_3 = List.Count(list=excluded_elements)
string_from_object_5 = FromObject(obj=count_3)
code_block_6 = CodeBlock(IN=create_2) { IN[1]; }
count_4 = List.Count(list=code_block_6)
code_block_7 = CodeBlock(a=string_from_object_5, b=count_4) { a; b; c = (a + " vrata nisu tagovana " + b + " su tagovana"); }
alert = Python(IN[0]=code_block_7.c)
# ---------- alert.python (7 lines) ----------
import clr
clr.AddReference('System.Windows.Forms')
from System.Windows.Forms import MessageBox
msg = IN[0]
if msg:
	MessageBox.Show(msg, "Termovent")
OUT = msg
# ----------------------------------------
writeDoors_FromToRoom = Custom[WriteDoors_FromToRoom]()  # frozen; package Write Rooms To doors
