# Dynamo graph DY 2.3 - A9. Unconnected Height to Visina zida - V2.dyn (Dynamo 2.3.1.11775)
# packages: designtech 1.0.8, TBF 1.1.9, Orchid 203.3.0.7865

string = StringInput("Walls")
byName = Category.ByName(name=string)
all_elements_of_category = ElementsOfCategory(Category=byName)

# group: Metoda 1, Top Constraint - ne računa "Unconnected" zidove
codeBlock = CodeBlock { "Top Constraint"; "Elevation"; 0; }
getParameterValueByName = Element.GetParameterValueByName(element=all_elements_of_category, parameterName=codeBlock.out0)
getParameterValueByName_2 = Element.GetParameterValueByName(element=getParameterValueByName, parameterName=codeBlock.out1)
# note: 0 - Seq.
# 1 - Replacement
replaceNull = Python(IN[0]=getParameterValueByName_2, IN[1]=codeBlock.out2)  # "List.ReplaceNull"
# ---------- replaceNull.python (8 lines) ----------
items = IN[0]
rep = IN[1]
elementlist = list()
for item in items:
	if item is None: 
		item = rep
	elementlist.append(item)
OUT = elementlist
# ----------------------------------------
flatten = List.Flatten(list=replaceNull)

# group: Metoda 2, Visina pojedinačnog zidnog sistema
codeBlock_2 = CodeBlock { "Unconnected Height"; 0; }
getParameterValueByName_3 = Element.GetParameterValueByName(element=all_elements_of_category, parameterName=codeBlock_2.out0)
round = Math.Round(number=getParameterValueByName_3, digits=codeBlock_2.out1)

code_block = CodeBlock(Element=all_elements_of_category, M1=flatten, M2=round) { Element; "Visina zidova"; M1; M2; }
setParameterByName = Element.SetParameterByName(element=code_block.Element, parameterName=code_block.out1, value=code_block.M2)
categories = Categories("OST_Roads")  # frozen
all_elements_of_category_2 = ElementsOfCategory(Category=categories)

# group: Metoda 1, Top Constraint - ne računa "Unconnected" zidove
code_block_2 = CodeBlock { "Base Level"; "Elevation"; 0; }
getParameterValueByName_4 = Element.GetParameterValueByName(element=all_elements_of_category_2, parameterName=code_block_2.out0)
getParameterValueByName_5 = Element.GetParameterValueByName(element=getParameterValueByName_4, parameterName=code_block_2.out1)
# note: 0 - Seq.
# 1 - Replacement
replaceNull_2 = Python(IN[0]=getParameterValueByName_5, IN[1]=code_block_2.out2)  # "List.ReplaceNull"; same code as replaceNull
flatten_2 = List.Flatten(list=replaceNull_2)

setParameterByName_2 = Element.SetParameterByName(element=all_elements_of_category_2, parameterName=code_block.out1, value=flatten_2)

# group: iZBACI GRUPE
# note: Custom Package: TBF
allGroup = Custom[AllGroup]()  # frozen; package TBF; Get All Model Group
code_block_3 = CodeBlock { "Walls"; }
byName_2 = Category.ByName(name=code_block_3)
# note: Custom Package: designtech
fromObject = dtCore.String.FromObject(obj=byName_2)

getNestedElement = Orchid.RevitProject.Elements.Group.GetNestedElement(group=allGroup.Group)

# group (continued): iZBACI GRUPE
# note: Custom Package: Orchid
getCategory = Element.GetCategory(element=getNestedElement)
flatten_3 = List.Flatten(list=getCategory)
fromObject_2 = dtCore.String.FromObject(obj=flatten_3)
eq = fromObject_2 == fromObject
filterByBoolMask = List.FilterByBoolMask(list=flatten_3, mask=eq)
