# Dynamo graph DY 2.3 - B1 - Parameter Associate 2.dyn (Dynamo 2.12.1.8246)
# packages: Orchid 230.1.0.7697

string = StringInput("Curtain Panels")
byName = Category.ByName(name=string)
all_elements_of_category = ElementsOfCategory(Category=byName)
elementType = Element.ElementType(element=all_elements_of_category)
associate = Orchid.RevitProject.Parameters.GlobalParameter.Associate(element=elementType)  # unwired: parameterName, globalParameter

# group: Mat. Par u Familiji
string_2 = StringInput("Materijal Ispune")
string_3 = StringInput("Materijal Lim Front")
string_4 = StringInput("Materijal Lim Back")
string_5 = StringInput("Materijal Profila Vrata")
string_6 = StringInput("Materijal Šarke")
string_7 = StringInput("Materijal Konstrukcija Prozora")
string_8 = StringInput("N/A")
list_create = List.Create(item0=string_2, item1=string_3, item2=string_4, item3=string_5, item4=string_6, item5=string_7, item6=string_8)
string_9 = StringInput("Materijal Ispune Obloge")

# group: Global
element_types = ElementTypes("GlobalParameter")
all_elements_of_type = ElementsOfType(element_type=element_types)
name = Element.Name(element=all_elements_of_type)
watch = Watch(name)
findByName = GlobalParameter.FindByName(name=watch)

combine = List.Combine(comb=associate, list1=list_create, list2=findByName)
string_10 = StringInput("Doors")
list_create_2 = List.Create(item0=string_10, item1=string)
