# Dynamo graph DY 2.3 - B1 - Parameter Associate.dyn "Parameter Associate" (Dynamo 2.3.1.11775)
# packages: Orchid 230.1.0.7697

string = StringInput("Doors")
string_2 = StringInput("Curtain Panels")
list_create = List.Create(item0=string, item1=string_2)
byName = Category.ByName(name=list_create)
all_elements_of_category = ElementsOfCategory(Category=byName)
elementType = Element.ElementType(element=all_elements_of_category)

# group: Mat. Par u Familiji
string_3 = StringInput("Materijal Ispune")
string_4 = StringInput("Materijal Lim Front")
string_5 = StringInput("Materijal Lim Back")
string_6 = StringInput("Material Push Plate")
string_7 = StringInput("Materijal Ručke")
string_8 = StringInput("Materijal Profil Krila")
string_9 = StringInput("Materijal Štok A")
string_10 = StringInput("Materijal Štok B")
string_11 = StringInput("Materijal Sarke")
string_12 = StringInput("Materijal Konstrukcija Prozora")
string_13 = StringInput("Materijal Profil Dvokrilnih Vrata")
string_14 = StringInput("Material Kick Plate")
list_create_2 = List.Create(item0=string_3, item1=string_4, item2=string_5, item3=string_6, item4=string_7, item5=string_8, item6=string_9, item7=string_10, item8=string_11, item9=string_12, item10=string_13, item11=string_14)

# group: Global
element_types = ElementTypes("GlobalParameter")
all_elements_of_type = ElementsOfType(element_type=element_types)
name = Element.Name(element=all_elements_of_type)
watch = Watch(name)
findByName = GlobalParameter.FindByName(name=watch)

associate = Orchid.RevitProject.Parameters.GlobalParameter.Associate(element=elementType, parameterName=list_create_2, globalParameter=findByName)  # frozen
watch_2 = Watch(associate)
associate_2 = Orchid.RevitProject.Parameters.GlobalParameter.Associate(element=elementType)  # unwired: parameterName, globalParameter
combine = List.Combine(comb=associate_2, list1=list_create_2, list2=findByName)
