# Dynamo graph DY 2.3 - B3 - Add Shared Parameter.dyn (Dynamo 2.3.1.11775)
# packages: Orchid 230.1.0.7697, Orchid 203.3.0.7865, archi-lab.net 2020.23.13

# group: bckp
code_block = CodeBlock { "Visina Kick Plate Back"; "DIMENZIJE"; "PG_ELECTRICAL"; true; }
code_block_2 = CodeBlock { "Dužina Kabla"; "DIMENZIJE"; "Length"; "PG_ELECTRICAL"; true; }
# note: Custom Package: archilab
parameter_types = ParameterTypeUi()  # nothing selected
parameter_groups = ParameterGroupUi()  # nothing selected
code_block_3 = CodeBlock { "Total Selling Price"; "AAA"; "Currency"; "PG_GENERAL"; true; }
code_block_4 = CodeBlock { "Bolt"; "OPCIJE"; "YesNo"; "INVALID"; }

code_block_5 = CodeBlock()
# ---------- code_block_5.designscript (14 lines) ----------
"Pozicija Push Plate";
	// Parameter Name;

"DIMENZIJE";
	// Shared File Group Name;

"PG_GEOMETRY";
	// Revit PG_Group;

true;
	// Is Instance?;

1050;
	//vrednost;
# ----------------------------------------
list_create = List.Create(item0=code_block_5.out0, item1=code_block_5.out1, item2=code_block_5.out2, item3=code_block_5.out3, item4=code_block_5.out4)
code_block_6 = CodeBlock()
# ---------- code_block_6.designscript (14 lines) ----------
"Push Plate";
	// Parameter Name;

"OPCIJE";
	// Shared File Group Name;

"INVALID";
	// Revit PG_Group;

true;
	// Is Instance?;

false;
	//vrednost;
# ----------------------------------------
list_create_2 = List.Create(item0=code_block_6.out0, item1=code_block_6.out1, item2=code_block_6.out2, item3=code_block_6.out3, item4=code_block_6.out4)

# group: File Location
string = StringInput("C:\Users\nikola.markovic\Documents\DiRoots\FamilyReviser\Families")  # graph input
i = CodeBlock { "*.rfa"; }
contentsAll = Python(IN[0]=string, IN[1]=i)  # "Directory.ContentsAll"
# ---------- contentsAll.python (7 lines) ----------
from System.IO import Directory, SearchOption
dir = IN[0]
searchstring = IN[1]
if Directory.Exists(dir):
	OUT = Directory.GetFiles(dir, searchstring, SearchOption.AllDirectories)
else:
	OUT = list()
# ----------------------------------------
# note: Custom Package: Orchid
backgroundOpen = Orchid.RevitProject.Common.Document.BackgroundOpen(file=contentsAll)

watch = Watch(backgroundOpen)
count = List.Count(list=backgroundOpen)
code_block_7 = CodeBlock()
# ---------- code_block_7.designscript (14 lines) ----------
"Ručka Napred";
	// Parameter Name;

"INVALID";
	// Shared File Group Name;

"PG_OTHER";
	// Revit PG_Group;

true;
	// Is Instance?;

false;
	//vrednost;
# ----------------------------------------
list_create_3 = List.Create(item0=code_block_7.out0, item1=code_block_7.out1, item2=code_block_7.out2, item3=code_block_7.out3, item4=code_block_7.out4)
code_block_8 = CodeBlock()
# ---------- code_block_8.designscript (14 lines) ----------
"Ručka Pozadi";
	// Parameter Name;

"INVALID";
	// Shared File Group Name;

"PG_OTHER";
	// Revit PG_Group;

true;
	// Is Instance?;

false;
	//vrednost;
# ----------------------------------------
list_create_4 = List.Create(item0=code_block_8.out0, item1=code_block_8.out1, item2=code_block_8.out2, item3=code_block_8.out3, item4=code_block_8.out4)
list_create_5 = List.Create(item0=list_create_3, item1=list_create_4)
transpose = List.Transpose(lists=list_create_5)
code_block_9 = CodeBlock(rep=count, a=transpose)
# ---------- code_block_9.designscript (16 lines) ----------
rep;

DSCore.List.OfRepeatedItem(a[0], rep);
 // Parameter Name;

DSCore.List.OfRepeatedItem(a[1], rep);
 // Shared File Group Name;

DSCore.List.OfRepeatedItem(a[2], rep);
 // Revit PG_Group;

DSCore.List.OfRepeatedItem(a[3], rep);
 // Is Instance?;

DSCore.List.OfRepeatedItem(a[4], rep);
 // Value;
# ----------------------------------------
# note: Custom Package: Orchid
add = Orchid.RevitFamily.SharedParameter.Add(familyDocument=backgroundOpen, parameterName=code_block_9.out1, groupName=code_block_9.out2, group=code_block_9.out3, instance=code_block_9.out4)
await_ = Orchid.Common.DataStream.Await(pass=watch, waitFor=add)
setValue = Orchid.RevitFamily.Parameter.SetValue(familyDocument=await_, parameterName=code_block_9.rep, value=code_block_9.out5)
await_2 = Orchid.Common.DataStream.Await(pass=await_, waitFor=setValue)
code_block_10 = CodeBlock { true; }
save = Orchid.RevitProject.Common.Document.Save(document=await_2, compact=code_block_10)
watch_2 = Watch(code_block_9.out1)
watch_3 = Watch(code_block_9.out2)
watch_4 = Watch(code_block_9.out3)
watch_5 = Watch(code_block_9.out4)
watch_6 = Watch(code_block_9.out5)
code_block_11 = CodeBlock()
# ---------- code_block_11.designscript (14 lines) ----------
"Obrada Stok Pozicija Boxer";
	// Parameter Name;

"OBRADE";
	// Shared File Group Name;

"PG_GEOMETRY";
	// Revit PG_Group;

true;
	// Is Instance?;

333;
	//vrednost;
# ----------------------------------------
list_create_6 = List.Create(item0=code_block_11.out0, item1=code_block_11.out1, item2=code_block_11.out2, item3=code_block_11.out3, item4=code_block_11.out4)
code_block_12 = CodeBlock()
# ---------- code_block_12.designscript (14 lines) ----------
"Obrada Krilo Pozicija Boxer";
	// Parameter Name;

"OBRADE";
	// Shared File Group Name;

"PG_GEOMETRY";
	// Revit PG_Group;

true;
	// Is Instance?;

333;
	//vrednost;
# ----------------------------------------
list_create_7 = List.Create(item0=code_block_12.out0, item1=code_block_12.out1, item2=code_block_12.out2, item3=code_block_12.out3, item4=code_block_12.out4)
code_block_13 = CodeBlock()
# ---------- code_block_13.designscript (14 lines) ----------
"Boxer";
	// Parameter Name;

"OPCIJE";
	// Shared File Group Name;

"INVALID";
	// Revit PG_Group;

true;
	// Is Instance?;

false;
	//vrednost;
# ----------------------------------------
list_create_8 = List.Create(item0=code_block_13.out0, item1=code_block_13.out1, item2=code_block_13.out2, item3=code_block_13.out3, item4=code_block_13.out4)
