# Dynamo graph DY 2.3 - B3.1 - Add Shared Parameter and set formula.dyn (Dynamo 2.12.1.8246)
# packages: Orchid 212.1.0.8171, archi-lab.net 2022.212.3222

parameter_groups = ParameterGroupUi()  # nothing selected
string = StringInput("C:\Users\nikola.markovic\Documents\DiRoots\FamilyReviser\Families\VRATA")  # graph input
i = CodeBlock { "*.rfa"; }
contentsAll = Python(IN[0]=string, IN[1]=i)  # "Directory.ContentsAll"; IronPython2
# ---------- contentsAll.python (7 lines) ----------
from System.IO import Directory, SearchOption
dir = IN[0]
searchstring = IN[1]
if Directory.Exists(dir):
	OUT = Directory.GetFiles(dir, searchstring, SearchOption.AllDirectories)
else:
	OUT = list()
# ----------------------------------------
backgroundOpen = Orchid.RevitProject.Common.Document.BackgroundOpen(file=contentsAll)
watch = Watch(backgroundOpen)
code_block = CodeBlock { "Push Plate"; "AAA"; "INVALID"; true; }
add = Orchid.RevitFamily.SharedParameter.Add(familyDocument=watch, parameterName=code_block.out0, groupName=code_block.out1, group=code_block.out2, instance=code_block.out3)
await_ = Orchid.Common.DataStream.Await(pass=watch, waitFor=add)
set_formula = BoolSelector(false)

# group: Set Formula
string_2 = StringInput("\"ARH\"")

set = Orchid.RevitFamily.Formula.Set(familyDocument=await_, parameterName=code_block.out0, value=string_2)
if_ = RefactoredIf(test=set_formula, true=set, false=await_)
await_2 = Orchid.Common.DataStream.Await(pass=await_, waitFor=if_)
code_block_2 = CodeBlock { true; }
save = Orchid.RevitProject.Common.Document.Save(document=await_2, compact=code_block_2)
close = Orchid.RevitProject.Common.Document.Close(document=save)
code_block_3 = CodeBlock { "PG_GEOMETRY"; }
watch_2 = Watch(backgroundOpen)  # frozen
izbriši_parametre = CodeBlock()
# ---------- izbriši_parametre.designscript (15 lines) ----------
[
"Cirkular -",
"Formiranje",
"Ger -",
"Glodalica -",
"Lepljenje -",
"Makaze -",
"Presovanje -",
"Probija",
"Sastavljanje -",
"Savijanje -",
"Zavarivanje -",
"LOD 100",
"LOD 400"
];
# ----------------------------------------

# group: Delete all shared
delete = Orchid.RevitFamily.Parameter.Delete(familyDocument=watch_2, parameterName=izbriši_parametre)
await_3 = Orchid.Common.DataStream.Await(pass=watch_2, waitFor=delete)  # frozen
code_block_4 = CodeBlock { true; }
save_2 = Orchid.RevitProject.Common.Document.Save(document=await_3, compact=code_block_4)
close_2 = Orchid.RevitProject.Common.Document.Close(document=save_2)

sharedParameters = Orchid.RevitProject.Common.Document.SharedParameters(document=watch_2)
name = Element.Name(element=sharedParameters.Parameter)
contains = List.Contains(list=name, item=izbriši_parametre, lacing=CrossProduct)
code_block_5 = CodeBlock { true; }
contains_2 = String.Contains(string=name, searchFor=izbriši_parametre, ignoreCase=code_block_5, lacing=Longest)
filterByBoolMask = List.FilterByBoolMask(list=sharedParameters.Parameter, mask=contains_2)
filterByBoolMask_2 = List.FilterByBoolMask(list=name, mask=contains_2)
setFormula = FamilyDocument.SetFormula()  # unwired: familyDocument, parameterName, formula
