# Dynamo graph DY 2.3 - B3.1 - Add Shared Parameters.dyn (Dynamo 2.3.1.11775)
# packages: Orchid 203.3.0.7865, archi-lab.net 2020.23.13

code_block = CodeBlock { "Rooms"; }
byName = Category.ByName(name=code_block)
code_block_2 = CodeBlock { "Projektna Celina"; "Faziranje"; "Text"; "PG_PHASING"; true; }
list_create = List.Create(item0=code_block_2.out0, item1=code_block_2.out1, item2=code_block_2.out2, item3=code_block_2.out3, item4=code_block_2.out4)
code_block_3 = CodeBlock { "Dodatni Radovi"; "Faziranje"; "Text"; "PG_PHASING"; true; }
list_create_2 = List.Create(item0=code_block_3.out0, item1=code_block_3.out1, item2=code_block_3.out2, item3=code_block_3.out3, item4=code_block_3.out4)
code_block_4 = CodeBlock { "Dodatna Narudžbina"; "Faziranje"; "Text"; "PG_PHASING"; true; }
list_create_3 = List.Create(item0=code_block_4.out0, item1=code_block_4.out1, item2=code_block_4.out2, item3=code_block_4.out3, item4=code_block_4.out4)
code_block_5 = CodeBlock { "Koleta"; "Faziranje"; "Text"; "PG_PHASING"; true; }
list_create_4 = List.Create(item0=code_block_5.out0, item1=code_block_5.out1, item2=code_block_5.out2, item3=code_block_5.out3, item4=code_block_5.out4)
code_block_6 = CodeBlock { "01OR"; "Faziranje"; "Text"; "PG_PHASING"; true; }
list_create_5 = List.Create(item0=code_block_6.out0, item1=code_block_6.out1, item2=code_block_6.out2, item3=code_block_6.out3, item4=code_block_6.out4)
code_block_7 = CodeBlock { "Otpremnica"; "Faziranje"; "Text"; "PG_PHASING"; true; }
list_create_6 = List.Create(item0=code_block_7.out0, item1=code_block_7.out1, item2=code_block_7.out2, item3=code_block_7.out3, item4=code_block_7.out4)
code_block_8 = CodeBlock { "Datum Instalacije"; "Faziranje"; "Text"; "PG_PHASING"; true; }
list_create_7 = List.Create(item0=code_block_8.out0, item1=code_block_8.out1, item2=code_block_8.out2, item3=code_block_8.out3, item4=code_block_8.out4)
code_block_9 = CodeBlock { "Mesec Instalacije"; "Faziranje"; "Text"; "PG_PHASING"; true; }
list_create_8 = List.Create(item0=code_block_9.out0, item1=code_block_9.out1, item2=code_block_9.out2, item3=code_block_9.out3, item4=code_block_9.out4)
code_block_10 = CodeBlock { "Broj Ljudi"; "Faziranje"; "Integer"; "PG_PHASING"; true; }
list_create_9 = List.Create(item0=code_block_10.out0, item1=code_block_10.out1, item2=code_block_10.out2, item3=code_block_10.out3, item4=code_block_10.out4)
code_block_11 = CodeBlock { "Komentar Montaži"; "Faziranje"; "MultilineText"; "PG_PHASING"; true; }
list_create_10 = List.Create(item0=code_block_11.out0, item1=code_block_11.out1, item2=code_block_11.out2, item3=code_block_11.out3, item4=code_block_11.out4)
list_create_11 = List.Create(item0=list_create, item1=list_create_2, item2=list_create_3, item3=list_create_4, item4=list_create_5, item5=list_create_6, item6=list_create_7, item7=list_create_8, item8=list_create_9, item9=list_create_10)
count = List.Count(list=list_create_11)
ofRepeatedItem = List.OfRepeatedItem(item=byName, amount=count)
transpose = List.Transpose(lists=list_create_11)
code_block_12 = CodeBlock(lista=transpose)
# ---------- code_block_12.designscript (17 lines) ----------
lista;

// Par. Name:
lista[0];

// Group Name
lista[1];

// Par. Type
lista[2];

// Par. Group cat
kat = lista[3];
Revit.Category.ByName(kat);

// Instance yes?
lista[4];
# ----------------------------------------
add = Orchid.RevitProject.Parameters.SharedParameter.Add(parameterName=code_block_12.out1, groupName=code_block_12.out2, group=code_block_12.out5, instance=code_block_12.out6, vary=code_block_12.out6, category=code_block_12.out3)

# group: primeri
parameter_types = ParameterTypeUi()  # nothing selected
parameter_groups = ParameterGroupUi()  # nothing selected
code_block_13 = CodeBlock { "Total Selling Price"; "AAA"; "Currency"; "PG_GENERAL"; true; }
code_block_14 = CodeBlock { "Bolt"; "OPCIJE"; "YesNo"; "INVALID"; }

code_block_15 = CodeBlock { category1 = Revit.Category.ByName("test"); }
watch = Watch(code_block_12.out5)
