# Dynamo graph DY 2.3 - B3.1.1 - Add Shared Parameters.dyn "DY 2.3 - B3.1 - Add Shared Parameter and set formula" (Dynamo 2.12.1.8246)
# packages: Orchid 212.1.0.8171, archi-lab.net 2022.212.3222

# note: Custom Node: archilab
parameter_groups = ParameterGroupUi()  # nothing selected
string = StringInput("C:\Users\nikola.markovic\Desktop\Export")  # graph input
i = CodeBlock { "*.rfa"; }
contentsAll = Python(IN[0]=string, IN[1]=i)  # "Directory.ContentsAll"; IronPython2
# ---------- contentsAll.python (7 lines) ----------
from System.IO import Directory, SearchOption
dir = IN[0]
searchstring = IN[1]
if Directory.Exists(dir):
	OUT = Directory.GetFiles(dir, searchstring, SearchOption.AllDirectories)
else:
	OUT = list()
# ----------------------------------------
# note: Custom Node: Orchidv.212.1.0.8171
backgroundOpen = Orchid.RevitProject.Common.Document.BackgroundOpen(file=contentsAll)
watch = Watch(backgroundOpen)
code_block = CodeBlock { "Ident"; "Naziv Identa"; "Dobavljačeva šifra"; "Dobavljač"; "Cena"; "AAA"; "PG_OVERALL_LEGEND"; false; }
parameter_name = List.Create(item0=code_block.out0, item1=code_block.out1, item2=code_block.out2, item3=code_block.out3, item4=code_block.out4)
add = Orchid.RevitFamily.SharedParameter.Add(familyDocument=watch, parameterName=parameter_name, groupName=code_block.out5, group=code_block.out7, instance=code_block.out6)
o_datastream_await = Orchid.Common.DataStream.Await(pass=watch, waitFor=add)
code_block_2 = CodeBlock { true; }
save = Orchid.RevitProject.Common.Document.Save(document=o_datastream_await, compact=code_block_2)
close = Orchid.RevitProject.Common.Document.Close(document=save)
code_block_3 = CodeBlock { "PG_GEOMETRY"; }
