# Dynamo graph DY 2.3 - B3.2 - Add ↓↓↓.dyn (Dynamo 2.3.1.11775)
# packages: Orchid 230.1.0.7697, archi-lab.net 2020.23.13

code_block = CodeBlock { "↓↓↓ Elektro Oprema"; "↓↓↓ Nadgradna Oprema"; "↓↓↓ Standardna Oprema"; }
watch = Watch(code_block.out0)
parameter_types = ParameterTypeUi("Text")
relay = Relay(parameter_types)
parameter_groups = ParameterGroupUi("INVALID")
code_block_2 = CodeBlock { "Text"; "INVALID"; true; }
add = Orchid.RevitFamily.Parameter.Add(parameterName=watch, type=relay, group=parameter_groups, instance=code_block_2.out2)
