# Dynamo graph DY 2.3 - B3.3 - Set Formula, Delete Shared Parameter.dyn (Dynamo 2.3.1.11775)
# packages: Orchid 203.3.0.7865

# group: Document Open
string = StringInput("C:\Users\nikola.markovic\Documents\DiRoots\FamilyReviser\Families")  # graph input
i = CodeBlock { "*.rfa"; }
contentsAll = Python(IN[0]=string, IN[1]=i)  # "Directory.ContentsAll"
# ---------- contentsAll.python (7 lines) ----------
from System.IO import Directory, SearchOption
dir = IN[0]
searchstring = IN[1]
if Directory.Exists(dir):
	OUT = Directory.GetFiles(dir, searchstring, SearchOption.AllDirectories)
else:
	OUT = list()
# ----------------------------------------
# note: Custom Node: Orchid v. 203.3.0.7865
backgroundOpen = Orchid.RevitProject.Common.Document.BackgroundOpen(file=contentsAll)

# group: Delete Parameter
# note: Custom Node: Orchid v. 203.3.0.7865
sharedParameters = Orchid.RevitProject.Common.Document.SharedParameters(document=backgroundOpen)  # frozen
code_block = CodeBlock(Elements=sharedParameters.Parameter) { Elements; }
name = Element.Name(element=sharedParameters.Parameter)
code_block_2 = CodeBlock { "Selekcija"; }
contains = String.Contains(str=name, searchFor=code_block_2)
filterByBoolMask = List.FilterByBoolMask(list=code_block, mask=contains)
code_block_3 = CodeBlock { 1; 0; }
getItemAtIndex = List.GetItemAtIndex(list=filterByBoolMask.in, index=code_block_3.out1)
name_2 = Element.Name(element=filterByBoolMask.in)
await_ = Orchid.Common.DataStream.Await(pass=backgroundOpen, waitFor=name_2)

flatten = List.Flatten(list=name_2)

# group (continued): Delete Parameter
delete = Orchid.RevitFamily.Parameter.Delete(familyDocument=await_, parameterName=flatten)

watch = Watch(backgroundOpen)

# group: Set Formula
code_block_4 = CodeBlock()
# ---------- code_block_4.designscript (4 lines) ----------
"Elektromagnetni Prihvatnik";

//Value As String
"1=0";
# ----------------------------------------
# note: Custom Node: Orchid v. 203.3.0.7865
set = Orchid.RevitFamily.Formula.Set(familyDocument=backgroundOpen, parameterName=code_block_4.out0, value=code_block_4.out1)

# group: Set Instance to Type
# note: Custom Node: Orchid v. 203.3.0.7865
sharedParameters_2 = Orchid.RevitProject.Common.Document.SharedParameters(document=backgroundOpen)
code_block_5 = CodeBlock(Elements=sharedParameters_2.Parameter) { Elements; }
name_3 = Element.Name(element=sharedParameters_2.Parameter)
code_block_6 = CodeBlock { "Elektromagnetni Prihvatnik"; }
contains_2 = String.Contains(str=name_3, searchFor=code_block_6)
filterByBoolMask_2 = List.FilterByBoolMask(list=code_block_5, mask=contains_2)
flatten_2 = List.Flatten(list=filterByBoolMask_2.in)
makeType = Python(IN[0]=flatten_2)  # "FamilyParameter.MakeType"
# ---------- makeType.python (23 lines) ----------
import clr
clr.AddReference('RevitAPI')
from Autodesk.Revit.DB import *

clr.AddReference("RevitServices")
import RevitServices
from RevitServices.Persistence import DocumentManager
from RevitServices.Transactions import TransactionManager

def MakeTypeParam(doc, param):
	success = False
	if doc.IsFamilyDocument and hasattr(param, "Formula"):
		try:
			doc.FamilyManager.MakeType(param)
			success = True
		except: pass
	return param, success

doc = DocumentManager.Instance.CurrentDBDocument
TransactionManager.Instance.EnsureInTransaction(doc)
if isinstance(IN[0], list): OUT = map(list, zip(*[MakeTypeParam(doc, x) for x in IN[0]]))
else: OUT = MakeTypeParam(doc, IN[0])
TransactionManager.Instance.TransactionTaskDone()
# ----------------------------------------
lastItem = List.LastItem(list=makeType)
code_block_7 = CodeBlock(success=lastItem) { success; }
firstItem = List.FirstItem(list=makeType)
code_block_8 = CodeBlock(familyParameter=firstItem) { familyParameter; }
code_block_9 = CodeBlock { 1; 0; }
getItemAtIndex_2 = List.GetItemAtIndex(list=filterByBoolMask_2.in, index=code_block_9.out1)

list_create = List.Create(item0=set, item1=code_block_7)

# group: Save & Close
await_2 = Orchid.Common.DataStream.Await(pass=watch, waitFor=list_create)
# note: Custom Nodes: Orchid v. 203.3.0.7865
code_block_10 = CodeBlock { true; }
save = Orchid.RevitProject.Common.Document.Save(document=await_2, compact=code_block_10)
close = Orchid.RevitProject.Common.Document.Close(document=save)

makeInstance = Python()  # "FamilyParameter.MakeInstance"; unwired: IN[0]
# ---------- makeInstance.python (23 lines) ----------
import clr
clr.AddReference('RevitAPI')
from Autodesk.Revit.DB import *

clr.AddReference("RevitServices")
import RevitServices
from RevitServices.Persistence import DocumentManager
from RevitServices.Transactions import TransactionManager

def MakeInstanceParam(doc, param):
	success = False
	if doc.IsFamilyDocument and hasattr(param, "Formula"):
		try:
			doc.FamilyManager.MakeInstance(param)
			success = True
		except: pass
	return param, success

doc = DocumentManager.Instance.CurrentDBDocument
TransactionManager.Instance.EnsureInTransaction(doc)
if isinstance(IN[0], list): OUT = map(list, zip(*[MakeInstanceParam(doc, x) for x in IN[0]]))
else: OUT = MakeInstanceParam(doc, IN[0])
TransactionManager.Instance.TransactionTaskDone()
# ----------------------------------------
lastItem_2 = List.LastItem(list=makeInstance)
code_block_11 = CodeBlock(success=lastItem_2) { success; }
