# Dynamo graph DY 2.3 - B3.3 - Set Param Value.dyn (Dynamo 2.3.1.11775)
# packages: Orchid 230.1.0.7697, Orchid 203.3.0.7865

string = StringInput("C:\Users\nikola.markovic\Documents\DiRoots\FamilyReviser\Families")  # graph input
i = CodeBlock { "*.rfa"; }
contentsAll = Python(IN[0]=string, IN[1]=i)  # "Directory.ContentsAll"
# ---------- contentsAll.python (7 lines) ----------
from System.IO import Directory, SearchOption
dir = IN[0]
searchstring = IN[1]
if Directory.Exists(dir):
	OUT = Directory.GetFiles(dir, searchstring, SearchOption.AllDirectories)
else:
	OUT = list()
# ----------------------------------------
backgroundOpen = Orchid.RevitProject.Common.Document.BackgroundOpen(file=contentsAll)
watch = Watch(backgroundOpen)
code_block = CodeBlock { "Pozicija Push Plate"; }
list_create = List.Create(item0=code_block)
code_block_2 = CodeBlock { 1050; }
list_create_2 = List.Create(item0=code_block_2)
setValue = Orchid.RevitFamily.Parameter.SetValue(familyDocument=backgroundOpen, parameterName=list_create, value=list_create_2)
await_ = Orchid.Common.DataStream.Await(pass=watch, waitFor=setValue)
code_block_3 = CodeBlock { true; }
save = Orchid.RevitProject.Common.Document.Save(document=await_, compact=code_block_3)
close = Orchid.RevitProject.Common.Document.Close(document=save)
code_block_4 = CodeBlock { 250; }
code_block_5 = CodeBlock { "Visina Push Plate"; }
code_block_6 = CodeBlock { false; }
code_block_7 = CodeBlock { "Boxer"; }
