# Dynamo graph DY 2.3 - B4.1 - Place all of category.dyn "Place all of category" (Dynamo 2.12.1.8246)
# packages: Orchid 212.1.0.8171

# note: Custom Node: Orchidv.212.1.0.8171
o_family_all = Orchid.RevitProject.Elements.Family.All()  # frozen
o_families = Family("Belimo_22ADP")  # frozen
code_block = CodeBlock { 1819; }
element_by_id = ElementById(Id=code_block)
categories = Categories("OST_Windows")
o_family_bycategory = Orchid.RevitProject.Elements.Family.ByCategory(category=categories)
types = Family.Types(family=o_family_bycategory)
flatten = List.Flatten(list=types)
code_block_2 = CodeBlock { 10; }
chop = List.Chop(list=flatten, lengths=code_block_2)
count = List.Count(list=chop)
code_block_3 = CodeBlock(en=count) { start = 0; step = 500; end = step*(en-1); }
range = Range(start=code_block_3.start, end=code_block_3.end, step=code_block_3.step)
code_block_4 = CodeBlock { 10; }
ofRepeatedItem = List.OfRepeatedItem(item=range, amount=code_block_4)
flatten_2 = List.Flatten(list=ofRepeatedItem)
flatten_3 = List.Flatten(list=chop)
count_2 = List.Count(list=flatten_3)
div = count_2 / count
ceiling = Math.Ceiling(number=div)
code_block_5 = CodeBlock(redova=ceiling) { start = 0; step = 500; end = (redova-1)*step; }
range_2 = Range(start=code_block_5.start, end=code_block_5.end, step=code_block_5.step)
ofRepeatedItem_2 = List.OfRepeatedItem(item=range_2, amount=count)
transpose = List.Transpose(lists=ofRepeatedItem_2)
flatten_4 = List.Flatten(list=transpose)
code_block_6 = CodeBlock { 0; }
byCoordinates = Point.ByCoordinates(x=flatten_2, y=flatten_4, z=code_block_6)
o_familyinstance_byhostandpoint = Orchid.RevitProject.Elements.FamilyInstance.ByHostAndPoint(host=element_by_id, familyType=flatten, point=byCoordinates)
all_elements_of_category = ElementsOfCategory(Category=categories)  # frozen
code_block_7 = CodeBlock(t2=flatten) { num3 = List.Count(t2); n = num3; t1 = n + 1; t3 = 500 * t1; t4 = (500..t3..500); t5 = List.DropItems(t4, -1); }  # frozen
