# Dynamo graph DY 2.3 - B5 - Replace family.dyn (Dynamo 2.19.3.6394)

# group: Lokacija familija sa kojima se update-uju druge familije
string = StringInput("C:\Users\nikola.markovic\Desktop\Import")  # graph input
code_block = CodeBlock { "*.rfa"; }
contentsAll = Python(IN[0]=string, IN[1]=code_block)  # "Directory.ContentsAll"; CPython3
# ---------- contentsAll.python (7 lines) ----------
from System.IO import Directory, SearchOption
dir = IN[0]
searchstring = IN[1]
if Directory.Exists(dir):
	OUT = Directory.GetFiles(dir, searchstring, SearchOption.AllDirectories)
else:
	OUT = list()
# ----------------------------------------

# group: Lokacija familija koje treba da se update-uju
string_2 = StringInput("C:\Users\nikola.markovic\Desktop\EXPORT")  # graph input
code_block_2 = CodeBlock { "*.rfa"; }
contentsAll_2 = Python(IN[0]=string_2, IN[1]=code_block_2)  # "Directory.ContentsAll"; CPython3; same code as contentsAll

apdejter_3000 = Python(IN[0]=contentsAll, IN[1]=contentsAll_2)  # CPython3
# ---------- apdejter_3000.python (65 lines) ----------
import clr
clr.AddReference('RevitAPI')
from Autodesk.Revit.DB import *
clr.AddReference('RevitServices')

# Revit and Dynamo modules
from Autodesk.Revit.DB import Document, FamilySource, IFamilyLoadOptions
from RevitServices.Persistence import DocumentManager
from RevitServices.Transactions import TransactionManager

uiapp = DocumentManager.Instance.CurrentUIApplication
app = uiapp.Application

#input assigned to IN variable
paths = IN[0]
docpaths = IN[1]

#wrap input inside a list if not a list.
if not isinstance(paths, list): 
    paths = [paths]
if not isinstance(docpaths, list): 
    docpaths = [docpaths]

#ensure loaded families can overwrite existing families.
class FamilyOption(IFamilyLoadOptions):
    def OnFamilyFound(self, familyInUse, overwriteParameterValues):
        overwriteParameterValues = True
        return True

    def OnSharedFamilyFound(self, sharedFamily, familyInUse, source, overwriteParameterValues):
        source = FamilySource.Family
        overwriteParameterValues = True
        return True     

#core data processing
documents = []
families = []
for docpath in docpaths:
    doc=app.OpenDocumentFile(docpath)
    documents.append(doc)
for path in paths:
    family_doc = app.OpenDocumentFile(path)
    families.append(family_doc)

for document in documents:
    map(lambda family: family.LoadFamily(document, FamilyOption()),
    families)

map(lambda x: x.Close(False), families)
map(lambda x: x.Close(True), documents)

# output assigned to the OUT variable
OUT = [paths, docpaths]

#core data processing
for path in paths:
    try:
        famDoc = app.OpenDocumentFile(path)
        famDoc.LoadFamily(doc, FamilyOption())
        famDoc.Close(False)
    except:
        pass

#output assigned the OUT variable
OUT = paths
# ----------------------------------------
contentsAll_3 = Custom[Directory.ContentsAll]()  # unwired: dir
