# Dynamo graph DY 2.3 - B6 - Replace parameter x-y-z -v2.dyn "4. Replace parameter x-y-z -v2" (Dynamo 2.3.1.11775)
# packages: Orchid 230.0.1.7437, Orchid 230.1.0.7697, archi-lab.net 2020.23.13, Crumple 2021.5.27

string = StringInput("A:\SERVER\CLR\CLR_Family_2021\Family Reviser")  # graph input
i = CodeBlock { "*.rfa"; }
contentsAll = Python(IN[0]=string, IN[1]=i)  # "Directory.ContentsAll"
# ---------- contentsAll.python (7 lines) ----------
from System.IO import Directory, SearchOption
dir = IN[0]
searchstring = IN[1]
if Directory.Exists(dir):
	OUT = Directory.GetFiles(dir, searchstring, SearchOption.AllDirectories)
else:
	OUT = list()
# ----------------------------------------
backgroundOpen = Orchid.RevitProject.Common.Document.BackgroundOpen(file=contentsAll)
watch = Watch(backgroundOpen)
all = Orchid.RevitFamily.FamilyType.All(familyDocument=watch)  # frozen
code_block = CodeBlock { "Total Manufacturing Price"; }
getValue = Orchid.RevitFamily.Parameter.GetValue(familyDocument=watch, familyType=all, parameterName=code_block)
byName = Orchid.RevitFamily.Parameter.ByName(familyDocument=watch, name=code_block)  # frozen
delete = Orchid.RevitFamily.Parameter.Delete(familyDocument=watch, parameterName=code_block)
await_ = Orchid.Common.DataStream.Await(pass=watch, waitFor=delete)
code_block_2 = CodeBlock { "Total Selling Price"; "AAA"; "Currency"; "PG_GENERAL"; true; }
add = Orchid.RevitFamily.SharedParameter.Add(familyDocument=await_, parameterName=code_block_2.out0, groupName=code_block_2.out1, type=code_block_2.out2, group=code_block_2.out3, instance=code_block_2.out4)
await_2 = Orchid.Common.DataStream.Await(pass=await_, waitFor=add)
save = Orchid.RevitProject.Common.Document.Save(document=await_2)
parameter_groups = ParameterGroupUi()  # nothing selected
sharedParameterDefinitions = Custom[SharedParameterDefinitions]()  # package Crumple; Returns the currently available shared parameters, their groups and the external definitions for both.
code_block_3 = CodeBlock { "Total Selling Price"; }
contains = Orchid.Common.String.Contains(string=sharedParameterDefinitions.paramNames, searchFor=code_block_3)
filterByBoolMask = List.FilterByBoolMask(list=sharedParameterDefinitions.paramNames, mask=contains)
flatten = List.Flatten(list=filterByBoolMask.in)
filterByBoolMask_2 = List.FilterByBoolMask(list=sharedParameterDefinitions.paramDefs, mask=contains)
flatten_2 = List.Flatten(list=filterByBoolMask_2.in)
