# Dynamo graph DY 2.3 - B7 - shared parameters in family to family parameters.dyn (Dynamo 2.3.1.11775)
# packages: Crumple 2021.5.27, Orchid 230.1.0.7697

familyparameters = Custom[© FamilyParameters]()  # package Crumple; Obtains all parameters in the document, as well as their properties.
filterByBoolMask = List.FilterByBoolMask(list=familyparameters.names, mask=familyparameters.isShared)
watch = Watch(filterByBoolMask.in)
filterByBoolMask_2 = List.FilterByBoolMask(list=familyparameters.isInstance, mask=familyparameters.isShared)
watch_2 = Watch(filterByBoolMask_2.in)
convert = Orchid.RevitFamily.SharedParameter.Convert(parameterName=watch, instance=watch_2)
