# Dynamo graph DY 2.3 - B8 - add project parameters.dyn (Dynamo 2.3.1.11775)
# packages: Orchid 203.3.0.7865

projectParameters = Orchid.RevitProject.Common.Document.ProjectParameters()
name = Element.Name(element=projectParameters.Parameter)
code_block = CodeBlock()
# ---------- code_block.designscript (13 lines) ----------
[
"FAZA",
"Projektna Celina",
"Dodatni Radovi",
"Dodatna Narudžbina",
"Koleta",
"01OR",
"Otpremnica",
"Datum Instalacije",
"Mesec Instalacije",
"Broj Ljudi",
"Komentar Montaži"
];
# ----------------------------------------
contains = List.Contains(list=code_block, lacing=CrossProduct)  # unwired: item
anyTrue = Orchid.Common.List.AnyTrue(list=contains)
filterByBoolMask = List.FilterByBoolMask(list=projectParameters.Parameter, mask=anyTrue)
name_2 = Element.Name(element=filterByBoolMask.in)
delete = Orchid.RevitProject.Elements.Element.Delete(element=filterByBoolMask.in)  # frozen
watch = Watch(delete)
createProjectParameter = Parameter.CreateProjectParameter()  # unwired: parameterName, groupName, type, group, instance, categoryList
createProjectParameter_2 = Parameter.CreateProjectParameter()  # unwired: parameterName, groupName, type, group, instance, categoryList
create = Orchid.RevitProject.Parameters.SharedParameter.Create()  # unwired: parameterName, groupName, type, group
