# Dynamo graph DY 2.3 - B8 - delete project parameters.dyn (Dynamo 2.3.1.11775)
# packages: Orchid 230.1.0.7697, Genius Loci 2020.4.23, Zhukoven.com 2019.5.7, Bakery 2019.5.8, Orchid 203.3.0.7865, Crumple 2021.5.27, Synthesize toolkit 6.8.0

code_block = CodeBlock()
# ---------- code_block.designscript (3 lines) ----------
[
"Završni materijal"
];
# ----------------------------------------
watch = Watch(code_block)
delete = Orchid.RevitProject.Parameters.Parameter.Delete(parameterName=watch)  # frozen
watch_2 = Watch(delete)
code_block_2 = CodeBlock { "Selekcija"; }
contains = List.Contains(item=code_block_2)  # unwired: list
shared_parameters = SharedParameter()  # nothing selected
element_parameters_properties = Custom[Element Parameters Properties](element=shared_parameters)  # package Genius Loci; Retrieves all the properties of the parameters from a given element in the active or given document.
watch_3 = Watch(element_parameters_properties.Value)
watch_4 = Watch(element_parameters_properties.Parameter)

# group: Delete one parameter
shared_parameters_2 = SharedParameter()  # nothing selected
START = BoolSelector(true)
circut = Orchid.Common.DataStream.Circut(pass=shared_parameters_2, state=START)
delete_2 = Orchid.RevitProject.Elements.Element.Delete(element=circut)

info = Custom[SharedParameters.Info]()  # package Zhukoven.com; Get the following information about shared parameters loaded in the Revit project: parameter group, parameter type, unit type.
file_path = Filename("..\..\Desktop\a.xlsx")
code_block_3 = CodeBlock { "Sheet1"; 0; }
element_types = ElementTypes("SharedParameterElement")  # graph input; frozen
all_elements_of_type = ElementsOfType(element_type=element_types)
element_guid = Custom[Element GUID](elements=all_elements_of_type)  # package Bakery; also gets normal id
nameById = Orchid.RevitProject.Elements.Element.NameById(id=element_guid.ids)
sort = List.Sort(list=nameById)
exportExcel = Data.ExportExcel(filePath=file_path, sheetName=code_block_3.out0, startRow=code_block_3.out1, startCol=code_block_3.out1, data=sort)

# group: Delete list of parameters
projectParameters = Orchid.RevitProject.Common.Document.ProjectParameters()
name = Element.Name(element=projectParameters.Parameter)
code_block_4 = CodeBlock()  # frozen
# ---------- code_block_4.designscript (11 lines) ----------
[
"Projektna Celina",
"Dodatni Radovi",
"Dodatna Narudžbina",
"Koleta",
"01OR",
"Otpremnica",
"Datum instalacije",
"Mesec instalacije",
"Broj Ljudi"
];
# ----------------------------------------
contains_2 = List.Contains(list=name, item=code_block_4, lacing=CrossProduct)
anyTrue = Orchid.Common.List.AnyTrue(list=contains_2)
filterByBoolMask = List.FilterByBoolMask(list=projectParameters.Parameter, mask=anyTrue)
name_2 = Element.Name(element=filterByBoolMask.in)
delete_3 = Orchid.RevitProject.Elements.Element.Delete(element=filterByBoolMask.in)  # frozen
watch_5 = Watch(delete_3)

# group: Convert Shared to Project params
familyparameters = Custom[© FamilyParameters]()  # package Crumple; Obtains all parameters in the document, as well as their properties.
START_2 = BoolSelector(false)
circut_2 = Orchid.Common.DataStream.Circut(pass=familyparameters.elements, state=START_2)
izbaci_sledeće_parametre_iz = CodeBlock()  # "Izbaci sledeće parametre iz liste konverzije"
# ---------- izbaci_sledeće_parametre_iz.designscript (11 lines) ----------
[
"E-Stop Napred",
"E-Stop Pozadi",
"Evakuaciona brava pasiv",
"Evakuaciona brava",
"Padajuci Prag",
"Otpremnica",
"Padajući prag pasiv",
"Push plate / Rucka",
"Semafor"
];
# ----------------------------------------
contains_3 = List.Contains(list=familyparameters.names, item=izbaci_sledeće_parametre_iz, lacing=CrossProduct)
anyTrue_2 = Orchid.Common.List.AnyTrue(list=contains_3)
filterByBoolMask_2 = List.FilterByBoolMask(list=circut_2, mask=anyTrue_2)
filterByBoolMask_3 = List.FilterByBoolMask(list=filterByBoolMask_2.out, mask=familyparameters.isShared)
properties = Custom[CW.FamilyParameter.Properties](VARfamilyParameter=filterByBoolMask_3.in)  # package Synthesize toolkit; Retrieves all properties of a given family parameter. PLEASE NOTE: This node will only work in a family document!
filterByBoolMask_4 = List.FilterByBoolMask(list=filterByBoolMask_2.out, mask=familyparameters.isInstance)
eq = filterByBoolMask_3.in == filterByBoolMask_4.out  # lacing=CrossProduct
anyTrue_3 = Orchid.Common.List.AnyTrue(list=eq)
convert = Orchid.RevitFamily.SharedParameter.Convert(parameterName=properties.VARName, instance=anyTrue_3)

# group: Delete all shared
element_types_2 = ElementTypes("SharedParameterElement")  # graph input
all_elements_of_type_2 = ElementsOfType(element_type=element_types_2)
name_3 = Element.Name(element=all_elements_of_type_2)
izbaci_sledeće_parametre_iz_2 = CodeBlock()  # "Izbaci sledeće parametre iz liste konverzije"; same code as izbaci_sledeće_parametre_iz
contains_4 = List.Contains(list=name_3, item=izbaci_sledeće_parametre_iz_2, lacing=CrossProduct)
anyTrue_4 = Orchid.Common.List.AnyTrue(list=contains_4)
filterByBoolMask_5 = List.FilterByBoolMask(list=all_elements_of_type_2, mask=anyTrue_4)
START_3 = BoolSelector(false)
circut_3 = Orchid.Common.DataStream.Circut(pass=filterByBoolMask_5.out, state=START_3)
delete_4 = Orchid.RevitProject.Elements.Element.Delete(element=circut_3)
