# Dynamo graph DY 2.3 - B9 - Selekcija To Null.dyn (Dynamo 2.3.1.11775)

code_block = CodeBlock { "Curtain Panels"; "Doors"; }
list_create = List.Create(item0=code_block.out0, item1=code_block.out1)
byName = Category.ByName(name=list_create)
all_elements_of_category = ElementsOfCategory(Category=byName)
code_block_2 = CodeBlock { "Selekcija"; }
parameterByName = Parameter.ParameterByName(element=all_elements_of_category, name=code_block_2)
watch = Watch(parameterByName)
code_block_3 = CodeBlock { ""; }
setValue = Parameter.SetValue(parameter=parameterByName, value=code_block_3)
watch_2 = Watch(setValue)
code_block_4 = CodeBlock { "Mark History"; }
parameterByName_2 = Parameter.ParameterByName(element=all_elements_of_category, name=code_block_4)
code_block_5 = CodeBlock { ""; }
setValue_2 = Parameter.SetValue(parameter=parameterByName_2, value=code_block_5)
code_block_6 = CodeBlock { "Mark"; }
parameterByName_3 = Parameter.ParameterByName(element=all_elements_of_category, name=code_block_6)
code_block_7 = CodeBlock { ""; }
setValue_3 = Parameter.SetValue(parameter=parameterByName_3, value=code_block_7)
code_block_8 = CodeBlock { "Pozicija EK1"; }
parameterByName_4 = Parameter.ParameterByName(element=all_elements_of_category, name=code_block_8)
code_block_9 = CodeBlock { null; }
setValue_4 = Parameter.SetValue(parameter=parameterByName_4, value=code_block_9)
