# Dynamo graph Hangers v1 r22.dyn (Dynamo 2.12.1.8246)
# packages: Rhythm 2022.4.3, Data-Shapes 2022.2.103

# group: Izbor Papira
family_types = FamilyTypes("Visilica:Visilica")
opis_iso_oznake = CodeBlock { "Izbor Familije za postavljanje na presek mullion-a"; }
code_block = CodeBlock { "Visilica"; }
byName = FamilyType.ByName(name=code_block)
string_from_object = FromObject(object=byName)
code_block_2 = CodeBlock { 0; }
ui_dropdown_data = Custom[UI.DropDown Data](Keys=string_from_object, Values=byName, DefaultValueIndex=code_block_2)  # package Data-Shapes; Create data for DropDown input in UI.MultiInputForm ++ . Check out www.data-shapes.net for more infos.
ui_inputgroup_data = Custom[UI.InputGroup Data](GroupTitle=opis_iso_oznake, Inputs=ui_dropdown_data)  # package Data-Shapes; Creates a group of inputs for UI.MultipleInputForm ++ . Check out www.data-shapes.net for more infos !

code_block_3 = CodeBlock()
# ---------- code_block_3.designscript (2 lines) ----------
"v1 ";
// inicijalna verzija
# ----------------------------------------

# group: Interfejs
code_block_4 = CodeBlock(verzija=code_block_3) { tekst= "Hangers"; opis = tekst + verzija; }
file_path = Filename("Z:\Čiste Sobe\T1.png")
file_from_path = FileObject(path=file_path)
readFromFile = Image.ReadFromFile(file=file_from_path)
code_block_5 = CodeBlock { "Done"; true; "Cancel"; 400; }
create = List.Create(item0=ui_inputgroup_data)
ui_multipleinputform = Custom[UI.MultipleInputForm ++](Description_optional=code_block_4.opis, Logo_optional=readFromFile, ButtonText_optional=code_block_5.out0, Inputs=create, Toggle=code_block_5.out1, CancelButtonText_optional=code_block_5.out2, Width_optional=code_block_5.out3)  # package Data-Shapes; Create a form with multiple inputs. see www.data-shapes.net for tutorials and infos!
code_block_6 = CodeBlock(lista=ui_multipleinputform.User_Inputs)
# ---------- code_block_6.designscript (2 lines) ----------
//Family Types
lista[0];
# ----------------------------------------

collector_element_category = Python()  # "Collector.Element Category (Category) - Roof"; CPython3; unwired: IN[0]
# ---------- collector_element_category.python (32 lines) ----------
#Copyright(c) 2017, john pierson
# @60secondrevit, http://sixtysecondrevit.com

import clr
clr.AddReference('ProtoGeometry')
from Autodesk.DesignScript.Geometry import *

# Import DocumentManager and TransactionManager
clr.AddReference("RevitServices")
import RevitServices
from RevitServices.Persistence import DocumentManager
from RevitServices.Transactions import TransactionManager

# Import RevitAPI
clr.AddReference("RevitAPI")
import Autodesk
from Autodesk.Revit.DB import *

doc = DocumentManager.Instance.CurrentDBDocument
uiapp = DocumentManager.Instance.CurrentUIApplication
app = uiapp.Application

from System.Collections.Generic import *


#The inputs to this node will be stored as a list in the IN variable.
dataEnteringNode = IN
collector = FilteredElementCollector(doc)
roofs = collector.OfCategory(BuiltInCategory.OST_Roofs).WhereElementIsNotElementType().ToElements()


OUT = roofs;
# ----------------------------------------
curtainGridLines = Python(IN[0]=collector_element_category)  # "Element.CurtainGridLines"; CPython3
# ---------- curtainGridLines.python (26 lines) ----------
import clr
clr.AddReference('RevitAPI')
from Autodesk.Revit.DB import *

clr.AddReference("RevitNodes")
import Revit
clr.ImportExtensions(Revit.Elements)

def GetCurtainGridLines(host):
        if hasattr(host, "CurtainGrid"):
                return GetCurtainGridLinesByGrid(host.CurtainGrid, host)
        elif hasattr(host, "CurtainGrids"):
                return list(map(list, list(zip(*[GetCurtainGridLinesByGrid(x, host) for x in host.CurtainGrids]))))
        else: return []

def GetCurtainGridLinesByGrid(grid, host):
        if grid:
                uGrids = [host.Document.GetElement(x) for x in grid.GetUGridLineIds()]
                vGrids = [host.Document.GetElement(x) for x in grid.GetVGridLineIds()]
                return uGrids, vGrids
        else: return list()

items = UnwrapElement(IN[0])

if isinstance(IN[0], list): OUT = [GetCurtainGridLines(x) for x in items]
else: OUT = GetCurtainGridLines(items[0],items[1])
# ----------------------------------------

# group: Horizontal
firstItem = List.FirstItem()  # unwired: list
map = List.Map(list=curtainGridLines, function=firstItem)

# note: Custom Node: Rhythmv.2022.4.3
ʳʰʸᵗʰᵐ_curtaingridline = Rhythm.Revit.Elements.CurtainGridLine.AllSegmentCurves(curtainGridLine=map)
curves = PolyCurve.Curves(polyCurve=ʳʰʸᵗʰᵐ_curtaingridline)
code_block_7 = CodeBlock { 3; }
flatten = List.Flatten(list=curves, amount=code_block_7)

# group: Vertical
lastItem = List.LastItem()  # unwired: list
map_2 = List.Map(list=curtainGridLines, function=lastItem)

ʳʰʸᵗʰᵐ_curtaingridline_2 = Rhythm.Revit.Elements.CurtainGridLine.AllSegmentCurves(curtainGridLine=map_2)
curves_2 = PolyCurve.Curves(polyCurve=ʳʰʸᵗʰᵐ_curtaingridline_2)
code_block_8 = CodeBlock { 3; }
flatten_2 = List.Flatten(list=curves_2, amount=code_block_8)
intersectAll = Geometry.IntersectAll(geometry=flatten, others=flatten_2, lacing=CrossProduct)
flatten_3 = List.Flatten(list=intersectAll)
code_block_9 = CodeBlock { 1; }
pruneDuplicates = Point.PruneDuplicates(points=flatten_3, tolerance=code_block_9)
X = Point.X(point=pruneDuplicates)
Y = Point.Y(point=pruneDuplicates)
Z = Point.Z(point=pruneDuplicates)
code_block_10 = CodeBlock { 31; }
add = Z + code_block_10
byCoordinates = Point.ByCoordinates(x=X, y=Y, z=add)
familyinstance_bypointeachrun = Python(IN[0]=code_block_6, IN[1]=byCoordinates)  # "FamilyInstance.ByPointEachRun Zhukoven"; IronPython2
# ---------- familyinstance_bypointeachrun.python (34 lines) ----------
#Based on Bakery node 'Family instance by point in transaction'
import clr
clr.AddReference('RevitAPI')
from Autodesk.Revit.DB import *

clr.AddReference("RevitNodes")
import Revit
clr.ImportExtensions(Revit.Elements)
clr.ImportExtensions(Revit.GeometryConversion)

clr.AddReference("RevitServices")
import RevitServices
from RevitServices.Persistence import DocumentManager
from RevitServices.Transactions import TransactionManager
from Autodesk.Revit.DB.Structure import *

doc = DocumentManager.Instance.CurrentDBDocument
famtype = UnwrapElement(IN[0])
points = UnwrapElement(IN[1])

elementlist = list()

ST = StructuralType.NonStructural

TransactionManager.Instance.EnsureInTransaction(doc)
# Make sure the familysymbol is active
if famtype.IsActive == False:
	famtype.Activate()
	doc.Regenerate()
for point in points:
	newobj = doc.Create.NewFamilyInstance(point.ToXyz(),famtype,ST)
	elementlist.append(newobj)
TransactionManager.Instance.TransactionTaskDone()
OUT = elementlist
# ----------------------------------------
all_elements_of_family_type = ElementsOfFamilyType()  # frozen; unwired: Family_Type
