# Dynamo graph Hangers v1.dyn (Dynamo 2.13.1.3887)
# packages: Rhythm 2023.1.1, Zhukoven.com 2021.2.27, Synthesize toolkit 12.7.5

family_types = FamilyTypes("Vis:Vis")
collector_element_category = Python()  # "Collector.Element Category (Category) - Roof"; CPython3; unwired: IN[0]
# ---------- collector_element_category.python (32 lines) ----------
#Copyright(c) 2017, john pierson
# @60secondrevit, http://sixtysecondrevit.com

import clr
clr.AddReference('ProtoGeometry')
from Autodesk.DesignScript.Geometry import *

# Import DocumentManager and TransactionManager
clr.AddReference("RevitServices")
import RevitServices
from RevitServices.Persistence import DocumentManager
from RevitServices.Transactions import TransactionManager

# Import RevitAPI
clr.AddReference("RevitAPI")
import Autodesk
from Autodesk.Revit.DB import *

doc = DocumentManager.Instance.CurrentDBDocument
uiapp = DocumentManager.Instance.CurrentUIApplication
app = uiapp.Application

from System.Collections.Generic import *


#The inputs to this node will be stored as a list in the IN variable.
dataEnteringNode = IN
collector = FilteredElementCollector(doc)
roofs = collector.OfCategory(BuiltInCategory.OST_Roofs).WhereElementIsNotElementType().ToElements()


OUT = roofs;
# ----------------------------------------
curtainGridLines = Python(IN[0]=collector_element_category)  # "Element.CurtainGridLines"; CPython3
# ---------- curtainGridLines.python (26 lines) ----------
import clr
clr.AddReference('RevitAPI')
from Autodesk.Revit.DB import *

clr.AddReference("RevitNodes")
import Revit
clr.ImportExtensions(Revit.Elements)

def GetCurtainGridLines(host):
        if hasattr(host, "CurtainGrid"):
                return GetCurtainGridLinesByGrid(host.CurtainGrid, host)
        elif hasattr(host, "CurtainGrids"):
                return list(map(list, list(zip(*[GetCurtainGridLinesByGrid(x, host) for x in host.CurtainGrids]))))
        else: return []

def GetCurtainGridLinesByGrid(grid, host):
        if grid:
                uGrids = [host.Document.GetElement(x) for x in grid.GetUGridLineIds()]
                vGrids = [host.Document.GetElement(x) for x in grid.GetVGridLineIds()]
                return uGrids, vGrids
        else: return list()

items = UnwrapElement(IN[0])

if isinstance(IN[0], list): OUT = [GetCurtainGridLines(x) for x in items]
else: OUT = GetCurtainGridLines(items[0],items[1])
# ----------------------------------------

# group: Horizontal
firstItem = List.FirstItem()  # unwired: list
map = List.Map(list=curtainGridLines, function=firstItem)

# note: Custom Node: Rhythmv.2023.1.1
ʳʰʸᵗʰᵐ_curtaingridline = Rhythm.Revit.Elements.CurtainGridLine.AllSegmentCurves(curtainGridLine=map)
curves = PolyCurve.Curves(polyCurve=ʳʰʸᵗʰᵐ_curtaingridline)
code_block = CodeBlock { 3; }
flatten = List.Flatten(list=curves, amount=code_block)

# group: Vertical
lastItem = List.LastItem()  # unwired: list
map_2 = List.Map(list=curtainGridLines, function=lastItem)

ʳʰʸᵗʰᵐ_curtaingridline_2 = Rhythm.Revit.Elements.CurtainGridLine.AllSegmentCurves(curtainGridLine=map_2)
curves_2 = PolyCurve.Curves(polyCurve=ʳʰʸᵗʰᵐ_curtaingridline_2)
code_block_2 = CodeBlock { 3; }
flatten_2 = List.Flatten(list=curves_2, amount=code_block_2)
intersectAll = Geometry.IntersectAll(geometry=flatten, others=flatten_2, lacing=CrossProduct)  # frozen
flatten_3 = List.Flatten(list=intersectAll)
code_block_3 = CodeBlock { 1; }
pruneDuplicates = Point.PruneDuplicates(points=flatten_3, tolerance=code_block_3)
X = Point.X(point=pruneDuplicates)
Y = Point.Y(point=pruneDuplicates)
Z = Point.Z(point=pruneDuplicates)
code_block_4 = CodeBlock { 31; }
add = Z + code_block_4
byCoordinates = Point.ByCoordinates(x=X, y=Y, z=add)
byPointEachRun = Custom[FamilyInstance.ByPointEachRun](familyType=family_types, points=byCoordinates)  # frozen; package Zhukoven.com; Place family instance by point each time you hit the 'Run' button without deleting previously placed ones. Don't use this node in 'Auto' mode!
byElement = Mullion.ByElement(hostingElement=collector_element_category)
locationCurve = Mullion.LocationCurve(mullion=byElement)
code_block_5 = CodeBlock { 1; }
chop = List.Chop(list=locationCurve, lengths=code_block_5)  # frozen
startPoint = Curve.StartPoint(curve=chop)
code_block_6 = CodeBlock { 2; }
flatten_4 = List.Flatten(list=startPoint, amount=code_block_6)
code_block_7 = CodeBlock { 1; }
pruneDuplicates_2 = Point.PruneDuplicates(points=flatten_4, tolerance=code_block_7)
bk_remove_list_from_list_by_item = Custom[BK.Remove List from List by Item not Value](VARListOfItemsToRemove=pruneDuplicates_2, VARListToRemoveFrom=flatten_4)  # package Synthesize toolkit; remove the items in ListA from the items in ListB and return whats left
code_block_8 = CodeBlock(a=bk_remove_list_from_list_by_item.VARreducedList) { a; }
intersects = BoundingBox.Intersects(lacing=CrossProduct)  # unwired: boundingBox, other
faces = Element.Faces(element=byElement)
code_block_9 = CodeBlock { 5; }
thicken = Surface.Thicken(surface=faces, thickness=code_block_9)
boundingBox = Geometry.BoundingBox(geometry=thicken)
boundingBox_2 = Geometry.BoundingBox(geometry=locationCurve)
intersection = BoundingBox.Intersection(boundingBox=boundingBox, other=boundingBox_2)
