# Dynamo graph WIP ABG_190930_TagAll1.dyn "ABG_190930_TagAll1" (Dynamo 2.3.0.5885)
# packages: archi-lab.net 2020.23.13, Chynamo 0.8.5, designtech 1.0.8, Orchid 230.0.3.7493

code_block = CodeBlock { "Curtain Panels"; }
byName = Category.ByName(name=code_block)
all_elements_of_category = ElementsOfCategory(Category=byName)
isPhantomPanel = Custom[CurtainPanel.IsPhantomPanel](curtainPanel=all_elements_of_category)  # Checks whether a given curtain panel is not an actual model element. (These types of objects get generated when curtain grid segments are deleted or in other words when multiple cells of the curtain grid are merged into one panel)
views = Views("+0.00")
code_block_2 = CodeBlock { "Doors"; }
byName_2 = Category.ByName(name=code_block_2)
all_elements_of_category_2 = ElementsOfCategory(Category=byName_2)
taggable_parameter = StringInput("TAG VRATA")  # graph input
getParameterValueByName = Element.GetParameterValueByName(element=all_elements_of_category_2, parameterName=taggable_parameter)
code_block_3 = CodeBlock { ""; }
ne = getParameterValueByName != code_block_3
filterByBoolMask = List.FilterByBoolMask(list=all_elements_of_category_2, mask=ne)
categories = Categories("OST_DoorTags")
current = Document.Current()
activeView = Document.ActiveView(document=current)
boolean = BoolSelector(true)
# note: Clockwork
all_view_dependent_family = Custom[All View-Dependent Family Instances Of Category](category=categories, view=activeView, toggle=boolean)  # Gets all view-dependent family instances in a given view for a given list of categories - useful for finding annotation elements
type = archilab.Revit.Elements.Elements.Type(element=all_view_dependent_family)
flatten = List.Flatten(list=type)
string_from_object = FromObject(obj=flatten)
tag_family = FamilyTypes("2.Vrata 1-50:Mark + Dimensions + Tag")  # graph input
string_from_object_2 = FromObject(obj=tag_family)
eq = string_from_object == string_from_object_2
filterByBoolMask_2 = List.FilterByBoolMask(list=all_view_dependent_family, mask=eq)
taggedElement = Tag.TaggedElement(tag=filterByBoolMask_2.in)
flatten_2 = List.Flatten(list=taggedElement)
id = Element.Id(element=flatten_2)
id_2 = Element.Id(element=filterByBoolMask.in)
contains = List.Contains(list=id, item=id_2@L1)
filterByBoolMask_3 = List.FilterByBoolMask(list=filterByBoolMask.in, mask=contains)
flatten_3 = List.Flatten(list=filterByBoolMask_3.out)
hostelement_archilab = Custom[HostElement-ArchiLab](Nested=filterByBoolMask_3.out)  # package Chynamo; Get host elements of given nest elements, imported from ArchiLab
getLocation = Element.GetLocation(element=hostelement_archilab)
curve = dtGeometry.Deconstruct.Curve(curve=getLocation)
byElementAndLocation = Orchid.RevitProject.Annotations.Tag.ByElementAndLocation(view=views, element=flatten_3, tagType=tag_family, location=curve.midPt)
bySpatialElementAndLocation = Orchid.RevitProject.Annotations.Tag.BySpatialElementAndLocation(view=views)  # unwired: spatialElement, tagType, location
