# Dynamo graph WIP Clash Detection.dyn "Clash Detection" (Dynamo 2.3.0.5885)
# packages: bimorphNodes 3.0.3, designtech 1.0.8, Synthesize toolkit 6.8.0

categories = Categories()  # nothing selected
code_block = CodeBlock { "Curtain Panels"; }
byName = Category.ByName(name=code_block)
all_elements_of_category = ElementsOfCategory(Category=byName)
flatten = List.Flatten(list=all_elements_of_category)
code_block_2 = CodeBlock { "Curtain Panels"; }
byName_2 = Category.ByName(name=code_block_2)
all_elements_of_category_2 = ElementsOfCategory(Category=byName_2)
flatten_2 = List.Flatten(list=all_elements_of_category_2)
list_create = List.Create(item0=flatten, item1=flatten_2)
string = StringInput("Test")
py = Python(IN[0]=list_create, IN[1]=string)
# ---------- py.python (26 lines) ----------
import clr
clr.AddReference('ProtoGeometry')
from Autodesk.DesignScript.Geometry import *

clr.AddReference("RevitServices")
import RevitServices
from RevitServices.Persistence import DocumentManager
from RevitServices.Transactions import TransactionManager
clr.AddReference("RevitAPI")
import Autodesk
from Autodesk.Revit.DB import *

doc = DocumentManager.Instance.CurrentDBDocument

data=IN[0]

TransactionManager.Instance.ForceCloseTransaction()
	
with Transaction(doc , "testing") as t:
	t.Start()
	
	OUT=data
	t.Commit()
		
	
	
# ----------------------------------------
i = CodeBlock(i=py) { i[0]; i[1]; }
intersectsElement = Revit.Element.IntersectsElement(elementSetA=i.out0, elementSetB=i.out1)
color_palette = ColorPalette({R: 144, G: 238, B: 144, A: 255})
overrideColorInView = Element.OverrideColorInView(element=intersectsElement.intersectsWith, color=color_palette)  # frozen
start = Revit.Transaction.Transaction.Start(input=list_create)  # frozen
color_palette_2 = ColorPalette({R: 220, G: 20, B: 60, A: 255})
overrideColorInView_2 = Element.OverrideColorInView(element=intersectsElement.Element, color=color_palette_2)
end = Revit.Transaction.Transaction.End(input=overrideColorInView_2)
start_2 = Revit.Transaction.Transaction.Start(input=end)
current = dtRevit.View.Current()
resetElementOverrides = Custom[CW.View.ResetElementOverrides](VARelement=start_2, VARview=current)  # package Synthesize toolkit; Resets all overrides for an element in a given view
end_2 = Revit.Transaction.Transaction.End(input=resetElementOverrides.VARelement)
name2 = Python()  # "Transaction.Name2"; frozen; unwired: IN[0], IN[1]
# ---------- name2.python (23 lines) ----------
import clr
clr.AddReference("RevitServices")
import RevitServices
from RevitServices.Persistence import DocumentManager
from RevitServices.Transactions import TransactionManager
clr.AddReference("RevitAPI")
import Autodesk
from Autodesk.Revit.DB import *

doc = DocumentManager.Instance.CurrentDBDocument
uidoc=DocumentManager.Instance.CurrentUIApplication.ActiveUIDocument

TransactionManager.Instance.ForceCloseTransaction()

start = IN[0]
prokletoime = IN[1]

t = TransactionGroup(doc, 'sss')
t.Start()
t.Commit() 


OUT = start
# ----------------------------------------
python_script = Python()  # frozen; unwired: IN[0], IN[1]
# ---------- python_script.python (27 lines) ----------
# Load the Python Standard and DesignScript Libraries
import sys
import clr
clr.AddReference('ProtoGeometry')
from Autodesk.DesignScript.Geometry import *
clr.AddReference("RevitServices")
import RevitServices
from RevitServices.Persistence import DocumentManager
from RevitServices.Transactions import TransactionManager
clr.AddReference("RevitAPI")
import Autodesk
from Autodesk.Revit.DB import *

doc = DocumentManager.Instance.CurrentDBDocument

pocetak = IN[0]
prokletoime = IN[1]

OUT = []

with Transaction(doc , prokletoime) as t:
t.Start()

# do shit
OUT = pocetak

t.Commit()
# ----------------------------------------
python_script_2 = Python()  # frozen; unwired: IN[0], IN[1]
# ---------- python_script_2.python (28 lines) ----------
# Load the Python Standard and DesignScript Libraries
import sys
import clr
clr.AddReference('ProtoGeometry')
from Autodesk.DesignScript.Geometry import *
clr.AddReference("RevitServices")
import RevitServices
from RevitServices.Persistence import DocumentManager
from RevitServices.Transactions import TransactionManager
clr.AddReference("RevitAPI")
import Autodesk
from Autodesk.Revit.DB import *

# The inputs to this node will be stored as a list in the IN variables.
pocetak = IN[0]
prokletoime = IN[1]

doc = DocumentManager.Instance.CurrentDBDocument


from Autodesk.Revit.DB import Transaction
t = Transaction(doc, 'sssssssssss sss')
t.Start()
#Do stuff
t.Commit()


OUT = pocetak
# ----------------------------------------
