# Dynamo graph WIP Create description parameter.dyn (Dynamo 2.3.0.5885)
# packages: Orchid 230.1.0.7697, Bakery 2019.5.8

string = StringInput("C:\Users\nikola.markovic\Termovent Komerc d.o.o\TERMOVENT Sharepoint - R&D\01 Čiste sobe\01 Template Čiste sobe\1. ARH FAMILIJE\Vrata")  # graph input
code_block = CodeBlock { "*.rfa"; }
contentsAll = Custom[Directory.ContentsAll](dir=string, searchString=code_block)  # package Bakery
backgroundOpen = Orchid.RevitProject.Common.Document.BackgroundOpen(file=contentsAll)
string_2 = StringInput("↓↓↓ OPREMA")
string_3 = StringInput("↓↓↓ PANEL")
string_4 = StringInput("↓↓↓ STAKLENI PANEL")
string_5 = StringInput("↓↓↓ PROFILI/KONSTRUKCIJA")
list_create = List.Create(item0=string_2, item1=string_3, item2=string_4, item3=string_5)
string_from_object = FromObject(obj=list_create)
code_block_2 = CodeBlock { "Text"; }
string_6 = StringInput("PG_MATERIALS")
boolean = BoolSelector(false)
add = Orchid.RevitFamily.Parameter.Add(familyDocument=backgroundOpen, parameterName=string_from_object, type=code_block_2, group=string_6, instance=boolean, reporting=boolean)  # frozen
name = Parameter.Name(parameter=add)
current = Document.Current()
string_7 = StringInput("\"↓↓↓ OPREMA\"")
string_8 = StringInput("\"↓↓↓ PANEL\"")
string_9 = StringInput("\"↓↓↓ STAKLENI PANEL\"")
string_10 = StringInput("\"↓↓↓ PROFILI/KONSTRUKCIJA\"")
list_create_2 = List.Create(item0=string_7, item1=string_8, item2=string_9, item3=string_10)
count = List.Count(list=backgroundOpen)
ofRepeatedItem = List.OfRepeatedItem(item=list_create_2, amount=count)
transpose = List.Transpose(lists=ofRepeatedItem)
set = Orchid.RevitFamily.Formula.Set(familyDocument=backgroundOpen@L2, parameterName=string_from_object, value=transpose)
await_ = Orchid.Common.DataStream.Await(pass=backgroundOpen, waitFor=set)
code_block_3 = CodeBlock { true; }
close = Orchid.RevitProject.Common.Document.Close(document=await_, save=code_block_3)
