# Dynamo graph WIP DETAIL RENUMBER by sheet.dyn (Dynamo 2.3.0.5885)
# packages: archi-lab.net 2020.23.13, Orchid 230.0.1.7437

# group: Kategorija crteža
parameter_name = StringInput("INSULINI - 04 POGLEDI")

# group: Filter po parametru
getAllViews = Python()  # graph input
# ---------- getAllViews.python (97 lines) ----------
import clr
clr.AddReference('ProtoGeometry')
from Autodesk.DesignScript.Geometry import *

# Import DocumentManager and TransactionManager
clr.AddReference("RevitServices")
import RevitServices
from RevitServices.Persistence import DocumentManager
from RevitServices.Transactions import TransactionManager

# Import RevitAPI
clr.AddReference("RevitAPI")
import Autodesk
from Autodesk.Revit.DB import *

doc = DocumentManager.Instance.CurrentDBDocument
uiapp = DocumentManager.Instance.CurrentUIApplication
app = uiapp.Application

from System.Collections.Generic import *

# Import ToDSType(bool) extension method
clr.AddReference("RevitNodes")
import Revit
clr.ImportExtensions(Revit.Elements)

#The inputs to this node will be stored as a list in the IN variable.
dataEnteringNode = IN

#collect all views in the model
collector = FilteredElementCollector(doc)
views = collector.OfClass(View).ToElements()

#sort views into separate lists based on view type
areaPlans, ceilingPlans, columnSchedules = [], [], []
costReport, details, draftingViews = [], [], []
drawingSheets, elevations, engineetingPlans = [], [], []
floorPlans, internal, legends, loadReports = [], [], [], []
panelSchedules, pressureLossReports, renderings = [], [], []
reports, schedules, sections, threeD = [], [], [], []
undefined, walkthrough = [], []
for i in views:
	if not i.IsTemplate:
		if i.ViewType == ViewType.AreaPlan:
			areaPlans.append(i.ToDSType(True))
		elif i.ViewType == ViewType.CeilingPlan:
			ceilingPlans.append(i.ToDSType(True))
		elif i.ViewType == ViewType.ColumnSchedule:
			columnSchedules.append(i.ToDSType(True))
		elif i.ViewType == ViewType.CostReport:
			costReport.append(i.ToDSType(True))
		elif i.ViewType == ViewType.Detail:
			details.append(i.ToDSType(True))
		elif i.ViewType == ViewType.DraftingView:
			draftingViews.append(i.ToDSType(True))
		elif i.ViewType == ViewType.DrawingSheet:
			drawingSheets.append(i.ToDSType(True))
		elif i.ViewType == ViewType.Elevation:
			elevations.append(i.ToDSType(True))
		elif i.ViewType == ViewType.EngineeringPlan:
			engineetingPlans.append(i.ToDSType(True))
		elif i.ViewType == ViewType.FloorPlan:
			floorPlans.append(i.ToDSType(True))
		elif i.ViewType == ViewType.Internal:
			internal.append(i.ToDSType(True))
		elif i.ViewType == ViewType.Legend:
			legends.append(i.ToDSType(True))
		elif i.ViewType == ViewType.LoadsReport:
			loadReports.append(i.ToDSType(True))
		elif i.ViewType == ViewType.PanelSchedule:
			panelSchedules.append(i.ToDSType(True))
		elif i.ViewType == ViewType.PresureLossReport:
			pressureLossReports.append(i.ToDSType(True))
		elif i.ViewType == ViewType.Rendering:
			renderings.append(i.ToDSType(True))
		elif i.ViewType == ViewType.Report:
			reports.append(i.ToDSType(True))
		elif i.ViewType == ViewType.Schedule:
			schedules.append(i.ToDSType(True))
		elif i.ViewType == ViewType.Section:
			sections.append(i.ToDSType(True))
		elif i.ViewType == ViewType.ThreeD:
			threeD.append(i.ToDSType(True))
		elif i.ViewType == ViewType.Undefined:
			undefined.append(i.ToDSType(True))
		elif i.ViewType == ViewType.Walkthrough:
			walkthrough.append(i.ToDSType(True))
		else:
			continue

#Assign your output to the OUT variable
OUT = areaPlans, ceilingPlans, columnSchedules, costReport, \
	details, draftingViews, drawingSheets, elevations, \
	engineetingPlans, floorPlans, internal, legends, \
	loadReports, panelSchedules, pressureLossReports, \
	renderings, reports, schedules, sections, threeD, \
	undefined, walkthrough
# ----------------------------------------
i = CodeBlock(A=getAllViews)
# ---------- i.designscript (4 lines) ----------
//SHEETS
A[6];

"KATEGORIJA CRTEZA";
# ----------------------------------------
getParameterValueByName = Element.GetParameterValueByName(element=i.out0, parameterName=i.out1)
eq = getParameterValueByName == parameter_name  # lacing=CrossProduct
filterByBoolMask = List.FilterByBoolMask(list=i.out0, mask=eq)
watch = Watch(filterByBoolMask.in)

# group: Koj tip pogleda?
i_2 = StringInput("2. Pogledi")

# group: Provera šta je pogled od crteža sa šita
views = Sheet.Views(sheet=watch)
type = archilab.Revit.Elements.Elements.Type(element=views)
name = Orchid.RevitProject.Elements.ElementType.Name(elementType=type)
eq_2 = name == i_2  # lacing=CrossProduct
filterByBoolMask_2 = List.FilterByBoolMask(list=views, mask=eq_2)
# note: izbaci šitove bez pogleda
isEmpty = List.IsEmpty()  # unwired: list
map = List.Map(list=filterByBoolMask_2.in, f_x=isEmpty)
filterByBoolMask_3 = List.FilterByBoolMask(list=filterByBoolMask_2.in, mask=map)

# group: Numeracija pogleda ABCD
code_block = CodeBlock { 4; "Detail Number"; }
code_block_2 = CodeBlock { A = ["D","A","B","C"]<1>; }
count = List.Count(list=filterByBoolMask_3.out)
ofRepeatedItem = List.OfRepeatedItem(item=code_block_2, amount=count)
flatten = List.Flatten(list=ofRepeatedItem)
chop = List.Chop(list=flatten, lengths=code_block.out0)
setParameterByName = Element.SetParameterByName(element=filterByBoolMask_3.out, parameterName=code_block.out1, value=chop)

watch_2 = Watch(i.out0)
