# Dynamo graph WIP DETAIL RENUMBER.dyn (Dynamo 2.3.0.5885)
# packages: DynamoDots 2020.1.3

getAllViews = Custom[GetAllViews]()  # package DynamoDots; Get all the Views / Sheets / Legends etc
watch = Watch(getAllViews.Elevations)
number = Room.Number()  # unwired: room
sortByFunction = List.SortByFunction(list=watch, func=number)
code_block = CodeBlock { "Detail Number"; }
code_block_2 = CodeBlock { A = ["D","A","B","C"]<1>; }
count = List.Count(list=sortByFunction)
ofRepeatedItem = List.OfRepeatedItem(item=code_block_2, amount=count)
flatten = List.Flatten(list=ofRepeatedItem)
setParameterByName = Element.SetParameterByName(element=sortByFunction, parameterName=code_block, value=flatten)
placedRooms = Python()  # "Collector.PlacedRooms"; unwired: IN[0]
# ---------- placedRooms.python (36 lines) ----------
#Copyright(c) 2017, john pierson
# @60secondrevit, http://sixtysecondrevit.com

import clr
clr.AddReference('ProtoGeometry')
from Autodesk.DesignScript.Geometry import *

# Import DocumentManager and TransactionManager
clr.AddReference("RevitServices")
import RevitServices
from RevitServices.Persistence import DocumentManager
from RevitServices.Transactions import TransactionManager

# Import RevitAPI
clr.AddReference("RevitAPI")
import Autodesk
from Autodesk.Revit.DB import *

doc = DocumentManager.Instance.CurrentDBDocument
uiapp = DocumentManager.Instance.CurrentUIApplication
app = uiapp.Application

from System.Collections.Generic import *


#The inputs to this node will be stored as a list in the IN variable.
dataEnteringNode = IN
collector = FilteredElementCollector(doc)
rooms = collector.OfCategory(BuiltInCategory.OST_Rooms).ToElements()

roomInstances = []
for i in rooms:
	if i.Area != 0:
		roomInstances.append(i)

OUT = roomInstances
# ----------------------------------------
sortByFunction_2 = List.SortByFunction(list=placedRooms, func=number)
number_2 = Room.Number(room=sortByFunction_2)
