# Dynamo graph WIP Delete family parameter.dyn (Dynamo 2.3.1.11775)
# packages: Orchid 203.3.0.7865

string = StringInput("C:\Users\nikola.markovic\Desktop\EXPORT")  # graph input
i = CodeBlock { "*.rfa"; }
contentsAll = Python(IN[0]=string, IN[1]=i)  # "Directory.ContentsAll"
# ---------- contentsAll.python (7 lines) ----------
from System.IO import Directory, SearchOption
dir = IN[0]
searchstring = IN[1]
if Directory.Exists(dir):
	OUT = Directory.GetFiles(dir, searchstring, SearchOption.AllDirectories)
else:
	OUT = list()
# ----------------------------------------
backgroundOpen = Orchid.RevitProject.Common.Document.BackgroundOpen(file=contentsAll)
code_block = CodeBlock { "H rucke"; }
delete = Orchid.RevitFamily.Parameter.Delete(familyDocument=backgroundOpen, parameterName=code_block)
await_ = Orchid.Common.DataStream.Await(pass=backgroundOpen, waitFor=delete)
save = Orchid.RevitProject.Common.Document.Save(document=await_)
