# Dynamo graph WIP FLIPOVANI ELEMENTI.dyn (Dynamo 2.3.1.11775)
# packages: designtech 1.0.8, Data-Shapes 2019.2.44, Bakery 2019.5.8, Modelical 2.2.19, Orchid 203.3.0.7865

# group: Provera flipovanih vrata
string = StringInput("Doors")
byName = Category.ByName(name=string)
all_elements_of_category = ElementsOfCategory(Category=byName)
# note: Custom Package: designtech
fromObject = dtCore.String.FromObject(obj=all_elements_of_category)
code_block = CodeBlock { ["WDB","WDS","WDD","WDDB"]; }
contains = String.Contains(str=fromObject, searchFor=code_block, lacing=CrossProduct)
countTrue = List.CountTrue(list=contains@L2)
code_block_2 = CodeBlock(n=countTrue) { n > 0; }
filterByBoolMask = List.FilterByBoolMask(list=all_elements_of_category, mask=code_block_2)
elementhandflipped = Python(IN[0]=filterByBoolMask.in)
# ---------- elementhandflipped.python (25 lines) ----------
# Made by Gavin Crump
# Free for use
# BIM Guru, www.bimguru.com.au

# Boilerplate text
import clr
clr.AddReference("RevitAPI")

# Define list/unwrap list functions
def uwlist(input):
    result = input if isinstance(input, list) else [input]
    return UnwrapElement(input)

# Preparing input from dynamo to revit
uw_list  = uwlist(IN[0])

flips = []

for i in uw_list:
	flip = 1 if i.HandFlipped else 0
	face = 1 if i.FacingFlipped else 0	
	flips.append(flip+face == 1)

# Preparing output to Dynamo
OUT = flips
# ----------------------------------------
filterByBoolMask_2 = List.FilterByBoolMask(list=filterByBoolMask.in, mask=elementhandflipped)
select_in_revit = Python(IN[0]=filterByBoolMask_2.in)
# ---------- select_in_revit.python (36 lines) ----------
import clr
clr.AddReference('ProtoGeometry')
from Autodesk.DesignScript.Geometry import *

clr.AddReference("RevitNodes")
import Revit
clr.ImportExtensions(Revit.Elements)

clr.ImportExtensions(Revit.GeometryConversion)

clr.AddReference("RevitServices")
import RevitServices
from RevitServices.Persistence import DocumentManager
from RevitServices.Transactions import TransactionManager
from System.Collections.Generic import *

clr.AddReference("RevitAPI")
import Autodesk
from Autodesk.Revit.DB import *

doc = DocumentManager.Instance.CurrentDBDocument
uiapp = DocumentManager.Instance.CurrentUIApplication
app = uiapp.Application
uidoc=DocumentManager.Instance.CurrentUIApplication.ActiveUIDocument

select = []
elements = UnwrapElement(IN[0])
uisel = uidoc.Selection
result = []

for i in elements:
	select.append(i.Id)
	Icollection = List[ElementId](select)
	uisel.SetElementIds(Icollection)
	result.append("Seccess")
OUT = result
# ----------------------------------------
code_block_3 = CodeBlock { "Flipovana vrata"; "Selektovana vrata u modelu:"; }
code_block_4 = CodeBlock { ", "; }
code_block_5 = CodeBlock { "Mark"; }
getParameterValueByName = Element.GetParameterValueByName(element=filterByBoolMask_2.in, parameterName=code_block_5)
join = String.Join(separator=code_block_4, string0=getParameterValueByName)
ui_textnote_data = Custom[UI.TextNote Data](Title=code_block_3.out1, TextNote=join)  # package Data-Shapes; Create Data for TextNote input in UI.MultipleInputForm ++ . Check out www.data-shapes.net for more informations
ui_inputgroup_data = Custom[UI.InputGroup Data](GroupTitle=code_block_3.out0, Inputs=ui_textnote_data)  # package Data-Shapes; Creates a group of inputs for UI.MultipleInputForm ++ . Check out www.data-shapes.net for more infos !

# group: PopUp
code_block_6 = CodeBlock { "Greške i obaveštenja"; "OK"; true; "Prekid"; }
# note: Custom Package: Data-Shapes
join_2 = List.Join(list0=ui_inputgroup_data)
ui_multipleinputform = Custom[UI.MultipleInputForm ++](Description_optional=code_block_6.out0, ButtonText_optional=code_block_6.out1, Inputs=join_2, Toggle=code_block_6.out2, CancelButtonText_optional=code_block_6.out3)  # package Data-Shapes; Create a form with multiple inputs. see www.data-shapes.net for tutorials and infos!

make_perspective_3d_view_at = Custom[Make Perspective 3D View at Element Location]()  # package Bakery; unwired: arg0, arg1, arg2, arg3
perspectiveViewByPoints = Custom[PerspectiveViewByPoints]()  # package Modelical; Creates a new Perspective view given its camera location, target location and name.; unwired: camLocation, targetLocation, viewName

# group: 3D POGLEDI - Flipovani elementi
boundingBox = Element.BoundingBox(element=filterByBoolMask_2.in)
minPoint = BoundingBox.MinPoint(boundingBox=boundingBox)
offset = CodeBlock { 1; }
code_block_7 = CodeBlock(a=offset) { -a; }
byCoordinates = Vector.ByCoordinates(x=code_block_7, y=code_block_7, z=code_block_7)
add = Point.Add(point=minPoint, vectorToAdd=byCoordinates)
maxPoint = BoundingBox.MaxPoint(boundingBox=boundingBox)
byCoordinates_2 = Vector.ByCoordinates(x=offset, y=offset, z=offset)
add_2 = Point.Add(point=maxPoint, vectorToAdd=byCoordinates_2)
python_script = Python(IN[0]=add, IN[1]=add_2)
# ---------- python_script.python (59 lines) ----------
#python nodes in dynamo 1.0
#proposed by Julien Benoit @jbenoit44 
#http://aecuandme.wordpress.com/
import clr
clr.AddReference('ProtoGeometry')
from Autodesk.DesignScript.Geometry import *
# Import ToDSType(bool) extension method
clr.AddReference("RevitNodes")
import Revit
clr.ImportExtensions(Revit.Elements)
# Import geometry conversion extension methods
clr.ImportExtensions(Revit.GeometryConversion)
# Import DocumentManager and TransactionManager
clr.AddReference("RevitServices")
import RevitServices
from RevitServices.Persistence import DocumentManager
from RevitServices.Transactions import TransactionManager
from System.Collections.Generic import *
# Import RevitAPI
clr.AddReference("RevitAPI")
import Autodesk
from Autodesk.Revit.DB import *

doc = DocumentManager.Instance.CurrentDBDocument
uiapp = DocumentManager.Instance.CurrentUIApplication
app = uiapp.Application
uidoc=DocumentManager.Instance.CurrentUIApplication.ActiveUIDocument

Min=[]
Max=[]
viewlist=[]
bbox=[]
for i in IN[0]:
	Min.append(UnwrapElement(i.ToXyz(True)))
for i in IN[1]:
	Max.append(UnwrapElement(i.ToXyz(True)))



# Start Transaction
TransactionManager.Instance.EnsureInTransaction(doc)
activeview=doc.ActiveView
typeid=View.GetTypeId(activeview)

count = 0
while (count < len(Min)):
	b=View3D.CreateIsometric(doc, typeid)
	viewlist.append(b)
	box = app.Create.NewBoundingBoxXYZ()
	box.Min = Min[count]
	box.Max = Max[count]
	bbox.append(box)
	a=View3D.SetSectionBox(b,box)
	count = count + 1
	

# End Transaction
TransactionManager.Instance.TransactionTaskDone()
OUT=bbox,viewlist
# ----------------------------------------
code_block_8 = CodeBlock(a=python_script) { a[0]; a[1]; }
code_block_9 = CodeBlock(Bbox=code_block_8.out0) { Bbox; }
code_block_10 = CodeBlock(Views=code_block_8.out1) { Views; }
view_templates = ViewTemplate("FloorPlan : 1.1 OSNOVA 1.100")
set = Orchid.RevitProject.Views.ViewTemplate.Set(view=code_block_10, viewTemplate=view_templates)
