# Dynamo graph WIP FORMULA SET.dyn (Dynamo 2.3.1.11775)
# packages: Orchid 203.3.0.7865

string = StringInput("C:\Users\nikola.markovic\Termovent Komerc d.o.o\TERMOVENT Sharepoint - ČISTE SOBE\02 Šabloni\01 Template Clean Room Termovent\UPDATE PARAMETARA ZA STARE FAMILIJE\Vrata")  # graph input
i = CodeBlock { "*.rfa"; }
contentsAll = Python(IN[0]=string, IN[1]=i)  # "Directory.ContentsAll"
# ---------- contentsAll.python (7 lines) ----------
from System.IO import Directory, SearchOption
dir = IN[0]
searchstring = IN[1]
if Directory.Exists(dir):
	OUT = Directory.GetFiles(dir, searchstring, SearchOption.AllDirectories)
else:
	OUT = list()
# ----------------------------------------
backgroundOpen = Orchid.RevitProject.Common.Document.BackgroundOpen(file=contentsAll)
watch = Watch(backgroundOpen)
code_block = CodeBlock { "Dužina Kabla"; }
code_block_2 = CodeBlock { "3000"; }
set = Orchid.RevitFamily.Formula.Set(familyDocument=backgroundOpen, parameterName=code_block, value=code_block_2)
await_ = Orchid.Common.DataStream.Await(pass=watch, waitFor=set)
save = Orchid.RevitProject.Common.Document.Save(document=await_)
code_block_3 = CodeBlock { "Dužina Kabla"; }
code_block_4 = CodeBlock { "3000"; }
setValue = Orchid.RevitFamily.Parameter.SetValue(familyDocument=backgroundOpen, parameterName=code_block_3, value=code_block_4)  # frozen
