# Dynamo graph WIP HANGERS V2.dyn "22. HANGERS V2" (Dynamo 2.0.3.8810)

string = StringInput("P3_Duct_Height")
setParameterByName = Element.SetParameterByName(parameterName=string)  # unwired: element, value
string_2 = StringInput("P3_DuctHanger")
byName = Family.ByName(name=string_2)
types = Family.Types(family=byName)
flatten = List.Flatten(list=types)
boolean = BoolSelector(false)
ꟿ_selectelementsinorder = Custom[ꟿ SelectElementsInOrder](refresh=boolean)  # Select multiple elements from the Revit document in the desired order. Hit ESC to stop picking. To refresh the node, connect a boolean switch node.
element_curve = Custom[Element Curve](element=ꟿ_selectelementsinorder)  # Get the curve from the element.
string_3 = StringInput("Length")
getParameterValueByName = Element.GetParameterValueByName(element=ꟿ_selectelementsinorder, parameterName=string_3)
parametar_dužine_postavljanja = CodeBlock { 4000; }  # "parametar dužine postavljanja Hangera"
code_block = CodeBlock(a=getParameterValueByName, b=parametar_dužine_postavljanja) { a; b; 2000..a..b; }
pointAtSegmentLength = Curve.PointAtSegmentLength(curve=element_curve, segmentLength=code_block.out2)
byPoint = FamilyInstance.ByPoint(familyType=flatten, point=pointAtSegmentLength, lacing=Longest)
facingOrientation = FamilyInstance.FacingOrientation(familyInstance=byPoint)
direction = Line.Direction(line=element_curve)
angleWithVector = Vector.AngleWithVector(vector=facingOrientation, otherVector=direction)
setRotation = FamilyInstance.SetRotation(familyInstance=byPoint, degree=angleWithVector)
string_4 = StringInput("Height")
getParameterValueByName_2 = Element.GetParameterValueByName(element=ꟿ_selectelementsinorder, parameterName=string_4)
string_5 = StringInput("Insulation Thickness")
getParameterValueByName_3 = Element.GetParameterValueByName(element=ꟿ_selectelementsinorder, parameterName=string_5)
code_block_2 = CodeBlock(a=getParameterValueByName_2, b=getParameterValueByName_3) { a; b; a+2*b; }
passthrough = Custom[Passthrough](passThrough=code_block_2.out2, waitFor=setRotation)  # Forces a sequential order of execution. The node wired into the output of the Passthrough node will be executed *after* the node wired into the waitFor input (e.g. important for some Revit operations). The value of the passThrough input will be passed on to the node wired into the output port of the Passthrough node.
combine = List.Combine(comb=setParameterByName, list1=setRotation, list2=passthrough)
string_6 = StringInput("P3_Duct_Width")
setParameterByName_2 = Element.SetParameterByName(parameterName=string_6)  # unwired: element, value
string_7 = StringInput("Width")
getParameterValueByName_4 = Element.GetParameterValueByName(element=ꟿ_selectelementsinorder, parameterName=string_7)
code_block_3 = CodeBlock(a=getParameterValueByName_4, b=getParameterValueByName_3) { a; b; a+2*b; }
passthrough_2 = Custom[Passthrough](passThrough=code_block_3.out2, waitFor=setRotation)
combine_2 = List.Combine(comb=setParameterByName_2, list1=setRotation, list2=passthrough_2)
string_8 = StringInput("P3_UpperSupport")
boolean_2 = BoolSelector(true)
setParameterByName_3 = Element.SetParameterByName(element=setRotation, parameterName=string_8, value=boolean_2)
string_9 = StringInput("Offset")
getParameterValueByName_5 = Element.GetParameterValueByName(element=ꟿ_selectelementsinorder, parameterName=string_9)
string_10 = StringInput("Reference Level")
getParameterValueByName_6 = Element.GetParameterValueByName(element=ꟿ_selectelementsinorder, parameterName=string_10)
levelAbove = Custom[Level.LevelAbove]()  # This node takes an input of level and returns level above it.; unwired: Level
string_11 = StringInput("P3_Dynamo_Center2Ceiling")
setParameterByName_4 = Element.SetParameterByName(parameterName=string_11)  # unwired: element, value
collector_of_levels = Custom[Collector of Levels]()  # Collects Levels in the active or given document. Based on a Lunchbox node.
elevation = Level.Elevation(level=collector_of_levels.Element)
getLocation = Element.GetLocation(element=setRotation)
Z = Point.Z(point=getLocation)
sub = elevation - Z  # lacing=CrossProduct
minimumItem = List.MinimumItem(list=sub@L3)
sign = Math.Sign(number=minimumItem)
code_block_4 = CodeBlock { 1; }
eq = sign == code_block_4
allTrue = List.AllTrue(list=eq@L2)
filterByBoolMask = List.FilterByBoolMask(list=minimumItem, mask=allTrue)
transpose = List.Transpose(lists=filterByBoolMask.in)
minimumItem_2 = List.MinimumItem(list=transpose)
combine_3 = List.Combine(comb=setParameterByName_4, list1=setRotation, list2=minimumItem_2)
categories = Categories(index=408)
all_elements_of_category = ElementsOfCategory(Category=categories)
byElement = CurtainPanel.ByElement(hostingElement=all_elements_of_category)
byElement_2 = Mullion.ByElement(hostingElement=all_elements_of_category)
name = Element.Name(element=byElement_2)
byPointHostTypeAndLevel = WombatDynamo.FamilyInstance.ByPointHostTypeAndLevel()  # unwired: location, host, familyType, level
flatten_2 = List.Flatten(list=byElement_2)
tip = StringInput("2mm")
metod = StringInput("Equals")
ʳʰʸᵗʰᵐ_elementfilter_byname = Rhythm.Revit.ElementFilter.ElementFilter.ByName(elements=flatten_2, value=tip, filterMethod=metod)
