# Dynamo graph WIP Instalaterska roba V3 - Copy.dyn "WIP Instalaterska roba V3" (Dynamo 2.3.0.5885)
# packages: Bakery 2019.5.8, archi-lab.net 2020.23.13

setRotation = FamilyInstance.SetRotation()  # frozen; unwired: familyInstance, degree
familija_koja_se_postavlja_u = CodeBlock()  # "Familija koja se postavlja u model"
# ---------- familija_koja_se_postavlja_u.designscript (5 lines) ----------
Italijan = Revit.Family.Types(Revit.Family.ByName("Italijan"));

Pod = DSCore.List.GetItemAtIndex(Italijan, 0);
Zid = DSCore.List.GetItemAtIndex(Italijan, 1);
Plafon = DSCore.List.GetItemAtIndex(Italijan, 2);
# ----------------------------------------
watch = Watch(familija_koja_se_postavlja_u.Zid)
watch_2 = Watch(familija_koja_se_postavlja_u.Plafon)

# group: jedinstveni zidovi po sobama - filter
code_block = CodeBlock { "Walls"; }
byName = Category.ByName(name=code_block)
all_elements_of_category = ElementsOfCategory(Category=byName)
boolean = BoolSelector(true)
placedRooms = Python(IN[0]=boolean)  # "Collector.PlacedRooms"
# ---------- placedRooms.python (36 lines) ----------
#Copyright(c) 2017, john pierson
# @60secondrevit, http://sixtysecondrevit.com

import clr
clr.AddReference('ProtoGeometry')
from Autodesk.DesignScript.Geometry import *

# Import DocumentManager and TransactionManager
clr.AddReference("RevitServices")
import RevitServices
from RevitServices.Persistence import DocumentManager
from RevitServices.Transactions import TransactionManager

# Import RevitAPI
clr.AddReference("RevitAPI")
import Autodesk
from Autodesk.Revit.DB import *

doc = DocumentManager.Instance.CurrentDBDocument
uiapp = DocumentManager.Instance.CurrentUIApplication
app = uiapp.Application

from System.Collections.Generic import *


#The inputs to this node will be stored as a list in the IN variable.
dataEnteringNode = IN
collector = FilteredElementCollector(doc)
rooms = collector.OfCategory(BuiltInCategory.OST_Rooms).ToElements()

roomInstances = []
for i in rooms:
	if i.Area != 0:
		roomInstances.append(i)

OUT = roomInstances
# ----------------------------------------
getboundingelements_archilab = Python(IN[0]=placedRooms)
# ---------- getboundingelements_archilab.python (78 lines) ----------
# Copyright(c) 2015, Konrad K Sobon
# @arch_laboratory, http://archi-lab.net

# This node was an update to Wall.Boundaries node
# that can be found in Clockwork package. Thanks
# to Andreas Dieckmann for making the original one.

import clr
clr.AddReference('RevitAPI')
from Autodesk.Revit.DB import *

clr.AddReference('RevitNodes')
import Revit
clr.ImportExtensions(Revit.GeometryConversion)

clr.AddReference('RevitServices')
import RevitServices
from RevitServices.Persistence import DocumentManager
doc = DocumentManager.Instance.CurrentDBDocument

import sys
pyt_path = r'C:\Program Files (x86)\IronPython 2.7\Lib'
sys.path.append(pyt_path)

def Unwrap(item):
	return UnwrapElement(item)

def ProcessList(_func, _list):
    return map( lambda x: ProcessList(_func, x) if type(x)==list else _func(x), _list )

def GetRoomBoundary(doc, item, options):
	eList = []
	cList = []
	try:
		for i in item.GetBoundarySegments(options):
			for j in i:
				eList.append(doc.GetElement(j.ElementId))
				cList.append(j.Curve.ToProtoType())
	except:
		calculator = SpatialElementGeometryCalculator(doc)
		try:
			results = calculator.CalculateSpatialElementGeometry(item)
			for face in results.GetGeometry().Faces:
				for bface in results.GetBoundaryFaceInfo(face):
					eList.append(doc.GetElement(bface.SpatialBoundaryElement.HostElementId))
		except:
			pass
	return [eList, cList]

if isinstance(IN[0], list):
	items = ProcessList(Unwrap, IN[0])
else:
	items = [Unwrap(IN[0])]

options = SpatialElementBoundaryOptions()

boundloc = AreaVolumeSettings.GetAreaVolumeSettings(doc).GetSpatialElementBoundaryLocation(SpatialElementType.Room)
options.SpatialElementBoundaryLocation = boundloc

elementList = []

try:
	errorReport = None
	if isinstance(items, list):
		for item in items:
			elementList.append(GetRoomBoundary(doc, item, options)[0])	
	else:
		elementList = GetRoomBoundary(doc, items, options)[0]		
except:
	# if error accurs anywhere in the process catch it
	import traceback
	errorReport = traceback.format_exc()

#Assign your output to the OUT variable
if errorReport == None:
	OUT = elementList
else:
	OUT = errorReport
# ----------------------------------------
join = List.Join(list0=all_elements_of_category, list1=getboundingelements_archilab)
watch_3 = Watch(join)
flatten = List.Flatten(list=watch_3)
uniqueItems = List.UniqueItems(list=flatten)

# group: Izbacivanje zidova vrata
i = CodeBlock(i=uniqueItems) { i; }
name = Element.Name(element=i)
tipovi_zidova_za_proveru = CodeBlock { "WPS"; "WCS"; }
join_2 = List.Join(list0=tipovi_zidova_za_proveru.out0, list1=tipovi_zidova_za_proveru.out1)
boolean_2 = BoolSelector(true)
contains = String.Contains(str=name, searchFor=join_2, ignoreCase=boolean_2, lacing=CrossProduct)
contains_2 = List.Contains(list=contains@L2, item=boolean_2)
filterByBoolMask = List.FilterByBoolMask(list=i, mask=contains_2)

watch_4 = Watch(filterByBoolMask.in)
code_block_2 = CodeBlock(Wallz=watch_4)
# ---------- code_block_2.designscript (19 lines) ----------
// Željeni korak na koji se stavljaju italijani
korak = 600;
// Željeni razmak od zida
razmak = 150;

// Matematika
duzinaZida = Math.Round(Revit.Elements.Element.GetParameterValueByName(Wallz, "Length"));

start = razmak;
end = duzinaZida-razmak;
step1 = Math.Ceiling((duzinaZida-2*razmak)/korak);

step2 = end/step1;





italijanoDasa = (start..#step1..step2);
# ----------------------------------------
watch_5 = Watch(code_block_2.duzinaZida)
watch_6 = Watch(code_block_2.step1)
watch_7 = Watch(code_block_2.end)
watch_8 = Watch(code_block_2.step2)
# note: Bakery
rotate_families_around_origin_by = Custom[Rotate Families Around Origin by Angle]()  # frozen; package Bakery; this will take Family Instance and angles as list inputs, and rotate Families around their origin. Outputs provide feedback on information used.; unwired: FamilyElement, DegreesToRotate
watch_9 = Watch(familija_koja_se_postavlja_u.Pod)
element_curve = Python(IN[0]=watch_4)
# ---------- element_curve.python (143 lines) ----------
#Alban de Chasteigner 2020
#twitter : @geniusloci_bim
#geniusloci.bim@gmail.com

import clr
clr.AddReference('RevitAPI')
import Autodesk
from Autodesk.Revit.DB import *

clr.AddReference("RevitNodes")
import Revit
clr.ImportExtensions(Revit.GeometryConversion)

clr.AddReference("RevitServices")
import RevitServices
from RevitServices.Persistence import DocumentManager
from RevitServices.Transactions import TransactionManager
uiapp = DocumentManager.Instance.CurrentUIApplication
app = uiapp.Application
version=int(app.VersionNumber)

items = UnwrapElement(IN[0]) if isinstance(IN[0],list) else [UnwrapElement(IN[0])]
curves = []

def Curve(dimension):
	curve = []
	if dimension.DimensionShape == DimensionShape.Linear:
		direction = dimension.Curve.Direction
		if dimension.NumberOfSegments ==0:
			start = dimension.Origin.Subtract(direction.Multiply(dimension.Value/2))
			end = dimension.Origin.Subtract(direction.Multiply(-dimension.Value/2))
			curve=Line.CreateBound(start,end).ToProtoType()
		else:
			for segment in dimension.Segments:
				start = segment.Origin.Subtract(direction.Multiply(segment.Value/2))
				end = segment.Origin.Subtract(direction.Multiply(-segment.Value/2))
				curve.append(Line.CreateBound(start,end).ToProtoType())
	return curve
	
def getCurve(section):
	#Thanks to Fair59 https://forums.autodesk.com/t5/revit-api-forum/how-can-i-get-the-coordinates-of-the-endpoints-for-a-section/td-p/6877871
	correction = 21.130014403 / 304.8
	#get the Section Marker from the section view
	if ElementId(BuiltInCategory.OST_Viewers) == section.Category.Id :
		viewSection = doc.GetElement(ElementId(section.Id.IntegerValue + 1))
		marker=section
	#get the Section Marker from the section view
	elif isinstance(section,Autodesk.Revit.DB.ViewSection):
		marker = doc.GetElement(ElementId(section.Id.IntegerValue - 1))
		viewSection=section

	if marker and viewSection:
		vType = doc.GetElement(marker.GetTypeId())
		if vType:
			TransactionManager.Instance.EnsureInTransaction(doc)
			trans = Autodesk.Revit.DB.SubTransaction(doc)
			trans.Start()
			par = vType.get_Parameter(BuiltInParameter.SECTION_TAG)
			par.Set( ElementId.InvalidElementId)
			par = vType.get_Parameter(BuiltInParameter.VIEWER_REFERENCE_LABEL_TEXT)
			par.Set("")
			view.Scale = 1
			doc.Regenerate()
			bb1 = marker.get_BoundingBox(view)
			trans.RollBack()
			TransactionManager.Instance.ForceCloseTransaction()

			bb = marker.get_BoundingBox(view)
			if bb:
				pt1 = bb.Min
				pt2 = bb.Max
				if bb1 :
					pt1 = bb1.Min
					pt2 = bb1.Max
	
				Origin = viewSection.Origin
				ViewBasisX = viewSection.RightDirection
				ViewBasisY = viewSection.ViewDirection
				if ViewBasisX.X < 0 != ViewBasisX.Y < 0 :
					d = pt1.Y
					pt1 = XYZ( pt1.X, pt2.Y, pt1.Z)
					pt2 = XYZ( pt2.X, d, pt2.Z)

				ToPlane1 = pt1.Add(ViewBasisY.Multiply(ViewBasisY.DotProduct(Origin.Subtract(pt1))))
				ToPlane2 = pt2.Subtract(ViewBasisY.Multiply(ViewBasisY.DotProduct(pt2.Subtract(Origin))))
				correctionVector = ToPlane2.Subtract( ToPlane1 ).Normalize().Multiply(correction)
				endPoint0 = ToPlane1.Add(correctionVector)
				endPoint1 = ToPlane2.Subtract(correctionVector)
				curve=Line.CreateBound(endPoint0,endPoint1).ToProtoType()
				return curve

def colCurve(col):	
	loc= col.Location.Point
	bb = col.get_BoundingBox(None).Min
	height=col.get_Parameter(BuiltInParameter.INSTANCE_LENGTH_PARAM).AsDouble()
	start=XYZ(loc.X,loc.Y,bb.Z)
	end=XYZ(start.X,start.Y,start.Z+height)
	curve=Line.CreateBound(start,end).ToProtoType()
	return curve

for item in items:
	doc=item.Document
	view = doc.ActiveView
	#Railing
	if hasattr(item, "GetPath"):
		curves.append([railpath.ToProtoType() for railpath in item.GetPath()])
	#Revision Cloud
	elif hasattr(item, "GetSketchCurves"): 
		curves.append([sk.ToProtoType() for sk in item.GetSketchCurves()])
	elif hasattr(item, "LocationCurve"): 
		curves.append(item.LocationCurve.ToProtoType())
	elif hasattr(item, "FullCurve"): 
		curves.append(item.FullCurve.ToProtoType())
	elif hasattr(item, "ValueOverride"):
		curves.append(Curve(item))
	elif hasattr(item, "Curve"): 
		curves.append(item.Curve.ToProtoType())
	elif hasattr(item, "GeometryCurve"): 		
		curves.append(item.GeometryCurve.ToProtoType())
	elif hasattr(item, "GetEndpoint"): 
		curves.append(item.ToProtoType())
	elif version > 2019 and isinstance(item,Autodesk.Revit.DB.Analysis.PathOfTravel):
		curves.append([i.ToProtoType() for i in item.GetCurves()])
	elif ElementId(BuiltInCategory.OST_StructuralColumns) == item.Category.Id and not item.IsSlantedColumn :
		curves.append(colCurve(item))
	elif hasattr(item, "GetCurvesInView"):
		for crv in item.GetCurvesInView(DatumExtentType.ViewSpecific,view):
			curves.append(crv.ToProtoType())
	elif ElementId(BuiltInCategory.OST_Viewers) == item.Category.Id or isinstance(item,Autodesk.Revit.DB.ViewSection):
		curves.append(getCurve(item))
	elif hasattr(item, "Location"):
		loc = item.Location
		if isinstance(loc,Autodesk.Revit.DB.LocationCurve):
			curves.append(loc.Curve.ToProtoType())
		else:
			curves.append(None)
	else: curves.append(None)

if isinstance(IN[0], (list)): OUT = curves
elif hasattr(item, "GetPath"): OUT = curves
elif hasattr(item, "GetSketchCurves"): OUT = curves
elif hasattr(item, "ValueOverride"): OUT = curves
else: OUT = curves[0]
# ----------------------------------------
pointAtSegmentLength = Curve.PointAtSegmentLength(curve=element_curve, segmentLength=code_block_2.italijanoDasa)
byPoint = FamilyInstance.ByPoint(familyType=watch_9, point=pointAtSegmentLength, lacing=Longest)
facingOrientation = FamilyInstance.FacingOrientation(familyInstance=byPoint)
direction = Line.Direction(line=element_curve)
normalized = Vector.Normalized(vector=direction)
angleWithVector = Vector.AngleWithVector(vector=facingOrientation, otherVector=normalized)
round = Math.Round(number=angleWithVector)

# group: Rotacija modela prema zidu
code_block_3 = CodeBlock(FamilyElement=byPoint) { FamilyElement; }
element_ids = Custom[Element Ids](element=code_block_3)  # package archi-lab.net; This node will query an element id that can be used with Revit nodes. Dynamo Element Id node returns integer value.
flatten_2 = List.Flatten(list=element_ids.idString)
location = FamilyInstance.Location(familyInstance=code_block_3)
X = Point.X(point=location)
Y = Point.Y(point=location)
number = DoubleInput(-2000)
sum = Math.Sum(values=number)
byCoordinates = Point.ByCoordinates(x=X, y=Y, z=sum)
byStartPointEndPoint = Line.ByStartPointEndPoint(startPoint=location, endPoint=byCoordinates)
code_block_4 = CodeBlock(DegreesToRotate=round) { DegreesToRotate; }
degreesToRadians = Math.DegreesToRadians(degrees=code_block_4)
code_block_5 = CodeBlock(elementid=flatten_2, axis=byStartPointEndPoint, angle=degreesToRadians) { a = DSCore.List.Flatten(elementid, 10); b = DSCore.List.Flatten(axis, 10); c = DSCore.List.Flatten(angle, 10); }
python_script = Python(IN[0]=code_block_5.a, IN[1]=code_block_5.b, IN[2]=code_block_5.c)
# ---------- python_script.python (61 lines) ----------
#Copyright(c) 2015, Konrad Sobon
# @arch_laboratory, http://archi-lab.net

import clr
clr.AddReference('ProtoGeometry')
from Autodesk.DesignScript.Geometry import *

# Import ToDSType(bool) extension method
clr.AddReference("RevitNodes")
import Revit
clr.ImportExtensions(Revit.Elements)

# Import DocumentManager and TransactionManager
clr.AddReference("RevitServices")
import RevitServices
from RevitServices.Persistence import DocumentManager
from RevitServices.Transactions import TransactionManager

from System.Collections.Generic import *

# Import RevitAPI
clr.AddReference("RevitAPI")
import Autodesk
from Autodesk.Revit.DB import *

doc = DocumentManager.Instance.CurrentDBDocument
uiapp = DocumentManager.Instance.CurrentUIApplication
app = uiapp.Application

# Import geometry conversion extension methods
clr.ImportExtensions(Revit.GeometryConversion)

#The inputs to this node will be stored as a list in the IN variable.
dataEnteringNode = IN

def toRvtId(_id):
	if isinstance(_id, int) or isinstance(_id, str):
		id = ElementId(int(_id))
		return id
	elif isinstance(_id, ElementId):
		return _id

lmntIds, axises, angles = [], [], []
for i, j in zip(IN[0], IN[1]):
	lmntIds.append(toRvtId(UnwrapElement(i)))
	axises.append(j.ToRevitType())
angles = IN[2]

# "Start" the transaction
TransactionManager.Instance.EnsureInTransaction(doc)

elements = []
for axis_, angle_, lmntId_ in zip(axises, angles, lmntIds):
	Autodesk.Revit.DB.ElementTransformUtils.RotateElement(doc, lmntId_, axis_, angle_)
	elements.append(doc.GetElement(lmntId_))

# "End" the transaction
TransactionManager.Instance.TransactionTaskDone()

#Assign your output to the OUT variable
OUT = elements
# ----------------------------------------
