# Dynamo graph WIP Instalaterska roba V3.dyn (Dynamo 2.3.1.11775)
# packages: designtech 1.0.8, Caribou 2.0.3

# note: Površine
# note: Ivice

familija_koja_se_postavlja_u = CodeBlock()  # "Familija koja se postavlja u model"
# ---------- familija_koja_se_postavlja_u.designscript (5 lines) ----------
Italijan = Revit.Family.Types(Revit.Family.ByName("Italijan"));

Pod = DSCore.List.GetItemAtIndex(Italijan, 0);
Zid = DSCore.List.GetItemAtIndex(Italijan, 1);
Plafon = DSCore.List.GetItemAtIndex(Italijan, 2);
# ----------------------------------------
watch = Watch(familija_koja_se_postavlja_u.Pod)
watch_2 = Watch(familija_koja_se_postavlja_u.Zid)
watch_3 = Watch(familija_koja_se_postavlja_u.Plafon)

# group: jedinstveni zidovi po sobama - filter
curtainWalls = dtRevit.Collector.CurtainWalls()
uniqueItems = List.UniqueItems(list=curtainWalls)
code_block = CodeBlock { "Walls"; }
byName = Category.ByName(name=code_block)
all_elements_of_category = ElementsOfCategory(Category=byName)
boolean = BoolSelector(true)
placedRooms = Python(IN[0]=boolean)  # "Collector.PlacedRooms"
# ---------- placedRooms.python (36 lines) ----------
#Copyright(c) 2017, john pierson
# @60secondrevit, http://sixtysecondrevit.com

import clr
clr.AddReference('ProtoGeometry')
from Autodesk.DesignScript.Geometry import *

# Import DocumentManager and TransactionManager
clr.AddReference("RevitServices")
import RevitServices
from RevitServices.Persistence import DocumentManager
from RevitServices.Transactions import TransactionManager

# Import RevitAPI
clr.AddReference("RevitAPI")
import Autodesk
from Autodesk.Revit.DB import *

doc = DocumentManager.Instance.CurrentDBDocument
uiapp = DocumentManager.Instance.CurrentUIApplication
app = uiapp.Application

from System.Collections.Generic import *


#The inputs to this node will be stored as a list in the IN variable.
dataEnteringNode = IN
collector = FilteredElementCollector(doc)
rooms = collector.OfCategory(BuiltInCategory.OST_Rooms).ToElements()

roomInstances = []
for i in rooms:
	if i.Area != 0:
		roomInstances.append(i)

OUT = roomInstances
# ----------------------------------------
getboundingelements_archilab = Python(IN[0]=placedRooms)
# ---------- getboundingelements_archilab.python (78 lines) ----------
# Copyright(c) 2015, Konrad K Sobon
# @arch_laboratory, http://archi-lab.net

# This node was an update to Wall.Boundaries node
# that can be found in Clockwork package. Thanks
# to Andreas Dieckmann for making the original one.

import clr
clr.AddReference('RevitAPI')
from Autodesk.Revit.DB import *

clr.AddReference('RevitNodes')
import Revit
clr.ImportExtensions(Revit.GeometryConversion)

clr.AddReference('RevitServices')
import RevitServices
from RevitServices.Persistence import DocumentManager
doc = DocumentManager.Instance.CurrentDBDocument

import sys
pyt_path = r'C:\Program Files (x86)\IronPython 2.7\Lib'
sys.path.append(pyt_path)

def Unwrap(item):
	return UnwrapElement(item)

def ProcessList(_func, _list):
    return map( lambda x: ProcessList(_func, x) if type(x)==list else _func(x), _list )

def GetRoomBoundary(doc, item, options):
	eList = []
	cList = []
	try:
		for i in item.GetBoundarySegments(options):
			for j in i:
				eList.append(doc.GetElement(j.ElementId))
				cList.append(j.Curve.ToProtoType())
	except:
		calculator = SpatialElementGeometryCalculator(doc)
		try:
			results = calculator.CalculateSpatialElementGeometry(item)
			for face in results.GetGeometry().Faces:
				for bface in results.GetBoundaryFaceInfo(face):
					eList.append(doc.GetElement(bface.SpatialBoundaryElement.HostElementId))
		except:
			pass
	return [eList, cList]

if isinstance(IN[0], list):
	items = ProcessList(Unwrap, IN[0])
else:
	items = [Unwrap(IN[0])]

options = SpatialElementBoundaryOptions()

boundloc = AreaVolumeSettings.GetAreaVolumeSettings(doc).GetSpatialElementBoundaryLocation(SpatialElementType.Room)
options.SpatialElementBoundaryLocation = boundloc

elementList = []

try:
	errorReport = None
	if isinstance(items, list):
		for item in items:
			elementList.append(GetRoomBoundary(doc, item, options)[0])	
	else:
		elementList = GetRoomBoundary(doc, items, options)[0]		
except:
	# if error accurs anywhere in the process catch it
	import traceback
	errorReport = traceback.format_exc()

#Assign your output to the OUT variable
if errorReport == None:
	OUT = elementList
else:
	OUT = errorReport
# ----------------------------------------
join = List.Join(list0=all_elements_of_category, list1=getboundingelements_archilab, list2=curtainWalls)
watch_4 = Watch(join)
flatten = List.Flatten(list=watch_4)

# group: Izbacivanje zidova vrata
i = CodeBlock(i=uniqueItems) { i; }
name = Element.Name(element=i)
tipovi_zidova_za_proveru = CodeBlock { "WP"; "WC"; }
join_2 = List.Join(list0=tipovi_zidova_za_proveru.out0, list1=tipovi_zidova_za_proveru.out1)
boolean_2 = BoolSelector(true)
contains = String.Contains(str=name, searchFor=join_2, ignoreCase=boolean_2, lacing=CrossProduct)
contains_2 = List.Contains(list=contains@L2, item=boolean_2)
filterByBoolMask = List.FilterByBoolMask(list=i, mask=contains_2)

watch_5 = Watch(filterByBoolMask.in)
element_curve = Python(IN[0]=watch_5)
# ---------- element_curve.python (143 lines) ----------
#Alban de Chasteigner 2020
#twitter : @geniusloci_bim
#geniusloci.bim@gmail.com

import clr
clr.AddReference('RevitAPI')
import Autodesk
from Autodesk.Revit.DB import *

clr.AddReference("RevitNodes")
import Revit
clr.ImportExtensions(Revit.GeometryConversion)

clr.AddReference("RevitServices")
import RevitServices
from RevitServices.Persistence import DocumentManager
from RevitServices.Transactions import TransactionManager
uiapp = DocumentManager.Instance.CurrentUIApplication
app = uiapp.Application
version=int(app.VersionNumber)

items = UnwrapElement(IN[0]) if isinstance(IN[0],list) else [UnwrapElement(IN[0])]
curves = []

def Curve(dimension):
	curve = []
	if dimension.DimensionShape == DimensionShape.Linear:
		direction = dimension.Curve.Direction
		if dimension.NumberOfSegments ==0:
			start = dimension.Origin.Subtract(direction.Multiply(dimension.Value/2))
			end = dimension.Origin.Subtract(direction.Multiply(-dimension.Value/2))
			curve=Line.CreateBound(start,end).ToProtoType()
		else:
			for segment in dimension.Segments:
				start = segment.Origin.Subtract(direction.Multiply(segment.Value/2))
				end = segment.Origin.Subtract(direction.Multiply(-segment.Value/2))
				curve.append(Line.CreateBound(start,end).ToProtoType())
	return curve
	
def getCurve(section):
	#Thanks to Fair59 https://forums.autodesk.com/t5/revit-api-forum/how-can-i-get-the-coordinates-of-the-endpoints-for-a-section/td-p/6877871
	correction = 21.130014403 / 304.8
	#get the Section Marker from the section view
	if ElementId(BuiltInCategory.OST_Viewers) == section.Category.Id :
		viewSection = doc.GetElement(ElementId(section.Id.IntegerValue + 1))
		marker=section
	#get the Section Marker from the section view
	elif isinstance(section,Autodesk.Revit.DB.ViewSection):
		marker = doc.GetElement(ElementId(section.Id.IntegerValue - 1))
		viewSection=section

	if marker and viewSection:
		vType = doc.GetElement(marker.GetTypeId())
		if vType:
			TransactionManager.Instance.EnsureInTransaction(doc)
			trans = Autodesk.Revit.DB.SubTransaction(doc)
			trans.Start()
			par = vType.get_Parameter(BuiltInParameter.SECTION_TAG)
			par.Set( ElementId.InvalidElementId)
			par = vType.get_Parameter(BuiltInParameter.VIEWER_REFERENCE_LABEL_TEXT)
			par.Set("")
			view.Scale = 1
			doc.Regenerate()
			bb1 = marker.get_BoundingBox(view)
			trans.RollBack()
			TransactionManager.Instance.ForceCloseTransaction()

			bb = marker.get_BoundingBox(view)
			if bb:
				pt1 = bb.Min
				pt2 = bb.Max
				if bb1 :
					pt1 = bb1.Min
					pt2 = bb1.Max
	
				Origin = viewSection.Origin
				ViewBasisX = viewSection.RightDirection
				ViewBasisY = viewSection.ViewDirection
				if ViewBasisX.X < 0 != ViewBasisX.Y < 0 :
					d = pt1.Y
					pt1 = XYZ( pt1.X, pt2.Y, pt1.Z)
					pt2 = XYZ( pt2.X, d, pt2.Z)

				ToPlane1 = pt1.Add(ViewBasisY.Multiply(ViewBasisY.DotProduct(Origin.Subtract(pt1))))
				ToPlane2 = pt2.Subtract(ViewBasisY.Multiply(ViewBasisY.DotProduct(pt2.Subtract(Origin))))
				correctionVector = ToPlane2.Subtract( ToPlane1 ).Normalize().Multiply(correction)
				endPoint0 = ToPlane1.Add(correctionVector)
				endPoint1 = ToPlane2.Subtract(correctionVector)
				curve=Line.CreateBound(endPoint0,endPoint1).ToProtoType()
				return curve

def colCurve(col):	
	loc= col.Location.Point
	bb = col.get_BoundingBox(None).Min
	height=col.get_Parameter(BuiltInParameter.INSTANCE_LENGTH_PARAM).AsDouble()
	start=XYZ(loc.X,loc.Y,bb.Z)
	end=XYZ(start.X,start.Y,start.Z+height)
	curve=Line.CreateBound(start,end).ToProtoType()
	return curve

for item in items:
	doc=item.Document
	view = doc.ActiveView
	#Railing
	if hasattr(item, "GetPath"):
		curves.append([railpath.ToProtoType() for railpath in item.GetPath()])
	#Revision Cloud
	elif hasattr(item, "GetSketchCurves"): 
		curves.append([sk.ToProtoType() for sk in item.GetSketchCurves()])
	elif hasattr(item, "LocationCurve"): 
		curves.append(item.LocationCurve.ToProtoType())
	elif hasattr(item, "FullCurve"): 
		curves.append(item.FullCurve.ToProtoType())
	elif hasattr(item, "ValueOverride"):
		curves.append(Curve(item))
	elif hasattr(item, "Curve"): 
		curves.append(item.Curve.ToProtoType())
	elif hasattr(item, "GeometryCurve"): 		
		curves.append(item.GeometryCurve.ToProtoType())
	elif hasattr(item, "GetEndpoint"): 
		curves.append(item.ToProtoType())
	elif version > 2019 and isinstance(item,Autodesk.Revit.DB.Analysis.PathOfTravel):
		curves.append([i.ToProtoType() for i in item.GetCurves()])
	elif ElementId(BuiltInCategory.OST_StructuralColumns) == item.Category.Id and not item.IsSlantedColumn :
		curves.append(colCurve(item))
	elif hasattr(item, "GetCurvesInView"):
		for crv in item.GetCurvesInView(DatumExtentType.ViewSpecific,view):
			curves.append(crv.ToProtoType())
	elif ElementId(BuiltInCategory.OST_Viewers) == item.Category.Id or isinstance(item,Autodesk.Revit.DB.ViewSection):
		curves.append(getCurve(item))
	elif hasattr(item, "Location"):
		loc = item.Location
		if isinstance(loc,Autodesk.Revit.DB.LocationCurve):
			curves.append(loc.Curve.ToProtoType())
		else:
			curves.append(None)
	else: curves.append(None)

if isinstance(IN[0], (list)): OUT = curves
elif hasattr(item, "GetPath"): OUT = curves
elif hasattr(item, "GetSketchCurves"): OUT = curves
elif hasattr(item, "ValueOverride"): OUT = curves
else: OUT = curves[0]
# ----------------------------------------
code_block_2 = CodeBlock(Wallz=watch_5)
# ---------- code_block_2.designscript (20 lines) ----------
// Željeni korak na koji se stavljaju italijani
korak = 600;
// Željeni razmak od zida
razmak = 180;

// Matematika
duzinaZida = Math.Round(Revit.Elements.Element.GetParameterValueByName(Wallz, "Length"));

start = razmak;
end = duzinaZida-razmak;
razmakizmedjuprvogiposlednjeg = duzinaZida-2*razmak;
brojkoraka = Math.Ceiling(razmakizmedjuprvogiposlednjeg/korak);


step2 = razmakizmedjuprvogiposlednjeg/brojkoraka;




italijanoDasa = (start..#brojkoraka..step2);
# ----------------------------------------
code_block_3 = CodeBlock(t2=code_block_2.end, t4=code_block_2.italijanoDasa) { t1 = DSCore.List.Chop(t2, 1); t3 = [t4, t1]; t5 = DSCore.List.Transpose(t3); }
clear_list = Python(IN[0]=code_block_3.t5)
# ---------- clear_list.python (23 lines) ----------
#Copyright(c) 2015, Konrad K Sobon
# @arch_laboratory, http://archi-lab.net

import clr
clr.AddReference('ProtoGeometry')
from Autodesk.DesignScript.Geometry import *
#The inputs to this node will be stored as a list in the IN variable.
dataEnteringNode = IN

def ClearList(_list):
    out = []
    for _list1 in _list:
        if _list1 is None:
            continue
        if isinstance(_list1, list):
             _list1 = ClearList(_list1)
             if not _list1:
                 continue
        out.append(_list1)
    return out

#Assign your output to the OUT variable
OUT = ClearList(IN[0])
# ----------------------------------------
reverseFlatten = Custom[List.Operations.ReverseFlatten](Elements=clear_list)  # package Caribou; Works the same as flatten, but operatios are made from the end side.
pointAtSegmentLength = Curve.PointAtSegmentLength(curve=element_curve, segmentLength=reverseFlatten)
byPoint = FamilyInstance.ByPoint(familyType=watch_3, point=pointAtSegmentLength, lacing=Longest)
code_block_4 = CodeBlock(FamilyElement=byPoint) { FamilyElement; }
facingOrientation = FamilyInstance.FacingOrientation(familyInstance=byPoint)
code_block_5 = CodeBlock(t1=element_curve) { vector1 = Autodesk.Line.Direction(t1); vector2 = Autodesk.Vector.Normalized(vector1); }
angleWithVector = Vector.AngleWithVector(vector=facingOrientation, otherVector=code_block_5.vector2)
round = Math.Round(number=angleWithVector)
code_block_6 = CodeBlock(familyElement=code_block_4) { empty = DSCore.List.Empty; t2 = [empty, familyElement]; t4 = DSCore.List.Flatten(t2, -1); }
python_script = Python(IN[0]=code_block_6.t4)
# ---------- python_script.python (21 lines) ----------
import clr
clr.AddReference('ProtoGeometry')
from Autodesk.DesignScript.Geometry import *
# Import RevitAPI
clr.AddReference('RevitAPI')
import Autodesk
#The inputs to this node will be stored as a list in the IN variable.
dataEnteringNode = IN

elements = []
for i in IN[0]:
    elements.append(UnwrapElement(i))

elementIds, idString, guid = [], [], []
for i in elements:
    elementIds.append(i.Id)
    idString.append(i.Id.ToString())
    guid.append(i.UniqueId)
    
#Assign your output to the OUT variable
OUT = elementIds, idString, guid
# ----------------------------------------
code_block_7 = CodeBlock(t1=code_block_4, t3=round, OUT=python_script)
# ---------- code_block_7.designscript (16 lines) ----------
point1 = Revit.FamilyInstance.Location(t1);
num1 = Autodesk.Point.X(point1);
num2 = Autodesk.Point.Y(point1);
t2 = -2000;
num3 = Math.Sum(t2);
point2 = Autodesk.Point.ByCoordinates(num1, num2, num3);
axis = Autodesk.Line.ByStartPointEndPoint(point1, point2);
angle = Math.DegreesToRadians(t3);

elementid = DSCore.List.Flatten(Get.ValueAtIndex(OUT, 0), -1);

a = DSCore.List.Flatten(elementid, 10);

b = DSCore.List.Flatten(axis, 10);

c = DSCore.List.Flatten(angle, 10);
# ----------------------------------------
python_script_2 = Python(IN[0]=code_block_7.a, IN[1]=code_block_7.b, IN[2]=code_block_7.c)
# ---------- python_script_2.python (61 lines) ----------
#Copyright(c) 2015, Konrad Sobon
# @arch_laboratory, http://archi-lab.net

import clr
clr.AddReference('ProtoGeometry')
from Autodesk.DesignScript.Geometry import *

# Import ToDSType(bool) extension method
clr.AddReference("RevitNodes")
import Revit
clr.ImportExtensions(Revit.Elements)

# Import DocumentManager and TransactionManager
clr.AddReference("RevitServices")
import RevitServices
from RevitServices.Persistence import DocumentManager
from RevitServices.Transactions import TransactionManager

from System.Collections.Generic import *

# Import RevitAPI
clr.AddReference("RevitAPI")
import Autodesk
from Autodesk.Revit.DB import *

doc = DocumentManager.Instance.CurrentDBDocument
uiapp = DocumentManager.Instance.CurrentUIApplication
app = uiapp.Application

# Import geometry conversion extension methods
clr.ImportExtensions(Revit.GeometryConversion)

#The inputs to this node will be stored as a list in the IN variable.
dataEnteringNode = IN

def toRvtId(_id):
	if isinstance(_id, int) or isinstance(_id, str):
		id = ElementId(int(_id))
		return id
	elif isinstance(_id, ElementId):
		return _id

lmntIds, axises, angles = [], [], []
for i, j in zip(IN[0], IN[1]):
	lmntIds.append(toRvtId(UnwrapElement(i)))
	axises.append(j.ToRevitType())
angles = IN[2]

# "Start" the transaction
TransactionManager.Instance.EnsureInTransaction(doc)

elements = []
for axis_, angle_, lmntId_ in zip(axises, angles, lmntIds):
	Autodesk.Revit.DB.ElementTransformUtils.RotateElement(doc, lmntId_, axis_, angle_)
	elements.append(doc.GetElement(lmntId_))

# "End" the transaction
TransactionManager.Instance.TransactionTaskDone()

#Assign your output to the OUT variable
OUT = elements
# ----------------------------------------

# group: Fonpla
finishBoundary = Room.FinishBoundary(room=placedRooms)
startPoint = Curve.StartPoint(curve=finishBoundary)
code_block_8 = CodeBlock { 1; }
flatten_2 = List.Flatten(list=finishBoundary, amt=code_block_8)
tangentAtParameter = Curve.TangentAtParameter(curve=flatten_2, param=code_block_8)
shiftIndices = List.ShiftIndices(list=flatten_2@L2, amount=code_block_8)
tangentAtParameter_2 = Curve.TangentAtParameter(curve=shiftIndices, param=code_block_8)
isAlmostEqualTo = Vector.IsAlmostEqualTo(vector=tangentAtParameter, other=tangentAtParameter_2)
filterByBoolMask_2 = List.FilterByBoolMask(list=startPoint, mask=isAlmostEqualTo)
reverse = List.Reverse(list=filterByBoolMask_2.out@L2)
X = Point.X(point=reverse)
Y = Point.Y(point=reverse)
add = X + Y
maximumItem = List.MaximumItem(list=add)
indexOf = List.IndexOf(list=add, element=maximumItem, lacing=Longest)
code_block_9 = CodeBlock(x=indexOf) { x*-1; }
shiftIndices_2 = List.ShiftIndices(list=indexOf@L2, amount=code_block_9, lacing=Longest)

code_block_10 = CodeBlock { 1; }
pruneDuplicates = Point.PruneDuplicates()  # unwired: points
contains_3 = String.Contains()  # unwired: str, searchFor
watch_6 = Watch(placedRooms)
geometry = Element.Geometry(element=watch_6)
bySolid = PolySurface.BySolid(solid=geometry)

# group: Ivice
edgeCount = PolySurface.EdgeCount(polySurface=bySolid)

# group: Ćoškovi
vertexCount = PolySurface.VertexCount(polySurface=bySolid)

# group: Površine
# note: Ćoškovi
surfaceCount = PolySurface.SurfaceCount(polySurface=bySolid)

byUnion = Solid.ByUnion(solids=geometry)
watch_7 = Watch()  # unwired: arg0
sobe_pojedinačno = CodeBlock(solid=geometry)
# ---------- sobe_pojedinačno.designscript (7 lines) ----------
sobepojedinacno = PolySurface.BySolid(solid);

ĆoškoviSoba = PolySurface.VertexCount(sobepojedinacno);
IviceSoba = PolySurface.EdgeCount(sobepojedinacno);

OkoObjekta = Autodesk.Solid.ByUnion(solid);
sobeukupno = PolySurface.BySolid(OkoObjekta);
# ----------------------------------------
watch_8 = Watch(sobe_pojedinačno.ĆoškoviSoba)
watch_9 = Watch(sobe_pojedinačno.IviceSoba)
watch_10 = Watch(sobe_pojedinačno.sobeukupno)
