# Dynamo graph WIP PASTE TAGS ON ROOMS.dyn (Dynamo 2.3.0.5885)
# packages: Bakery 2019.5.8, spring nodes 203.2.0

get_all_views = Custom[Get All Views]()  # package Bakery; taken from archi-lab
watch = Watch(get_all_views.Floor_Plans)
name = Element.Name(element=watch)

# group: FILTER OSNOVA
FILTER = StringInput("SA TAG")  # graph input

boolean = BoolSelector(true)
contains = String.Contains(str=name, searchFor=FILTER, ignoreCase=boolean)
filterByBoolMask = List.FilterByBoolMask(list=watch, mask=contains)
watch_2 = Watch(filterByBoolMask.in)
name_2 = Element.Name(element=watch)

# group: FILTER
FILTER_2 = StringInput("Цито")  # graph input

boolean_2 = BoolSelector(true)
contains_2 = String.Contains(str=name_2, searchFor=FILTER_2, ignoreCase=boolean_2)
filterByBoolMask_2 = List.FilterByBoolMask(list=watch, mask=contains_2)
watch_3 = Watch(filterByBoolMask_2.in)
string = StringInput("Curtain Panel Tags")
byName = Category.ByName(name=string)
all_elements_of_category_in_view = ElementsOfCategoryInView(Category=byName, View=watch_2)
name_3 = Element.Name(element=all_elements_of_category_in_view)
FILTER_3 = StringInput("Mark + Circle")
boolean_3 = BoolSelector(true)
contains_3 = String.Contains(str=name_3, searchFor=FILTER_3, ignoreCase=boolean_3)
filterByBoolMask_3 = List.FilterByBoolMask(list=all_elements_of_category_in_view, mask=contains_3)
flatten = List.Flatten(list=filterByBoolMask_3.in)
watch_4 = Watch(flatten)
ꟿ_document_copyfromviewtoview = Custom[ꟿ Document.CopyFromViewToView](sourceView=watch_2, destView=watch_3, elements=watch_4, lacing=Longest)  # package spring nodes; The node will copy the input (view based) elements from the source view into the destination view.
family_types = FamilyTypes("1. Paneli 1-50:Mark + Circle")
count = List.Count(list=watch_3)
ofRepeatedItem = List.OfRepeatedItem(item=watch_2, amount=count)
