# Dynamo graph WIP Profili - parametri - V1.dyn "20. Profili - parametri v1" (Dynamo 2.3.0.5885)
# packages: DynaTools 2018.1.15, archi-lab.net 2020.23.13

string = StringInput("3. Datum očitavanja")
string_2 = StringInput("1. Spoljašnji (IGM)")
string_3 = StringInput("2. Unutrašnji (Holker)")
string_4 = StringInput("Visina profila")
string_5 = StringInput("Špicevi")
string_6 = StringInput("Ćoškovi")
string_7 = StringInput("Podni holkeri")
string_8 = StringInput("TEXT")
string_9 = StringInput("Plafonski holkeri")
categories = Categories("OST_RoofsSurfacePattern")
string_10 = StringInput("Σ STUBOVI (IGM)")
string_11 = StringInput("Test1")
string_12 = StringInput("Test2")
string_13 = StringInput("Test3")
list_create = List.Create(item0=string_11, item1=string_12, item2=string_13)
string_from_object = FromObject(obj=list_create)
checkIfParameterExist = ElementTools.Parameters.CheckIfParameterExist(parameters=string_from_object)
string_14 = StringInput("Završni elementi")
parameter_types = ParameterTypeUi("Number")
string_15 = StringInput("PG_PROFILE")
boolean = BoolSelector(true)
categories_2 = Categories("OST_Walls")
createSharedParameter = Parameter.CreateSharedParameter(parameterName=checkIfParameterExist.notFound, groupName=string_14, type=parameter_types, group=string_15, instance=boolean, categoryList=categories_2)
string_16 = StringInput("ISO")
string_17 = StringInput("PG_PROFILE")
string_18 = StringInput("Faza")
string_19 = StringInput("Pressure")
parameter_groups = ParameterGroupUi("PG_PROFILE")
string_20 = StringInput("Class")
