# Dynamo graph WIP ROOM TAG.dyn (Dynamo 2.3.0.5885)
# packages: DynaTools 2018.1.15, Orchid 230.0.1.7437, SteamNodes 1.2.4, Bakery 2019.5.8, designtech 1.0.8

getAllElementsParameters = ElementTools.Elements.getAllElementsParameters()  # unwired: elements
byElementAndOffset = Tag.ByElementAndOffset()  # unwired: view, element
byElement = Orchid.RevitProject.Annotations.Tag.ByElement()  # unwired: view, element, tagType
list_all_views = Python()  # unwired: IN[0]
# ---------- list_all_views.python (109 lines) ----------
#Copyright(c) 2015, Konrad Sobon
# @arch_laboratory, http://archi-lab.net

import clr
clr.AddReference('ProtoGeometry')
from Autodesk.DesignScript.Geometry import *

# Import DocumentManager and TransactionManager
clr.AddReference("RevitServices")
import RevitServices
from RevitServices.Persistence import DocumentManager
from RevitServices.Transactions import TransactionManager

# Import RevitAPI
clr.AddReference("RevitAPI")
import Autodesk
from Autodesk.Revit.DB import *

doc = DocumentManager.Instance.CurrentDBDocument
uiapp = DocumentManager.Instance.CurrentUIApplication
app = uiapp.Application

from System.Collections.Generic import *

# Import ToDSType(bool) extension method
clr.AddReference("RevitNodes")
import Revit
clr.ImportExtensions(Revit.Elements)

#The inputs to this node will be stored as a list in the IN variable.
dataEnteringNode = IN


#Part of script from Clockwork
inputdoc = UnwrapElement(IN[0])
if inputdoc == None:
	doc = DocumentManager.Instance.CurrentDBDocument
elif inputdoc.GetType().ToString() == "Autodesk.Revit.DB.RevitLinkInstance":
	doc = inputdoc.GetLinkDocument()
elif inputdoc.GetType().ToString() == "Autodesk.Revit.DB.Document":
	doc = inputdoc
else: doc = None

views = FilteredElementCollector(doc).OfClass(View).ToElements()

#sort views into separate lists based on view type
areaPlans, ceilingPlans, columnSchedules = [], [], []
costReport, details, draftingViews = [], [], []
drawingSheets, elevations, engineetingPlans = [], [], []
floorPlans, internal, legends, loadReports = [], [], [], []
panelSchedules, pressureLossReports, renderings = [], [], []
reports, schedules, sections, threeD = [], [], [], []
undefined, walkthrough, revisionschedules = [], [], []
for i in views:
	if not i.IsTemplate:
		if i.ViewType == ViewType.AreaPlan:
			areaPlans.append(i.ToDSType(True))
		elif i.ViewType == ViewType.CeilingPlan:
			ceilingPlans.append(i.ToDSType(True))
		elif i.ViewType == ViewType.ColumnSchedule:
			columnSchedules.append(i.ToDSType(True))
		elif i.ViewType == ViewType.CostReport:
			costReport.append(i.ToDSType(True))
		elif i.ViewType == ViewType.Detail:
			details.append(i.ToDSType(True))
		elif i.ViewType == ViewType.DraftingView:
			draftingViews.append(i.ToDSType(True))
		elif i.ViewType == ViewType.DrawingSheet:
			drawingSheets.append(i.ToDSType(True))
		elif i.ViewType == ViewType.Elevation:
			elevations.append(i.ToDSType(True))
		elif i.ViewType == ViewType.EngineeringPlan:
			engineetingPlans.append(i.ToDSType(True))
		elif i.ViewType == ViewType.FloorPlan:
			floorPlans.append(i.ToDSType(True))
		elif i.ViewType == ViewType.Internal:
			internal.append(i.ToDSType(True))
		elif i.ViewType == ViewType.Legend:
			legends.append(i.ToDSType(True))
		elif i.ViewType == ViewType.LoadsReport:
			loadReports.append(i.ToDSType(True))
		elif i.ViewType == ViewType.PanelSchedule:
			panelSchedules.append(i.ToDSType(True))
		elif i.ViewType == ViewType.PresureLossReport:
			pressureLossReports.append(i.ToDSType(True))
		elif i.ViewType == ViewType.Rendering:
			renderings.append(i.ToDSType(True))
		elif i.ViewType == ViewType.Report:
			reports.append(i.ToDSType(True))
		elif i.ViewType == ViewType.Schedule:
			if not i.IsTitleblockRevisionSchedule :
				schedules.append(i.ToDSType(True))
		elif i.ViewType == ViewType.Section:
			sections.append(i.ToDSType(True))
		elif i.ViewType == ViewType.ThreeD:
			threeD.append(i.ToDSType(True))
		elif i.ViewType == ViewType.Undefined:
			undefined.append(i.ToDSType(True))
		elif i.ViewType == ViewType.Walkthrough:
			walkthrough.append(i.ToDSType(True))
		else:
			continue
#Assign your output to the OUT variable
OUT = areaPlans, ceilingPlans, columnSchedules, costReport, \
	details, draftingViews, elevations, \
	engineetingPlans, floorPlans, internal, \
	loadReports, panelSchedules, pressureLossReports, \
	renderings, reports, sections, threeD, \
	undefined, walkthrough, legends, schedules, drawingSheets
# ----------------------------------------
item_at_index = CodeBlock(Crteži=list_all_views)
# ---------- item_at_index.designscript (7 lines) ----------
// Floor Plans
Crteži[8];

"View Template";

//Elevation Plans
Crteži[6];
# ----------------------------------------

# group: Filter za osnove
watch = Watch(item_at_index.out0)
parameterByName = Parameter.ParameterByName(element=watch, name=item_at_index.out1, lacing=CrossProduct)
string_from_object = FromObject(obj=parameterByName)
parameter_value = StringInput("View Template : 1.2 OSNOVA 1.50")
eq = string_from_object == parameter_value  # lacing=CrossProduct
filterByBoolMask = List.FilterByBoolMask(list=watch, mask=eq)

# group: Filter za poglede
watch_2 = Watch(item_at_index.out2)
parameterByName_2 = Parameter.ParameterByName(element=watch_2, name=item_at_index.out1, lacing=CrossProduct)
string_from_object_2 = FromObject(obj=parameterByName_2)
parameter_value_2 = StringInput("View Template : 3.1 POGLEDI")
eq_2 = string_from_object_2 == parameter_value_2  # lacing=CrossProduct
filterByBoolMask_2 = List.FilterByBoolMask(list=watch_2, mask=eq_2)

join = List.Join(list0=filterByBoolMask.in, list1=filterByBoolMask_2.in)
elements_in_view_s = Python(IN[0]=join)
# ---------- elements_in_view_s.python (23 lines) ----------
#Made by Marc Tavenier @marctavenier
import clr
clr.AddReference('RevitAPI')
from Autodesk.Revit.DB import *

clr.AddReference('RevitServices')
import RevitServices
from RevitServices.Persistence import DocumentManager

#The inputs to this node will be stored as a list in the IN variable.
dataEnteringNode = IN

views = UnwrapElement(IN[0])

elementlist = []
doc = DocumentManager.Instance.CurrentDBDocument

for view in views:
	collector = FilteredElementCollector(doc, view.Id)
	elementlist.append(collector.ToElements())

#Assign your output to the OUT variable
OUT = elementlist
# ----------------------------------------
getCategory = Element.GetCategory(element=elements_in_view_s)
cleanr_null_and_empty_list = Python(IN[0]=getCategory)
# ---------- cleanr_null_and_empty_list.python (23 lines) ----------
#Copyright(c) 2015, Konrad K Sobon
# @arch_laboratory, http://archi-lab.net

import clr
clr.AddReference('ProtoGeometry')
from Autodesk.DesignScript.Geometry import *
#The inputs to this node will be stored as a list in the IN variable.
dataEnteringNode = IN

def ClearList(_list):
    out = []
    for _list1 in _list:
        if _list1 is None:
            continue
        if isinstance(_list1, list):
             _list1 = ClearList(_list1)
             if not _list1:
                 continue
        out.append(_list1)
    return out

#Assign your output to the OUT variable
OUT = ClearList(IN[0])
# ----------------------------------------

# group: Filter za room
string_from_object_3 = FromObject(obj=cleanr_null_and_empty_list)
parameter_value_3 = StringInput("Room")
eq_3 = string_from_object_3 == parameter_value_3  # lacing=CrossProduct
filterByBoolMask_3 = List.FilterByBoolMask(list=cleanr_null_and_empty_list, mask=eq_3)

# group: Filter za tagovane
string_from_object_4 = FromObject()  # unwired: obj
parameter_value_4 = StringInput("Tag")
contains = String.Contains(str=string_from_object_4, searchFor=parameter_value_4)
filterByBoolMask_4 = List.FilterByBoolMask(mask=contains)  # unwired: list

byElement_2 = Tag.ByElement()  # unwired: view, element, horizontal, addLeader, horizontalAlignment, verticalAlignment
isTagged = Custom[Element.IsTagged]()  # package SteamNodes; Checks if all Elements are tagged in the project; unwired: arg0, arg1
select_taggable_elements_not = Custom[Select Taggable Elements Not Tagged in Active View]()  # package Bakery; from the Dynamo Player samples
filter = List.Filter(list=cleanr_null_and_empty_list)  # unwired: condition
select_elements = Python(IN[0]=filter.out)
# ---------- select_elements.python (25 lines) ----------
import clr
clr.AddReference("RevitAPI")
clr.AddReference("RevitAPIUI")
import Autodesk
from Autodesk.Revit.UI import *
from Autodesk.Revit.DB import *
clr.AddReference("RevitServices")
import RevitServices
from RevitServices.Persistence import DocumentManager
clr.AddReference("RevitNodes")
import Revit
# clr.ImportExtensions(Revit.Elements)
from System.Collections.Generic import *

elems = UnwrapElement(IN[0])

elemIds = []
for elem in elems:
	elemIds.append(elem.Id)
	
uidoc = DocumentManager.Instance.CurrentUIDocument
uidoc.Selection.SetElementIds(List[ElementId](elemIds))

# Just for fun - give it to the output!
OUT = elemIds
# ----------------------------------------
id = Element.Id(element=elements_in_view_s)
fromObject = dtCore.String.FromObject(obj=id)
element_types = ElementTypes("IndependentTag")  # graph input
all_elements_of_type = ElementsOfType(element_type=element_types)
taggedElement = Tag.TaggedElement(tag=all_elements_of_type)
id_2 = Element.Id(element=taggedElement)
fromObject_2 = dtCore.String.FromObject(obj=id_2)
boolean = BoolSelector(true)
contains_2 = String.Contains(str=fromObject, searchFor=fromObject_2, ignoreCase=boolean)
anyTrue = Orchid.Core.List.AnyTrue(list=contains_2)
isTagged_2 = Custom[Element.IsTagged]()  # unwired: arg0, arg1
code_block = CodeBlock { Flatten([item]); }  # unwired: item
code_block_2 = CodeBlock { "Tags of Category"; }
code_block_3 = CodeBlock(item=code_block_2) { Flatten([item]); }
python_script = Python(IN[0]=code_block_3)
# ---------- python_script.python (50 lines) ----------
#python nodes in dynamo 1.0
#proposed by Julien Benoit @jbenoit44 
#http://aecuandme.wordpress.com/
import clr
clr.AddReference('ProtoGeometry')
from Autodesk.DesignScript.Geometry import *
# Import ToDSType(bool) extension method
clr.AddReference("RevitNodes")
import Revit
clr.ImportExtensions(Revit.Elements)
# Import geometry conversion extension methods
clr.ImportExtensions(Revit.GeometryConversion)
# Import DocumentManager and TransactionManager
clr.AddReference("RevitServices")
import RevitServices
from RevitServices.Persistence import DocumentManager
from RevitServices.Transactions import TransactionManager
from System.Collections.Generic import *
# Import RevitAPI
clr.AddReference("RevitAPI")
import Autodesk
from Autodesk.Revit.DB import *

doc = DocumentManager.Instance.CurrentDBDocument
uiapp = DocumentManager.Instance.CurrentUIApplication
app = uiapp.Application
uidoc=DocumentManager.Instance.CurrentUIApplication.ActiveUIDocument

elt = []
for i in IN[0]:
	elt.append(UnwrapElement(i))

ids, tags = [], []

# Start Transaction
#TransactionManager.Instance.EnsureInTransaction(doc)


for i in elt:
	if i.TaggedLocalElementId.IntegerValue != -1:
		ids.append(i.TaggedLocalElementId)
		tags.append(i)
	else:
		continue
		

# End Transaction
#TransactionManager.Instance.TransactionTaskDone()

OUT = ids, tags
# ----------------------------------------
code_block_4 = CodeBlock(a=python_script) { a[0]; a[1]; }
uniqueItems = List.UniqueItems(list=code_block_4.out0)
python_script_2 = Python(IN[0]=code_block)
# ---------- python_script_2.python (24 lines) ----------
#python nodes in dynamo 1.0
#proposed by Julien Benoit @jbenoit44 
#http://aecuandme.wordpress.com/
import clr
clr.AddReference('ProtoGeometry')
from Autodesk.DesignScript.Geometry import *
# Import RevitAPI
clr.AddReference('RevitAPI')
import Autodesk
#The inputs to this node will be stored as a list in the IN variable.
dataEnteringNode = IN

elements = []
for i in IN[0]:
    elements.append(UnwrapElement(i))

elementIds, idString, guid = [], [], []
for i in elements:
    elementIds.append(i.Id)
    idString.append(i.Id.ToString())
    guid.append(i.UniqueId)
    
#Assign your output to the OUT variable
OUT = elementIds, idString, guid
# ----------------------------------------
code_block_5 = CodeBlock(OUT=python_script_2) { OUT[0]; }
contains_3 = List.Contains(list=uniqueItems, item=code_block_5)
filterByBoolMask_5 = List.FilterByBoolMask(list=code_block, mask=contains_3)
code_block_6 = CodeBlock { Untagged Element(s); }
code_block_7 = CodeBlock { Tagged Element(s); }
code_block_8 = CodeBlock { Tag's ID; }
code_block_9 = CodeBlock { Elements of Category; }
