# Dynamo graph WIP VIEW RENEMER.dyn (Dynamo 2.3.0.5885)
# packages: DynamoDots 2020.1.3, designtech 1.0.8, Orchid 230.0.1.7437, DynaTools 2018.1.15, archi-lab.net 2020.23.13

code_block = CodeBlock { "View Name"; }
code_block_2 = CodeBlock { A = ["D","A","B","C"]<1>; }
getAllViews = Custom[GetAllViews]()  # package DynamoDots; Get all the Views / Sheets / Legends etc
views = Sheet.Views(sheet=getAllViews.Drawing_Sheets)
code_block_3 = CodeBlock { "View Template"; "1.2 OSNOVA 1.50"; true; }
getParameterValueByName = Element.GetParameterValueByName(element=views, parameterName=code_block_3.out0)
fromObject = dtCore.String.FromObject(obj=getParameterValueByName)
contains = String.Contains(str=fromObject, searchFor=code_block_3.out1, ignoreCase=code_block_3.out2)
anyTrue = Orchid.Core.List.AnyTrue(list=contains)
filterByBoolMask = List.FilterByBoolMask(list=views, mask=anyTrue)
watch = Watch(filterByBoolMask.in)
code_block_4 = CodeBlock { "Sheet Number"; "04"; }
getParameterValueByName_2 = Element.GetParameterValueByName(element=watch, parameterName=code_block_4.out0)
fromObject_2 = dtCore.String.FromObject(obj=getParameterValueByName_2)
contains_2 = String.Contains(str=fromObject_2, searchFor=code_block_4.out1, ignoreCase=code_block_3.out2)
filterByBoolMask_2 = List.FilterByBoolMask(list=watch, mask=contains_2)
count = List.Count(list=filterByBoolMask_2.in)
ofRepeatedItem = List.OfRepeatedItem(item=code_block_2, amount=count)
flatten = List.Flatten(list=ofRepeatedItem)
setParameterByName = Element.SetParameterByName(parameterName=code_block, value=flatten)  # unwired: element
placedRooms = Python()  # "Collector.PlacedRooms"; unwired: IN[0]
# ---------- placedRooms.python (36 lines) ----------
#Copyright(c) 2017, john pierson
# @60secondrevit, http://sixtysecondrevit.com

import clr
clr.AddReference('ProtoGeometry')
from Autodesk.DesignScript.Geometry import *

# Import DocumentManager and TransactionManager
clr.AddReference("RevitServices")
import RevitServices
from RevitServices.Persistence import DocumentManager
from RevitServices.Transactions import TransactionManager

# Import RevitAPI
clr.AddReference("RevitAPI")
import Autodesk
from Autodesk.Revit.DB import *

doc = DocumentManager.Instance.CurrentDBDocument
uiapp = DocumentManager.Instance.CurrentUIApplication
app = uiapp.Application

from System.Collections.Generic import *


#The inputs to this node will be stored as a list in the IN variable.
dataEnteringNode = IN
collector = FilteredElementCollector(doc)
rooms = collector.OfCategory(BuiltInCategory.OST_Rooms).ToElements()

roomInstances = []
for i in rooms:
	if i.Area != 0:
		roomInstances.append(i)

OUT = roomInstances
# ----------------------------------------
number = Room.Number()  # unwired: room
sortByFunction = List.SortByFunction(list=placedRooms, func=number)
number_2 = Room.Number(room=sortByFunction)
getAllElementsParameters = ElementTools.Elements.getAllElementsParameters(elements=watch)
join = List.Join(list0=getAllViews.Drawing_Sheets, list1=views)
sheetName = Sheet.SheetName()  # unwired: sheet
sheetNumber = Sheet.SheetNumber()  # unwired: sheet
byNameNumberTitleBlockAndView = Sheet.ByNameNumberTitleBlockAndView()  # unwired: sheetName, sheetNumber, titleBlockFamilyType, view
parameters = Element.Parameters(element=filterByBoolMask_2.in)
type = archilab.Revit.Elements.Elements.Type()  # unwired: element
code_block_5 = CodeBlock { "Sheet Number"; }
getParameterValueByName_3 = Element.GetParameterValueByName(element=filterByBoolMask_2.in, parameterName=code_block_5)
setParameterByName_2 = Element.SetParameterByName()  # unwired: element, parameterName, value
code_block_6 = CodeBlock { "View Name"; }
code_block_7 = CodeBlock { A = ["D","A","B","C"]<1>; }
count_2 = List.Count(list=filterByBoolMask_2.in)  # frozen
ofRepeatedItem_2 = List.OfRepeatedItem(item=code_block_7, amount=count_2)
flatten_2 = List.Flatten(list=ofRepeatedItem_2)
setParameterByName_3 = Element.SetParameterByName(parameterName=code_block_6, value=flatten_2)  # unwired: element
placedRooms_2 = Python()  # "Collector.PlacedRooms"; unwired: IN[0]; same code as placedRooms
number_3 = Room.Number()  # unwired: room
sortByFunction_2 = List.SortByFunction(list=placedRooms_2, func=number_3)
number_4 = Room.Number(room=sortByFunction_2)
