# Dynamo graph WIP VisiblSharedParam.dyn (Dynamo 2.3.0.5885)
# packages: Data-Shapes 2019.2.42

# group: Allow the user to select the Shared Parameter Group to get parameters from
get_sp_groups = Python()  # unwired: IN[0]
# ---------- get_sp_groups.python (32 lines) ----------
import clr

clr.AddReference('RevitAPI')
from Autodesk.Revit.DB import *

clr.AddReference('System')
from System.Collections.Generic import List

clr.AddReference('RevitNodes')
import Revit
clr.ImportExtensions(Revit.Elements)

clr.AddReference('RevitServices')
import RevitServices
from RevitServices.Persistence import DocumentManager

doc = DocumentManager.Instance.CurrentDBDocument
uidoc=DocumentManager.Instance.CurrentUIApplication.ActiveUIDocument

#Preparing input from dynamo to revit
element = UnwrapElement(IN[0])

groupNames = []
groups = []
#Get the Shared parameter file for the currect document
defFile = doc.Application.OpenSharedParameterFile()
#Get each shared parameter group from the file
for grp in defFile.Groups:
	groupNames.Add(grp.Name)
	groups.Add(grp)

OUT = groupNames,groups,defFile.Filename
# ----------------------------------------
code_block = CodeBlock(grp=get_sp_groups) { grp[0]; grp[1]; grp[2]; }
code_block_2 = CodeBlock { "SELECT GROUP"; }
code_block_3 = CodeBlock { "Parameter Group"; }
ui_dropdown_data = Custom[UI.DropDown Data](InputName=code_block_3, Keys=code_block.out0, Values=code_block.out1)  # package Data-Shapes; Create data for DropDown input in UI.MultiInputForm ++ . Check out www.data-shapes.net for more infos.
list_create = List.Create(item0=ui_dropdown_data)
boolean = BoolSelector(true)
code_block_4 = CodeBlock { "CANCEL"; 200; }
ui_multipleinputform = Custom[UI.MultipleInputForm ++](ButtonText_optional=code_block_2, Inputs=list_create, Toggle=boolean, CancelButtonText_optional=code_block_4.out0, Width_optional=code_block_4.out1)  # package Data-Shapes; Create a form with multiple inputs. see www.data-shapes.net for tutorials and infos!

# group: Allow the user to select the Shared Parameters to Change
code_block_5 = CodeBlock { "SELECT PARAMETERS"; }
code_block_6 = CodeBlock(grp=ui_multipleinputform.User_Inputs) { grp[0]; }
sp_definition_guid = Python(IN[0]=code_block_6)
# ---------- sp_definition_guid.python (22 lines) ----------
import clr

clr.AddReference('RevitAPI')
from Autodesk.Revit.DB import *

clr.AddReference('System')
from System.Collections.Generic import List

clr.AddReference('RevitNodes')
import Revit
clr.ImportExtensions(Revit.Elements)

#Preparing input from dynamo to revit
defGroup = UnwrapElement(IN[0])
defNames = []
defGUID = []
#Get each definition from the group selected
for definition in defGroup.Definitions:
	defGUID.Add(definition.GUID)
	defNames.Add(definition.Name)

OUT = defNames,defGUID
# ----------------------------------------
code_block_7 = CodeBlock(defs=sp_definition_guid) { defs[0]; defs[1]; }
ui_listview_data = Custom[UI.Listview Data](Keys=code_block_7.out0, Values=code_block_7.out1)  # package Data-Shapes; Create data for ListView input in UI.MultiInputForm ++ . Check out www.data-shapes.net for more infos.
ui_multipleinputform_2 = Custom[UI.MultipleInputForm ++](ButtonText_optional=code_block_5, Inputs=ui_listview_data, Toggle=boolean, CancelButtonText_optional=code_block_4.out0, Width_optional=code_block_4.out1)

code_block_8 = CodeBlock(str=ui_multipleinputform_2.User_Inputs) { str[0]; }

# group: Change Visibility and Write txt File
visible = BoolSelector(true)
change_visibility = Python(IN[0]=code_block.out2, IN[1]=code_block_8, IN[2]=visible)
# ---------- change_visibility.python (42 lines) ----------
import clr

clr.AddReference('System')
from System.Collections.Generic import List

#Get the path and GUIDs for the parameters to change
path = IN[0]
guids = IN[1]
writeLines = []
#set up the separator, here it is \t TAB
sep = '\t'

#open the shared parameters file to read
with open(path) as f:
#Read each line of the file
	lines = f.readlines()
	for line in lines:
#Create a temp string to add to the collection
		tempLine = line
#This line helps skip all the stuff at the beginning of the file
		if line.startswith("PARAM"):
#Iterate through each of the GUIDs selected
			for guid in guids:
#Create a parts array to hold each index of the line when split
				parts = []
#Check to see if the GUID is in the line
				if guid.ToString() in line:
#If so, split the line by the tab separator
					parts = line.split(sep)
#Check to see if the paramter is Visible or not and set the value to the correct part index
					if IN[2]:
						parts[6] = '1'
					else:
						parts[6] = '0'
#Set the tempLine to the new string after joining the parts back together
					tempLine = sep.join(parts)
#Since we found the correct parameter, break the for loop for speed
					break
#Add the tempLine to the writeLines list
		writeLines.Add(tempLine)

OUT = writeLines,path
# ----------------------------------------
code_block_9 = CodeBlock(seq=change_visibility) { seq[0]; seq[1]; }
new_file = BoolSelector(false)
write_file = Python(IN[0]=code_block_9.out0, IN[1]=code_block_9.out1, IN[2]=new_file)
# ---------- write_file.python (26 lines) ----------
import clr

clr.AddReference('System')
from System.Collections.Generic import List

#Preparing input from dynamo to revit
lines = IN[0]
fPath = IN[1]

#This is here to make a new file, but remove it to just overwrite the existing file.
if IN[2]:
	sep = '.'
	p1 = fPath.split('.')
	p1[0] += '_NEW'
	nPath = sep.join(p1)
else:
	nPath = fPath

#open, write and close the file
try:
	file = open(nPath,"w+")
	file.writelines(lines)
	file.close()
	OUT = nPath
except:
	OUT = "Failed"
# ----------------------------------------

watch = Watch(write_file)
