# Dynamo graph WIP automatsko tagiranje vrata.dyn (Dynamo 2.3.0.5885)
# packages: Orchid 230.0.1.7437, designtech 1.0.8, Bakery 2019.5.8, archi-lab.net 2020.23.13, Onion 0.1.6

byElement = Orchid.RevitProject.Annotations.Tag.ByElement()  # unwired: view, element, tagType
code_block = CodeBlock { "Door Tags"; }
byName = Category.ByName(name=code_block)
current = dtRevit.View.Current()
all_elements_of_category_in_view = ElementsOfCategoryInView(Category=byName, View=current)
all_elements_of_type = ElementsOfType(element_type=all_elements_of_category_in_view)
all_elements_of_category = ElementsOfCategory(Category=byName)
list_all_views = Custom[List All Views]()  # package Bakery; not including sheets
get_all_viewport_types = Custom[Get All Viewport Types]()  # package archi-lab.net; This node will retrieve all Viewport Types currently in the model.
list_all_views_2 = Custom[List All Views]()
findNotTagged = Onion.Elements.FindNotTagged(category=byName, views=list_all_views_2)
