# Dynamo graph WIP prosečan panel - wip V1.dyn "21. prosečan panel - wip" (Dynamo 2.0.3.8810)

categories = Categories(index=159)
all_elements_of_category = ElementsOfCategory(Category=categories)
string = StringInput("B")
parameterByName = Parameter.ParameterByName(element=all_elements_of_category, name=string)
bv_remove_nulls = Custom[bv Remove Nulls](List=parameterByName)  # forked from Lunchbox
value = Parameter.Value(parameter=bv_remove_nulls)
code_block = CodeBlock { 1; }
round = Math.Round(number=value, digits=code_block)
sum = Math.Sum(values=round)
string_2 = StringInput("A")
parameterByName_2 = Parameter.ParameterByName(element=all_elements_of_category, name=string_2)
bv_remove_nulls_2 = Custom[bv Remove Nulls](List=parameterByName_2)
value_2 = Parameter.Value(parameter=bv_remove_nulls_2)
code_block_2 = CodeBlock { 1; }
round_2 = Math.Round(number=value_2, digits=code_block_2)
sum_2 = Math.Sum(values=round_2)
categories_2 = Categories(index=142)
all_elements_of_category_2 = ElementsOfCategory(Category=categories_2)
string_3 = StringInput("A")
parameterByName_3 = Parameter.ParameterByName(element=all_elements_of_category_2, name=string_3)
value_3 = Parameter.Value(parameter=parameterByName_3)
code_block_3 = CodeBlock { 1; }
round_3 = Math.Round(number=value_3, digits=code_block_3)
sum_3 = Math.Sum(values=round_3)
code_block_4 = CodeBlock { 1000; }
div = sum_3 / code_block_4
string_4 = StringInput("B")
parameterByName_4 = Parameter.ParameterByName(element=all_elements_of_category_2, name=string_4)
value_4 = Parameter.Value(parameter=parameterByName_4)
code_block_5 = CodeBlock { 1; }
round_4 = Math.Round(number=value_4, digits=code_block_5)
sum_4 = Math.Sum(values=round_4)
div_2 = sum_4 / code_block_4
mul = div * div_2
count = List.Count(list=all_elements_of_category_2)
div_3 = mul / count
categories_3 = Categories(index=604)
all_elements_of_category_3 = ElementsOfCategory(Category=categories_3)
parameters = Element.Parameters(element=all_elements_of_category_2)
name = Parameter.Name(parameter=parameters)
code_block_6 = CodeBlock { "Family"; }
firstIndexOf = List.FirstIndexOf(list=name, item=code_block_6, lacing=Longest)
getItemAtIndex = List.GetItemAtIndex(list=parameters, index=firstIndexOf, lacing=Longest)
string_from_object = FromObject(obj=getItemAtIndex)
code_block_7 = CodeBlock(x=string_from_object) { x == "Family : Curtain Wall"; }
filterByBoolMask = List.FilterByBoolMask(list=parameters, mask=code_block_7)
watch = Watch(filterByBoolMask.in)
wall_types = WallTypes(index=13)
filterByWallType = Python(IN[0]=wall_types)
# ---------- filterByWallType.python (40 lines) ----------
import clr
clr.AddReference('ProtoGeometry')
from Autodesk.DesignScript.Geometry import *

clr.AddReference("RevitAPIUI")
from Autodesk.Revit.UI import TaskDialog

clr.AddReference("RevitAPI")
from Autodesk.Revit.DB.Events import *
from Autodesk.Revit.DB import *

clr.AddReference("RevitNodes")
import Revit
clr.ImportExtensions(Revit.Elements)
clr.ImportExtensions(Revit.GeometryConversion)

clr.AddReference("RevitServices")
import RevitServices
from RevitServices.Persistence import DocumentManager
from RevitServices.Transactions import TransactionManager

def _GetAll (category):
	collector = FilteredElementCollector(doc)
	collector.OfCategory(category)
	rtn = collector.GetElementIdIterator()
	rtn.Reset()
	return rtn
	
doc = DocumentManager.Instance.CurrentDBDocument
Walls=_GetAll(BuiltInCategory.OST_Walls)
WType=UnwrapElement(IN[0]).UniqueId
rtn=[]
for wall in Walls:
	wall=doc.GetElement(wall)
	try:
		wt=wall.WallType
		if WType==wt.UniqueId:
			rtn.append(wall)
	except: pass
OUT=rtn
# ----------------------------------------
wall_types_2 = WallTypes(index=12)
filterByWallType_2 = Python(IN[0]=wall_types_2)  # same code as filterByWallType
roof_types = RoofTypes(index=1)
filterByRoofType = Python(IN[0]=roof_types)
# ---------- filterByRoofType.python (40 lines) ----------
import clr
clr.AddReference('ProtoGeometry')
from Autodesk.DesignScript.Geometry import *

clr.AddReference("RevitAPIUI")
from Autodesk.Revit.UI import TaskDialog

clr.AddReference("RevitAPI")
from Autodesk.Revit.DB.Events import *
from Autodesk.Revit.DB import *

clr.AddReference("RevitNodes")
import Revit
clr.ImportExtensions(Revit.Elements)
clr.ImportExtensions(Revit.GeometryConversion)

clr.AddReference("RevitServices")
import RevitServices
from RevitServices.Persistence import DocumentManager
from RevitServices.Transactions import TransactionManager

def _GetAll (category):
	collector = FilteredElementCollector(doc)
	collector.OfCategory(category)
	rtn = collector.GetElementIdIterator()
	rtn.Reset()
	return rtn
	
doc = DocumentManager.Instance.CurrentDBDocument
Roofs=_GetAll(BuiltInCategory.OST_Roofs)
WType=UnwrapElement(IN[0]).UniqueId
rtn=[]
for roof in Roofs:
	roof=doc.GetElement(roof)
	try:
		wt=roof.RoofType
		if WType==wt.UniqueId:
			rtn.append(roof)
	except: pass
OUT=rtn
# ----------------------------------------
roof_types_2 = RoofTypes(index=2)
filterByRoofType_2 = Python(IN[0]=roof_types_2)  # same code as filterByRoofType
roof_types_3 = RoofTypes(index=3)
filterByRoofType_3 = Python(IN[0]=roof_types_3)  # same code as filterByRoofType
roof_types_4 = RoofTypes(index=4)
filterByRoofType_4 = Python(IN[0]=roof_types_4)  # same code as filterByRoofType
roof_types_5 = RoofTypes(index=5)
filterByRoofType_5 = Python(IN[0]=roof_types_5)  # same code as filterByRoofType
roof_types_6 = RoofTypes(index=6)
filterByRoofType_6 = Python(IN[0]=roof_types_6)  # same code as filterByRoofType
join = List.Join(list0=filterByWallType, list1=filterByWallType_2, list2=filterByRoofType, list3=filterByRoofType_2, list4=filterByRoofType_3, list5=filterByRoofType_4, list6=filterByRoofType_5, list7=filterByRoofType_6)
