# Dynamo graph WIP sheet location.dyn (Dynamo 2.3.0.5885)
# packages: DynaTools 2018.1.15, Synthesize toolkit 6.8.0

all_elements_in_active_view = ElementsInView()
firstItem = List.FirstItem(list=all_elements_in_active_view)
getAllElementsParameters = ElementTools.Elements.getAllElementsParameters()  # unwired: elements
boolean = BoolSelector(true)
placedRooms = Python(IN[0]=boolean)  # "Collector.PlacedRooms"
# ---------- placedRooms.python (36 lines) ----------
#Copyright(c) 2017, john pierson
# @60secondrevit, http://sixtysecondrevit.com

import clr
clr.AddReference('ProtoGeometry')
from Autodesk.DesignScript.Geometry import *

# Import DocumentManager and TransactionManager
clr.AddReference("RevitServices")
import RevitServices
from RevitServices.Persistence import DocumentManager
from RevitServices.Transactions import TransactionManager

# Import RevitAPI
clr.AddReference("RevitAPI")
import Autodesk
from Autodesk.Revit.DB import *

doc = DocumentManager.Instance.CurrentDBDocument
uiapp = DocumentManager.Instance.CurrentUIApplication
app = uiapp.Application

from System.Collections.Generic import *


#The inputs to this node will be stored as a list in the IN variable.
dataEnteringNode = IN
collector = FilteredElementCollector(doc)
rooms = collector.OfCategory(BuiltInCategory.OST_Rooms).ToElements()

roomInstances = []
for i in rooms:
	if i.Area != 0:
		roomInstances.append(i)

OUT = roomInstances
# ----------------------------------------
parameters = Element.Parameters(element=placedRooms)
value = Parameter.Value(parameter=parameters)
location = Custom[CW.Element.Location](VARelement=all_elements_in_active_view)  # package Synthesize toolkit; Returns the location of an element as an XYZ (or if it's line-based the start and end point of the line), along with some booleans to help filtering the results. Use this for some element types (e.g. walls or lines) that do not work with the built-in Get Family Instance Location node.
code_block = CodeBlock { 44; }
getItemAtIndex = List.GetItemAtIndex(list=all_elements_in_active_view, index=code_block)
