# Dynamo graph test casework.dyn (Dynamo 2.3.0.5885)
# packages: Orchid 230.0.1.7437

inDocument = Orchid.RevitProject.Elements.Category.InDocument()
name = Category.Name(category=inDocument)
code_block = CodeBlock()
# ---------- code_block.designscript (6 lines) ----------
[
"Casework",
"Generic Models",
"Lighting Fixtures",
"Specialty Equipment"
];
# ----------------------------------------
byName = Category.ByName(name=code_block)
all_elements_of_category = ElementsOfCategory(Category=byName)
isEmpty = List.IsEmpty(list=all_elements_of_category@L2)
boolean = BoolSelector(false)
eq = isEmpty == boolean
filterByBoolMask = List.FilterByBoolMask(list=byName, mask=eq)
filterByBoolMask_2 = List.FilterByBoolMask(list=all_elements_of_category, mask=eq)
list_create = List.Create(item0=filterByBoolMask.in, item1=filterByBoolMask_2.in)
transpose = List.Transpose(lists=list_create)
watch = Watch(transpose)
