# Dynamo graph wip 3D view from room.dyn (Dynamo 2.3.1.11775)
# packages: archi-lab.net 2020.23.13, Crumple 2021.5.27, designtech 1.0.8

string = StringInput("Rooms")
byName = Category.ByName(name=string)
all_elements_of_category = ElementsOfCategory(Category=byName)
name = archilab.Revit.Elements.Room.Name(room=all_elements_of_category)
number = Room.Number(room=all_elements_of_category)
parameters = Element.Parameters(element=all_elements_of_category)
watch = Watch(all_elements_of_category)
viewsectionbox = Custom[© ViewSectionBox](views=watch)  # package Crumple; Returns the section box of any view as a bounding box in Dynamo. Does not support section boxes with rotations applied to them (will return the original section box before rotation), and will actually return a bounding box even if a view doesn't have one applied. Use with care!
geometry = Element.Geometry(element=watch)
boundingBox = Geometry.BoundingBox(geometry=geometry)
point = dtGeometry.Deconstruct.Point(point=boundingBox)
solid = dtGeometry.Deconstruct.Solid(solid=geometry)
bySolid = PolySurface.BySolid()  # unwired: solid
