# Dynamo graph wip Check parameters.dyn "3. Check parameters" (Dynamo 2.3.0.5885)
# packages: Bakery 2019.5.8, Orchid 230.0.1.7437, Orchid 230.1.0.7697, Data-Shapes 2019.2.44, Zhukoven.com 2019.5.7, Genius Loci 2020.4.23

string = StringInput("C:\TEMPLATE\Familije druge")  # graph input
code_block = CodeBlock { "*.rfa"; }
contentsAll = Custom[Directory.ContentsAll](dir=string, searchString=code_block)  # package Bakery
backgroundOpen = Orchid.RevitProject.Common.Document.BackgroundOpen(file=contentsAll)
current = Document.Current()
toOrchidType = Orchid.RevitProject.Common.Document.ToOrchidType(document=current)
sharedParameters = Orchid.RevitProject.Common.Document.SharedParameters(document=toOrchidType)
name = Element.Name(element=sharedParameters.Parameter)
code_block_2 = CodeBlock { "Bolt"; }
contains = String.Contains(str=name, searchFor=code_block_2, lacing=CrossProduct)
filterByBoolMask = List.FilterByBoolMask(list=sharedParameters.Parameter, mask=contains)
name_2 = Element.Name(element=filterByBoolMask.in)
family_types = FamilyTypes("CCS:CCS")
all_elements_of_family_type = ElementsOfFamilyType(Family_Type=family_types)
parametergroup_list = Custom[ParameterGroup list]()  # package Data-Shapes; List of all parameter groups
group = Parameter.Group()  # unwired: parameter
info = Custom[SharedParameters.Info]()  # package Zhukoven.com; Get the following information about shared parameters loaded in the Revit project: parameter group, parameter type, unit type.
get_shared_parameter = Custom[Get Shared Parameter]()  # package Genius Loci; Get the parameters names, parameters groups, parameters types and assigned categories of the active shared parameter file.
