# Dynamo graph wip GRUPE U SOBAMA.dyn (Dynamo 2.3.0.5885)
# packages: Rhythm 2020.2.13, archi-lab.net 2020.23.13

python_script = Python()  # unwired: IN[0]
# ---------- python_script.python (34 lines) ----------
import clr

clr.AddReference('RevitAPIUI')
from  Autodesk.Revit.UI import *

clr.AddReference('RevitAPI')
from Autodesk.Revit.DB import *
from Autodesk.Revit.Creation import *

clr.AddReference('RevitNodes')
import Revit
clr.ImportExtensions(Revit.Elements)

clr.AddReference('RevitServices')
from RevitServices.Persistence import DocumentManager
from RevitServices.Transactions import TransactionManager
#Access the active document#
doc = DocumentManager.Instance.CurrentDBDocument
#Start a transaction on the active document#
TransactionManager.Instance.EnsureInTransaction(doc)

#Insert here your code#
input = IN[0]
output = []
Name = []
col = FilteredElementCollector(doc).OfCategory(BuiltInCategory.OST_IOSModelGroups).WhereElementIsNotElementType()
for c in col:
	output.append(c.ToDSType(True))
	Name.append(c.Name)
#Dispose the active transaction
TransactionManager.Instance.TransactionTaskDone()

#List outputs#
OUT = output,Name
# ----------------------------------------
code_block = CodeBlock(Group_=python_script, Group_Name=python_script) { Group_[0]; Group_Name[1]; }
watch = Watch(code_block.out0)
flatten = List.Flatten(list=watch)
boolean = BoolSelector(true)
placedRooms = Custom[Collector.PlacedRooms](toggle=boolean)  # package Rhythm; This will collect placed rooms in current file.
elements_in_room = Custom[Elements in Room](elements=flatten, rooms=placedRooms)  # package archi-lab.net; This node will check if any of the elements are inside any of the supplied rooms.
watch_2 = Watch(code_block.out1)
