# Dynamo graph A04.8 Crteži od soba.dyn (Dynamo 2.3.1.11775)
# packages: DynaTools 2018.1.15, Data-Shapes 2019.2.44

# group: Verzije
code_block = CodeBlock()
# ---------- code_block.designscript (12 lines) ----------
"V3";
//Dodati elevation-i
"V4";
//Dodato pozicioniranje na papir
"V5";
//započeto tagiranje
"V6";
//Dodati filteri za izbor rada
"V7";
//"data shapes opcije, korigovani node-ovi
"V8";
//sitne korekcije
# ----------------------------------------

# group: Podešavanja/izbor ISO klase
code_block_2 = CodeBlock { name = "ISO (klasa po GMPu)"; klaseDef = [0,1,2,3]; }
opis_iso_oznake = CodeBlock { "B"; "C"; "D"; "CNC"; "NC"; "PB"; "Ostale prostorije"; }
join = List.Join(list0=opis_iso_oznake.out0, list1=opis_iso_oznake.out1, list2=opis_iso_oznake.out2, list3=opis_iso_oznake.out3, list4=opis_iso_oznake.out4, list5=opis_iso_oznake.out5, list6=opis_iso_oznake.out6)
iso_oznake = CodeBlock { 6; 7; 8; 9; 10; 11; ""; }
join_2 = List.Join(list0=iso_oznake.out0, list1=iso_oznake.out1, list2=iso_oznake.out2, list3=iso_oznake.out3, list4=iso_oznake.out4, list5=iso_oznake.out5, list6=iso_oznake.out6)
ui_listview_data = Custom[UI.Listview Data](Keys=join, Values=join_2, DefaultValueIndices_optionnal=code_block_2.klaseDef)  # package Data-Shapes; Create data for ListView input in UI.MultiInputForm ++ . Check out www.data-shapes.net for more infos.
ui_inputgroup_data = Custom[UI.InputGroup Data](GroupTitle=code_block_2.name, Inputs=ui_listview_data)  # package Data-Shapes; Creates a group of inputs for UI.MultipleInputForm ++ . Check out www.data-shapes.net for more infos !

# group: Templejti za crteže
get_all_view_templates = Python()
# ---------- get_all_view_templates.python (22 lines) ----------
import clr
clr.AddReference('ProtoGeometry')
from Autodesk.DesignScript.Geometry import *
clr.AddReference('RevitAPI')
from Autodesk.Revit.DB import *
import Autodesk
clr.AddReference('RevitServices')
from RevitServices.Persistence import *
import RevitServices
#The inputs to this node will be stored as a list in the IN variables.
dataEnteringNode = IN

doc = DocumentManager.Instance.CurrentDBDocument
views = FilteredElementCollector(doc).OfClass(View)
viewlist = list()

for view in views:
	if view.IsTemplate == True:
		viewlist.append(view)

#Assign your output to the OUT variable.
OUT = viewlist
# ----------------------------------------
code_block_3 = CodeBlock(viewTemp=get_all_view_templates)
# ---------- code_block_3.designscript (23 lines) ----------
gTitle = "View Template";

values = viewTemp;

viewTempName = Revit.Elements.Element.Name(viewTemp);

str = dtCore.String.FromObject(viewTemp);
osnova = "Osnova 1.50";
plafoni = "Plafoni 1.50";
pogledi = "Pogledi 1.50";
da = true;

osnovaName = "Osnove";
bool1 = DSCore.String.Contains(str, osnova, da);
DSCore.List.AllIndicesOf(da, bool1);

plafoniName = "Plafoni";
bool2 = DSCore.String.Contains(str, plafoni, da);
DSCore.List.AllIndicesOf(da, bool2);

poglediName = "Pogledi";
bool3 = DSCore.String.Contains(str, pogledi, da);
DSCore.List.AllIndicesOf(da, bool3);
# ----------------------------------------
indexOf = List.IndexOf(list=code_block_3.viewTempName, element=code_block_3.osnova)
ui_dropdown_data = Custom[UI.DropDown Data](InputName=code_block_3.osnovaName, Keys=code_block_3.viewTempName, Values=code_block_3.values, DefaultValueIndex=indexOf)  # package Data-Shapes; Create data for DropDown input in UI.MultiInputForm ++ . Check out www.data-shapes.net for more infos.
indexOf_2 = List.IndexOf(list=code_block_3.viewTempName, element=code_block_3.plafoni)
ui_dropdown_data_2 = Custom[UI.DropDown Data](InputName=code_block_3.plafoniName, Keys=code_block_3.viewTempName, Values=code_block_3.values, DefaultValueIndex=indexOf_2)
indexOf_3 = List.IndexOf(list=code_block_3.viewTempName, element=code_block_3.pogledi)
ui_dropdown_data_3 = Custom[UI.DropDown Data](InputName=code_block_3.poglediName, Keys=code_block_3.viewTempName, Values=code_block_3.values, DefaultValueIndex=indexOf_3)

create = List.Create(item0=ui_dropdown_data, item1=ui_dropdown_data_2, item2=ui_dropdown_data_3)

# group (continued): Templejti za crteže
ui_inputgroup_data_2 = Custom[UI.InputGroup Data](GroupTitle=code_block_3.gTitle, Inputs=create)

# group: Izbor Papira
opis_iso_oznake_2 = CodeBlock()
# ---------- opis_iso_oznake_2.designscript (11 lines) ----------
"A1 - RU";
"A1 - ENG";
"A1 - SRB";

"A2 - RU";
"A2 - ENG";
"A2 - SRB";

//////////////
2;
"Izbor Papira";
# ----------------------------------------
join_3 = List.Join(list0=opis_iso_oznake_2.out0, list1=opis_iso_oznake_2.out1, list2=opis_iso_oznake_2.out2, list3=opis_iso_oznake_2.out3, list4=opis_iso_oznake_2.out4, list5=opis_iso_oznake_2.out5)
ui_dropdown_data_4 = Custom[UI.DropDown Data](Keys=join_3, Values=join_3, DefaultValueIndex=opis_iso_oznake_2.out6)
ui_inputgroup_data_3 = Custom[UI.InputGroup Data](GroupTitle=opis_iso_oznake_2.out7, Inputs=ui_dropdown_data_4)

# group: Nazivi Crteža
code_block_4 = CodeBlock { "Plan Name Prefix"; "Osnova "; "Sheet Name Prefix"; "04 - "; katName = "Kategorija Crteža"; katVred = "04 Pogledi"; }
ui_textbox_data = Custom[UI.TextBox Data](InputName=code_block_4.out0, DefaultText=code_block_4.out1)  # package Data-Shapes; Create Data for TextBox input in UI.MultipleInputForm ++ . Check out www.data-shapes.net for more informations
ui_textbox_data_2 = Custom[UI.TextBox Data](InputName=code_block_4.out2, DefaultText=code_block_4.out3)
ui_textbox_data_3 = Custom[UI.TextBox Data](InputName=code_block_4.katName, DefaultText=code_block_4.katVred)
code_block_5 = CodeBlock(t1=ui_textbox_data, t2=ui_textbox_data_2, t3=ui_textbox_data_3) { gTitle = "Imena crteža i listova"; lista = [t1, t2, t3]; }
ui_inputgroup_data_4 = Custom[UI.InputGroup Data](GroupTitle=code_block_5.gTitle, Inputs=code_block_5.lista)

# group: Interfejs
code_block_6 = CodeBlock(verzija=code_block.out5) { tekst= "Crteži od soba "; opis = tekst + verzija; }
file_path = Filename("Z:\Čiste Sobe\T1.png")
file_from_path = FileObject(path=file_path)
readFromFile = Image.ReadFromFile(file=file_from_path)
code_block_7 = CodeBlock { "Done"; true; "Cancel"; 400; }
create_2 = List.Create(item0=ui_inputgroup_data, item1=ui_inputgroup_data_2, item2=ui_inputgroup_data_3, item3=ui_inputgroup_data_4)
ui_multipleinputform = Custom[UI.MultipleInputForm ++](Description_optional=code_block_6.opis, Logo_optional=readFromFile, ButtonText_optional=code_block_7.out0, Inputs=create_2, Toggle=code_block_7.out1, CancelButtonText_optional=code_block_7.out2, Width_optional=code_block_7.out3)  # package Data-Shapes; Create a form with multiple inputs. see www.data-shapes.net for tutorials and infos!
code_block_8 = CodeBlock(lista=ui_multipleinputform.User_Inputs)
# ---------- code_block_8.designscript (26 lines) ----------
//sobe
DSCore.List.Flatten(lista[0], -1);

//view template za osnove
lista[1];

//view template za plafone
lista[2];

//view template za poglede
lista[3];

//izbor papira
lista[4];

//Plan Name Prefix
lista[5];

//Sheet Name Prefix
lista[6];

//KATEGORIJA CRTEZA
lista[7];


plaf = "Plafon ";
# ----------------------------------------

# group: Filter po parametru
placedRooms = Python()  # "Collector.PlacedRooms"
# ---------- placedRooms.python (36 lines) ----------
#Copyright(c) 2017, john pierson
# @60secondrevit, http://sixtysecondrevit.com

import clr
clr.AddReference('ProtoGeometry')
from Autodesk.DesignScript.Geometry import *

# Import DocumentManager and TransactionManager
clr.AddReference("RevitServices")
import RevitServices
from RevitServices.Persistence import DocumentManager
from RevitServices.Transactions import TransactionManager

# Import RevitAPI
clr.AddReference("RevitAPI")
import Autodesk
from Autodesk.Revit.DB import *

doc = DocumentManager.Instance.CurrentDBDocument
uiapp = DocumentManager.Instance.CurrentUIApplication
app = uiapp.Application

from System.Collections.Generic import *


#The inputs to this node will be stored as a list in the IN variable.
dataEnteringNode = IN
collector = FilteredElementCollector(doc)
rooms = collector.OfCategory(BuiltInCategory.OST_Rooms).ToElements()

roomInstances = []
for i in rooms:
	if i.Area != 0:
		roomInstances.append(i)

OUT = roomInstances
# ----------------------------------------
parameter_name = StringInput("ISO")
getParameterValueByName = Element.GetParameterValueByName(element=placedRooms, parameterName=parameter_name)
eq = getParameterValueByName == code_block_8.out0  # lacing=CrossProduct
code_block_9 = CodeBlock(lista=eq) { Orchid.List.AnyTrue(lista); }
filterByBoolMask = List.FilterByBoolMask(list=placedRooms, mask=code_block_9)
flatten = List.Flatten(list=filterByBoolMask.in)
sobe = Watch(flatten)

# group: sort
number = Room.Number()  # unwired: room
sortByFunction = List.SortByFunction(list=sobe, func=number)

# group: Plan Creator
code_block_10 = CodeBlock { "Annotation Crop"; true; false; 2; }
# note: rooms = [UnwrapElement(IN[0])]
# namePrefix = IN[1]
# bboxOffset = IN[2]
# runMe = IN[3]
# nameSufix = IN[4]
byRoom = Python(IN[0]=sobe, IN[1]=code_block_8.out5, IN[2]=code_block_10.out3, IN[3]=code_block_10.out1)  # "FloorPlan.ByRoom"
# ---------- byRoom.python (119 lines) ----------
# Copyright(c) 2015, Konrad K Sobon
# @arch_laboratory, http://archi-lab.net

import clr
clr.AddReference('ProtoGeometry')
from Autodesk.DesignScript.Geometry import *

# Import Element wrapper extension methods
clr.AddReference("RevitNodes")
import Revit
clr.ImportExtensions(Revit.Elements)

# Import geometry conversion extension methods
clr.ImportExtensions(Revit.GeometryConversion)

# Import DocumentManager and TransactionManager
clr.AddReference("RevitServices")
import RevitServices
from RevitServices.Persistence import DocumentManager
from RevitServices.Transactions import TransactionManager
doc = DocumentManager.Instance.CurrentDBDocument

# Import RevitAPI
clr.AddReference("RevitAPI")
import Autodesk
from Autodesk.Revit.DB import *

import System
from System import Array
from System.Collections.Generic import *

import sys
pyt_path = r'C:\Program Files (x86)\IronPython 2.7\Lib'
sys.path.append(pyt_path)

#The inputs to this node will be stored as a list in the IN variable.
dataEnteringNode = IN

if isinstance(IN[0], list):
	rooms = UnwrapElement(IN[0])
else:
	rooms = [UnwrapElement(IN[0])]
namePrefix = IN[1]
bboxOffset = IN[2]
runMe = IN[3]
# nameSufix = IN[4]

def OffsetBBox(bbox, offset):
	bboxMinX = bbox.Min.X - offset
	bboxMinY = bbox.Min.Y - offset
	bboxMinZ = bbox.Min.Z - offset
	bboxMaxX = bbox.Max.X + offset
	bboxMaxY = bbox.Max.Y + offset
	bboxMaxZ = bbox.Max.Z + offset
	newBbox = BoundingBoxXYZ()
	newBbox.Min = XYZ(bboxMinX, bboxMinY, bboxMinZ)
	newBbox.Max = XYZ(bboxMaxX, bboxMaxY, bboxMaxZ)
	return newBbox

try:
	errorReport = None
	if runMe:
		viewTypes = FilteredElementCollector(doc).OfClass(ViewFamilyType)
		for i in viewTypes:
			if i.ViewFamily == ViewFamily.FloorPlan:
				viewTypeId = i.Id
				break
			else:
				continue
		
		existingPlans = FilteredElementCollector(doc).OfClass(View).ToElements()
		
		existingPlanNames, existingPlanElements = [], []
		for i in existingPlans:
			if not i.IsTemplate:
				if i.ViewType == ViewType.FloorPlan:
					existingPlanNames.append(i.ToDSType(True).Name)
					existingPlanElements.append(i)
					
		# Start Transaction
		# i.get_Parameter(BuiltInParameter.ROOM_NAME).AsString()
        # viewName = namePrefix + i.get_Parameter(BuiltInParameter.ROOM_NUMBER).AsString() + nameSufix

		TransactionManager.Instance.EnsureInTransaction(doc)
		
		floorPlans = []
		for i in rooms:
			levelId = i.LevelId
			bbox = i.BoundingBox[doc.ActiveView]
			newBbox = OffsetBBox(bbox, bboxOffset)
			viewName = namePrefix + i.get_Parameter(BuiltInParameter.ROOM_NUMBER).AsString()
			if viewName in existingPlanNames:
				view = existingPlanElements[existingPlanNames.index(viewName)]
				view.CropBox = newBbox
				view.CropBoxActive = True
				view.CropBoxVisible = False
				floorPlans.append(view)
			else:
				newView = ViewPlan.Create(doc, viewTypeId, levelId)
				newView.Name = viewName
				newView.CropBox = newBbox
				newView.CropBoxActive = True
				newView.CropBoxVisible = False
				floorPlans.append(newView)
	
		# End Transaction
		TransactionManager.Instance.TransactionTaskDone()
	else:
		errorReport = "Run Me set to False"
except:
	# if error accurs anywhere in the process catch it
	import traceback
	errorReport = traceback.format_exc()

#Assign your output to the OUT variable
if errorReport == None:
	OUT = floorPlans
else:
	OUT = errorReport
# ----------------------------------------
byRoom_2 = Python(IN[0]=sobe, IN[1]=code_block_8.plaf, IN[2]=code_block_10.out3, IN[3]=code_block_10.out1)  # "CeilingPlan.ByRoom"; graph output
# ---------- byRoom_2.python (121 lines) ----------
# Copyright(c) 2015, Konrad K Sobon
# @arch_laboratory, http://archi-lab.net
# http://tinypic.com/m/kbrvxh/1

import clr
clr.AddReference('ProtoGeometry')
from Autodesk.DesignScript.Geometry import *

# Import Element wrapper extension methods
clr.AddReference("RevitNodes")
import Revit
clr.ImportExtensions(Revit.Elements)

# Import geometry conversion extension methods
clr.ImportExtensions(Revit.GeometryConversion)

# Import DocumentManager and TransactionManager
clr.AddReference("RevitServices")
import RevitServices
from RevitServices.Persistence import DocumentManager
from RevitServices.Transactions import TransactionManager
doc = DocumentManager.Instance.CurrentDBDocument

# Import RevitAPI
clr.AddReference("RevitAPI")
import Autodesk
from Autodesk.Revit.DB import *

import System
from System import Array
from System.Collections.Generic import *

import sys
pyt_path = r'C:\Program Files (x86)\IronPython 2.7\Lib'
sys.path.append(pyt_path)

#The inputs to this node will be stored as a list in the IN variable.
dataEnteringNode = IN

if isinstance(IN[0], list):
	rooms = UnwrapElement(IN[0])
else:
	rooms = [UnwrapElement(IN[0])]
namePrefix = IN[1]
bboxOffset = IN[2]
runMe = IN[3]
# nameSufix = IN[4]

def OffsetBBox(bbox, offset):
	bboxMinX = bbox.Min.X - offset
	bboxMinY = bbox.Min.Y - offset
	bboxMinZ = bbox.Min.Z - offset
	bboxMaxX = bbox.Max.X + offset
	bboxMaxY = bbox.Max.Y + offset
	bboxMaxZ = bbox.Max.Z + offset
	newBbox = BoundingBoxXYZ()
	newBbox.Min = XYZ(bboxMinX, bboxMinY, bboxMinZ)
	newBbox.Max = XYZ(bboxMaxX, bboxMaxY, bboxMaxZ)
	return newBbox

try:
	errorReport = None
	if runMe:
		viewTypes = FilteredElementCollector(doc).OfClass(ViewFamilyType)
		for i in viewTypes:
			if i.ViewFamily == ViewFamily.CeilingPlan:
				viewTypeId = i.Id
				break
			else:
				continue
		
		existingPlans = FilteredElementCollector(doc).OfClass(View).ToElements()
		
		existingPlanNames, existingPlanElements = [], []
		for i in existingPlans:
			if not i.IsTemplate:
				if i.ViewType == ViewType.CeilingPlan:
					existingPlanNames.append(i.ToDSType(True).Name)
					existingPlanElements.append(i)
					
		# Start Transaction
		# viewName = namePrefix + i.get_Parameter(BuiltInParameter.ROOM_NUMBER).AsString()
        # viewName = namePrefix + i.get_Parameter(BuiltInParameter.ROOM_NUMBER).AsString() + nameSufix


		TransactionManager.Instance.EnsureInTransaction(doc)
		
		ceilingPlans = []
		for i in rooms:
			levelId = i.LevelId
			bbox = i.BoundingBox[doc.ActiveView]
			newBbox = OffsetBBox(bbox, bboxOffset)
			viewName = namePrefix + i.get_Parameter(BuiltInParameter.ROOM_NUMBER).AsString()
			if viewName in existingPlanNames:
				view = existingPlanElements[existingPlanNames.index(viewName)]
				view.CropBox = newBbox
				view.CropBoxActive = True
				view.CropBoxVisible = True
				ceilingPlans.append(view)
			else:
				newView = ViewPlan.Create(doc, viewTypeId, levelId)
				newView.Name = viewName
				newView.CropBox = newBbox
				newView.CropBoxActive = True
				newView.CropBoxVisible = False
				ceilingPlans.append(newView)
	
		# End Transaction
		TransactionManager.Instance.TransactionTaskDone()
	else:
		errorReport = "Run Me set to False"
except:
	# if error accurs anywhere in the process catch it
	import traceback
	errorReport = traceback.format_exc()

#Assign your output to the OUT variable
if errorReport == None:
	OUT = ceilingPlans
else:
	OUT = errorReport
# ----------------------------------------
list_create = List.Create(item0=byRoom, item1=byRoom_2)
setParameterByName = Element.SetParameterByName(element=list_create, parameterName=code_block_10.out0, value=code_block_10.out1)

# group: Get Room Location & Create Elevation Marker
location = Room.Location(room=sortByFunction)
elevation_marker = Python()
# ---------- elevation_marker.python (41 lines) ----------
#Copyright(c) 2016 www.Learndynamo.com 
#Please contact at jeremy@learndynamo.com

import clr
clr.AddReference('RevitAPI')
clr.AddReference("RevitServices")
clr.AddReference("RevitNodes")
import RevitServices
import Revit
import Autodesk
from Autodesk.Revit.DB import *
from math import *

clr.ImportExtensions(Revit.GeometryConversion)

from RevitServices.Persistence import DocumentManager
from RevitServices.Transactions import TransactionManager

doc = DocumentManager.Instance.CurrentDBDocument

elements = []
names = []
lst = []

#Get Family View Type
vft = 0
collector = FilteredElementCollector(doc).OfClass(ViewFamilyType).ToElements()

#eleViews = []
for i in collector:
	if i.ViewFamily == ViewFamily.Elevation:
		elements.append(i)
		#elements.append(i.Name)
		for j in i.Parameters:
			if j.Definition.Name == "Type Name":
				names.append(j.AsString())
		
lst.append(elements)
lst.append(names)
	
OUT = lst
# ----------------------------------------
pogledi = CodeBlock(a=elevation_marker) { a[0][1]; }
ʳʰʸᵗʰᵐ_elevationmarker = CodeBlock(roomPoint=location, familijaMarkera=pogledi, floorPlan=byRoom)  # "ʳʰʸᵗʰᵐ|ElevationMarker.CreateElevationMarker & ʳʰʸᵗʰᵐ|ElevationMarker.CreateElevationByMarkerIndex"
# ---------- ʳʰʸᵗʰᵐ_elevationmarker.designscript (3 lines) ----------
elevationMarker = ElevationMarker.CreateElevationMarker(roomPoint, 96, familijaMarkera);

poglediMarker = ElevationMarker.CreateElevationByMarkerIndex(elevationMarker, floorPlan, 0..3);
# ----------------------------------------

# group: pregled
pogledi_2 = Watch(code_block_8.out3)
watch = Watch(code_block_8.out4)
osnove = Watch(code_block_8.out1)
plafoni = Watch(code_block_8.out2)

# group: View Set Template - Pogledi & Osnova & Plafoni
views_setviewtemplate_archilab = CodeBlock(elementz=ʳʰʸᵗʰᵐ_elevationmarker.poglediMarker, template=pogledi_2) { poglediView = DSCore.List.Flatten(elementz, 0); set = Views.SetViewTemplate(poglediView, template); }
views_setviewtemplate_archilab_2 = CodeBlock(elementz=setParameterByName, template=osnove) { osnoveView = DSCore.List.Flatten(elementz[0], -1); set = Views.SetViewTemplate(osnoveView, template); }
name = Element.Name()  # unwired: element
sortByFunction_2 = List.SortByFunction(list=views_setviewtemplate_archilab_2.set, func=name)
flatten_2 = List.Flatten(list=sortByFunction_2)
views_setviewtemplate_archilab_3 = CodeBlock(elementz=setParameterByName, template=plafoni) { plafoniView = DSCore.List.Flatten(elementz[1], -1); list = Views.SetViewTemplate(plafoniView, template); }
name_2 = Element.Name()  # unwired: element
sortByFunction_3 = List.SortByFunction(list=views_setviewtemplate_archilab_3.list, func=name_2)
flatten_3 = List.Flatten(list=sortByFunction_3)
join_4 = List.Join(list0=flatten_2, list1=flatten_3)

# group: View Names based on Room Name & Number, Assign to Elevations
number_2 = Room.Number(room=sortByFunction)
code_block_11 = CodeBlock(RNum=number_2)
# ---------- code_block_11.designscript (4 lines) ----------
parName = "View Name";
ABCD = (RNum + " - ") + (["D", "A", "B", "C"]<1>);
listSort = DSCore.Sort(ABCD@L2<1>);
listTranspose = DSCore.Transpose(listSort);
# ----------------------------------------
setParameterByName_2 = Element.SetParameterByName(element=views_setviewtemplate_archilab.set, parameterName=code_block_11.parName, value=code_block_11.listTranspose@L2, lacing=Longest)

code_block_12 = CodeBlock(list=watch, listaCrteza=flatten_2)
# ---------- code_block_12.designscript (5 lines) ----------
titleBlock = Revit.FamilyType.ByName(list);

//count 1...n
brojac = DSCore.Count(listaCrteza);
brojacCrteza = 1..brojac..1;
# ----------------------------------------
toString = Python(IN[0]=code_block_12.brojacCrteza)
# ---------- toString.python (20 lines) ----------
# Made by Gavin Crump
# Free for use
# BIM Guru, www.bimguru.com.au

# Get inputs
items = IN[0] if isinstance(IN[0], list) else [IN[0]]

# Convert to strings
strings = []

for i in items:
	tostr = str(i)
	try:
		ind = tostr.index(".")
		strings.append(tostr[:ind])
	except:
		strings.append(tostr)

# Define outputs
OUT = strings
# ----------------------------------------
add = CodeBlock(X=code_block_8.out6, Y=toString) { X+Y; }
# note: Custom Node: DynaTools v.2018.1.15
createSheets = ViewTools.Sheets.CreateSheets(sheetNames=toString, sheetNumbers=add, titleBlock=code_block_12.titleBlock)
# note: TRIM ( SET CROP BOX )
# 0 - Plan
# 1- Conversion Factor
# 2 - Trim Size
i = CodeBlock()
# ---------- i.designscript (4 lines) ----------
// Conversion Factor
200;
// Number plan;
1;
# ----------------------------------------
TRIM = Python(IN[0]=join_4, IN[1]=i.out0, IN[2]=i.out1)
# ---------- TRIM.python (52 lines) ----------
import clr
clr.AddReference('ProtoGeometry')
from Autodesk.DesignScript.Geometry import *

import clr
clr.AddReference('RevitAPI')
import Autodesk.Revit.DB

import clr
clr.AddReference("RevitNodes")
import Revit

clr.AddReference('DSCoreNodes')
import DSCore
from DSCore import *

clr.AddReference("RevitServices")
import RevitServices
from RevitServices.Persistence import DocumentManager
from RevitServices.Transactions import TransactionManager
doc = DocumentManager.Instance.CurrentDBDocument

# Import ToProtoType, ToRevitType geometry conversion extension methods
clr.ImportExtensions(Revit.GeometryConversion)

#The inputs to this node will be stored as a list in the IN variables.
if isinstance(IN[0], list):
	views = UnwrapElement(IN[0])
	cf = IN[1]
	Tsize = IN[2]/cf

else:
	views = [UnwrapElement(IN[0])]
	    	
listout = []
for view in views:
	regionMan = view.GetCropRegionShapeManager()
	TransactionManager.Instance.EnsureInTransaction(doc)
	try:
		regionMan.BottomAnnotationCropOffset = Tsize
		regionMan.LeftAnnotationCropOffset = Tsize
		regionMan.RightAnnotationCropOffset = Tsize
		regionMan.TopAnnotationCropOffset = Tsize
		listout.append(view)
	except:
		listout.append("failed")
	
	TransactionManager.Instance.TransactionTaskDone()


#Assign your output to the OUT variable.
OUT = listout
# ----------------------------------------
chop = List.Chop(list=TRIM, lengths=code_block_12.brojac)
transpose = List.Transpose(lists=chop)
# note: Pakovanje osnova plafona i pogleda na Sheet-ove
list_create_2 = List.Create(item0=transpose, item1=setParameterByName_2)
transpose_2 = List.Transpose(lists=list_create_2)
flatten_4 = List.Flatten(list=transpose_2@L3)

# group: pozicioniranje na listu
number_slider = DoubleSlider(50, range=0..1000 step 0.001)  # graph input
# note: Floor
number_slider_2 = DoubleSlider(50, range=0..1000 step 0.001)  # graph input
byCoordinates = Point.ByCoordinates(x=number_slider, y=number_slider_2)
number_slider_3 = DoubleSlider(200, range=0..1000 step 0.001)  # graph input
# note: Roof
number_slider_4 = DoubleSlider(50, range=0..1000 step 0.001)  # graph input
byCoordinates_2 = Point.ByCoordinates(x=number_slider_3, y=number_slider_4)
number_slider_5 = DoubleSlider(200, range=0..1000 step 0.001)  # graph input
# note: D
number_slider_6 = DoubleSlider(200, range=0..1000 step 0.001)  # graph input
byCoordinates_3 = Point.ByCoordinates(x=number_slider_5, y=number_slider_6)
number_slider_7 = DoubleSlider(50, range=0..1000 step 0.001)  # graph input
# note: A
number_slider_8 = DoubleSlider(400, range=0..1000 step 0.001)  # graph input
byCoordinates_4 = Point.ByCoordinates(x=number_slider_7, y=number_slider_8)
number_slider_9 = DoubleSlider(200, range=0..1000 step 0.001)  # graph input
# note: B
number_slider_10 = DoubleSlider(400, range=0..1000 step 0.001)  # graph input
byCoordinates_5 = Point.ByCoordinates(x=number_slider_9, y=number_slider_10)
number_slider_11 = DoubleSlider(50, range=0..1000 step 0.001)  # graph input
# note: C
number_slider_12 = DoubleSlider(200, range=0..1000 step 0.001)  # graph input
byCoordinates_6 = Point.ByCoordinates(x=number_slider_11, y=number_slider_12)
create_3 = List.Create(item0=byCoordinates, item1=byCoordinates_2, item2=byCoordinates_3, item3=byCoordinates_4, item4=byCoordinates_5, item5=byCoordinates_6)

govno = CodeBlock(t1=transpose_2) { t2=DSCore.List.Count(t1); t3=t2-1; }

# group: Place Views on a Sheet
ofRepeatedItem = List.OfRepeatedItem(item=create_3, amount=govno.t2)
code_block_13 = CodeBlock(Sheetz=createSheets, Viewz=flatten_4, Locationz=ofRepeatedItem) { true; Sheetz; Viewz; Locationz; }
place_views_on_sheet_py = Python(IN[0]=code_block_13.out0, IN[1]=code_block_13.Sheetz, IN[2]=code_block_13.Viewz, IN[3]=code_block_13.Locationz)
# ---------- place_views_on_sheet_py.python (60 lines) ----------
################### Import References ###################
import clr

clr.AddReference("RevitServices")
import RevitServices
from RevitServices.Persistence import DocumentManager
from RevitServices.Transactions import TransactionManager
doc =  DocumentManager.Instance.CurrentDBDocument
app = DocumentManager.Instance.CurrentUIApplication.Application

clr.AddReference("RevitNodes")
import Revit
clr.ImportExtensions(Revit.Elements)
clr.ImportExtensions(Revit.GeometryConversion)

clr.AddReference("RevitAPI")
from Autodesk.Revit.DB import *
################### Definitions ###################
def tolist(obj1):
	if hasattr(obj1,"__iter__"): return obj1
	else: return [obj1]
################### Inputs ###################
#get the bool in port IN[0]...
run = tolist(IN[0])[0]
#get the sheet in port IN[1] and UnwrapElement if not already...
sheetsIN = tolist(UnwrapElement(IN[1]))
#get the views in port IN[1] and UnwrapElement if not already...
viewsIN = tolist(UnwrapElement(IN[2]))
#get the points in port IN[2] (no need to unwrap as these are Dynamo Points)...
locsIN = tolist(IN[3])
################### Outputs ###################
outList = []
################### Script ###################
if run:
	# check if list lengths are the same (the views and locations will be lists of lists here, but the outermost list layer should all be the same length)
	if len(sheetsIN) == len(viewsIN) == len(locsIN):
		TransactionManager.Instance.EnsureInTransaction(doc)
		# loop through all lists (views and locs will be lists of lists)
		for sht,views,locs in zip(sheetsIN,viewsIN,locsIN):
			arr = []
			# test if number of views and number of locations match
			if len(views) == len(locs):
				# loop through all views and locations and try place them on sheet...			
				for v,l in zip(views, locs):					
					try:
						if Viewport.CanAddViewToSheet(doc,sht.Id,v.Id):
							vp = Viewport.Create(doc,sht.Id,v.Id,l.ToXyz())
							arr.append(vp)
						else: arr.append("Can't place view on sheet")
					except Exception, e:
						arr.append(e.message)					
				outList.append(arr)								
			else:
				outList.append("Number of views does not match number of locations")				
		OUT = outList
		TransactionManager.Instance.TransactionTaskDone()			
	else:
		OUT = "Number of sheets does not match either the number of view lists of location lists"
else:
	OUT = "Set Run to True"
# ----------------------------------------

# group: Detail numbering
code_block_14 = CodeBlock(elementSectionView=setParameterByName_2, viewPortzOUT=place_views_on_sheet_py) { ggg = DataStream.Await(elementSectionView, viewPortzOUT); parName = "Detail Number"; A = ["D","A","B","C"]<1>; }
ofRepeatedItem_2 = List.OfRepeatedItem(item=code_block_14.A, amount=code_block_12.brojac)
setParameterByName_3 = Element.SetParameterByName(element=code_block_14.ggg, parameterName=code_block_14.parName, value=ofRepeatedItem_2, lacing=Longest)

# group: Kategorije Listova
code_block_15 = CodeBlock(lista7=code_block_8.out7)
# ---------- code_block_15.designscript (4 lines) ----------
"KATEGORIJA CRTEZA";
lista7;
 //kat. crt. vrednost;
true;
# ----------------------------------------
# note: Dodeljivanje kategorije Sheet-ovima
setParameterByName_4 = Element.SetParameterByName(element=createSheets@L1, parameterName=code_block_15.out0, value=code_block_15.lista7)
# note: views = IN[0]
# setName= IN[1]
# Overwrite = IN[2]
python_script = Python(IN[0]=setParameterByName_4, IN[1]=code_block_15.lista7, IN[2]=code_block_15.out2)
# ---------- python_script.python (56 lines) ----------
#Copyright(c) 2015, Dimitar Venkov
# @5devene, dimitar.ven@gmail.com
#code inspired by Harry Mattison
#https://boostyourbim.wordpress.com

import clr

clr.AddReference("RevitServices")
import RevitServices
from RevitServices.Persistence import DocumentManager
from RevitServices.Transactions import TransactionManager
doc = DocumentManager.Instance.CurrentDBDocument

clr.AddReference("RevitAPI")
from Autodesk.Revit.DB import *

def tolist(obj1):
	if hasattr(obj1,"__iter__") : return obj1
	else : return [obj1]

def first(obj1):
	if hasattr(obj1,'__iter__') : return obj1[0]
	else : return obj1

views = UnwrapElement(tolist(IN[0]))
name1 = str(first(IN[1]) )
overwrite = IN[2]
vs_exists = None

fec = FilteredElementCollector(doc).OfClass(ViewSheetSet).GetElementIterator()
fec.Reset()
for f in fec:
	if f.Name == name1:
		vs_exists = f
		break
if vs_exists != None and overwrite:
	TransactionManager.Instance.EnsureInTransaction(doc)
	doc.Delete(vs_exists.Id)
	TransactionManager.Instance.TransactionTaskDone()
	vs_exists = None
elif vs_exists != None and not overwrite:
	OUT = "There's a ViewSet with the same name.\nSet Overwrite to true to continue."
if vs_exists == None:
	vs1 = ViewSet()
	for v in views: (vs1.Insert(v))
	printMan = doc.PrintManager
	printMan.PrintRange = PrintRange.Select
	viewSS = printMan.ViewSheetSetting
	try:
		TransactionManager.Instance.EnsureInTransaction(doc)
		viewSS.CurrentViewSheetSet.Views = vs1
		viewSS.SaveAs(name1)
		TransactionManager.Instance.TransactionTaskDone()
		OUT = "ViewSet created with %s views inside." %len(views)
	except:
		OUT = "The ViewSet could not be created"
# ----------------------------------------
watch_2 = Watch(python_script)
