# Dynamo graph A10.2 Disallow Joins On Curtain Walls.dyn (Dynamo 2.3.1.11775)

true_allow_false_disallow = BoolSelector(false)  # graph input
allow_disallow_joins = Python(IN[0]=true_allow_false_disallow)
# ---------- allow_disallow_joins.python (85 lines) ----------
import clr
clr.AddReference("RevitAPI")
clr.AddReference("ProtoGeometry")
clr.AddReference("RevitNodes")
clr.AddReference("RevitServices")
clr.AddReference("RevitAPIUI")
clr.AddReference("DSCoreNodes")
import DSCore
from DSCore import *
import Autodesk
from Autodesk.Revit.DB import *

import Revit
clr.ImportExtensions(Revit.Elements)
clr.ImportExtensions(Revit.GeometryConversion)

# import DocumentManager and TransactionManager
clr.AddReference("RevitServices")
import RevitServices
from RevitServices.Persistence import DocumentManager
from RevitServices.Transactions import TransactionManager

from Autodesk.Revit.UI import TaskDialog
from Autodesk.Revit.DB import *
from Autodesk.DesignScript.Geometry import *

clr.AddReference("System.Windows.Forms")
from System.Windows.Forms import Form,Label,FormStartPosition

# get current Revit document
doc = DocumentManager.Instance.CurrentDBDocument

##### End of generic stuff imports
dataEnteringNode = IN
collector = FilteredElementCollector(doc)
collector.WhereElementIsNotElementType().WhereElementIsViewIndependent();

kolektor = collector.OfCategory(BuiltInCategory.OST_Walls).ToElements()

spoji = IN[0]

# Unwrap input
inputs = kolektor
curtainWalls = []
# Initiate counter
n = 0


# Get only curtain walls from input
for e in inputs:
	try:
		elementType = doc.GetElement(e.GetTypeId())
		if elementType.Kind == WallKind.Curtain:
			curtainWalls.append(e)
			n = n + 1
	except:
		print("not curtain wall")
		
text = "Broj obrađenih panela je : " + str(n)


msgBox=TaskDialog

msgBox.Show("Trolovi su uspešno obavili posao", text)

# Start Transaction
doc = DocumentManager.Instance.CurrentDBDocument
TransactionManager.Instance.EnsureInTransaction(doc)

# Code to run
for e in curtainWalls:
	if spoji:
		Autodesk.Revit.DB.WallUtils.AllowWallJoinAtEnd(e, 0)
		Autodesk.Revit.DB.WallUtils.AllowWallJoinAtEnd(e, 1)
	else :
		Autodesk.Revit.DB.WallUtils.DisallowWallJoinAtEnd(e, 0)
		Autodesk.Revit.DB.WallUtils.DisallowWallJoinAtEnd(e, 1)
	
# End Transaction
TransactionManager.Instance.TransactionTaskDone()



# Wrap results
OUT = curtainWalls
# ----------------------------------------
